# Dynamo graph 3106_CBNConditionsDontProcessLists.dyn (Dynamo 0.7.6.4070)

code_block = CodeBlock { booleans = {true,false}; vars1 = 2..3; vars2 = {"A","B"}; booleans ? vars1 : List.Empty; booleans ? vars1 : vars2; }
watch = Watch(code_block.out3)
watch_2 = Watch(code_block.out4)
