# Dynamo graph CompareNodeListWithNodeDir.dyn (Dynamo 2.12.0.5650)
# packages: Clockwork for Dynamo 2.x 2.3.0

# group: INPUTS
directory_path = Directory("C:\Users\andreas\Documents\GitHub\ClockworkForDynamo\nodes\2.x")  # graph input
file_path = Filename("..\..\..\..\..\Desktop\NodeList.csv")  # graph input
index_of_name_column = DoubleInput(1)  # graph input

# group: Get node names from file
fromPath = DirectoryObject(path=directory_path)  # "Directory.FromPath"
string = StringInput("*.dyf")  # graph input
getDirectoryContents = FileSystem.GetDirectoryContents(directory=fromPath, searchString=string)

# group: Get node names from directory
string_2 = StringInput(",")  # graph input
fromPath_2 = FileObject(path=file_path)  # "File.FromPath"
readText = FileSystem.ReadText(file=fromPath_2)
boolean = BoolSelector(true)  # graph input
fromCSV = Custom[List.FromCSV](delimiter=string_2, CSVstring=readText, ignoreFirstRow=boolean)  # package Clockwork for Dynamo 2.x; Converts the content of a given CSV file to a list
transpose = List.Transpose(lists=fromCSV)
code_block = CodeBlock(dir=directory_path, seq=transpose, name_index=index_of_name_column)
# ---------- code_block.designscript (2 lines) ----------
// Filename
dir + "\\" + seq[name_index] + ".dyf";
# ----------------------------------------

# group: Identify discrepancies
contains = List.Contains(list=code_block, item=getDirectoryContents.files@L1)
filterByBoolMask = List.FilterByBoolMask(list=getDirectoryContents.files, mask=contains)
contains_2 = List.Contains(list=getDirectoryContents.files, item=code_block@L1)
filterByBoolMask_2 = List.FilterByBoolMask(list=code_block, mask=contains_2)

# group: OUTPUT
existing_files_not_in_the_list = Watch(filterByBoolMask.out)
listed_files_not_in_the = Watch(filterByBoolMask_2.out)  # "Listed files not in the directory"
