# Dynamo graph CreateNodeDocumentation.dyn (Dynamo 2.0.1.5055)

# group: Create Node Documentation
# note: This graph parses each *.dyf file in a given directory and creates a Markdown-formatted documentation of all nodes.
# I am using this in order to create my node documentation for the Clockwork wiki on GitHub.

# group: INPUTS
directory_path_documentation = Directory("C:\Users\andreas\Desktop")  # graph input
file_name_documentation = StringInput("NodeDocumentation20")  # graph input
directory_path_nodes = Directory("C:\Users\andreas\Documents\GitHub\ClockworkForDynamo\nodes\2.x")  # graph input
string_to_be_removed_from = StringInput("Clockwork.")  # "String to be Removed from Category Name"; graph input
directory_path_samples = Directory("C:\Users\andreas\Documents\GitHub\ClockworkForDynamo\package_samples\2.x\dynamo")  # graph input
samples_base_url = StringInput("https://github.com/andydandy74/ClockworkForDynamo/tree/master/package_samples/2.x/dynamo/")  # graph input
repository_base_url = StringInput("https://github.com/andydandy74/ClockworkForDynamo/tree/master/nodes/2.x/")  # graph input

# group: Browse node directory
fromPath = DirectoryObject(path=directory_path_nodes)  # "Directory.FromPath"
file_extension = CodeBlock { "*.dyf"; }
getDirectoryContents = FileSystem.GetDirectoryContents(directory=fromPath, searchString=file_extension)

# group: Retrieve node properties
info = Custom[CustomNode.Info](path=getDirectoryContents.files)  # Extracts information from a custom node.
python_script = Python(IN[0]=info.Category, IN[1]=info.Name)
# ---------- python_script.python (14 lines) ----------
import clr
cats = IN[0]
names = IN[1]
OUT = []

for cat, name in zip(cats, names):
	nameParts = name.split(".")
	if len(nameParts) > 1:
		catParts = cat.split(".")
		newCatParts = catParts[0:-1]
		newCatParts.append(nameParts[0])
		newCatParts.append(catParts[-1])
		OUT.append(".".join(newCatParts))
	else: OUT.append(cat)
# ----------------------------------------
code_block = CodeBlock(inputlabel=info.Inputs, datatype=info.InputDataTypes, defaultval=info.InputDefaultVals) { inputlabel +  " (" + datatype + " - " + defaultval + ")"; " - )"; ")"; " ()"; ""; }
replace = String.Replace(str=code_block.out0, searchFor=code_block.out1, replaceWith=code_block.out2)
replace_2 = String.Replace(str=replace, searchFor=code_block.out3, replaceWith=code_block.out4)
isNotEmpty = Custom[List.IsNotEmpty](seq=info.PythonScripts@L2)  # Just the inversion of the built-in Is Empty List node.
string = StringInput("\")  # graph input
split = String.Split(str=getDirectoryContents.files, separater0=string)
lastItem = List.LastItem(list=split@L2)

# group: Aggregate and sort list
# note: 1. Category
# 2. Name
# 3. Description
# 4. Inputs
# 5. Outputs
# 6. Contains Python scripts
# 7. Nested custom nodes
# 8. File name
create = List.Create(item0=python_script, item1=info.Name, item2=info.Description, item3=replace_2, item4=info.Outputs, item5=isNotEmpty, item6=info.NestedCustomNodes, item7=lastItem)
code_block_2 = CodeBlock { 1; }
# note: Sort node list by category and name
sortListOfLists = Custom[List.SortListOfLists](seq=create, sortIndex=code_block_2)  # Sorts a list of lists by one of its sublists
sortListOfLists_2 = Custom[List.SortListOfLists](seq=sortListOfLists)

# group: Browse samples directory and retrieve file names
fromPath_2 = DirectoryObject(path=directory_path_samples)  # "Directory.FromPath"
file_extension_2 = CodeBlock { "*.dyn"; }
getDirectoryContents_2 = FileSystem.GetDirectoryContents(directory=fromPath_2, searchString=file_extension_2)
boolean = BoolSelector(false)  # graph input
fileName = FileSystem.FileName(path=getDirectoryContents_2.files, withExtension=boolean)

# group: Create table of contents, headings and links to sample files (Markdown)
firstItem = List.FirstItem(list=sortListOfLists_2)
code_block_3 = CodeBlock { ""; }
replace_3 = String.Replace(str=firstItem, searchFor=string_to_be_removed_from, replaceWith=code_block_3)
countOccurences = Custom[List.CountOccurences](seq=replace_3)  # Counts the number of occurences of each unique element in a given list
python_script_2 = Python(IN[0]=countOccurences.uniqueElements, IN[1]=countOccurences.count, IN[2]=fileName, IN[3]=samples_base_url)
# ---------- python_script_2.python (40 lines) ----------
cats = IN[0]
catcount = IN[1]
samples = IN[2]
sample_base_url = IN[3]
headings = list()
toc = ""
i = 0
for cat in cats:
	# split category name by delimiter (.)
	parts = cat.split(".")
	j = 2
	heading = ""
	for part in parts:
		# concatenate full category name
		fullcat = '.'.join(parts[:j-1])
		if i == 0:
			heading += "#"*j + ' <a name="' + fullcat.lower().replace('.','_') + '">' + part + "</a>\n"
			if part != "Create" and part != "Actions" and part != "Query":
				toc += "  "*(j-2) + "- " + '<a href="#' + fullcat.lower().replace('.','_') + '">' + part + "</a>\n"
			# add link to sample file
			if fullcat in samples: 
				heading += 'Sample file: <a href="' + sample_base_url + fullcat + '.dyn">' + sample_base_url + fullcat + '.dyn</a><br>\n'
		else:
			prev_parts = cats[i-1].split(".")
			if len(prev_parts) >= j-1 and (part != prev_parts[j-2] or heading != ""):
				heading += "#"*j + ' <a name="' + fullcat.lower().replace('.','_') + '">' + part + "</a>\n"
				if part != "Create" and part != "Actions" and part != "Query":
					toc += "  "*(j-2) + "- " + '<a href="#' + fullcat.lower().replace('.','_') + '">' + part + "</a>\n"
				# add link to sample file
				if fullcat in samples: 
					heading += 'Sample file: <a href="' + sample_base_url + fullcat + '.dyn">' + sample_base_url + fullcat + '.dyn</a><br><br>\n'
		j += 1
	headings.append(heading)
	if catcount[i] > 1:
		k = 0
		while k < catcount[i]-1:
			headings.append("")
			k += 1
	i += 1
OUT = (toc,headings)
# ----------------------------------------
code_block_4 = CodeBlock(seq=python_script_2) { seq[0]; seq[1]; }

# group: Process & format data (Markdown)
string_2 = StringInput("\\\"")  # graph input
code_block_5 = CodeBlock(seq=sortListOfLists_2) { seq[1]; seq[2]; seq[3]; seq[4]; seq[5]; seq[6]; seq[7]; }
code_block_6 = CodeBlock(quot=string_2, nname=code_block_5.out0) { "**<a name=" + quot + String.ToLower(nname) + quot + ">" + nname + "</a>**<br>"; }
string_3 = StringInput("\")  # graph input
string_4 = StringInput("")  # graph input
replace_4 = String.Replace(str=code_block_6, searchFor=string_3, replaceWith=string_4)
code_block_7 = CodeBlock(desc=code_block_5.out1) { desc + "<br>"; }
code_block_8 = CodeBlock { ", "; }
join = String.Join(separator=code_block_8)  # unwired: string0
map = List.Map(list=code_block_5.out2, f_x=join)
flatten = List.Flatten(list=map)
code_block_9 = CodeBlock(input=flatten) { input == "" ? input : "*Input(s):* " + input + "<br>"; }
map_2 = List.Map(list=code_block_5.out3, f_x=join)
flatten_2 = List.Flatten(list=map_2)
code_block_10 = CodeBlock(outputs=flatten_2) { "*Output(s):* " + outputs + "<br>"; }
code_block_11 = CodeBlock(haspython=code_block_5.out4) { haspython ? "*Contains Python code!*<br>" : ""; }
code_block_12 = CodeBlock(quot=string_2, nestednode=code_block_5.out5) { "<a href=" + quot + "#" + String.ToLower(nestednode) + quot + ">" + nestednode + "</a>"; }
replace_5 = String.Replace(str=code_block_12, searchFor=string_3, replaceWith=string_4)
map_3 = List.Map(list=replace_5, f_x=join)
flatten_3 = List.Flatten(list=map_3)
code_block_13 = CodeBlock(customnodes=flatten_3)
# ---------- code_block_13.designscript (2 lines) ----------
customnodes_formatted = "*Nested Custom Node(s):* " + customnodes + "<br>";
customnodes == "" ? customnodes : customnodes_formatted;
# ----------------------------------------
code_block_14 = CodeBlock { " "; "%20"; }
replace_6 = String.Replace(str=code_block_5.out6, searchFor=code_block_14.out0, replaceWith=code_block_14.out1)
code_block_15 = CodeBlock(quot=string_2, repo_base_url=repository_base_url, filename=replace_6) { "*Link to file:* <a href=" + quot + repo_base_url + filename + quot + ">" + repo_base_url + filename + "</a><br>"; }
replace_7 = String.Replace(str=code_block_15, searchFor=string_3, replaceWith=string_4)

# group: Write to file
code_block_16 = CodeBlock(filename=file_name_documentation) { filename + ".TXT"; }
string_5 = StringInput("")  # graph input
code_block_17 = CodeBlock { "\n\n"; }
count = List.Count(list=replace_4)
ofRepeatedItem = List.OfRepeatedItem(item=code_block_17, amount=count)
create_2 = List.Create(item0=code_block_4.out1, item1=replace_4, item2=code_block_7, item3=code_block_9, item4=code_block_10, item5=code_block_11, item6=code_block_13.out1, item7=replace_7, item8=ofRepeatedItem)
transpose = List.Transpose(lists=create_2)
flatten_4 = List.Flatten(list=transpose)
join_2 = String.Join(separator=string_5, string0=flatten_4)
firstItem_2 = List.FirstItem(list=join_2)
code_block_18 = CodeBlock(toc=code_block_4.out0, body=firstItem_2) { toc + "\n" + body; }

combinePath = FileSystem.CombinePath(path0=directory_path_documentation, path1=code_block_16)

# group (continued): Write to file
writeText = FileSystem.WriteText(filePath=combinePath, text=code_block_18)
