# Dynamo graph FindNodesByVersion.dyn (Dynamo 2.12.1.8246)
# packages: Clockwork for Dynamo 2.x 2.3.0, Clockwork for Dynamo 2.x 2.4.0

# group: Find Nodes By Version
# note: This graph parses each *.dyf file in a given directory and compares their version numbers to a given version number.
# I am using this in order to find nodes that need up- or downgrading in a package.

# group: INPUTS
directory_path = Directory("C:\Users\adsk\Documents\andreas\repos\ClockworkForDynamo\nodes\2.x")  # graph input
version_number = StringInput("2.6")  # graph input

# group: Browse directory
fromPath = DirectoryObject(path=directory_path)  # "Directory.FromPath"
file_extension = CodeBlock { "*.dyf"; }
getDirectoryContents = FileSystem.GetDirectoryContents(directory=fromPath, searchString=file_extension)

# group: Extract node names & version numbers
info = Custom[CustomNode.Info](path=getDirectoryContents.files)  # package Clockwork for Dynamo 2.x; Extracts information from a custom node.

# group: Compare versions
filterByBoolMask = List.FilterByBoolMask()  # unwired: list, mask
code_block = CodeBlock(nname=info.Name, nversion=info.Version) { nname + " (" + nversion + ")"; }
compare = Custom[VersionNumber.Compare](versionA=info.Version, versionB=version_number)  # package Clockwork for Dynamo 2.x; Compares two version numbers. Returns 1 if A is higher than B, 0 if they are equal and -1 if A is lower than B.
code_block_2 = CodeBlock(vcomp=compare) { vcomp == -1; vcomp < 1; vcomp == 0; vcomp > -1; vcomp == 1; }
create = List.Create(item0=code_block_2.out0, item1=code_block_2.out1, item2=code_block_2.out2, item3=code_block_2.out3, item4=code_block_2.out4)
count = List.Count(list=create)
ofRepeatedItem = List.OfRepeatedItem(item=code_block, amount=count)
combine = List.Combine(combineFunction=filterByBoolMask.in, list0=ofRepeatedItem, list1=create)
code_block_3 = CodeBlock(seq=combine) { seq[0]; seq[1]; seq[2]; seq[3]; seq[4]; }

# group: OUTPUTS
GREATER = Watch(code_block_3.out4)
LOWER = Watch(code_block_3.out0)
lower_or_equal = Watch(code_block_3.out1)
EQUAL = Watch(code_block_3.out2)
equal_or_greater = Watch(code_block_3.out3)
