# Dynamo graph CreateNodeDocumentation.dyn (Dynamo 0.9.0.3067)

# group: INFO & INPUTS
directory_path_documentation = Directory("C:\Users\adieckmann\Desktop")
file_name_documentation = StringInput("NodeDocumentation")
directory_path_nodes = Directory("C:\Users\adieckmann\Documents\GitHub\ClockworkForDynamo\nodes\0.8.x")
# note: This graph parses each *.dyf file in a given directory and creates a Markdown-formatted documentation of all nodes.
# I am using this in order to create my node documentation for the Clockwork wiki on GitHub.
remove_string_from_category_name = StringInput("Clockwork.")

# group: Browse directory
fromPath = DirectoryObject(directory_path_nodes)  # "Directory.FromPath"
file_extension = CodeBlock { "*.dyf"; }
contents = Directory.Contents(fromPath, file_extension)

# group: Retrieve node properties
info = Custom[CustomNode.Info](path=contents)  # Extracts information from a custom node.
code_block = CodeBlock(inputlabel=info.Inputs, datatype=info.InputDataTypes, defaultval=info.InputDefaultVals) { inputlabel +  " (" + datatype + " - " + defaultval + ")"; " - )"; ")"; " ()"; ""; }
replace = String.Replace(str=code_block.out0, searchFor=code_block.out1, replaceWith=code_block.out2)
replace_2 = String.Replace(str=replace, searchFor=code_block.out3, replaceWith=code_block.out4)
isNotEmpty = Custom[List.IsNotEmpty]()  # Just the inversion of the built-in Is Empty List node.
map = List.Map(list=info.PythonScripts, f_x=isNotEmpty)

# group: Aggregate and sort list
# note: 1. Category
# 2. Name
# 3. Description
# 4. Inputs
# 5. Outputs
# 6. Contains Python scripts
# 7. Nested custom nodes
create = List.Create(info.Category, info.Name, info.Description, replace_2, info.Outputs, map, info.NestedCustomNodes)
code_block_2 = CodeBlock { 1; }
# note: Sort node list by category and name
sortListOfLists = Custom[List.SortListOfLists](seq=create, sortIndex=code_block_2)  # Sorts a list of lists by one of its sublists
sortListOfLists_2 = Custom[List.SortListOfLists](seq=sortListOfLists)

# group: Create table of contents and headings (Markdown)
firstItem = List.FirstItem(sortListOfLists_2)
code_block_3 = CodeBlock { ""; }
replace_3 = String.Replace(str=firstItem, searchFor=remove_string_from_category_name, replaceWith=code_block_3)
countOccurences = Custom[List.CountOccurences](seq=replace_3)  # Counts the number of occurences of each unique element in a given list
python_script = Python(IN[0]=countOccurences.uniqueElements, IN[1]=countOccurences.count)
# ---------- python_script.python (29 lines) ----------
cats = IN[0]
catcount = IN[1]
headings = list()
toc = ""
i = 0
for cat in cats:
	parts = cat.split(".")
	j = 2
	heading = ""
	for part in parts:
		if i == 0:
			heading += "#"*j + part + "\n"
			if part != "Create" and part != "Actions" and part != "Query":
				toc += "  "*(j-2) + "- " + '<a href="#' + part.lower() + '">' + part + "</a>\n"
		else:
			prev_parts = cats[i-1].split(".")
			if len(prev_parts) >= j-1 and (part != prev_parts[j-2] or heading != ""):
				heading += "#"*j + part + "\n"
				if part != "Create" and part != "Actions" and part != "Query":
					toc += "  "*(j-2) + "- " + '<a href="#' + part.lower() + '">' + part + "</a>\n"
		j += 1
	headings.append(heading)
	if catcount[i] > 1:
		k = 0
		while k < catcount[i]-1:
			headings.append("")
			k += 1
	i += 1
OUT = (toc,headings)
# ----------------------------------------
code_block_4 = CodeBlock(seq=python_script) { seq[0]; seq[1]; }

# group: Process & format data (Markdown)
string = StringInput("\\\"")
code_block_5 = CodeBlock(seq=sortListOfLists_2) { seq[1]; seq[2]; seq[3]; seq[4]; seq[5]; seq[6]; }
code_block_6 = CodeBlock(quot=string, nname=code_block_5.out0) { "**<a name=" + quot + String.ToLower(nname) + quot + ">" + nname + "</a>**<br>"; }
string_2 = StringInput("\")
string_3 = StringInput("")
replace_4 = String.Replace(str=code_block_6, searchFor=string_2, replaceWith=string_3)
code_block_7 = CodeBlock(desc=code_block_5.out1) { desc + "<br>"; }
code_block_8 = CodeBlock { ", "; }
join = String.Join(code_block_8)
map_2 = List.Map(list=code_block_5.out2, f_x=join)
flatten = Flatten(map_2)
code_block_9 = CodeBlock(input=flatten) { input == "" ? input : "*Input(s):* " + input + "<br>"; }
map_3 = List.Map(list=code_block_5.out3, f_x=join)
flatten_2 = Flatten(map_3)
code_block_10 = CodeBlock(outputs=flatten_2) { "*Output(s):* " + outputs + "<br>"; }
code_block_11 = CodeBlock(haspython=code_block_5.out4) { haspython ? "*Contains Python code!*<br>" : ""; }
code_block_12 = CodeBlock(quot=string, nestednode=code_block_5.out5) { "<a href=" + quot + "#" + String.ToLower(nestednode) + quot + ">" + nestednode + "</a>"; }

replace_5 = String.Replace(str=code_block_12, searchFor=string_2, replaceWith=string_3)

# group (continued): Process & format data (Markdown)
map_4 = List.Map(list=replace_5, f_x=join)
flatten_3 = Flatten(map_4)
code_block_13 = CodeBlock(customnodes=flatten_3)
# ---------- code_block_13.designscript (2 lines) ----------
customnodes_formatted = "*Nested Custom Node(s):* " + customnodes + "<br>";
customnodes == "" ? customnodes : customnodes_formatted;
# ----------------------------------------

# group: Write to file
string_4 = StringInput("\")
code_block_14 = CodeBlock(dir=directory_path_documentation, delimiter=string_4, filename=file_name_documentation) { dir + delimiter + filename + ".TXT"; }
string_5 = StringInput("")
code_block_15 = CodeBlock { "\n\n"; }
count = List.Count(replace_4)
ofRepeatedItem = List.OfRepeatedItem(item=code_block_15, amount=count)
create_2 = List.Create(code_block_4.out1, replace_4, code_block_7, code_block_9, code_block_10, code_block_11, code_block_13.out1, ofRepeatedItem)
transpose = List.Transpose(create_2)

flatten_4 = Flatten(transpose)

# group (continued): Write to file
join_2 = String.Join(string_5, flatten_4)
firstItem_2 = List.FirstItem(join_2)
code_block_16 = CodeBlock(toc=code_block_4.out0, body=firstItem_2) { toc + "\n" + body; }
writeText = File.WriteText(code_block_14, code_block_16)
