# Dynamo graph ExtractPythonScripts.dyn (Dynamo 0.9.0.3067)

# group: Extract Python Scripts
# note: This graph parses each *.dyf file in a given directory and extracts all Python scripts within that file into a subdirectory. Previous Pythons script files in that directory will be deleted.
# I am using this in order to keep the Python documentation of my custom nodes more accessible.

# group: INPUTS
directory_path = Directory("C:\Users\adieckmann\Documents\GitHub\ClockworkForDynamo\nodes\0.9.x")
subdirectory_name = StringInput("python")

# group: Delete previous *.py files
delimiter = StringInput("\")
code_block = CodeBlock(dir=directory_path, delimiter=delimiter, subdir=subdirectory_name) { dir + delimiter + subdir; }
file_extension = CodeBlock { "*.py"; }

fromPath = DirectoryObject(code_block)  # "Directory.FromPath"

# group (continued): Delete previous *.py files
contents = Directory.Contents(fromPath, file_extension)
delete = File.Delete(contents)
code_block_2 = CodeBlock(dir=code_block, deleted=delete) { {dir,deleted}[0]; }

# group: Browse directory
fromPath_2 = DirectoryObject(directory_path)  # "Directory.FromPath"
file_extension_2 = CodeBlock { "*.dyf"; }
contents_2 = Directory.Contents(fromPath_2, file_extension_2)

# group: Extract Python scripts
info = Custom[CustomNode.Info](path=contents_2)  # Extracts information from a custom node.
isNotEmpty = Custom[List.IsNotEmpty]()  # Just the inversion of the built-in Is Empty List node.
map = List.Map(list=info.PythonScripts, f_x=isNotEmpty)
filterByBoolMask = List.FilterByBoolMask(list=info.PythonScripts, mask=map)
string = StringInput("&gt;")
string_2 = StringInput(">")
replace = String.Replace(str=filterByBoolMask.in, searchFor=string, replaceWith=string_2)
string_3 = StringInput("&lt;")
string_4 = StringInput("<")
# note: Angle brackets: Replace HTML notation with normal characters
replace_2 = String.Replace(str=replace, searchFor=string_3, replaceWith=string_4)
string_5 = StringInput("\n\n##### NEXT PYTHON NODE #####\n\n")
# note: If a custom node contains more than one Python script, concatenate them with a custom delimiter
join = String.Join(string_5)
map_2 = List.Map(list=replace_2, f_x=join)
flatten = Flatten(map_2)

# group: Create new *.py files
# note: Filter out all files that do not contain Python scripts
filterByBoolMask_2 = List.FilterByBoolMask(list=contents_2, mask=map)
boolean = BoolSelector(false)
fileName = FilePath.FileName(filterByBoolMask_2.in, boolean)
code_block_3 = CodeBlock(dir=code_block_2, delimiter=delimiter, filename=fileName) { dir + delimiter + filename + ".py"; }
writeText = File.WriteText(code_block_3, flatten)
