# Dynamo graph TopoStuff.dyn (Dynamo 0.6.3.7375)

select_elements = MultipleCurvesBySelection()  # 1 picked in the model
# note: Ths example also requires the package Select By Category to be installed.
category = Categories(index=852)
get_family_instances_by_category = Custom[Get Family Instances By Category](BuiltInCategories=category)  # Gets all family instances in the model for a given list of categories
watch = Watch(get_family_instances_by_category)
filter_for_topo_subregions = Custom[Filter For Topo Subregions](Toposurface_s=watch)  # Filters out everything that is *not* a topo subregion. Needs Revit 2014 or newer to work.
watch_2 = Watch(filter_for_topo_subregions.Subregions)
watch_3 = Watch(filter_for_topo_subregions.bool)
watch_4 = Watch(filter_for_topo_subregions.No_Subregions)
first_of_list = First(watch_4)
topo_to_mesh = Custom[Topo To Mesh](Topo=first_of_list)  # Extracts the mesh of a toposurface
watch_5 = Watch(topo_to_mesh)
xz_plane = XzPlane(lacing=Longest)
yz_plane = YzPlane(lacing=Longest)
topo_plane_intersection = Custom[Topo-Plane Intersection](Plane=yz_plane, Topo=first_of_list)  # Calculates the intersection of a toposurface and a plane
watch_6 = Watch(topo_plane_intersection.XYZs)
model_curve = ModelCurve(topo_plane_intersection.Nurbs_Spline, lacing=Longest)
