# Dynamo custom node If X Equal.dyf (Dynamo 0.6.3.5256)
# category: Clockwork.Conditional
# If X = Y as a mappable function

x = Input()
y = Input()
equal = Equal(x, y)
true = Input()
# note: Why is this a custom node?
# So it can be used in conjunction with a Map node.
false = Input()
if_ = Conditional(equal, true, false)
