# Dynamo custom node If X Greater Than.dyf (Dynamo 0.6.3.5256)
# category: Clockwork.Conditional
# If X > Y as a mappable function

x = Input()
y = Input()
greater_than = GreaterThan(x, y)
true = Input()
# note: Why is this a custom node?
# So it can be used in conjunction with a Map node.
false = Input()
if_ = Conditional(greater_than, true, false)
