# Dynamo custom node Triangular Subpattern.dyf (Dynamo 0.6.3.7375)
# category: Clockwork.Patterning.Helpers
# Subcomponent of the Triangular Pattern From Grid node.

list = Input()
number = DoubleInput(1)
Shift_Pattern = Input()
Reverse_Pattern = Input()
Point1 = Input()
Point2 = Input()
Point3 = Input()
build_triangular_sublists = Custom[Build Triangular Sublists](list=list, offset=number, shift=Shift_Pattern, reverse=Reverse_Pattern, index0=Point1, index1=Point2, index2=Point3)
V = Input()
# note: Unclutter
drop_last_row_column_from_uv = Custom[Drop Last Row & Column From UV Field](list=build_triangular_sublists, V=V)  # Drops the last row and column from a UV field
list_2 = Output(drop_last_row_column_from_uv)  # "list"
