# Dynamo custom node True For All (Boolean).dyf (Dynamo 0.6.3.5262)
# category: Clockwork.Conditional
# Returns true if all items in a list of booleans are true.

formula = Formula("x=1", lacing=Longest)
seq = Input()
turn_into_list = Custom[Turn Into List](item=seq)  # Turns an element into a list
true_for_all = AndMap(formula, turn_into_list)
all = Output(true_for_all)  # "all?"
