# Dynamo custom node True For Any (Boolean).dyf (Dynamo 0.6.3.5262)
# category: Clockwork.Conditional
# Returns true if any item in a list of booleans is true.

formula = Formula("x=1", lacing=Longest)
seq = Input()
turn_into_list = Custom[Turn Into List](item=seq)  # Turns an element into a list
true_for_any = OrMap(formula, turn_into_list)
any = Output(true_for_any)  # "any?"
