# Dynamo custom node -1.dyf (Dynamo 0.7.5.3566)
# category: Clockwork.Core.Math.Actions
# Decrements a value by 1

Input = Input()
code_block = CodeBlock(n=Input) { n-1; }
Output = Output(code_block)  # ""
