# Dynamo custom node All Families Of Category.dyf (Dynamo 0.7.5.3566)
# category: Clockwork.Revit.Selection.ByCollector
# Gets all famiies of a given category in the model  (does *not *work for system families)

Categories = Input()
all_family_types_of_category = Custom[All Family Types Of Category](Categories=Categories)  # Gets all family types/symbols of a given category in the model (does *not *work for system families)
family = FamilySymbol.Family(all_family_types_of_category)
uniqueItems = List.UniqueItems(family)
Families = Output(uniqueItems)
