# Dynamo custom node Angle.ExteriorAngle.dyf (Dynamo 0.7.2.2114)
# category: Clockwork.Core.Math.Formulas.Angles
# Computes the exterior angle of a given angle.

angle_degr = Input()  # "angle (degr.)"
code_block = CodeBlock(angle=angle_degr) { 360-angle; 180-angle; }
n360_angle = Output(code_block.out0)  # "360°-angle"
n180_angle = Output(code_block.out1)  # "180°-angle"
