# Dynamo custom node BoundingBox.ByElement.dyf (Dynamo 0.7.5.3566)
# category: Clockwork.Revit.Elements.BoundingBox.Create
# Gets the bounding box of a Revit element

Element_s = Input()  # "Element(s)"
turn_into_list = Custom[Turn Into List](item=Element_s)  # Turns an element (or a nested list) into a flat list
View = Input()
python_script = Python(IN[0]=turn_into_list, IN[1]=View)
# ---------- python_script.python (22 lines) ----------
import clr
clr.AddReference('RevitAPI')
from Autodesk.Revit.DB import *

clr.AddReference("RevitNodes")
import Revit
clr.ImportExtensions(Revit.GeometryConversion)

items = UnwrapElement(IN[0])
view = UnwrapElement(IN[1])
elementlist = list()
maxlist = list()
minlist = list()

for item in items:
	try:
		elementlist.append(item.BoundingBox[view])
		maxlist.append(item.BoundingBox[view].Max.ToPoint())
		minlist.append(item.BoundingBox[view].Min.ToPoint())
	except:
		donothing = 1
OUT = (elementlist,maxlist,minlist)
# ----------------------------------------
code_block = CodeBlock(seq=python_script) { seq[0]; seq[1]; seq[2]; }
Revit_Bounding_Box_es = Output(code_block.out0)  # "Revit Bounding Box(es)"
byCorners = BoundingBox.ByCorners(code_block.out1, code_block.out2)
Dynamo_Bounding_Box_es = Output(byCorners)  # "Dynamo Bounding Box(es)"
Bottom_left_rear_corner = Output(code_block.out2)
Top_right_front_corner = Output(code_block.out1)
