# Dynamo custom node BoundingBox.ByNestedListOfElements.dyf (Dynamo 0.7.5.3566)
# category: Clockwork.Revit.Elements.BoundingBox.Create
# Retrieves a bounding box for each sublist of elements

Element_s = Input()  # "Element(s)"
sublistLengths = Custom[List.SublistLengths](list=Element_s)  # Gets the lengths of all sublists in a given list of lists.
View = Input()
byElement = Custom[BoundingBox.ByElement](Element_s=Element_s, View=View)  # Gets the bounding box of a Revit element
code_block = CodeBlock(bl=byElement.Bottom_left_rear_corner, tr=byElement.Top_right_front_corner) { bl.X; bl.Y; bl.Z; tr.X; tr.Y; tr.Z; }
chopByLengths = Custom[List.SublistByLengths](lengths=sublistLengths, list=code_block.out0)  # "List.ChopByLengths"; Turns a list into a list of lists with sublists of varying lengths.
chopByLengths_2 = Custom[List.SublistByLengths](lengths=sublistLengths, list=code_block.out1)  # "List.ChopByLengths"
chopByLengths_3 = Custom[List.SublistByLengths](lengths=sublistLengths, list=code_block.out2)  # "List.ChopByLengths"
chopByLengths_4 = Custom[List.SublistByLengths](lengths=sublistLengths, list=code_block.out3)  # "List.ChopByLengths"
chopByLengths_5 = Custom[List.SublistByLengths](lengths=sublistLengths, list=code_block.out4)  # "List.ChopByLengths"
chopByLengths_6 = Custom[List.SublistByLengths](lengths=sublistLengths, list=code_block.out5)  # "List.ChopByLengths"
code_block_2 = CodeBlock(a=chopByLengths, b=chopByLengths_2, c=chopByLengths_3, d=chopByLengths_4, e=chopByLengths_5, f=chopByLengths_6)
# ---------- code_block_2.designscript (3 lines) ----------
p1 = Point.ByCoordinates(List.MinimumItem(a),List.MinimumItem(b),List.MinimumItem(c));
p2 = Point.ByCoordinates(List.MaximumItem(d),List.MaximumItem(e),List.MaximumItem(f));
BoundingBox.ByCorners(p1,p2);
# ----------------------------------------
fromDynamoBoundingBox = Custom[RevitBoundingBox.FromDynamoBoundingBox](Dynamo_Bounding_Box_es=code_block_2.out2)  # Turns a Dynamo bounding box into a Revit bounding box.
Revit_Bounding_Box_es = Output(fromDynamoBoundingBox)  # "Revit Bounding Box(es)"
Dynamo_Bounding_Box_es = Output(code_block_2.out2)  # "Dynamo Bounding Box(es)"
Bottom_left_rear_corners = Output(code_block_2.p2)
Top_right_front_corners = Output(code_block_2.p1)
