# Dynamo custom node Centimeters.ToFeet.dyf (Dynamo 0.7.5.3566)
# category: Clockwork.Units.Length
# Converts centimeters into feet

cm = Input()
code_block = CodeBlock(cm=cm) { cm/100/0.3048; }
ft = Output(code_block)
