# Dynamo custom node Color.ByWebColor.dyf (Dynamo 0.7.5.3566)
# category: Clockwork.Core.Color.Create
# Creates a color from a given web color (a hex triplet like #FF9900)

Hex = Input()
turn_into_list = Custom[Turn Into List](item=Hex)  # Turns an element (or a nested list) into a flat list
code_block = CodeBlock(str=turn_into_list) { String.Replace(str,"#",""); {0,2,4}; 2; }
substring = String.Substring(arg1=code_block.out1, arg2=code_block.out2)
map = List.Map(code_block.out0, substring)
code_block_2 = CodeBlock(seq=map) { seq2 = List.Transpose(seq); seq2[0]; seq2[1]; seq2[2]; }
hexToDecimal = Custom[String.HexToDecimal](Hex=code_block_2.out1)  # Converts a string of a hexadecimal value to a number
hexToDecimal_2 = Custom[String.HexToDecimal](Hex=code_block_2.out2)
hexToDecimal_3 = Custom[String.HexToDecimal](Hex=code_block_2.out3)
code_block_3 = CodeBlock(r=hexToDecimal, g=hexToDecimal_2, b=hexToDecimal_3) { Color.ByARGB(255,r,g,b); }
returnListOrSingleValue = Custom[ReturnListOrSingleValue](item_1_unknown=Hex, item_2_list=code_block_3)  # If the item in input #1 is not a list, only the first item of the list in input #2 will be returned.
Color = Output(returnListOrSingleValue)
