# Dynamo custom node Color.GreyscaleByNormalizedValue.dyf (Dynamo 0.7.5.3566)
# category: Clockwork.Core.Color.Create
# Creates a greyscale color based on a normalized value (0 = black, 1 = white)

dbl = Input()
code_block = CodeBlock(x=dbl) { Color.ByARGB(255,x*255,x*255,x*255); }
Color = Output(code_block)
