# Dynamo custom node CubicMeters.ToCubicFeet.dyf (Dynamo 0.7.2.3911)
# category: Clockwork.Units.Volume
# Converts cubic meters into cubic feet

m3 = Input()
code_block = CodeBlock(m3=m3) { m3/0.028316846592; }
cu_ft = Output(code_block)
