# Dynamo custom node CurtainSystem.Type.dyf (Dynamo 0.7.2.3911)
# category: Clockwork.Revit.Elements.CurtainSystem.Query
# Retrieves the family type for a given curtain system instance.

Curtain_System_Instance_s = Input()  # "Curtain System Instance(s)"
turn_into_list = Custom[Turn Into List](item=Curtain_System_Instance_s)  # Turns an element (or a nested list) into a flat list
python_script = Python(IN[0]=turn_into_list)
# ---------- python_script.python (16 lines) ----------
import clr
clr.AddReference('RevitAPI')
from Autodesk.Revit.DB import *

clr.AddReference("RevitNodes")
import Revit
clr.ImportExtensions(Revit.Elements)

csinstances = UnwrapElement(IN[0])
elementlist = list()
for item in csinstances:
	try:
		elementlist.append(item.CurtainSystemType.ToDSType(True))
	except:
		elementlist.append(list())
OUT = elementlist
# ----------------------------------------
return_list_or_single_value = Custom[Return List Or Single Value](list_1=turn_into_list, list_2=python_script)  # If the list in input #1 only contains one item, only the first item of the list in input #2 will be returned.
Curtain_System_Type_s = Output(return_list_or_single_value)  # "Curtain System Type(s)"
