# Dynamo custom node DividedSurface.VerticalIntersectsByEndpoints.dyf (Dynamo 0.7.5.3566)
# category: Clockwork.Revit.Elements.DividedSurface.Actions
# Creates a number of equally spaced vertical intersects for a divided surface based on the path between between two points. You may need to switch start point and end point.

DivSurf = Input()
Start_point = Input()
End_point = Input()
Subdivisions = Input()
code_block = CodeBlock(startp=Start_point, endp=End_point, subdiv=Subdivisions)
# ---------- code_block.designscript (15 lines) ----------
// Project the points to the XY plane and create a line between them
p1 = Point.ByCoordinates(startp.X,startp.Y);
p2 = Point.ByCoordinates(endp.X,endp.Y);
curve1 = Line.ByStartPointEndPoint(p1,p2);
// Create points for subdivisions
seq = 0..1..#(subdiv+1);
seq2 = List.RestOfItems(seq);
seq3 = List.TakeItems(seq2,List.Count(seq2)-1);
cpoints = curve1.PointAtParameter(seq3);
// Find vector orthogonal to line
vec1 = Vector.ByTwoPoints(p1,p2).Normalized();
vec2 = vec1.Cross(Vector.ZAxis());
vec3 = vec2.Scale(curve1.Length/10);
// Create a set of orthogonal planes to curve 1
ReferencePlane.ByStartPointEndPoint(cpoints.Add(vec3),cpoints.Subtract(vec3));
# ----------------------------------------
addIntersect = Custom[Add Intersect To Divided Surface](DivSurf=DivSurf, Element_s=code_block.out10)  # "DividedSurface.AddIntersect"; Adds an intersect to a divided surface
DivSurf_2 = Output(addIntersect)  # "DivSurf"
Intersects = Output(code_block.out10)
