# Dynamo custom node Document.ContainsElementsOfCategory.dyf (Dynamo 0.7.5.3566)
# category: Clockwork.Revit.Document.Query
# Checks if family instances of specified categories are present in the model.

Categories = Input()
turn_into_list = Custom[Turn Into List](item=Categories)  # Turns an element (or a nested list) into a flat list
all_elements_of_category = ElementsOfCategory(turn_into_list)
isNotEmpty = Custom[List Not Empty]()  # "List.IsNotEmpty"; Just the inversion of the built-in Is Empty List node.
map = List.Map(all_elements_of_category, isNotEmpty)
anyTrue = Custom[True For Any (Boolean)](seq=map)  # "List.AnyTrue"; Returns true if any item in a list of booleans is true.
any = Output(anyTrue)  # "any?"
code_block = CodeBlock(seq=map) { AllTrue(seq); }
all = Output(code_block)  # "all?"
returnListOrSingleValue = Custom[ReturnListOrSingleValue](item_1_unknown=Categories, item_2_list=map)  # If the item in input #1 is not a list, only the first item of the list in input #2 will be returned.
per_category = Output(returnListOrSingleValue)
returnListOrSingleValue_2 = Custom[ReturnListOrSingleValue](item_1_unknown=Categories, item_2_list=all_elements_of_category)
instances = Output(returnListOrSingleValue_2)
