# Dynamo custom node Document.DesignOptions.dyf (Dynamo 0.7.5.3566)
# category: Clockwork.Revit.Document.Query
# Returns all design options in the model, grouped by design option set

python_script = Python()
# ---------- python_script.python (13 lines) ----------
import clr
clr.AddReference('RevitAPI')
from Autodesk.Revit.DB import *
import Autodesk

clr.AddReference("RevitServices")
import RevitServices
from RevitServices.Persistence import DocumentManager

doc = DocumentManager.Instance.CurrentDBDocument
collector = FilteredElementCollector(doc)
desopts = collector.OfClass(DesignOption).ToElements()
OUT = desopts
# ----------------------------------------
designOptionSet = Custom[DesignOption.DesignOptionSet](DesignOption_s=python_script)  # Returns the design option set of a given design option
code_block = CodeBlock(options=python_script, dos=designOptionSet, elem=designOptionSet) { {options, List.IsEmpty(options) ? dos : elem.UniqueId}; 1; }
groupListOfListsByKey = Custom[List.GroupListOfListsByKey](list=code_block.out0, key_index=code_block.out1)  # Groups a list of lists by one of its keys
code_block_2 = CodeBlock(seq1=groupListOfListsByKey) { seq2 = List.Transpose(seq1); seq2[0]; List.UniqueItems(Flatten(seq2[1])); }
byID = Custom[Element.ByID](ID_s_or_UniqueId_s=code_block_2.out2)  # Gets the Revit element(s) for a list of IDs (or a single ID)
DesignOptionSets = Output(byID.Element_s)
DesignOptions = Output(code_block_2.out1)
