# Dynamo custom node Document.ListBuiltInCategoriesByName.dyf (Dynamo 0.7.2.2921)
# category: Clockwork.Revit.Document.Query
# Looks up all the built-in categories based on a given name (or part of a name) of the category. Search is case-insensitive.

list_builtincategories = Custom[List BuiltInCategories]()  # List all the available BuiltInCategories
search_term = Input()
boolean = BoolSelector(true)
contains = String.Contains(arg1=search_term, arg2=boolean)
filter = List.Filter(list_builtincategories, contains)
results = Output(filter)
