# Dynamo custom node Document.ListBuiltInParametersByName.dyf (Dynamo 0.7.2.2921)
# category: Clockwork.Revit.Document.Query
# Looks up all the built-in parameters based on a given name (or part of a name) of the parameters. Search is case-insensitive.

list_builtinparameters = Custom[List BuiltInParameters]()  # List all the available BuiltInParameters
search_term = Input()
boolean = BoolSelector(true)
contains = String.Contains(arg1=search_term, arg2=boolean)
filter = List.Filter(list_builtinparameters, contains)
results = Output(filter)
