# Dynamo custom node DoorOrWindow.ExitsToOneRoomOnly.dyf (Dynamo 0.7.5.3566)
# category: Clockwork.Revit.Elements.DoorOrWindow.Query
# Evaluates if a door or window has only set one of the ToRoom / FromRoom properties. This may help to determine whether a door/window is external.

Doors_Windows = Input()  # "Doors/Windows"
turn_into_list = Custom[Turn Into List](item=Doors_Windows)  # Turns an element (or a nested list) into a flat list
Phase = Input()
fromRoomAndToRoom = Custom[DoorOrWindow.FromRoomAndToRoom](Door_s_Window_s=turn_into_list, Phase=Phase)  # Gets the rooms that are connected by a given door or a window
isEmpty = List.IsEmpty()
map = List.Map(fromRoomAndToRoom.From_Room_s, isEmpty)
isNull = Object.IsNull(map)
map_2 = List.Map(fromRoomAndToRoom.To_Room_s, isEmpty)
isNull_2 = Object.IsNull(map_2)
code_block = CodeBlock(a=isNull, b=isNull_2) { List.Transpose({a,b}); }
anyFalse = Custom[False For Any (Booleans)]()  # "List.AnyFalse"; Returns true if any item in a list of booleans is false.
map_3 = List.Map(code_block, anyFalse)
anyTrue = Custom[True For Any (Booleans)]()  # "List.AnyTrue"; Returns true if any item in a list of booleans is true.
map_4 = List.Map(code_block, anyTrue)
code_block_2 = CodeBlock(a=map_3, b=map_4) { List.Transpose({a,b}); }
allTrue = AllTrue()
map_5 = List.Map(code_block_2, allTrue)
returnListOrSingleValue = Custom[ReturnListOrSingleValue](item_1_unknown=Doors_Windows, item_2_list=map_5)  # If the item in input #1 is not a list, only the first item of the list in input #2 will be returned.
bool = Output(returnListOrSingleValue)
