# Dynamo custom node Element.Area.dyf (Dynamo 0.7.2.2114)
# category: CAAD_RWTH.Revit.Elements.Element.Query
# Returns the area property of a given element (if that element has such a property)

element_s = Input()  # "element(s)"
turn_into_list = Custom[Turn Into List](item=element_s)  # Turns an element (or a nested list) into a flat list
python_script = Python(IN[0]=turn_into_list)
# ---------- python_script.python (12 lines) ----------
import clr
clr.AddReference('RevitAPI')
from Autodesk.Revit.DB import *

faminsts = UnwrapElement(IN[0])
elementlist = list()
for item in faminsts:
	try:
		elementlist.append(item.Area)
	except:
		elementlist.append(list())
OUT = elementlist
# ----------------------------------------
fromSquareFeet = DynamoUnits.Area.FromSquareFeet(python_script)
value = DynamoUnits.SIUnit.Value(fromSquareFeet)
return_list_or_single_value = Custom[Return List Or Single Value](list_1=turn_into_list, list_2=value)  # If the list in input #1 only contains one item, only the first item of the list in input #2 will be returned.
area_s = Output(return_list_or_single_value)  # "area(s)"
