# Dynamo custom node Element.FromDynamoSurface.dyf "Get Element By Face" (Dynamo 0.7.2.26223)
# category: CAAD_RWTH.Revit.Selection
# Returns the underlying Revit element of a given face

Face_s = Input()  # "Face(s)"
turn_into_list = Custom[Turn Into List](item=Face_s)  # Turns an element (or a nested list) into a flat list
python_script = Python(IN[0]=turn_into_list)
# ---------- python_script.python (19 lines) ----------
import clr
clr.AddReference('RevitAPI')
from Autodesk.Revit.DB import *

clr.AddReference("RevitServices")
import RevitServices
from RevitServices.Persistence import DocumentManager

doc = DocumentManager.Instance.CurrentDBDocument
faces = UnwrapElement(IN[0])
elementlist = list()
for face in faces:
	try:
		ref = face.Tags.LookupTag("RevitFaceReference")
		elem = doc.GetElement(ref)
		elementlist.append(elem)
	except:
		elementlist.append(list())
OUT = elementlist
# ----------------------------------------
return_list_or_single_value = Custom[Return List Or Single Value](list_1=turn_into_list, list_2=python_script)  # If the list in input #1 only contains one item, only the first item of the list in input #2 will be returned.
Element_s = Output(return_list_or_single_value)  # "Element(s)"
