# Dynamo custom node Element.Host.dyf (Dynamo 0.7.5.3437)
# category: Clockwork.Revit.Elements.Element.Query
# Gets an element's host

element_s = Input()  # "element(s)"
turn_into_list = Custom[Turn Into List](item=element_s)  # Turns an element (or a nested list) into a flat list
python_script = Python(IN[0]=turn_into_list)
# ---------- python_script.python (28 lines) ----------
import clr
clr.AddReference('RevitAPI')
from Autodesk.Revit.DB import *

clr.AddReference("RevitNodes")
import Revit
clr.ImportExtensions(Revit.Elements)

clr.AddReference("RevitServices")
import RevitServices
from RevitServices.Persistence import DocumentManager

doc = DocumentManager.Instance.CurrentDBDocument
faminsts = UnwrapElement(IN[0])
elementlist = list()
for item in faminsts:
	try:
		elementlist.append(item.Host.ToDSType(True))
	except:
		# if that doesn't work, maybe it's a WallSweep
		try:
			hostidlist = list()
			for host in item.GetHostIds():
				hostidlist.append(doc.GetElement(host).ToDSType(True))
			elementlist.append(hostidlist)
		except:
			elementlist.append(list())
OUT = elementlist
# ----------------------------------------
returnListOrSingleValue = Custom[ReturnListOrSingleValue](item_1_unknown=element_s, item_2_list=python_script)  # If the item in input #1 is not a list, only the first item of the list in input #2 will be returned.
host_s = Output(returnListOrSingleValue)  # "host(s)"
