# Dynamo custom node Element.Location.dyf "Get Element Location" (Dynamo 0.7.2.3911)
# category: CAAD_RWTH.Revit.Elements.Element.Query
# Returns the location of an element as an XYZ (or if it's line-based the start and end point of the line), along with some booleans to help filtering the results. Use this for some element types (e.g. walls or lines) that do not work with the built-in Get Family Instance Location node.

Element_s = Input()  # "Element(s)"
turn_into_list = Custom[Turn Into List](item=Element_s)  # Turns an element (or a nested list) into a flat list
python_script = Python(IN[0]=turn_into_list)
# ---------- python_script.python (47 lines) ----------
import clr
clr.AddReference('RevitAPI')
from Autodesk.Revit.DB import *

clr.AddReference("RevitNodes")
import Revit
clr.ImportExtensions(Revit.GeometryConversion)

items = UnwrapElement(IN[0])
pointlist = list()
curvepointlist = list()
ispoint = list()
iscurve = list()
curves = list()
haslocation = list()

for item in items:
	try:
		loc = item.Location
		if loc.ToString() == 'Autodesk.Revit.DB.LocationCurve':
			# line-based elements (e.g. walls)
			curvepoints = (loc.Curve.GetEndPoint(0).ToPoint(),loc.Curve.GetEndPoint(1).ToPoint())
			curvepointlist.append(curvepoints)
			curves.append(loc.Curve.ToProtoType())
			ispoint.append(False)
			iscurve.append(True)
			haslocation.append(True)
		else:
			# other elements
			pointlist.append(loc.Point.ToPoint())
			ispoint.append(True)
			iscurve.append(False)
			haslocation.append(True)
	except:
		try:
			# curves
			curvepoints = (item.GetEndPoint(0).ToPoint(),item.GetEndPoint(1).ToPoint())
			curvepointlist.append(curvepoints)
			curves.append(item.ToProtoType())
			ispoint.append(False)
			iscurve.append(True)
			haslocation.append(True)
		except:
			ispoint.append(False)
			iscurve.append(False)
			haslocation.append(False)
OUT = (pointlist,curvepointlist,curves,ispoint,iscurve,haslocation)
# ----------------------------------------
code_block = CodeBlock(seq=python_script) { seq[0]; seq[1]; seq[2]; seq[3]; seq[4]; seq[5]; }
Points = Output(code_block.out0)
Curve_Endpoints = Output(code_block.out1)
Curves = Output(code_block.out2)
Is_Point = Output(code_block.out3)
Is_Curve = Output(code_block.out4)
Has_Location = Output(code_block.out5)
