# Dynamo custom node Element.Materials.dyf (Dynamo 0.7.5.3566)
# category: Clockwork.Revit.Elements.Element.Query
# Retrieves all materials froma given element

Element_s = Input()  # "Element(s)"
turn_into_list = Custom[Turn Into List](item=Element_s)  # Turns an element (or a nested list) into a flat list
Include_paint_materials = Input()  # "Include paint materials?"
python_script = Python(IN[0]=turn_into_list, IN[1]=Include_paint_materials)
# ---------- python_script.python (27 lines) ----------
import clr
clr.AddReference('RevitAPI')
from Autodesk.Revit.DB import *

clr.AddReference("RevitServices")
import RevitServices
from RevitServices.Persistence import DocumentManager

doc = DocumentManager.Instance.CurrentDBDocument
items = UnwrapElement(IN[0])
paintedmats = IN[1]
elementmats = list()
elementareas = list()
elementvols = list()

for item in items:
	matlist = list()
	arealist = list()
	vollist = list()
	for matid in item.GetMaterialIds(paintedmats):
		matlist.append(doc.GetElement(matid))
		arealist.append(item.GetMaterialArea(matid,paintedmats))
		vollist.append(item.GetMaterialVolume(matid))
	elementmats.append(matlist)
	elementareas.append(arealist)
	elementvols.append(vollist)
OUT = (elementmats,elementareas,elementvols)
# ----------------------------------------
code_block = CodeBlock(seq=python_script) { seq[0]; seq[1]; seq[2]; }
isEmpty = List.IsEmpty()
map = List.Map(code_block.out0, isEmpty)
code_block_2 = CodeBlock(materials=code_block.out0, mask=map, areas=code_block.out1, volumes=code_block.out2)
# ---------- code_block_2.designscript (6 lines) ----------
filter1 = List.FilterByBoolMask(materials,mask)["out"];
filter2 = List.FilterByBoolMask(areas,mask);
filter3 = List.FilterByBoolMask(volumes,mask);
Area.FromSquareFeet(filter2["out"]).Value;
Volume.FromCubicFeet(filter3["out"]).Value;
!mask;
# ----------------------------------------
Materials = Output(code_block_2.filter1)
Material_Areas = Output(code_block_2.out3)
Material_Volumes = Output(code_block_2.out4)
Has_Material = Output(code_block_2.out5)
