# Dynamo custom node Element.ParameterExists.dyf (Dynamo 0.7.2.2921)
# category: Clockwork.Revit.Elements.Element.Query
# Checks if an element contains a parameter of a given name

Element_s = Input()  # "Element(s)"
turn_into_list = Custom[Turn Into List](item=Element_s)  # Turns an element (or a nested list) into a flat list
param = Input()
python_script = Python(IN[0]=turn_into_list, IN[1]=param)
# ---------- python_script.python (16 lines) ----------
import clr
clr.AddReference('RevitAPI')
from Autodesk.Revit.DB import *

items = UnwrapElement(IN[0])
param = IN[1]
elementlist = list()
for item in items:
	try:
		if item.Parameter[param].GetType().Name == 'Parameter':
			elementlist.append(True)
		else:
			elementlist.append(False)
	except:
		elementlist.append(False)
OUT = elementlist
# ----------------------------------------
returnListOrSingleValue = Custom[ReturnListOrSingleValue](item_1_unknown=Element_s, item_2_list=python_script)  # If the item in input #1 is not a list, only the first item of the list in input #2 will be returned.
bool = Output(returnListOrSingleValue)
