# Dynamo custom node Element.Type.dyf (Dynamo 0.7.2.3911)
# category: CAAD_RWTH.Revit.Elements.Element.Query
# Gets the family type of a given element (if applicable).

Element_s = Input()  # "Element(s)"
turn_into_list = Custom[Turn Into List](item=Element_s)  # Turns an element (or a nested list) into a flat list
python_script = Python(IN[0]=turn_into_list)
# ---------- python_script.python (17 lines) ----------
import clr
clr.AddReference('RevitAPI')
from Autodesk.Revit.DB import *

clr.AddReference("RevitServices")
import RevitServices
from RevitServices.Persistence import DocumentManager

doc = DocumentManager.Instance.CurrentDBDocument
items = UnwrapElement(IN[0])
typelist = list()
for item in items:
	try: 
		typelist.append(doc.GetElement(item.GetTypeId()))
	except:
		typelist.append(list())
OUT = typelist
# ----------------------------------------
return_list_or_single_value = Custom[Return List Or Single Value](list_1=turn_into_list, list_2=python_script)  # If the list in input #1 only contains one item, only the first item of the list in input #2 will be returned.
Type_s = Output(return_list_or_single_value)  # "Type(s)"
