# Dynamo custom node ElementType.Duplicate.dyf (Dynamo 0.7.5.3342)
# category: Clockwork.Revit.Elements.ElementType.Actions
# Duplicates an element type

Element_Type_s = Input()  # "Element Type(s)"
turn_into_list = Custom[Turn Into List](item=Element_Type_s)  # Turns an element (or a nested list) into a flat list
Name_s = Input()  # "Name(s)"
turn_into_list_2 = Custom[Turn Into List](item=Name_s)
create = List.Create(turn_into_list, turn_into_list_2)
equalSublistLengths = Custom[List.EqualSublistLengths](lists=create)  # Trims all given lists to the length of the shortest list
code_block = CodeBlock(seq=equalSublistLengths) { seq[0]; seq[1]; }
python_script = Python(IN[0]=code_block.out0, IN[1]=code_block.out1)
# ---------- python_script.python (27 lines) ----------
import clr
clr.AddReference('RevitAPI')
from Autodesk.Revit.DB import *

clr.AddReference("RevitNodes")
import Revit
clr.ImportExtensions(Revit.Elements)

clr.AddReference("RevitServices")
import RevitServices
from RevitServices.Persistence import DocumentManager
from RevitServices.Transactions import TransactionManager

doc = DocumentManager.Instance.CurrentDBDocument
famtypes = UnwrapElement(IN[0])
newnames = IN[1]
elementlist = list()
counter = 0
TransactionManager.Instance.EnsureInTransaction(doc)
for item in famtypes:
	try:
		elementlist.append(item.Duplicate(newnames[counter]))
	except:
		elementlist.append(list())
	counter += 1
TransactionManager.Instance.TransactionTaskDone()
OUT = elementlist
# ----------------------------------------
returnListOrSingleValue = Custom[ReturnListOrSingleValue](item_1_unknown=Element_Type_s, item_2_list=python_script)  # If the item in input #1 is not a list, only the first item of the list in input #2 will be returned.
Duplicate_s = Output(returnListOrSingleValue)  # "Duplicate(s)"
