# Dynamo custom node Elements.FilterByName.dyf (Dynamo 0.7.5.3566)
# category: Clockwork.Revit.Selection.Filters
# Retrieves those elements from a collection whose names match the search string

Elements = Input()
turn_into_list = Custom[Turn Into List](item=Elements)  # Turns an element (or a nested list) into a flat list
element_name_universal = Custom[Element.Name (Universal)](Element_s=turn_into_list)  # Gets an element's name (Dynamo's built-in Name nodes don't work for all element types, e.g. worksets...)
Search_string = Input()
Ignore_case = Input()  # "Ignore case ?"
contains = String.Contains(element_name_universal, Search_string, Ignore_case)
filterByBoolMask = List.FilterByBoolMask(turn_into_list, contains)
firstItem = List.FirstItem(filterByBoolMask.out0)
first = Output(firstItem)
in_ = Output(filterByBoolMask.out0)  # "in"
out = Output(filterByBoolMask.out1)
