# Dynamo custom node Elements.FilterByParameterValueAndCondition.dyf (Dynamo 0.7.5.3566)
# category: Clockwork.Revit.Selection.Filters

Elements = Input()
parameterName = Input()
parameterExists = Custom[Element.ParameterExists](param=parameterName)  # Checks if an element contains a parameter of a given name
filter = List.Filter(Elements, parameterExists)
getParameterValueByName = Element.GetParameterValueByName(filter.out0, parameterName)
f_x = Input()  # "f(x)"
map = List.Map(getParameterValueByName, f_x)
filterByBoolMask = List.FilterByBoolMask(filter.out0, map)
in_ = Output(filterByBoolMask.out0)  # "in"
join = List.Join(filter.out1, filterByBoolMask.out1)
out = Output(join)
