# Dynamo custom node Elements.GroupByHost.dyf (Dynamo 0.7.2.2114)
# category: Clockwork.Revit.Elements.Element.Actions
# Groups a list of Revit elements by their respective hosts (if they have any)

Element_s = Input()  # "Element(s)"
host = Custom[Get Host](element_s=Element_s)  # "Element.Host"; Gets an element's host
turn_into_list = Custom[Turn Into List](item=host)  # Turns an element (or a nested list) into a flat list
isNull = Object.IsNull()
map = List.Map(turn_into_list, isNull)
filterByBoolMask = List.FilterByBoolMask(turn_into_list, map)
turn_into_list_2 = Custom[Turn Into List](item=Element_s)
filterByBoolMask_2 = List.FilterByBoolMask(turn_into_list_2, map)
code_block = CodeBlock(hosts=filterByBoolMask.out1, elements=filterByBoolMask_2.out1) { uniqueids = hosts.UniqueId; {uniqueids,elements}; 0; false; 1; }
sortListOfLists = Custom[Sort List Of Lists](List_of_lists=code_block.out1, Sort_index=code_block.out2, Case_insensitive=code_block.out3, Order_Descending=code_block.out3)  # "List.SortListOfLists"; Sorts a list of lists by one of its sublists
groupListOfListsByKey = Custom[Group List of Lists By Key](list=sortListOfLists, key_index=code_block.out2)  # "List.GroupListOfListsByKey"; Groups a list of lists by one of its keys
transpose = List.Transpose()
map_2 = List.Map(groupListOfListsByKey, transpose)
getItemAtIndex = List.GetItemAtIndex(arg1=code_block.out4)
map_3 = List.Map(map_2, getItemAtIndex)
Hosted = Output(map_3)
firstItem = List.FirstItem()
map_4 = List.Map(map_2, firstItem)
firstItem_2 = List.FirstItem()
map_5 = List.Map(map_4, firstItem_2)
byID = Custom[IDs to Elements](ID_s_or_UniqueId_s=map_5)  # "Element.ByID"; Gets the Revit element(s) for a list of IDs (or a single ID)
Host_s = Output(byID.Element_s)  # "Host(s)"
Unhosted = Output(filterByBoolMask_2.out0)
