# Dynamo custom node FootingType.BreaksAtInserts.dyf (Dynamo 0.7.2.3911)
# category: CAAD_RWTH.Revit.Elements.FootingType.Query
# Determines whether a list of wall footing types break at inserts in their attached walls

Footing_Type_s = Input()  # "Footing Type(s)"
turn_into_list = Custom[Turn Into List](item=Footing_Type_s)  # Turns an element (or a nested list) into a flat list
python_script = Python(IN[0]=turn_into_list)
# ---------- python_script.python (14 lines) ----------
import clr
clr.AddReference('RevitAPI')
from Autodesk.Revit.DB import *

footingtypes = UnwrapElement(IN[0])
booleans = list()
for item in footingtypes:
	try:
		footingbreaks = item.get_Parameter(BuiltInParameter.CONTINUOUS_FOOTING_BREAK_AT_INSERTS_DISABLE).AsInteger()
		if footingbreaks == 0: booleans.append(True)
		elif footingbreaks == 1: booleans.append(False)
	except:
		booleans.append(False)
OUT = booleans
# ----------------------------------------
return_list_or_single_value = Custom[Return List Or Single Value](list_1=turn_into_list, list_2=python_script)  # If the list in input #1 only contains one item, only the first item of the list in input #2 will be returned.
bool = Output(return_list_or_single_value)
