# Dynamo custom node HostedObject.FacingOrientation.dyf (Dynamo 0.7.2.6209)
# category: CAAD_RWTH.Revit.Elements.Element.Query
# Gets the facing orientation of a hosted object (e.g. a window or a door)

element_s = Input()  # "element(s)"
turn_into_list = Custom[Turn Into List](item=element_s)  # Turns an element (or a nested list) into a flat list
python_script = Python(IN[0]=turn_into_list)
# ---------- python_script.python (17 lines) ----------
import clr
clr.AddReference('RevitAPI')
from Autodesk.Revit.DB import *

clr.AddReference("RevitNodes")
import Revit
clr.ImportExtensions(Revit.Elements)
clr.ImportExtensions(Revit.GeometryConversion)

objinstances = UnwrapElement(IN[0])
vectorlist = list()
for item in objinstances:
	try:
		vectorlist.append(item.FacingOrientation.ToVector())
	except:
		vectorlist.append(list())
OUT = vectorlist
# ----------------------------------------
return_list_or_single_value = Custom[Return List Or Single Value](list_1=turn_into_list, list_2=python_script)  # If the list in input #1 only contains one item, only the first item of the list in input #2 will be returned.
Vector_s = Output(return_list_or_single_value)  # "Vector(s)"
