# Dynamo custom node Hypotenuse.ByPythagoras.dyf (Dynamo 0.7.5.3566)
# category: Clockwork.Core.Formulas.Pythagoras
# Computes the length of the hypotenuse of a right triangle using the Pythagorean Theorem. A and B are the legs / catheti of the triangle.

A = Input()
B = Input()
code_block = CodeBlock(a=A, b=B) { Math.Sqrt(Math.Pow(a,2)+Math.Pow(b,2)); }
C = Output(code_block)
