# Dynamo custom node List.AnyFalse.dyf (Dynamo 0.7.5.3566)
# category: Clockwork.Core.List.Query
# Returns true if any item in a list of booleans is false.

seq = Input()
turn_into_list = Custom[Turn Into List](item=seq)  # Turns an element (or a nested list) into a flat list
formula = Formula("x=0")
code_block = CodeBlock(seq=turn_into_list, predicate=formula) { List.IsEmpty(seq) ? false : TrueForAny(seq,predicate); }
any = Output(code_block)  # "any?"
