# Dynamo custom node List.CountBooleanSequences.dyf (Dynamo 0.7.2.3911)
# category: CAAD_RWTH.Core.List.Actions
# Retrieves the lengths of uninterrupted sequences of booleans (true or false) in a given list.

True_False = Input()  # "True/False"
booleans = Input()
turn_into_list = Custom[Turn Into List](item=booleans)  # Turns an element (or a nested list) into a flat list
not_ = Not()
map = List.Map(turn_into_list, not_)
code_block = CodeBlock(tf=True_False, seq1=turn_into_list, seq1_inv=map) { tf ? seq1 : seq1_inv; }
python_script = Python(IN[0]=code_block)
# ---------- python_script.python (14 lines) ----------
import clr

booleans = IN[0]
elementlist = list()
elementlist.append(0)
counter = 0

for item in booleans:
	if item == True:
		elementlist[counter] += 1
	elif item == False:
		counter += 1
		elementlist.append(0)
OUT = elementlist
# ----------------------------------------
formula = Formula("n>0")
filter = Filter(python_script, formula)
lengths = Output(filter)
