# Dynamo custom node List.CountOccurences.dyf (Dynamo 0.7.5.3566)
# category: Clockwork.Core.List.Query
# Counts the number of occurences of each unique element in a given list

list = Input()
turn_into_list = Custom[Turn Into List](item=list)  # Turns an element (or a nested list) into a flat list
identity = Object.Identity()
groupByKey = GroupByKey(turn_into_list, identity)
firstItem = List.FirstItem()
map = List.Map(groupByKey, firstItem)
Unique_elements = Output(map)
sublistLengths = Custom[List.SublistLengths](list=groupByKey)  # Gets the lengths of all sublists in a given list of lists.
Count = Output(sublistLengths)
