# Dynamo custom node List.EqualSublistLengths.dyf "List.EqualListLengths" (Dynamo 0.7.2.3911)
# category: CAAD_RWTH.Core.List.Actions
# Trims all given lists to the length of the shortest list

lists = Input()
get_sublist_lengths = Custom[Get Sublist Lengths](list=lists)  # Gets the lengths of all sublists in a given list of lists.
minimumItem = List.MinimumItem(get_sublist_lengths)
takeItems = List.TakeItems(arg1=minimumItem)
map = List.Map(lists, takeItems)
lists_2 = Output(map)  # "lists"
