# Dynamo custom node List.FibonacciFromList.dyf (Dynamo 0.7.5.3566)
# category: Clockwork.Core.List.Create
# Creates a Fibonacci row from a starting list (last two values) of a given length (starting values do *not* count toward length).

initialList = Input()
length = Input()
python_script = Python(IN[0]=initialList, IN[1]=length)
# ---------- python_script.python (7 lines) ----------
fibseq = IN[0]
iterations = IN[1]
counter = 0
while counter < iterations:
	fibseq.append(fibseq[len(fibseq)-2] + fibseq[len(fibseq)-1])
	counter += 1
OUT = fibseq
# ----------------------------------------
list = Output(python_script)
