# Dynamo custom node List.FibonacciFromValues.dyf (Dynamo 0.7.5.3566)
# category: Clockwork.Core.List.Create
# Creates a Fibonacci row from two starting values of a given length (starting values do *not* count toward length).

a = Input()
b = Input()
code_block = CodeBlock(a=a, b=b) { {a,b}; }
length = Input()
fibonacciFromList = Custom[List.FibonacciFromList](initialList=code_block, length=length)  # Creates a Fibonacci row from a starting list (last two values) of a given length (starting values do *not* count toward length).
list = Output(fibonacciFromList)
