# Dynamo custom node List.FillSublists.dyf (Dynamo 0.7.2.2114)
# category: Clockwork.Core.List.Create
# Repeats a list of items into sublists of given lengths

ofRepeatedItem = List.OfRepeatedItem()
list = Input()
lengths = Input()
combine = List.Combine(ofRepeatedItem, list, lengths)
sublists = Output(combine)
