# Dynamo custom node List.FilterBySublistLength.dyf (Dynamo 0.7.5.3566)
# category: Clockwork.Core.List.Actions
# Filters out all sublists that do not have the specified length

list = Input()
count = List.Count()
map = List.Map(list, count)
length = Input()
formula = Formula("n=x", map, length)
filterByBoolMask = List.FilterByBoolMask(list, formula)
in_ = Output(filterByBoolMask.out0)  # "in"
out = Output(filterByBoolMask.out1)
