# Dynamo custom node List.FromString.dyf (Dynamo 0.7.5.3566)
# category: Clockwork.Core.String.Create
# Chops up a string into a list of characters

str = Input()
code_block = CodeBlock(str=str) { startindex = 0..(String.Length(str)-1); String.Substring(str,startindex,1); }
list = Output(code_block.out1)
