# Dynamo custom node List.GroupListOfListsByKey.dyf (Dynamo 0.7.2.6209)
# category: CAAD_RWTH.Core.List.Actions
# Groups a list of lists by one of its keys

list = Input()
transpose = List.Transpose(list)
key_index = Input()
python_script = Python(IN[0]=transpose, IN[1]=key_index)
# ---------- python_script.python (13 lines) ----------
import clr
from itertools import groupby

items = IN[0]
groupindex = int(IN[1])
listlist = list()

for key, group in groupby(items, lambda x: x[groupindex]):
	elementlist = list()
	for thing in group:
		elementlist.append(thing)
	listlist.append(elementlist)
OUT = listlist
# ----------------------------------------
list_2 = Output(python_script)  # "list"
