# Dynamo custom node List.IsNotEmpty.dyf (Dynamo 0.7.4.3245)
# category: Clockwork.Core.List.Query
# Just the inversion of the built-in Is Empty List node.

list = Input()
code_block = CodeBlock(seq=list) { !List.IsEmpty(seq); }
bool = Output(code_block)
