# Dynamo custom node List.MatchWithKeyValues.dyf (Dynamo 0.7.2.6209)
# category: Clockwork.Core.List.Actions
# Matches a list with a given set of keys and returns the values corresponding to the keys

list = Input()
turn_into_list = Custom[Turn Into List](item=list)  # Turns an element (or a nested list) into a flat list
keys = Input()
turn_into_list_2 = Custom[Turn Into List](item=keys)
values = Input()
turn_into_list_3 = Custom[Turn Into List](item=values)
python_script = Python(IN[0]=turn_into_list, IN[1]=turn_into_list_2, IN[2]=turn_into_list_3)
# ---------- python_script.python (13 lines) ----------
import clr

items = IN[0]
keys = IN[1]
values = IN[2]
elementlist = list()
for item in items:
	counter = 0
	for key in keys:
		if (item == key):
			elementlist.append(values[counter])
		counter += 1
OUT = elementlist
# ----------------------------------------
matched_values = Output(python_script)
