# Dynamo custom node List.NormalizedSequence.dyf (Dynamo 0.7.5.3566)
# category: Clockwork.Core.List.Create.Numbers
# Creates a sequence of N values between 0 and 1

N = Input()
code_block = CodeBlock(n=N) { 0..1..#n; }
Sequence = Output(code_block)
