# Dynamo custom node List.RandomElements.dyf (Dynamo 0.7.3.3034)
# category: Clockwork.Core.List.Create
# Creates a list of random elements based on a given list of elements

Base_elements = Input()
turn_into_list = Custom[Turn Into List](item=Base_elements)  # Turns an element (or a nested list) into a flat list
count = Count(turn_into_list)
code_block = CodeBlock(n=count) { n-1; }
Amount = Input()
randomIntegerList = Custom[Math.RandomIntegerList](Max=code_block, Amount=Amount)  # Creates a list of random integers between 0 and a given maximum value
getItemAtIndex = List.GetItemAtIndex(turn_into_list, randomIntegerList)
list = Output(getItemAtIndex)
