# Dynamo custom node List.ReplaceEmptyLists.dyf (Dynamo 0.7.5.3566)
# category: Clockwork.Core.List.Actions
# Replaces all empty lists within a given list with a substitute

list = Input()
isNotEmpty = Custom[List.IsNotEmpty]()  # Just the inversion of the built-in Is Empty List node.
map = List.Map(list, isNotEmpty)
boolean = BoolSelector(true)
replaceNull = Custom[List.ReplaceNull](list=map, replacement=boolean)  # Replaces all null values within a given list with a substitute
getKeys = GetKeys(replaceNull)
filterByBoolMask = List.FilterByBoolMask(getKeys, replaceNull)
replacement = Input()
replaceItemAtIndex = Custom[List.ReplaceItemAtIndex](list=list, index_indices=filterByBoolMask.out1, replacement=replacement)  # Replaces the item at a given index (or list of indices) of a list by another item
list_2 = Output(replaceItemAtIndex)  # "list"
