# Dynamo custom node List.ReplaceNull.dyf (Dynamo 0.7.5.3566)
# category: Clockwork.Core.List.Actions
# Replaces all null values within a given list with a substitute

list = Input()
replacement = Input()
isNull = Object.IsNull()
replaceByCondition = Replace(list, replacement, isNull)
list_2 = Output(replaceByCondition)  # "list"
