# Dynamo custom node List.SortListOfLists.dyf (Dynamo 0.7.2.6209)
# category: Clockwork.Core.List.Actions
# Sorts a list of lists by one of its sublists

List_of_lists = Input()
transpose = List.Transpose(List_of_lists)
Sort_index = Input()
Case_insensitive = Input()  # "Case-insensitive?"
Order_Descending = Input()  # "Order Descending?"
python_script = Python(IN[0]=transpose, IN[1]=Sort_index, IN[2]=Case_insensitive, IN[3]=Order_Descending)
# ---------- python_script.python (20 lines) ----------
import clr

lists = IN[0]
sortindex = int(IN[1])
caseinsensitive = IN[2]
sortdescending = IN[3]

# make sure that case-insensitive is turned of if it is not strings we're sorting
if caseinsensitive == True and isinstance(lists[0][sortindex], basestring) == False:
	caseinsensitive = False
if caseinsensitive == True:
	if sortdescending == True:
		OUT = sorted(lists, key=lambda lists:lists[sortindex].lower(), reverse=True)
	else:
		OUT = sorted(lists, key=lambda lists:lists[sortindex].lower())
else:
	if sortdescending == True:
		OUT = sorted(lists, key=lambda lists:lists[sortindex], reverse=True)
	else:
		OUT = sorted(lists, key=lambda lists:lists[sortindex])
# ----------------------------------------
transpose_2 = List.Transpose(python_script)
Sorted = Output(transpose_2)
