# Dynamo custom node Material.Properties.dyf (Dynamo 0.7.2.6209)
# category: CAAD_RWTH.Revit.Elements.Material.Query
# Retrieves a number of properties froma given material

Material_s = Input()  # "Material(s)"
turn_into_list = Custom[Turn Into List](item=Material_s)  # Turns an element (or a nested list) into a flat list
python_script = Python(IN[0]=turn_into_list)
# ---------- python_script.python (23 lines) ----------
import clr
clr.AddReference('RevitAPI')
from Autodesk.Revit.DB import *

mats = UnwrapElement(IN[0])
colorlist = list()
glowlist = list()
classlist = list()
shinylist = list()
smoothlist = list()
translist = list()

for mat in mats:
	colorlist.append(mat.Color)
	if mat.Glow:
		glowlist.append(True)
	else:
		glowlist.append(False)
	classlist.append(mat.MaterialClass)
	shinylist.append(mat.Shininess)
	smoothlist.append(mat.Smoothness)
	translist.append(mat.Transparency)
OUT = (classlist,colorlist,glowlist,shinylist,smoothlist,translist)
# ----------------------------------------
code_block = CodeBlock(seq=python_script) { seq[0]; seq[1]; seq[2]; seq[3]; seq[4]; seq[5]; }
Class = Output(code_block.out0)
toDynamoColor = Custom[Revit Color To Dynamo Color](item=code_block.out1)  # Converts Revit colors into Dynamo colors
Color = Output(toDynamoColor)
Glow_bool = Output(code_block.out2)  # "Glow (bool)"
Shininess = Output(code_block.out3)  # "Shininess (%)"
Smoothness = Output(code_block.out4)  # "Smoothness (%)"
Transparency = Output(code_block.out5)  # "Transparency (%)"
