# Dynamo custom node Math.NormalizeRange.dyf (Dynamo 0.7.5.3566)
# category: Clockwork.Core.Math.Actions
# Normalizes a range of numbers

numbers = Input()
code_block = CodeBlock { 0; 1; }
remapRange = Math.RemapRange(numbers, code_block.out0, code_block.out1)
Output = Output(remapRange)  # ""
