# Dynamo custom node Math.RandomIntegerList.dyf (Dynamo 0.7.5.3342)
# category: Clockwork.Core.Math.Create
# Creates a list of random integers between 0 and a given maximum value

Amount = Input()
Max = Input()
code_block = CodeBlock(amount=Amount, max=Max) { Math.Round(Math.RemapRange(Math.RandomList(amount),-0.499,max+0.499)); }
list = Output(code_block)
