# Dynamo custom node Math.RoundToPrecision.dyf (Dynamo 0.7.2.2114)
# category: Clockwork.Core.Math.Actions.Rounding
# Rounds a number to a specified precision

Number = Input()
Precision = Input()
code_block = CodeBlock(a=Number, b=Precision) { Math.Round(a/b)*b; }
round = Output(code_block)
