# Dynamo custom node Math.ScaleNormalized.dyf "Scale Normalized Value" (Dynamo 0.7.2.38829)
# category: CAAD_RWTH.Core.Math.Actions.Normalization
# Scales a normalized value according to a given minimum and maximum

Min = Input()
Max = Input()
val = Input()
code_block = CodeBlock(min=Min, max=Max, value=val) { min+(max-min)*value; }
