# Dynamo custom node Mesh.FaceVertices.dyf (Dynamo 0.7.4.3245)
# category: Clockwork.Geometry.Mesh.Query
# Gets the vertices of each face of a given mesh

Mesh = Input()
code_block = CodeBlock(m=Mesh)
# ---------- code_block.designscript (6 lines) ----------
vp = m.VertexPositions;
fi = m.FaceIndices;
a = List.GetItemAtIndex(vp,fi.A);
b = List.GetItemAtIndex(vp,fi.B);
c = List.GetItemAtIndex(vp,fi.C);
List.Transpose({a,b,c});
# ----------------------------------------
Vertices = Output(code_block.out5)
