# Dynamo custom node Meters.ToFeet.dyf (Dynamo 0.7.5.3566)
# category: Clockwork.Units.Length
# Converts meters into feet

m = Input()
code_block = CodeBlock(meters=m) { meters/0.3048; }
ft = Output(code_block)
