# Dynamo custom node Millimeters.ToFeet.dyf (Dynamo 0.7.5.3566)
# category: Clockwork.Units.Length
# Converts millimeters into feet

mm = Input()
code_block = CodeBlock(mm=mm) { mm/1000/0.3048; }
ft = Output(code_block)
