# Dynamo custom node Object.MembersByName.dyf (Dynamo 0.7.2.2921)
# category: Clockwork.Core.Object.Query
# Looks up all the members of a given element based on a given name (or part of a name) of the property or method. Search is case-insensitive.

Element = Input()
turn_into_list = Custom[Turn Into List](item=Element)  # Turns an element (or a nested list) into a flat list
firstItem = List.FirstItem(turn_into_list)
members = Custom[Object.Members](element_s=firstItem)  # Gets a list of all members (properties and methods) of a selected element
search_term = Input()
boolean = BoolSelector(true)
contains = String.Contains(arg1=search_term, arg2=boolean)
filter = List.Filter(members, contains)
results = Output(filter)
