# Dynamo custom node Paneling.GridFromFace.dyf (Dynamo 0.7.5.3342)
# category: Clockwork.Paneling.DataPreparation
# Returns UV coordinates, XYZ coordinates and normals for a face with UV subdivision

U = Input()
V = Input()
face = Input()
code_block = CodeBlock(unum=U, vnum=V, surf=face)
# ---------- code_block.designscript (4 lines) ----------
uvlist = UV.ByCoordinates((0..1..#unum+1)<1>,(0..1..#vnum+1)<2>);
UVs = Flatten(uvlist);
surf.PointAtParameter(UVs.U,UVs.V);
surf.NormalAtParameter(UVs.U,UVs.V);
# ----------------------------------------
Points = Output(code_block.out2)
Normals = Output(code_block.out3)
UVs = Output(code_block.UVs)
