# Dynamo custom node Panelling.DropLastRowAndColumn.dyf (Dynamo 0.7.2.2114)
# category: Clockwork.Paneling.Helpers
# Drops the last row and column from a UV field

list = Input()
V = Input()
code_block = CodeBlock(seq1=list, V=V)
# ---------- code_block.designscript (5 lines) ----------
amount = Count(seq1)-V;
// Drop the last row
seq2 = List.TakeItems(seq1,amount);
// Drop the last column
List.DropEveryNthItem(seq2,V,0);
# ----------------------------------------
list_2 = Output(code_block.out2)  # "list"
