# Dynamo custom node Panelling.TriangularSubpattern.dyf (Dynamo 0.7.2.2114)
# category: Clockwork.Paneling.Helpers
# Subcomponent of the Triangular Pattern From Grid node.

list = Input()
code_block = CodeBlock { 1; }
Shift_Pattern = Input()
Reverse_Pattern = Input()
Point1 = Input()
Point2 = Input()
Point3 = Input()
buildTriangularSublists = Custom[Build Triangular Sublists](list=list, offset=code_block, shift=Shift_Pattern, reverse=Reverse_Pattern, index0=Point1, index1=Point2, index2=Point3)  # "Panelling.BuildTriangularSublists"; Creates sublists of three items each from a list based on given indices, shift and reverse settings and offset.
V = Input()
# note: Unclutter
dropLastRowAndColumn = Custom[Drop Last Row & Column From UV Field](list=buildTriangularSublists, V=V)  # "Panelling.DropLastRowAndColumn"; Drops the last row and column from a UV field
list_2 = Output(dropLastRowAndColumn)  # "list"
