# Dynamo custom node PerspectiveView.OrientToEyeAndTargetPosition.dyf (Dynamo 0.7.5.3566)
# category: Clockwork.Revit.Views.PerspectiveView.Actions
# Sets the orientation of a given perspective view based on a given eye and target position

View = Input()
isLocked = Custom[View3D.IsLocked](View_s=View)  # Checks if a given view is locked
Eye_Position = Input()
Target_Position = Input()
code_block = CodeBlock(epos=Eye_Position, tpos=Target_Position)
# ---------- code_block.designscript (5 lines) ----------
v1 = Vector.ByTwoPoints(epos,tpos).Normalized();
zvec = Vector.ZAxis();
p3 = tpos.Add(zvec);
n = Plane.ByThreePoints(epos,tpos,p3).Normal;
v1.Rotate(n,90);
# ----------------------------------------
correctOrientation = Custom[Normal.CorrectOrientation](a=code_block.out4, b=code_block.zvec)  # Inverts normal A if its inversion is closer to normal B
python_script = Python(IN[0]=View, IN[1]=Eye_Position, IN[2]=correctOrientation, IN[3]=code_block.v1)
# ---------- python_script.python (27 lines) ----------
import clr
clr.AddReference('RevitAPI')
from Autodesk.Revit.DB import *

clr.AddReference("RevitNodes")
import Revit
clr.ImportExtensions(Revit.Elements)
clr.ImportExtensions(Revit.GeometryConversion)

clr.AddReference("RevitServices")
import RevitServices
from RevitServices.Persistence import DocumentManager
from RevitServices.Transactions import TransactionManager

doc = DocumentManager.Instance.CurrentDBDocument
view = UnwrapElement(IN[0])
eyeposition = IN[1].ToXyz()
updirection = IN[2].ToXyz()
forwarddirection = IN[3].ToXyz()

TransactionManager.Instance.EnsureInTransaction(doc)
newVO = ViewOrientation3D(eyeposition, updirection, forwarddirection)
view.SetOrientation(newVO)
view.SaveOrientation()
TransactionManager.Instance.TransactionTaskDone()

OUT = view
# ----------------------------------------
code_block_2 = CodeBlock(islocked=isLocked, view=python_script) { islocked ? "The view is locked..." : view; }
View_2 = Output(code_block_2)  # "View"
