# Dynamo custom node Plane.ByFirst3Points.dyf (Dynamo 0.7.5.3566)
# category: Clockwork.Geometry.Plane.Create
# Returns a plane, its origin and its normal based on the first three XYZs in a given list

list = Input()
code_block = CodeBlock(seq=list) { points = List.TakeItems(seq,3); Plane.ByBestFitThroughPoints(points); }
plane = Output(code_block.out1)
