# Dynamo custom node Point.Average.dyf (Dynamo 0.7.5.3566)
# category: Clockwork.Geometry.Point.Query
# Determines the average of a list of points

Points = Input()
code_block = CodeBlock(pts=Points) { Point.ByCoordinates(Math.Average(pts.X),Math.Average(pts.Y),Math.Average(pts.Z)); }
Point = Output(code_block)
