# Dynamo custom node Point.CentralProjectionOnFace.dyf (Dynamo 0.7.5.3342)
# category: Clockwork.Geometry.Point.Actions
# Projects a list of points onto a given face

Central_Projection_Point = Input()
Points_to_be_projected = Input()
Face = Input()
code_block = CodeBlock(center=Central_Projection_Point, plist=Points_to_be_projected, surf=Face) { dir = Vector.ByTwoPoints(center,plist); surf.ProjectInputOnto(plist,dir); }
Projected_points = Output(code_block.out1)
