# Dynamo custom node PointSequence.AccumulatedDistance.dyf (Dynamo 0.7.5.3566)
# category: Clockwork.Geometry.PointSequence.Query
# Retrieves the accumulated distances of a sequence of points

Points = Input()
code_block = CodeBlock(plist=Points)
# ---------- code_block.designscript (6 lines) ----------
plist2 = Flatten(plist);
n = List.Count(plist2);
pseq1 = List.TakeItems(plist2,n-1);
pseq2 = List.RestOfItems(plist2);
dist = Math.Sum(pseq1.DistanceTo(pseq2));
n < 2 ? 0 : dist;
# ----------------------------------------
Distance = Output(code_block.out5)
