# Dynamo custom node PointSequence.ContainsOutOfPlanePoints.dyf (Dynamo 0.7.5.3566)
# category: Clockwork.Geometry.Point.Query
# Checks a list for XYZs that are not located on a given plane

list = Input()
face_plane = Input()  # "face/plane"
isOutOfPlane = Custom[XYZ Is Out-Of-Plane](Face_Plane=face_plane)  # "Point.IsOutOfPlane"; Checks a list for XYZs that are not located on a given plane
map = List.Map(list, isOutOfPlane.bool)
true_for_any_booleans = Custom[True For Any (Boolean)](seq=map)  # Returns true if any item in a list of booleans is true.
bool = Output(true_for_any_booleans)
map_2 = List.Map(list, isOutOfPlane.amount)
maximumItem = List.MaximumItem(map_2)
max = Output(maximumItem)
