# Dynamo custom node ReturnListOrSingleValue.dyf (Dynamo 0.7.5.3566)
# category: Clockwork.Core.Logic.Conditional.Actions
# If the item in input #1 is not a list, only the first item of the list in input #2 will be returned.

item_1_unknown = Input()  # "item #1 (unknown)"
item_2_list = Input()  # "item #2 (list)"
python_script = Python(IN[0]=item_1_unknown, IN[1]=item_2_list)
# ---------- python_script.python (4 lines) ----------
check = IN[0]
items = IN[1]
if isinstance(check, (list)): OUT = items
else: OUT = items[0]
# ----------------------------------------
Output = Output(python_script)  # ""
