# Dynamo custom node RevitColor.FromDynamoColor.dyf (Dynamo 0.7.5.3437)
# category: Clockwork.Revit.Elements.Color.Create
# Creates a Revit color from a Dynamo color

Dynamo_Color_s = Input()  # "Dynamo Color(s)"
turn_into_list = Custom[Turn Into List](item=Dynamo_Color_s)  # Turns an element (or a nested list) into a flat list
red = Color.Red(turn_into_list)
green = Color.Green(turn_into_list)
blue = Color.Blue(turn_into_list)
python_script = Python(IN[0]=red, IN[1]=green, IN[2]=blue)
# ---------- python_script.python (28 lines) ----------
import clr
clr.AddReference('RevitAPI')
from Autodesk.Revit.DB import *
from Autodesk.Revit import *

clr.AddReference("RevitServices")
import RevitServices
from RevitServices.Persistence import DocumentManager
from RevitServices.Transactions import TransactionManager

doc = DocumentManager.Instance.CurrentDBDocument
#uiapp = DocumentManager.Instance.CurrentUIApplication
#app = uiapp.Application
appcreation = Creation.Application
r = IN[0]
g = IN[1]
b = IN[2]
counter = 0
elementlist = list()

TransactionManager.Instance.EnsureInTransaction(doc)
for red in r:
	newcolor = Color(red,g[counter],b[counter])
	elementlist.append(newcolor)
	counter += 1
TransactionManager.Instance.TransactionTaskDone()

OUT = elementlist
# ----------------------------------------
returnListOrSingleValue = Custom[ReturnListOrSingleValue](item_1_unknown=Dynamo_Color_s, item_2_list=python_script)  # If the item in input #1 is not a list, only the first item of the list in input #2 will be returned.
Revit_Color_s = Output(returnListOrSingleValue)  # "Revit Color(s)"
