# Dynamo custom node RevitColor.ToDynamoColor.dyf (Dynamo 0.7.2.3911)
# category: Clockwork.Revit.Elements.Color.Query
# Converts Revit colors into Dynamo colors

item = Input()
turn_into_list = Custom[Turn Into List](item=item)  # Turns an element (or a nested list) into a flat list
python_script = Python(IN[0]=turn_into_list)
# ---------- python_script.python (14 lines) ----------
import clr
clr.AddReference('RevitAPI')
from Autodesk.Revit.DB import *

colors = UnwrapElement(IN[0])
rlist = list()
glist = list()
blist = list()

for color in colors:
	rlist.append(color.Red)
	glist.append(color.Green)
	blist.append(color.Blue)
OUT = (rlist,glist,blist)
# ----------------------------------------
code_block = CodeBlock(seq=python_script) { Color.ByARGB(0,seq[0],seq[1],seq[2]); }
return_list_or_single_value = Custom[Return List Or Single Value](list_1=turn_into_list, list_2=code_block)  # If the list in input #1 only contains one item, only the first item of the list in input #2 will be returned.
Output = Output(return_list_or_single_value)  # ""
