# Dynamo custom node Roof.CreationMethod.dyf (Dynamo 0.7.2.26223)
# category: Clockwork.Revit.Elements.Roof.Query.CreationMethod
# Retrieves the creation method of a given roof

Roof_Instance_s = Input()  # "Roof Instance(s)"
turn_into_list = Custom[Turn Into List](item=Roof_Instance_s)  # Turns an element (or a nested list) into a flat list
python_script = Python(IN[0]=turn_into_list)
# ---------- python_script.python (21 lines) ----------
import clr
clr.AddReference('RevitAPI')
from Autodesk.Revit.DB import *

roofinstances = UnwrapElement(IN[0])
elementlist = list()
for item in roofinstances:
	try:
		if item.GetType().Name == 'FootPrintRoof':
			elementlist.append('By Footprint')
		elif item.GetType().Name == 'ExtrusionRoof':
			elementlist.append('By Extrusion')
		elif item.GetType().Name == 'RoofBase':
			elementlist.append('By Face')
		elif item.GetType().Name == 'FamilyInstance':
			elementlist.append('In-Place')
		else:
			elementlist.append('No Roof')
	except:
		elementlist.append('No Roof')
OUT = elementlist
# ----------------------------------------
return_list_or_single_value = Custom[Return List Or Single Value](list_1=turn_into_list, list_2=python_script)  # If the list in input #1 only contains one item, only the first item of the list in input #2 will be returned.
Creation_method_s = Output(return_list_or_single_value)  # "Creation method(s)"
