# Dynamo custom node Roof.Kind.dyf (Dynamo 0.7.2.26223)
# category: CAAD_RWTH.Revit.Elements.Roof.Query.Kind
# Retrieves the roof kind (Basic, Glazed, Other). PLEASE NOTE: Roofs that were created by face will be identified as 'Other'

Roof_Instance_s = Input()  # "Roof Instance(s)"
turn_into_list = Custom[Turn Into List](item=Roof_Instance_s)  # Turns an element (or a nested list) into a flat list
python_script = Python(IN[0]=turn_into_list)
# ---------- python_script.python (15 lines) ----------
import clr
clr.AddReference('RevitAPI')
from Autodesk.Revit.DB import *

items = UnwrapElement(IN[0])
elementlist = list()
for item in items:
	try:
		if item.CurtainGrids:
			elementlist.append('Glazed')
		else:
			elementlist.append('Basic')
	except:
		elementlist.append('Other / No Roof')
OUT = elementlist
# ----------------------------------------
return_list_or_single_value = Custom[Return List Or Single Value](list_1=turn_into_list, list_2=python_script)  # If the list in input #1 only contains one item, only the first item of the list in input #2 will be returned.
Kind_s = Output(return_list_or_single_value)  # "Kind(s)"
