# Dynamo custom node Roof.KindIsGlazed.dyf (Dynamo 0.7.2.26223)
# category: CAAD_RWTH.Revit.Elements.Roof.Query.Kind
# Checks whether a given roof is a Glazed Roof. PLEASE NOTE: Does not work correctly for roofs that were created by face

Roof_Instance_s = Input()  # "Roof Instance(s)"
turn_into_list = Custom[Turn Into List](item=Roof_Instance_s)  # Turns an element (or a nested list) into a flat list
python_script = Python(IN[0]=turn_into_list)
# ---------- python_script.python (15 lines) ----------
import clr
clr.AddReference('RevitAPI')
from Autodesk.Revit.DB import *

items = UnwrapElement(IN[0])
booleans = list()
for item in items:
	try:
		if item.CurtainGrids:
			booleans.append(True)
		else:
			booleans.append(False)
	except:
		booleans.append(False)
OUT = booleans
# ----------------------------------------
return_list_or_single_value = Custom[Return List Or Single Value](list_1=turn_into_list, list_2=python_script)  # If the list in input #1 only contains one item, only the first item of the list in input #2 will be returned.
bool = Output(return_list_or_single_value)
