# Dynamo custom node Roof.Type.dyf (Dynamo 0.7.2.6209)
# category: CAAD_RWTH.Revit.Elements.Roof.Query
# Retrieves the roof type for  a given roof instance

Roof_Instance_s = Input()  # "Roof Instance(s)"
turn_into_list = Custom[Turn Into List](item=Roof_Instance_s)  # Turns an element (or a nested list) into a flat list
python_script = Python(IN[0]=turn_into_list)
# ---------- python_script.python (12 lines) ----------
import clr
clr.AddReference('RevitAPI')
from Autodesk.Revit.DB import *

roofinstances = UnwrapElement(IN[0])
elementlist = list()
for item in roofinstances:
	try:
		elementlist.append(item.RoofType)
	except:
		elementlist.append(list())
OUT = elementlist
# ----------------------------------------
return_list_or_single_value = Custom[Return List Or Single Value](list_1=turn_into_list, list_2=python_script)  # If the list in input #1 only contains one item, only the first item of the list in input #2 will be returned.
Roof_Type_s = Output(return_list_or_single_value)  # "Roof Type(s)"
