# Dynamo custom node RoofOrFloor.SlabShapeHasBeenModified.dyf (Dynamo 0.7.2.6209)
# category: CAAD_RWTH.Revit.Elements.RoofOrFloor.Query
# Checks if the shape of a roof or floor slab has been modified with the shape editing tools

Element_s = Input()  # "Element(s)"
turn_into_list = Custom[Turn Into List](item=Element_s)  # Turns an element (or a nested list) into a flat list
python_script = Python(IN[0]=turn_into_list)
# ---------- python_script.python (16 lines) ----------
import clr
clr.AddReference('RevitAPI')
from Autodesk.Revit.DB import *

items = UnwrapElement(IN[0])
elementlist = list()

for item in items:
	try: 
		if item.SlabShapeEditor.SlabShapeCreases.IsEmpty == True or item.SlabShapeEditor.SlabShapeVertices.IsEmpty == True:
			elementlist.append(False)
		else:
			elementlist.append(True)
	except:
		elementlist.append(False)
OUT = elementlist
# ----------------------------------------
return_list_or_single_value = Custom[Return List Or Single Value](list_1=turn_into_list, list_2=python_script)  # If the list in input #1 only contains one item, only the first item of the list in input #2 will be returned.
bool = Output(return_list_or_single_value)
