# Dynamo custom node Room.Boundaries.dyf (Dynamo 0.7.5.3566)
# category: Clockwork.Revit.Elements.Room.Query
# Gets a list of all boundary elements of a given room or area

Room_s = Input()  # "Room(s)"
filterByBoolMask = List.FilterByBoolMask()
turn_into_list = Custom[Turn Into List](item=Room_s)  # Turns an element (or a nested list) into a flat list
python_script = Python(IN[0]=turn_into_list)
# ---------- python_script.python (46 lines) ----------
import clr
clr.AddReference('RevitAPI')
from Autodesk.Revit.DB import *
import Autodesk

clr.AddReference("RevitNodes")
import Revit
clr.ImportExtensions(Revit.GeometryConversion)

clr.AddReference("RevitServices")
import RevitServices
from RevitServices.Persistence import DocumentManager

doc = DocumentManager.Instance.CurrentDBDocument
items = UnwrapElement(IN[0])
elementlist = list()
curvelist = list()

calculator = SpatialElementGeometryCalculator(doc)
options = Autodesk.Revit.DB.SpatialElementBoundaryOptions()
# get boundary location from area computation settings
boundloc = Autodesk.Revit.DB.AreaVolumeSettings.GetAreaVolumeSettings(doc).GetSpatialElementBoundaryLocation(SpatialElementType.Room)
options.SpatialElementBoundaryLocation = boundloc
for item in items:
	#method #1 - get boundary segments
	blist = list()
	clist = list()
	try:
		for boundarylist in item.GetBoundarySegments(options):
			for boundary in boundarylist:
				blist.append(boundary.Element)
				clist.append(boundary.Curve.ToProtoType())
	except:
		donothing = 1
	#method #2 - spatial element geometry calculator
	try:
		results = calculator.CalculateSpatialElementGeometry(item)
		for face in results.GetGeometry().Faces:
			for bface in results.GetBoundaryFaceInfo(face):
				blist.append(doc.GetElement(bface.SpatialBoundaryElement.HostElementId))
	except:
		donothing = 1	
	# write results to list
	elementlist.append(blist)
	curvelist.append(clist)
OUT = (elementlist,curvelist)
# ----------------------------------------
code_block = CodeBlock(seq=python_script) { seq[0]; seq[1]; }
isNull = Object.IsNull()
map = List.Map(code_block.out0, isNull)
combine = List.Combine(filterByBoolMask.out1, code_block.out0, map)
uniqueItems = List.UniqueItems()
map_2 = List.Map(combine, uniqueItems)
returnListOrSingleValue = Custom[ReturnListOrSingleValue](item_1_unknown=Room_s, item_2_list=map_2)  # If the item in input #1 is not a list, only the first item of the list in input #2 will be returned.
Elements = Output(returnListOrSingleValue)
returnListOrSingleValue_2 = Custom[ReturnListOrSingleValue](item_1_unknown=Room_s, item_2_list=code_block.out1)
Curves = Output(returnListOrSingleValue_2)
