# Dynamo custom node Room.DoorsOrWindows.dyf (Dynamo 0.7.5.3566)
# category: Clockwork.Revit.Elements.Room.Query
# Retrieves all doors or windows that are associated with a room (hosted in walls and roofs).

Room_s = Input()  # "Room(s)"
join = List.Join()
Doors_Windows_Category = Input()  # "Doors/Windows (Category)"
all_elements_of_category = ElementsOfCategory(Doors_Windows_Category)
flatten = Flatten(all_elements_of_category)
Phase = Input()
fromRoomAndToRoom = Custom[Room.FromDoorOrWindow](Door_s_Window_s=flatten, Phase=Phase)  # "DoorOrWindow.FromRoomAndToRoom"; Gets the rooms that are connected by a given door or a window
isEmpty = List.IsEmpty()
map = List.Map(fromRoomAndToRoom.From_Room_s, isEmpty)
isNull = Object.IsNull(map)
filterByBoolMask = List.FilterByBoolMask(flatten, isNull)
turn_into_list = Custom[Turn Into List](item=Room_s)  # Turns an element (or a nested list) into a flat list
count = List.Count(turn_into_list)
ofRepeatedItem = List.OfRepeatedItem(filterByBoolMask, count)
uniqueId = Element.UniqueId(turn_into_list)
fromRoomAndToRoom_2 = Custom[Room.FromDoorOrWindow](Door_s_Window_s=filterByBoolMask, Phase=Phase)  # "DoorOrWindow.FromRoomAndToRoom"
uniqueId_2 = Element.UniqueId(fromRoomAndToRoom_2.From_Room_s)
eq = uniqueId == uniqueId_2  # lacing=CrossProduct
filterByBoolMask_2 = List.FilterByBoolMask(ofRepeatedItem, eq)
map_2 = List.Map(fromRoomAndToRoom.To_Room_s, isEmpty)
isNull_2 = Object.IsNull(map_2)
filterByBoolMask_3 = List.FilterByBoolMask(flatten, isNull_2)
ofRepeatedItem_2 = List.OfRepeatedItem(filterByBoolMask_3, count)
fromRoomAndToRoom_3 = Custom[Room.FromDoorOrWindow](Door_s_Window_s=filterByBoolMask_3, Phase=Phase)  # "DoorOrWindow.FromRoomAndToRoom"
uniqueId_3 = Element.UniqueId(fromRoomAndToRoom_3.To_Room_s)
eq_2 = uniqueId == uniqueId_3  # lacing=CrossProduct
filterByBoolMask_4 = List.FilterByBoolMask(ofRepeatedItem_2, eq_2)
combine = List.Combine(join, filterByBoolMask_2, filterByBoolMask_4)
returnListOrSingleValue = Custom[ReturnListOrSingleValue](item_1_unknown=Room_s, item_2_list=combine)  # If the item in input #1 is not a list, only the first item of the list in input #2 will be returned.
Doors_Windows = Output(returnListOrSingleValue)  # "Doors/Windows"
