# Dynamo custom node Sheet.Schedules.dyf (Dynamo 0.7.2.3911)
# category: CAAD_RWTH.Revit.Views.Sheet.Query
# Returns all schedules placed on a specified sheet

Sheet_s = Input()  # "Sheet(s)"
turn_into_list = Custom[Turn Into List](item=Sheet_s)  # Turns an element (or a nested list) into a flat list
python_script = Python(IN[0]=turn_into_list)
# ---------- python_script.python (22 lines) ----------
import clr
clr.AddReference('RevitAPI')
from Autodesk.Revit.DB import *

clr.AddReference("RevitServices")
import RevitServices
from RevitServices.Persistence import DocumentManager

doc = DocumentManager.Instance.CurrentDBDocument
sheets = UnwrapElement(IN[0])
elementlist = list()

for sheet in sheets:
	try:
		viewlist = list()
		collector = FilteredElementCollector(doc, sheet.Id).OfClass(ScheduleSheetInstance)
		for item in collector:
			viewlist.append(doc.GetElement(item.ScheduleId))
		elementlist.append(viewlist)
	except:
		elementlist.append(list())
OUT = elementlist
# ----------------------------------------
return_list_or_single_value = Custom[Return List Or Single Value](list_1=turn_into_list, list_2=python_script)  # If the list in input #1 only contains one item, only the first item of the list in input #2 will be returned.
Schedule_s = Output(return_list_or_single_value)  # "Schedule(s)"
