# Dynamo custom node SquareMeters.ToSquareFeet.dyf (Dynamo 0.7.5.3566)
# category: Clockwork.Units.Area
# Converts square meters into square feet

m2 = Input()
code_block = CodeBlock(m2=m2) { m2/0.09290304; }
sq_ft = Output(code_block)
