# Dynamo custom node String.BinaryToDecimal.dyf (Dynamo 0.7.5.3566)
# category: Clockwork.Core.String.Actions
# Converts a string of a binary number into a decimal value

str = Input()
fromString = Custom[List.FromString](str=str)  # Chops up a string into a list of characters
toNumber = String.ToNumber(fromString)
binaryToDecimal = Custom[List.BinaryToDecimal](list=toNumber)  # Converts a list of binary (boolean) values into a decimal value
decimal = Output(binaryToDecimal)
