# Dynamo custom node StructuralFoundation.Kind.dyf (Dynamo 0.7.5.3437)
# category: Clockwork.Revit.Elements.StructuralFoundation.Query.Kind
# Retrieves the kind of a given structural foundation (isolated, wall, slab).

Struct_Found_Instance_s = Input()  # "Struct. Found. Instance(s)"
turn_into_list = Custom[Turn Into List](item=Struct_Found_Instance_s)  # Turns an element (or a nested list) into a flat list
python_script = Python(IN[0]=turn_into_list)
# ---------- python_script.python (17 lines) ----------
import clr
clr.AddReference('RevitAPI')
from Autodesk.Revit.DB import *

foundinstances = UnwrapElement(IN[0])
kindlist = list()
for item in foundinstances:
	try:
		if item.GetType().Name == 'FamilyInstance':
			kindlist.append('Isolated')
		elif item.GetType().Name == 'ContFooting':
			kindlist.append('Wall Footing')
		elif item.GetType().Name == 'Floor':
			kindlist.append('Slab')
	except:
		kindlist.append('No Foundation')
OUT = kindlist
# ----------------------------------------
returnListOrSingleValue = Custom[ReturnListOrSingleValue](item_1_unknown=Struct_Found_Instance_s, item_2_list=python_script)  # If the item in input #1 is not a list, only the first item of the list in input #2 will be returned.
bool = Output(returnListOrSingleValue)
