# Dynamo custom node StructuralFoundation.KindIsIsolated.dyf (Dynamo 0.7.2.2921)
# category: Clockwork.Revit.Elements.StructuralFoundation.Query.Kind
# Checks whether a given structural foundation is an isolated foundation

Struct_Found_Instance_s = Input()  # "Struct. Found. Instance(s)"
turn_into_list = Custom[Turn Into List](item=Struct_Found_Instance_s)  # Turns an element (or a nested list) into a flat list
python_script = Python(IN[0]=turn_into_list)
# ---------- python_script.python (15 lines) ----------
import clr
clr.AddReference('RevitAPI')
from Autodesk.Revit.DB import *

foundinstances = UnwrapElement(IN[0])
booleans = list()
for item in foundinstances:
	try:
		if item.GetType().Name == 'FamilyInstance':
			booleans.append(True)
		else':
			booleans.append(False)
	except:
		booleans.append(False)
OUT = booleans
# ----------------------------------------
returnListOrSingleValue = Custom[ReturnListOrSingleValue](item_1_unknown=Struct_Found_Instance_s, item_2_list=python_script)  # If the item in input #1 is not a list, only the first item of the list in input #2 will be returned.
bool = Output(returnListOrSingleValue)
