# Dynamo custom node Surface.FilterByOrientation.dyf (Dynamo 0.7.5.3566)
# category: Clockwork.Geometry.Surface.Actions
# Sorts surfaces in three lists based on their orientation (vertical, horizontal up & horizontal down) and also returns three corresponding lists of booleans.

Face_s = Input()  # "Face(s)"
turn_into_list = Custom[Turn Into List](item=Face_s)  # Turns an element (or a nested list) into a flat list
almostZero = Custom[Math.AlmostZero]()  # Returns a feasable computational tolerance to zero (1.0e-9 or a billionth of 1) for use in calculations. More background info: https://github.com/ikeough/Dynamo/issues/879
ZAxisNegative = Custom[Vector.ZAxisNegative]()  # Returns an XYZ of 0,0,-1
code_block = CodeBlock(surf=turn_into_list, almostzero=almostZero, ZNeg=ZAxisNegative)
# ---------- code_block.designscript (11 lines) ----------
vec = surf.NormalAtParameter(0.5,0.5);
z = vec.Z;
// Vertical
mask1 = z >= (0 - almostzero) && z <= (0 + almostzero);
List.FilterByBoolMask(surf,mask1)["in"];
// Horizontal up
mask2 = vec.IsAlmostEqualTo(Vector.ZAxis());
List.FilterByBoolMask(surf,mask2)["in"];
// Horizontal down
mask3 = vec.IsAlmostEqualTo(ZNeg);
List.FilterByBoolMask(surf,mask3)["in"];
# ----------------------------------------
returnListOrSingleValue = Custom[ReturnListOrSingleValue](item_1_unknown=Face_s, item_2_list=code_block.out3)  # If the item in input #1 is not a list, only the first item of the list in input #2 will be returned.
Vertical = Output(returnListOrSingleValue)
returnListOrSingleValue_2 = Custom[ReturnListOrSingleValue](item_1_unknown=Face_s, item_2_list=code_block.mask1)
IsVertical = Output(returnListOrSingleValue_2)
returnListOrSingleValue_3 = Custom[ReturnListOrSingleValue](item_1_unknown=Face_s, item_2_list=code_block.out5)
Horizontal_Up = Output(returnListOrSingleValue_3)
returnListOrSingleValue_4 = Custom[ReturnListOrSingleValue](item_1_unknown=Face_s, item_2_list=code_block.mask2)
IsHorizontalUp = Output(returnListOrSingleValue_4)
returnListOrSingleValue_5 = Custom[ReturnListOrSingleValue](item_1_unknown=Face_s, item_2_list=code_block.out7)
Horizontal_Down = Output(returnListOrSingleValue_5)
returnListOrSingleValue_6 = Custom[ReturnListOrSingleValue](item_1_unknown=Face_s, item_2_list=code_block.mask3)
IsHorizontalDown = Output(returnListOrSingleValue_6)
