# Dynamo custom node Surface.Vertices.dyf (Dynamo 0.7.5.3566)
# category: Clockwork.Geometry.Surface.Query
# Returns all vertices of a given surface

Surface_s = Input()  # "Surface(s)"
turn_into_list = Custom[Turn Into List](item=Surface_s)  # Turns an element (or a nested list) into a flat list
code_block = CodeBlock(surf=turn_into_list) { surf.PerimeterCurves().StartPoint; }
returnListOrSingleValue = Custom[ReturnListOrSingleValue](item_1_unknown=Surface_s, item_2_list=code_block)  # If the item in input #1 is not a list, only the first item of the list in input #2 will be returned.
Vertices = Output(returnListOrSingleValue)
