# Dynamo custom node TextNote.ByStringAndPosition.dyf (Dynamo 0.7.3.3034)
# category: Clockwork.Revit.Elements.TextNote.Create
# Creates a text note at a given location

Point_s = Input()  # "Point(s)"
View = Input()
turn_into_list = Custom[Turn Into List](item=Point_s)  # Turns an element (or a nested list) into a flat list
BaseVector_s = Input()  # "BaseVector(s)"
turn_into_list_2 = Custom[Turn Into List](item=BaseVector_s)
UpVector_s = Input()  # "UpVector(s)"
turn_into_list_3 = Custom[Turn Into List](item=UpVector_s)
String_s = Input()  # "String(s)"
turn_into_list_4 = Custom[Turn Into List](item=String_s)
create = List.Create(turn_into_list, turn_into_list_2, turn_into_list_3, turn_into_list_4)
equalSublistLengths = Custom[List.EqualSublistLengths](lists=create)  # Trims all given lists to the length of the shortest list
code_block = CodeBlock(seq=equalSublistLengths) { seq[0]; seq[1]; seq[2]; seq[3]; }
python_script = Python(IN[0]=View, IN[1]=code_block.out0, IN[2]=code_block.out1, IN[3]=code_block.out2, IN[4]=code_block.out3)
# ---------- python_script.python (32 lines) ----------
import clr
clr.AddReference('RevitAPI')
from Autodesk.Revit.DB import *

clr.AddReference("RevitNodes")
import Revit
clr.ImportExtensions(Revit.GeometryConversion)

clr.AddReference("RevitServices")
import RevitServices
from RevitServices.Persistence import DocumentManager
from RevitServices.Transactions import TransactionManager

doc = DocumentManager.Instance.CurrentDBDocument
view = UnwrapElement(IN[0])
xyzlist = [x.ToXyz() for x in IN[1]]
basevecs = [x.ToXyz() for x in IN[2]]
upvecs = [x.ToXyz() for x in IN[3]]
text = IN[4]
doccreation = doc.Create
counter = 0
textalign = TextAlignFlags.TEF_ALIGN_LEFT
elementlist = list()

TransactionManager.Instance.EnsureInTransaction(doc)
for xyz in xyzlist:
	newtextnote = doccreation.NewTextNote(view,xyz,basevecs[counter],upvecs[counter],0,textalign,text[counter])
	elementlist.append(newtextnote)
	counter += 1
TransactionManager.Instance.TransactionTaskDone()

OUT = elementlist
# ----------------------------------------
returnListOrSingleValue = Custom[ReturnListOrSingleValue](item_1_unknown=Point_s, item_2_list=python_script)  # If the item in input #1 is not a list, only the first item of the list in input #2 will be returned.
Text_Note_s = Output(returnListOrSingleValue)  # "Text Note(s)"
