# Dynamo custom node Topography.IntersectionWithPlane.dyf (Dynamo 0.7.3.3034)
# category: Clockwork.Revit.Elements.Topography.Actions
# Calculates the intersection of a toposurface and a plane

Plane = Input()
Topo = Input()
mesh = Topography.Mesh(Topo)
intersectionWithPlane = Custom[Mesh.IntersectionWithPlane](Plane=Plane, Mesh=mesh)  # Calculates the intersection of a mesh and a plane
Points = Output(intersectionWithPlane.Points)
PolyCurve = Output(intersectionWithPlane.PolyCurve)
NurbsCurve_by_points = Output(intersectionWithPlane.NurbsCurve_by_points)  # "NurbsCurve (by points)"
NurbsCurve_by_control_points = Output(intersectionWithPlane.NurbsCurve_by_control_points)  # "NurbsCurve (by control points)"
