# Dynamo custom node Topography.IsSubregion.dyf (Dynamo 0.7.2.2921)
# category: Clockwork.Revit.Elements.Topography.Query
# Filters out everything that is *not* a topo subregion. Needs Revit 2014 or newer to work.

Toposurface_s = Input()  # "Toposurface(s)"
turn_into_list = Custom[Turn Into List](item=Toposurface_s)  # Turns an element (or a nested list) into a flat list
python_script = Python(IN[0]=turn_into_list)
# ---------- python_script.python (15 lines) ----------
import clr
clr.AddReference('RevitAPI')
from Autodesk.Revit.DB import *

topos = UnwrapElement(IN[0])
booleans = list()
for item in topos:
	try:
		if item.IsSiteSubRegion:
			booleans.append(True)
		else:
			booleans.append(False)
	except:
		booleans.append(False)
OUT = booleans
# ----------------------------------------
returnListOrSingleValue = Custom[Return List Or Single Value](list_1=turn_into_list, list_2=python_script)  # If the list in input #1 only contains one item, only the first item of the list in input #2 will be returned.
bool = Output(returnListOrSingleValue)
