# Dynamo custom node UV.Average.dyf (Dynamo 0.7.4.3245)
# category: Clockwork.Geometry.UV.Query
# Determines the average of a list of UVs

UVs = Input()
code_block = CodeBlock(uvlist=UVs) { UV.ByCoordinates(Math.Average(uvlist.U),Math.Average(uvlist.V)); }
UV = Output(code_block)
