# Dynamo custom node UV.IsInsidePolygon.dyf (Dynamo 0.7.2.6209)
# category: CAAD_RWTH.Geometry.UV.Query
# Determines if a point is inside the space enclosed by a polygon

Polygon_UVs = Input()
Point_UV_s = Input()  # "Point UV(s)"
code_block = CodeBlock(poly=Polygon_UVs, points=Point_UV_s) { List.Transpose({poly.U,poly.V}); List.Transpose({points.U,points.V}); }
python_script = Python(IN[0]=code_block.out0, IN[1]=code_block.out1)
# ---------- python_script.python (29 lines) ----------
import clr

# script found here:
# http://www.ariel.com.au/a/python-point-int-poly.html
# (with sight alterations for booleans)

def point_inside_polygon(x,y,poly):
    n = len(poly)
    inside = 0
    p1x,p1y = poly[0]
    for i in range(n+1):
        p2x,p2y = poly[i % n]
        if y > min(p1y,p2y):
            if y <= max(p1y,p2y):
                if x <= max(p1x,p2x):
                    if p1y != p2y:
                        xinters = (y-p1y)*(p2x-p1x)/(p2y-p1y)+p1x
                    if p1x == p2x or x <= xinters:
                        inside = 1 - inside
        p1x,p1y = p2x,p2y
    if inside == 1: return True
    else: return False
    
poly = IN[0]
points = IN[1]
elementlist = list()
for point in points:
	elementlist.append(point_inside_polygon(point[0],point[1],poly))
OUT = elementlist
# ----------------------------------------
return_list_or_single_value = Custom[Return List Or Single Value](list_1=code_block.out1, list_2=python_script)  # If the list in input #1 only contains one item, only the first item of the list in input #2 will be returned.
bool = Output(return_list_or_single_value)
