# Dynamo custom node UV.Swap.dyf (Dynamo 0.7.2.2921)
# category: Clockwork.Geometry.UV.Actions
# Swaps U and V coordinates

UV_s = Input()  # "UV(s)"
code_block = CodeBlock(seq=UV_s) { UV.ByCoordinates(seq.V,seq.U); }
UV_s_2 = Output(code_block)  # "UV(s)"
