# Dynamo custom node Vector.AltitudeAndAzimuth.dyf "Altitude And Azimuth From Vector" (Dynamo 0.7.2.6209)
# category: CAAD_RWTH.Geometry.Vector.Query
# Computes the altitude and azimuth of a given vector

vector_zaxis_negative = Custom[Z Axis (Negative)]()  # Returns an XYZ of 0,0,-1
Vector = Input()
code_block = CodeBlock(sundir=Vector)
# ---------- code_block.designscript (8 lines) ----------
// Turn normalized vector into point
vec = sundir.Normalized().AsPoint();
vec.X;
vec.Z;
Point.Origin();
Vector.YAxis().AsPoint();
// Project point to XY plane
Point.ByCoordinates(vec.X,vec.Y);
# ----------------------------------------
solve_triangle_by_xyzs = Custom[Solve Triangle By XYZs](XYZ_A=code_block.vec, XYZ_B=code_block.out3, XYZ_C=code_block.out5)  # Solves a triangle based on the XYZ coordinates of its vertices.
solve_triangle_by_xyzs_2 = Custom[Solve Triangle By XYZs](XYZ_A=code_block.out5, XYZ_B=code_block.out3, XYZ_C=code_block.out4)
code_block_2 = CodeBlock(zan=vector_zaxis_negative, vec=code_block.vec, z=code_block.out2, x=solve_triangle_by_xyzs.beta, vx=code_block.out1, a=solve_triangle_by_xyzs_2.beta)
# ---------- code_block_2.designscript (6 lines) ----------
cond1 = zan.AsPoint().IsAlmostEqualTo(vec);
zdir = z < 0 ? -x : x;
res1 = cond1 ? -90 : zdir;
cond2 = Vector.ZAxis().AsPoint().IsAlmostEqualTo(vec);
cond2 ? 90 : res1;
vx < 0 ? 360-a : a;
# ----------------------------------------
Altitude = Output(code_block_2.out4)
Azimuth = Output(code_block_2.out5)
