# Dynamo custom node Vector.Average.dyf (Dynamo 0.7.4.3245)
# category: Clockwork.Geometry.Vector.Query
# Determines the average vector of a list of vectors

Vectors = Input()
code_block = CodeBlock(v=Vectors) { vn = v.Normalized(); Vector.ByCoordinates(Math.Average(vn.X),Math.Average(vn.Y),Math.Average(vn.Z),true); }
Vector = Output(code_block.out1)
