# Dynamo custom node Vector.IsParallelToPlane.dyf (Dynamo 0.7.2.2921)
# category: Clockwork.Geometry.Vector.Query
# Checks if a given vector is parallel to a given plane

Vector = Input()
Plane = Input()
normal = Plane.Normal(Plane)
isOrthogonalToVector = Custom[Vector.IsOrthogonalToVector](Vector_1=Vector, Vector_2=normal)  # Checks if two vectors are orthogonal to each other
bool = Output(isOrthogonalToVector)
