# Dynamo custom node Vector.PruneDuplicates.dyf (Dynamo 0.7.3.3034)
# category: Clockwork.Geometry.Vector.Actions
# Prune vectors to exclude duplicates within a given tolerance

vector = Input()
asPoint = Vector.AsPoint(vector)
tolerance = Input()
pruneDuplicates = Point.PruneDuplicates(asPoint, tolerance)
asVector = Point.AsVector(pruneDuplicates)
Vector = Output(asVector)
