# Dynamo custom node View.DetailLevelIsMedium.dyf (Dynamo 0.7.2.26223)
# category: Clockwork.Revit.Views.View.Query.DetailLevel
# Checks whether the detail level of a given view is 'Medium'

View_s = Input()  # "View(s)"
turn_into_list = Custom[Turn Into List](item=View_s)  # Turns an element (or a nested list) into a flat list
python_script = Python(IN[0]=turn_into_list)
# ---------- python_script.python (15 lines) ----------
import clr
clr.AddReference('RevitAPI')
from Autodesk.Revit.DB import *

views = UnwrapElement(IN[0])
booleans = list()
for view in views:
	try:
		if str(view.DetailLevel) == 'Medium':
			booleans.append(True)
		else:
			booleans.append(False)
	except:
		booleans.append(False)
OUT = booleans
# ----------------------------------------
return_list_or_single_value = Custom[Return List Or Single Value](list_1=turn_into_list, list_2=python_script)  # If the list in input #1 only contains one item, only the first item of the list in input #2 will be returned.
bool = Output(return_list_or_single_value)
