# Dynamo custom node View.PermanentlyIsolateElement.dyf (Dynamo 0.7.2.3911)
# category: Clockwork.Revit.Views.View.Actions
# (Permanently) isolates elements in the given view

View = Input()
Element_s = Input()  # "Element(s)"
temporarilyIsolateElement = Custom[View.TemporarilyIsolateElement](View=View, Element_s=Element_s)  # (Temporarily) isolates elements in the given view
convertTemporaryHideIsolateToPermanent = Custom[View.ConvertTemporaryHideIsolateToPermanent](View=temporarilyIsolateElement.View)  # Convert all temporary hidden elements or categories to permanently hidden in the given view.
View_2 = Output(convertTemporaryHideIsolateToPermanent)  # "View"
Element_s_2 = Output(temporarilyIsolateElement.Element_s)  # "Element(s)"
