# Dynamo custom node View.ViewTemplate.dyf (Dynamo 0.7.2.3911)
# category: Clockwork.Revit.Views.View.Query
# Returns the view template assigned to a given view (if one is assigned)

View_s = Input()  # "View(s)"
turn_into_list = Custom[Turn Into List](item=View_s)  # Turns an element (or a nested list) into a flat list
python_script = Python(IN[0]=turn_into_list)
# ---------- python_script.python (18 lines) ----------
import clr
clr.AddReference('RevitAPI')
from Autodesk.Revit.DB import *

clr.AddReference("RevitServices")
import RevitServices
from RevitServices.Persistence import DocumentManager

doc = DocumentManager.Instance.CurrentDBDocument
views = UnwrapElement(IN[0])
elementlist = list()

for view in views:
	if view.ViewTemplateId.IntegerValue == -1:
		elementlist.append(list())
	else:
		elementlist.append(doc.GetElement(view.ViewTemplateId))
OUT = elementlist
# ----------------------------------------
return_list_or_single_value = Custom[Return List Or Single Value](list_1=turn_into_list, list_2=python_script)  # If the list in input #1 only contains one item, only the first item of the list in input #2 will be returned.
View_Templates_s = Output(return_list_or_single_value)  # "View Templates(s)"
