# Dynamo custom node Wall.CreationMethod.dyf (Dynamo 0.7.2.3911)
# category: CAAD_RWTH.Revit.Elements.Wall.Query.CreationMethod
# Retrieves the creation method of a given wall

Wall_Instance_s = Input()  # "Wall Instance(s)"
turn_into_list = Custom[Turn Into List](item=Wall_Instance_s)  # Turns an element (or a nested list) into a flat list
python_script = Python(IN[0]=turn_into_list)
# ---------- python_script.python (23 lines) ----------
import clr
clr.AddReference('RevitAPI')
from Autodesk.Revit.DB import *

clr.AddReference("RevitNodes")
import Revit
clr.ImportExtensions(Revit.Elements)

wallinstances = UnwrapElement(IN[0])
methodlist = list()
for item in wallinstances:
	try:
		if item.GetType().Name == 'Wall':
			methodlist.append('Standard')
		elif item.GetType().Name == 'FaceWall':
			methodlist.append('By Face')
		elif item.GetType().Name == 'FamilyInstance':
			methodlist.append('In-Place')
		else:
			methodlist.append('No Wall')
	except:
		methodlist.append('No Wall')
OUT = methodlist
# ----------------------------------------
return_list_or_single_value = Custom[Return List Or Single Value](list_1=turn_into_list, list_2=python_script)  # If the list in input #1 only contains one item, only the first item of the list in input #2 will be returned.
Creation_method_s = Output(return_list_or_single_value)  # "Creation method(s)"
