# Dynamo custom node Wall.CreationMethodIsInPlace.dyf (Dynamo 0.7.2.3911)
# category: Clockwork.Revit.Elements.Wall.Query.CreationMethod
# Checks if a given wall was created as an in-place family

Wall_Instance_s = Input()  # "Wall Instance(s)"
turn_into_list = Custom[Turn Into List](item=Wall_Instance_s)  # Turns an element (or a nested list) into a flat list
python_script = Python(IN[0]=turn_into_list)
# ---------- python_script.python (19 lines) ----------
import clr
clr.AddReference('RevitAPI')
from Autodesk.Revit.DB import *

clr.AddReference("RevitNodes")
import Revit
clr.ImportExtensions(Revit.Elements)

wallinstances = UnwrapElement(IN[0])
booleans = list()
for item in wallinstances:
	try:
		if item.GetType().Name == 'FamilyInstance':
			booleans.append(True)
		else:
			booleans.append(False)
	except:
		booleans.append(False)
OUT = booleans
# ----------------------------------------
return_list_or_single_value = Custom[Return List Or Single Value](list_1=turn_into_list, list_2=python_script)  # If the list in input #1 only contains one item, only the first item of the list in input #2 will be returned.
bool = Output(return_list_or_single_value)
