# Dynamo custom node Wall.Orientation.dyf (Dynamo 0.7.2.3911)
# category: Clockwork.Revit.Elements.Wall.Query
# Gets the orientation of a given wall instance (normal of the exterior face of the wall). Will *not* work for walls hosted on mass faces or in-place walls.

Wall_Instance_s = Input()  # "Wall Instance(s)"
turn_into_list = Custom[Turn Into List](item=Wall_Instance_s)  # Turns an element (or a nested list) into a flat list
python_script = Python(IN[0]=turn_into_list)
# ---------- python_script.python (17 lines) ----------
import clr
clr.AddReference('RevitAPI')
from Autodesk.Revit.DB import *

clr.AddReference("RevitNodes")
import Revit
clr.ImportExtensions(Revit.Elements)
clr.ImportExtensions(Revit.GeometryConversion)

wallinstances = UnwrapElement(IN[0])
vectorlist = list()
for item in wallinstances:
	try:
		vectorlist.append(item.Orientation.ToVector())
	except:
		vectorlist.append(list())
OUT = vectorlist
# ----------------------------------------
return_list_or_single_value = Custom[Return List Or Single Value](list_1=turn_into_list, list_2=python_script)  # If the list in input #1 only contains one item, only the first item of the list in input #2 will be returned.
Normal_s = Output(return_list_or_single_value)  # "Normal(s)"
