# Dynamo custom node WallType.Kind.dyf (Dynamo 0.7.2.3911)
# category: CAAD_RWTH.Revit.Elements.WallType.Query.Kind
# Retrieves the wall kind of a given wall type

Wall_Type_s = Input()  # "Wall Type(s)"
turn_into_list = Custom[Turn Into List](item=Wall_Type_s)  # Turns an element (or a nested list) into a flat list
python_script = Python(IN[0]=turn_into_list)
# ---------- python_script.python (12 lines) ----------
import clr
clr.AddReference('RevitAPI')
from Autodesk.Revit.DB import *

walltypes = UnwrapElement(IN[0])
kindlist = list()
for item in walltypes:
	try: 
		kindlist.append(str(item.Kind))
	except:
		kindlist.append('No Wall')
OUT = kindlist
# ----------------------------------------
return_list_or_single_value = Custom[Return List Or Single Value](list_1=turn_into_list, list_2=python_script)  # If the list in input #1 only contains one item, only the first item of the list in input #2 will be returned.
Kind_s = Output(return_list_or_single_value)  # "Kind(s)"
