# Dynamo custom node XYZAxis.FromVector.dyf (Dynamo 0.7.5.3566)
# category: Clockwork.Geometry.Vector.Create
# Returns whichever main axis (X, Y or Z) is closest to a given vector

Vector = Input()
code_block = CodeBlock(vec=Vector)
# ---------- code_block.designscript (5 lines) ----------
cond1 = Math.Abs(vec.Y) > Math.Abs(vec.X) && Math.Abs(vec.Y) > Math.Abs(vec.Z);
cond2 = Math.Abs(vec.X) > Math.Abs(vec.Y) && Math.Abs(vec.X) > Math.Abs(vec.Z);
Vector.XAxis();
Vector.ZAxis();
Vector.ZAxis();
# ----------------------------------------
formula = Formula("if(cond1,[trueval],[falseval])", cond1=code_block.cond1, trueval=code_block.out3, falseval=code_block.out4)
formula_2 = Formula("if(cond2,[trueval],[falseval])", cond2=code_block.cond2, trueval=code_block.out2, falseval=formula)
XYZ_Axis = Output(formula_2)
