# Dynamo custom node Category.Subcategories.dyf (Dynamo 0.8.2.2392)
# category: Clockwork.Revit.Elements.Category.Query
# Retrieves all the subcategories for a given category

category = Input()
turnIntoList = Custom[Turn Into List](category)  # Turns an element (or a nested list) into a flat list
python_script = Python(IN[0]=turnIntoList)
# ---------- python_script.python (13 lines) ----------
import clr
clr.AddReference('RevitAPI')
from Autodesk.Revit.DB import *

cats = UnwrapElement(IN[0])
elementlist = list()

for cat in cats:
	try:
		elementlist.append(cat.SubCategories)
	except:
		elementlist.append(list())
OUT = elementlist
# ----------------------------------------
returnListOrSingleValue = Custom[ReturnListOrSingleValue](unknownItem=category, seq=python_script)  # If the item in input #1 is not a list, only the first item of the list in input #2 will be returned.
subcategories = Output(returnListOrSingleValue)
