# Dynamo custom node ElementType.Duplicate.dyf (Dynamo 0.8.2.2392)
# category: Clockwork.Revit.Elements.ElementType.Actions
# Duplicates an element type

elementType = Input()
turn_into_list = Custom[Turn Into List](elementType)  # Turns an element (or a nested list) into a flat list
name = Input(name : string)
turn_into_list_2 = Custom[Turn Into List](name)
code_block = CodeBlock(types=turn_into_list, names=turn_into_list_2) { {types,names}; }
equalSublistLengths = Custom[List.EqualSublistLengths](lists=code_block)  # Trims all given lists to the length of the shortest list
code_block_2 = CodeBlock(seq=equalSublistLengths) { seq[0]; seq[1]; }
python_script = Python(IN[0]=code_block_2.out0, IN[1]=code_block_2.out1)
# ---------- python_script.python (27 lines) ----------
import clr
clr.AddReference('RevitAPI')
from Autodesk.Revit.DB import *

clr.AddReference("RevitNodes")
import Revit
clr.ImportExtensions(Revit.Elements)

clr.AddReference("RevitServices")
import RevitServices
from RevitServices.Persistence import DocumentManager
from RevitServices.Transactions import TransactionManager

doc = DocumentManager.Instance.CurrentDBDocument
famtypes = UnwrapElement(IN[0])
newnames = IN[1]
elementlist = list()
counter = 0
TransactionManager.Instance.EnsureInTransaction(doc)
for item in famtypes:
	try:
		elementlist.append(item.Duplicate(newnames[counter]))
	except:
		elementlist.append(list())
	counter += 1
TransactionManager.Instance.TransactionTaskDone()
OUT = elementlist
# ----------------------------------------
returnListOrSingleValue = Custom[ReturnListOrSingleValue](unknownItem=elementType, seq=python_script)  # If the item in input #1 is not a list, only the first item of the list in input #2 will be returned.
duplicate = Output(returnListOrSingleValue)
