# Dynamo custom node Level.Plane.dyf (Dynamo 0.8.2.2392)
# category: Clockwork.Revit.Elements.Level.Query
# Retrieves the plane of a given level

level = Input(level : Level)
code_block = CodeBlock(l=level) { o = Autodesk.Point.ByCoordinates(0,0,l.Elevation); pl = Plane.ByOriginNormal(o,Vector.ZAxis()); }
plane = Output(code_block.pl)
