# Dynamo custom node List.AlphabeticalSequence.dyf (Dynamo 0.8.1.1823)
# category: Clockwork.Core.List.Create
# Creates a list of the first N letters of the alphabet  (where 1 = A, 2 = B, ... , 27 = AA, 28 = AB etc.).

n = Input(n : int)
code_block = CodeBlock(n=n) { 1..n; }
upperCase = Input(upperCase : bool = false)
fromNumber = Custom[Number To Character](UpperCase=upperCase)  # "Character.FromNumber"; Converts a number into a character (where 1 = A, 2 = B, ... , 27 = AA, 28 = AB etc.).
map = List.Map(list=code_block, f_x=fromNumber)
seq = Output(map)
