# Dynamo custom node List.ChopByLengths.dyf (Dynamo 0.8.1.1823)
# category: Clockwork.Core.List.Actions
# Turns a list into a list of lists with sublists of varying lengths.

lengths = Input(lengths : int)
seq = Input()
turn_into_list = Custom[Turn Into List](lengths)  # Turns an element (or a nested list) into a flat list
python_script = Python(IN[0]=seq, IN[1]=turn_into_list)
# ---------- python_script.python (15 lines) ----------
import clr

inputlist = IN[0]
listlengths = IN[1]
rowcounter = 0
elementlist = list()
for item in listlengths:
	itemcounter = 0
	itemlist = list()
	while itemcounter < item:
		itemlist.append(inputlist[rowcounter])
		rowcounter += 1
		itemcounter += 1
	elementlist.append(itemlist)
OUT = elementlist
# ----------------------------------------
returnListOrSingleValue = Custom[ReturnListOrSingleValue](Item_1_unknown=lengths, Item_2_list=python_script)  # If the item in input #1 is not a list, only the first item of the list in input #2 will be returned.
seq_2 = Output(returnListOrSingleValue)  # "seq"
