# Dynamo custom node List.RandomElements.dyf (Dynamo 0.8.1.1823)
# category: Clockwork.Core.List.Create
# Creates a list of random elements based on a given list of elements

baseElements = Input()
turn_into_list = Custom[Turn Into List](baseElements)  # Turns an element (or a nested list) into a flat list
code_block = CodeBlock(seq=turn_into_list) { Count(seq)-1; }
amount = Input(amount : int)
randomIntegerList = Custom[Math.RandomIntegerList](Max=code_block, Amount=amount)  # Creates a list of random integers between 0 and a given maximum value
code_block_2 = CodeBlock(seq=turn_into_list, n=randomIntegerList) { seq[n]; }
seq = Output(code_block_2)
