# Dynamo custom node List.WithLeadingZeroes.dyf (Dynamo 0.8.1.1693)
# category: Clockwork.Core.List.Create
# Adds leading zeros to a sequence of numbers

seq = Input()
turn_into_list = Custom[Turn Into List](item=seq)  # Turns an element (or a nested list) into a flat list
string_from_object = FromObject()
map = List.Map(list=turn_into_list, f_x=string_from_object)
n = Input(n : int)
python_script = Python(IN[0]=map, IN[1]=n)
# ---------- python_script.python (8 lines) ----------
import clr

stringlist = IN[0]
stringlength = IN[1]
elementlist = list()
for item in stringlist:
	elementlist.append(item.zfill(stringlength))
OUT = elementlist
# ----------------------------------------
seq_2 = Output(python_script)  # "seq"
