# Dynamo custom node Math.RoundDownToPrecision.dyf (Dynamo 0.8.1.1693)
# category: Clockwork.Core.Math.Actions
# Rounds a number *down* to a specified precision

Number = Input(Number : double)
Precision = Input(Precision : double = 1)
code_block = CodeBlock(a=Number, b=Precision) { Math.Floor(a/b)*b; }
Floor = Output(code_block)
