# Dynamo custom node String.HexToDecimal.dyf (Dynamo 0.8.1.1823)
# category: Clockwork.Core.String.Actions
# Converts a string of a hexadecimal value to a number

hex = Input(hex : string)
turn_into_list = Custom[Turn Into List](hex)  # Turns an element (or a nested list) into a flat list
python_script = Python(IN[0]=turn_into_list)
# ---------- python_script.python (5 lines) ----------
hexstr = IN[0]
elementlist = []
for hex in hexstr:
	elementlist.append(int(hex,16))
OUT = elementlist
# ----------------------------------------
returnListOrSingleValue = Custom[ReturnListOrSingleValue](unknownItem=hex, seq=python_script)  # If the item in input #1 is not a list, only the first item of the list in input #2 will be returned.
decimal = Output(returnListOrSingleValue)
