# Dynamo custom node TurnIntoList.dyf (Dynamo 0.8.1.1823)
# category: Clockwork.Core.List.Create
# Turns an element (or a nested list) into a flat list

unknownItem = Input()
code_block = CodeBlock(item=unknownItem) { Flatten({item}); }
seq = Output(code_block)
