# Dynamo custom node View.DetailLevel.dyf (Dynamo 0.8.2.2392)
# category: Clockwork.Revit.Views.View.Query
# Retrieves the detail level of a given view

view = Input()
turnIntoList = Custom[Turn Into List](view)  # Turns an element (or a nested list) into a flat list
python_script = Python(IN[0]=turnIntoList)
# ---------- python_script.python (12 lines) ----------
import clr
clr.AddReference('RevitAPI')
from Autodesk.Revit.DB import *

views = UnwrapElement(IN[0])
elementlist = list()
for view in views:
	try:
		elementlist.append(str(view.DetailLevel))
	except:
		elementlist.append('Undefined')
OUT = elementlist
# ----------------------------------------
returnListOrSingleValue = Custom[ReturnListOrSingleValue](unknownItem=view, seq=python_script)  # If the item in input #1 is not a list, only the first item of the list in input #2 will be returned.
detailLevel = Output(returnListOrSingleValue)
