# Dynamo custom node View.DuplicateAsDependent.dyf (Dynamo 0.8.3.2580)
# category: Clockwork.Revit.Views.View.Actions
# Duplicates a given view as a dependent view

view = Input(view : View)
turn_into_list = Custom[Turn Into List](view)  # Turns an element (or a nested list) into a flat list
python_script = Python(IN[0]=turn_into_list)
# ---------- python_script.python (22 lines) ----------
import clr
clr.AddReference('RevitAPI')
from Autodesk.Revit.DB import *
import Autodesk

clr.AddReference("RevitServices")
import RevitServices
from RevitServices.Persistence import DocumentManager
from RevitServices.Transactions import TransactionManager

doc = DocumentManager.Instance.CurrentDBDocument
views = UnwrapElement(IN[0])
elementlist = list()
dupopt = Autodesk.Revit.DB.ViewDuplicateOption.AsDependent

TransactionManager.Instance.EnsureInTransaction(doc)
for view in views:
	newview = view.Duplicate(dupopt)
	elementlist.append(doc.GetElement(newview))
TransactionManager.Instance.TransactionTaskDone()
	
OUT = elementlist
# ----------------------------------------
returnListOrSingleValue = Custom[ReturnListOrSingleValue](unknownItem=view, seq=python_script)  # If the item in input #1 is not a list, only the first item of the list in input #2 will be returned.
view_2 = Output(returnListOrSingleValue)  # "view"
