# Dynamo custom node WallType.Kind.dyf (Dynamo 0.8.2.2392)
# category: Clockwork.Revit.Elements.WallType.Query
# Retrieves the wall kind of a given wall type

wallType = Input(wallType : WallType)
turnIntoList = Custom[Turn Into List](wallType)  # Turns an element (or a nested list) into a flat list
python_script = Python(IN[0]=turnIntoList)
# ---------- python_script.python (12 lines) ----------
import clr
clr.AddReference('RevitAPI')
from Autodesk.Revit.DB import *

walltypes = UnwrapElement(IN[0])
kindlist = list()
for item in walltypes:
	try: 
		kindlist.append(str(item.Kind))
	except:
		kindlist.append('No Wall')
OUT = kindlist
# ----------------------------------------
returnListOrSingleValue = Custom[ReturnListOrSingleValue](unknownItem=wallType, seq=python_script)  # If the item in input #1 is not a list, only the first item of the list in input #2 will be returned.
kind = Output(returnListOrSingleValue)
