# Dynamo custom node Document.Views.dyf (Dynamo 0.7.5.3566)
# category: Clockwork.Revit.Document.Query
# Gets all views in the document - except for 3D view templates (as long as this bug is not fixed: https://github.com/DynamoDS/Dynamo/issues/2970)

python_script = Python()
# ---------- python_script.python (20 lines) ----------
import clr
clr.AddReference('RevitAPI')
from Autodesk.Revit.DB import *
import Autodesk

clr.AddReference("RevitServices")
import RevitServices
from RevitServices.Persistence import DocumentManager

doc = DocumentManager.Instance.CurrentDBDocument
collector = FilteredElementCollector(doc)
views = collector.OfClass(View).ToElements()
viewlist = list()
for view in views:
	if view.ViewType == ViewType.ThreeD:
		if not(view.IsTemplate):
			viewlist.append(view)
	else:
		viewlist.append(view)
OUT = viewlist
# ----------------------------------------
Views = Output(python_script)
