# Dynamo custom node FamilyInstance.SetType.dyf (Dynamo 0.8.2.2392)
# category: Clockwork.Revit.Elements.FamilyInstance.Actions
# Changes the family type of a given family instance to the specified type

familyInstance = Input()
turnIntoList = Custom[Turn Into List](familyInstance)  # Turns an element (or a nested list) into a flat list
familyType = Input()
turnIntoList_2 = Custom[Turn Into List](familyType)
code_block = CodeBlock(instances=turnIntoList, types=turnIntoList_2) { inst = List.Count(instances); replist = List.OfRepeatedItem(types[0],inst); inst > List.Count(types) ? replist : types; }
python_script = Python(IN[0]=turnIntoList, IN[1]=code_block.out2)
# ---------- python_script.python (30 lines) ----------
import clr
clr.AddReference('RevitAPI')
from Autodesk.Revit.DB import *

clr.AddReference("RevitNodes")
import Revit
clr.ImportExtensions(Revit.Elements)

clr.AddReference("RevitServices")
import RevitServices
from RevitServices.Persistence import DocumentManager
from RevitServices.Transactions import TransactionManager

doc = DocumentManager.Instance.CurrentDBDocument
faminsts = UnwrapElement(IN[0])
famsymb = UnwrapElement(IN[1])
elementlist = list()
counter = 0

TransactionManager.Instance.EnsureInTransaction(doc)
for item in faminsts:
	try:
		item.Symbol = famsymb[counter]
		elementlist.append(item.ToDSType(True))
	except:
		emptylist = list()
	counter += 1
TransactionManager.Instance.TransactionTaskDone()

OUT = elementlist
# ----------------------------------------
returnListOrSingleValue = Custom[ReturnListOrSingleValue](unknownItem=familyInstance, seq=python_script)  # If the item in input #1 is not a list, only the first item of the list in input #2 will be returned.
familyInstance_2 = Output(returnListOrSingleValue)  # "familyInstance"
