# Dynamo custom node All Families Of Category.dyf (Dynamo 1.3.4.6666)
# category: Clockwork.Revit.Selection.ByCollector
# Gets all famiies of a given category in the model  (does *not *work for system families)

docOrRevitLinkInstance = Input(docOrRevitLinkInstance : var = null)  # Use only if you want to query a linked model
toggle = Input(toggle : bool = true)
python_script = Python(IN[0]=docOrRevitLinkInstance, IN[1]=toggle)
# ---------- python_script.python (20 lines) ----------
import System
import clr
clr.AddReference('RevitAPI')
from Autodesk.Revit.DB import *

clr.AddReference("RevitServices")
import RevitServices
from RevitServices.Persistence import DocumentManager

def FamiliesByDoc(doc):
	collector = FilteredElementCollector(doc).OfClass(Family)
	return collector.ToElements()

inputdoc = UnwrapElement(IN[0])
if not inputdoc: doc = DocumentManager.Instance.CurrentDBDocument
elif inputdoc.GetType().ToString() == "Autodesk.Revit.DB.RevitLinkInstance": doc = inputdoc.GetLinkDocument()
elif inputdoc.GetType().ToString() == "Autodesk.Revit.DB.Document": doc = inputdoc
else: doc = DocumentManager.Instance.CurrentDBDocument

OUT = FamiliesByDoc(doc)
# ----------------------------------------
category = Input(category : var[]..[])  # Works with categories, BuiltInCategories and BuiltInCategories as strings
isOfCategory = Custom[Element.IsOfCategory](element=python_script, category=category)  # Checks whether an element is of a specified category
filterByBoolMask = List.FilterByBoolMask(list=python_script, mask=isOfCategory)
families = Output(filterByBoolMask.in)
