# Dynamo custom node All Intersecting Elements Of Category By BoundingBox.dyf "All Intersecting Elements of Category By BoundingBox" (Dynamo 1.0.0.1180)
# category: Clockwork.Revit.Selection.ByCollector
# Finds all elements that intersect the bounding box of a given element

element = Input()
turnIntoList = Custom[TurnIntoList](unknownItem=element)  # Turns an element (or a nested list) into a flat list
view = Input(view: View = null)
isNull = Object.IsNull(view)
activeViewFromCurrentDocument = Custom[Document.ActiveViewFromCurrentDocument]()  # Gets the active view of the current document
if_ = If(test=isNull, true=activeViewFromCurrentDocument, false=view)
tolerance = Input(tolerance : double = 0)
unit_types = UnitTypes("Length")
toInternalUnit = Custom[DisplayUnit.ToInternalUnit](val=tolerance, displayUnitType=unit_types)  # Converts a value from a given display unit to Revit's internal unit
categories = Input()
turnIntoList_2 = Custom[TurnIntoList](unknownItem=categories)
python_script = Python(IN[0]=turnIntoList, IN[1]=if_, IN[2]=toInternalUnit, IN[3]=turnIntoList_2)
# ---------- python_script.python (43 lines) ----------
import clr

import System
from System.Collections.Generic import *

clr.AddReference('RevitAPI')
from Autodesk.Revit.DB import *

clr.AddReference("RevitNodes")
import Revit
clr.ImportExtensions(Revit.Elements)
clr.ImportExtensions(Revit.GeometryConversion)

clr.AddReference("RevitServices")
import RevitServices
from RevitServices.Persistence import DocumentManager

doc = DocumentManager.Instance.CurrentDBDocument
cutters = UnwrapElement(IN[0])
view = UnwrapElement(IN[1])
tol = IN[2]
cats = UnwrapElement(IN[3])

catlist = []
for cat in cats:
	catlist.append(cat.Id)
	#catlist.append(System.Enum.ToObject(BuiltInCategory, cat.Id))
filtercats = List[ElementId](catlist)
#filtercats = List[BuiltInCategory](catlist)
catfilter = ElementMulticategoryFilter(filtercats)

intersectorlist = list()
for cutter in cutters:
	bbox = cutter.get_BoundingBox(view)
	bboxfilter = BoundingBoxIntersectsFilter(Outline(bbox.Min,bbox.Max),tol)
	collector = FilteredElementCollector(doc, view.Id)
	excludelist = []
	excludelist.append(cutter.Id)
	excludeIDs = List[ElementId](excludelist)
	excfilter = ExclusionFilter(excludeIDs)
	intersectorlist.append(collector.WherePasses(bboxfilter).WherePasses(excfilter).WherePasses(catfilter).ToElements())
	
OUT = intersectorlist
# ----------------------------------------
OUT = Output(python_script)
