# Dynamo custom node All Intersecting Elements Of Category By Vector.dyf (Dynamo 1.3.3.4651)
# category: Clockwork.Revit.Selection.ByCollector
# Finds all elements of a specified category that intersect with a list of vectors

origin = Input(origin : Autodesk.Point)
direction = Input(direction : Vector)
maxBounces = Input(maxBounces : int = 1)
threeDView = Input(threeDView : Elements.View3D = null)
isNull = Object.IsNull(threeDView)
code_block = CodeBlock { 1; }
byCoordinates = Point.ByCoordinates(x=code_block, y=code_block, z=code_block)
origin_2 = Point.Origin()
byEyePointAndTarget = AxonometricView.ByEyePointAndTarget(byCoordinates, origin_2)
if_ = If(test=isNull, true=byEyePointAndTarget, false=threeDView)
category = Input()
toggle = Input(toggle : bool = true)
passthrough = Custom[Passthrough](passThrough=category, waitFor=toggle)  # Forces a sequential order of execution. The node wired into the output of the Passthrough node will be executed *after* the node wired into the waitFor input (e.g. important for some Revit operations). The value of the passThrough input will be passed on to the node wired into the output port of the Passthrough node.
turnIntoList = Custom[TurnIntoList](unknownItem=passthrough)  # Turns an element (or a nested list) into a flat list
temporarilyIsolateCategory = Custom[View.TemporarilyIsolateCategory](view=if_, category=turnIntoList)  # Temporarily isolates categories in the given view
end = Revit.Transaction.Transaction.End(temporarilyIsolateCategory.view)
byOriginDirection = Revit.References.RayBounce.ByOriginDirection(origin, direction, maxBounces, end)
elements = Output(byOriginDirection.out1)
passthrough_2 = Custom[Passthrough](passThrough=byEyePointAndTarget, waitFor=byOriginDirection.out1)
eraser = Custom[Tool.Eraser](List=passthrough_2)  # Try to delete any element from project
passthrough_3 = Custom[Passthrough](passThrough=threeDView, waitFor=byOriginDirection.out1)
disableTemporaryHideIsolate = Custom[View.DisableTemporaryHideIsolate](view=passthrough_3)  # Disables the temporary hide/isolate for the given view (if set)
