# Dynamo custom node All Placed Family Types of Category.dyf (Dynamo 1.3.0.875)
# category: Clockwork.Revit.Selection.ByCollector
# Retrieves all family types of a given category that have *placed* instances

category = Input(category : Category)
all_elements_of_category = ElementsOfCategory(category)
type = Custom[Element.Type](element=all_elements_of_category)  # Gets the family type of a given element (if applicable).
uniqueItems = List.UniqueItems(type)
familyTypes = Output(uniqueItems)
