# Dynamo custom node All View-Dependent Family Instances Of Category.dyf (Dynamo 1.3.3.4651)
# category: Clockwork.Revit.Selection.ByCollector
# Gets all view-dependent family instances in a given view for a given list of categories - useful for finding annotation elements

category = Input(category : Category)
turnIntoList = Custom[Turn Into List](unknownItem=category)  # Turns an element (or a nested list) into a flat list
view = Input()
primaryView = Custom[View.PrimaryView](view=view)  # Returns the primary view of a given view (i.e. the master view of a dependent view)
isNull = Object.IsNull(primaryView)
code_block = CodeBlock(isnull=isNull, originalView=view, primaryView=primaryView) { isnull ? originalView : primaryView; }
turnIntoList_2 = Custom[Turn Into List](unknownItem=code_block)
toggle = Input(toggle : bool = true)
python_script = Python(IN[0]=turnIntoList, IN[1]=turnIntoList_2, IN[2]=toggle)
# ---------- python_script.python (24 lines) ----------
import System
import clr
clr.AddReference('RevitAPI')
from Autodesk.Revit.DB import *

clr.AddReference("RevitServices")
import RevitServices
from RevitServices.Persistence import DocumentManager

doc = DocumentManager.Instance.CurrentDBDocument
cats = IN[0]
views = UnwrapElement(IN[1])

elementlist = list()
# This could be more elegant if only I knew how to implement a Multicategory filter in Python....
for cat in cats:
	catlist = list()
	for view in views:
		collector = FilteredElementCollector(doc)
		filter = ElementOwnerViewFilter(view.Id)
		bic = System.Enum.ToObject(BuiltInCategory, cat.Id)
		catlist.append(collector.WherePasses(filter).OfCategory(bic).ToElements())
	elementlist.append(catlist)
OUT = elementlist
# ----------------------------------------
returnListOrSingleValue = Custom[ReturnListOrSingleValue](unknownItem=category, seq=python_script)  # If the item in input #1 is not a list, only the first item of the list in input #2 will be returned.
elements = Output(returnListOrSingleValue)
