# Dynamo custom node Category.Type.dyf (Dynamo 1.3.4.6666)
# category: Clockwork.Revit.Elements.Category.Query
# Returns the type of the category

category = Input(category : var[]..[])  # Works with categories, BuiltInCategories and BuiltInCategories as strings
fromInput = Custom[Category.FromInput](var=category)  # Returns a category from a category, a Dynamo-wrapped category, a BuiltInCategory or a string representing a BuiltInCategory.
python_script = Python(IN[0]=fromInput)
# ---------- python_script.python (18 lines) ----------
import System
import clr
clr.AddReference('RevitAPI')
from Autodesk.Revit.DB import *

clr.AddReference("RevitNodes")
import Revit
clr.ImportExtensions(Revit.Elements)

def GetCategoryType(cat):
	if hasattr(cat, "CategoryType"): return cat.CategoryType.ToString()
	else: return None

cats = UnwrapElement(IN[0])
elementlist = list()

if isinstance(IN[0], list): OUT = [GetCategoryType(x) for x in cats]
else: OUT = GetCategoryType(cats)
# ----------------------------------------
categoryType = Output(python_script)
