# Dynamo custom node DividedSurface.VerticalIntersectsByEndpoints.dyf (Dynamo 0.8.2.2392)
# category: Clockwork.Revit.Elements.DividedSurface.Actions
# Creates a number of equally spaced vertical intersects for a divided surface based on the path between between two points. You may need to switch start point and end point.

dividedSurface = Input(dividedSurface : DividedSurface)
startPoint = Input(startPoint : Autodesk.Point)
endPoint = Input(endPoint : Autodesk.Point)
subdivisions = Input(subdivisions : int)
code_block = CodeBlock(startp=startPoint, endp=endPoint, subdiv=subdivisions)
# ---------- code_block.designscript (15 lines) ----------
// Project the points to the XY plane and create a line between them
p1 = Autodesk.Point.ByCoordinates(startp.X,startp.Y);
p2 = Autodesk.Point.ByCoordinates(endp.X,endp.Y);
curve1 = Line.ByStartPointEndPoint(p1,p2);
// Create points for subdivisions
seq = 0..1..#(subdiv+1);
seq2 = List.RestOfItems(seq);
seq3 = List.TakeItems(seq2,List.Count(seq2)-1);
cpoints = curve1.PointAtParameter(seq3);
// Find vector orthogonal to line
vec1 = Vector.ByTwoPoints(p1,p2).Normalized();
vec2 = vec1.Cross(Vector.ZAxis());
vec3 = vec2.Scale(curve1.Length/10);
// Create a set of orthogonal planes to curve 1
ReferencePlane.ByStartPointEndPoint(cpoints.Add(vec3),cpoints.Subtract(vec3));
# ----------------------------------------
addIntersect = Custom[Add Intersect To Divided Surface](dividedSurface=dividedSurface, element=code_block.out10)  # "DividedSurface.AddIntersect"; Adds an intersect to a divided surface
dividedSurface_2 = Output(addIntersect)  # "dividedSurface"
intersects = Output(code_block.out10)
