# Dynamo custom node DividedSurface.VerticalIntersectsByEndpointsAndFunction.dyf (Dynamo 0.8.2.2392)
# category: Clockwork.Revit.Elements.DividedSurface.Actions
# Creates a number of vertical intersects (reference planes) for a divided surface based on the path between between two points. The spacing can be controlled by a function. You may need to switch start point and end point.

dividedSurface = Input(dividedSurface : DividedSurface)
func = Input()
startPoint = Input(startPoint : Autodesk.Point)
endPoint = Input(endPoint : Autodesk.Point)
subdivisions = Input(subdivisions : int)
code_block = CodeBlock(startp=startPoint, endp=endPoint, subdiv=subdivisions)
# ---------- code_block.designscript (9 lines) ----------
// Project the points to the XY plane and create a line between them
p1 = Autodesk.Point.ByCoordinates(startp.X,startp.Y);
p2 = Autodesk.Point.ByCoordinates(endp.X,endp.Y);
curve1 = Line.ByStartPointEndPoint(p1,p2);
// Find vector orthogonal to line
vec1 = Vector.ByTwoPoints(p1,p2).Normalized();
vec2 = vec1.Cross(Vector.ZAxis());
vec3 = vec2.Scale(curve1.Length/10);
subdiv+1;
# ----------------------------------------
normalizedSequenceByFunction = Custom[Normalized Sequence by Function](func=func, n=code_block.out6)  # "List.NormalizedSequenceByFunction"; Creates a sequence of N values between 0 and 1 driven by a function
code_block_2 = CodeBlock(seq=normalizedSequenceByFunction, curve1=code_block.curve1, vec3=code_block.vec3)
# ---------- code_block_2.designscript (6 lines) ----------
seq2 = List.RestOfItems(seq);
seq3 = List.TakeItems(seq2,List.Count(seq2)-1);
// Create points for subdivisions
cpoints = curve1.PointAtParameter(seq3);
// Create a set of orthogonal planes to curve 1
seq1 = ReferencePlane.ByStartPointEndPoint(cpoints.Add(vec3),cpoints.Subtract(vec3));
# ----------------------------------------
addIntersect = Custom[Add Intersect To Divided Surface](dividedSurface=dividedSurface, element=code_block_2.seq1)  # "DividedSurface.AddIntersect"; Adds an intersect to a divided surface
dividedSurface_2 = Output(addIntersect)  # "dividedSurface"
intersects = Output(code_block_2.seq1)
