# Dynamo custom node Document.BuiltInCategories.dyf (Dynamo 1.0.0.1180)
# category: Clockwork.Revit.Document.Query
# List all the available BuiltInCategories

python_script = Python()
# ---------- python_script.python (22 lines) ----------
import clr
import System
clr.AddReference('RevitAPI')
clr.AddReference('RevitAPIUI')
from Autodesk.Revit.DB import *
import Autodesk
clr.AddReference("RevitNodes")
import Revit

clr.AddReference("RevitServices")
import RevitServices
from RevitServices.Persistence import DocumentManager
doc = DocumentManager.Instance.CurrentDBDocument

bics = System.Enum.GetValues(BuiltInCategory)
cdata = list()
for bic in bics:
	try:
		cdata.append((bic,ElementId(bic),Revit.Elements.Category.ById(ElementId(bic).IntegerValue)))
	except:
		pass
OUT = cdata
# ----------------------------------------
transpose = List.Transpose(python_script)
code_block = CodeBlock(seq=transpose) { seq[0]; seq[1]; seq[2]; }
BuiltInCategories = Output(code_block.out0)
ElementIDs = Output(code_block.out1)
Categories = Output(code_block.out2)
