# Dynamo custom node Document.ContainsElementsOfCategory.dyf (Dynamo 1.3.0.875)
# category: Clockwork.Revit.Document.Query
# Checks if family instances of specified categories are present in the model.

category = Input()
turnIntoList = Custom[Turn Into List](unknownItem=category)  # Turns an element (or a nested list) into a flat list
all_elements_of_category = ElementsOfCategory(turnIntoList)
isNotEmpty = Custom[List.IsNotEmpty](seq=all_elements_of_category@L2)  # Just the inversion of the built-in Is Empty List node.
anyTrue = Custom[List.AnyTrue](seq=isNotEmpty)  # Returns true if any item in a list of booleans is true.
any = Output(anyTrue)  # "any?"
allTrue = AllTrue(isNotEmpty)
all = Output(allTrue)  # "all?"
returnListOrSingleValue = Custom[ReturnListOrSingleValue](unknownItem=category, seq=isNotEmpty)  # If the item in input #1 is not a list, only the first item of the list in input #2 will be returned.
per_category = Output(returnListOrSingleValue)
returnListOrSingleValue_2 = Custom[ReturnListOrSingleValue](unknownItem=category, seq=isNotEmpty)
instances = Output(returnListOrSingleValue_2)
