# Dynamo custom node Document.Enums.dyf (Dynamo 1.3.4.6666)
# category: Clockwork.Revit.Document.Query
# Retrieves all Enums from the Revit API

python_script = Python()
# ---------- python_script.python (11 lines) ----------
import clr
import System
clr.AddReference('RevitAPI')
clr.AddReference('RevitAPIUI')
from Autodesk.Revit.DB import *
import Autodesk

OUT = []
for item in dir(Autodesk.Revit.DB):
	enumtype = getattr(Autodesk.Revit.DB, item)
	if hasattr(enumtype, 'GetNames'): OUT.append(item)
# ----------------------------------------
enumNames = Output(python_script)
