# Dynamo custom node Document.IsWorkshared.dyf (Dynamo 1.3.0.875)
# category: Clockwork.Revit.Document.Query
# Returns true if the current project is workshared

toggle = Input(toggle : bool = true)
python_script = Python(IN[0]=toggle)
# ---------- python_script.python (8 lines) ----------
import clr
clr.AddReference("RevitServices")
import RevitServices
from RevitServices.Persistence import DocumentManager

doc = DocumentManager.Instance.CurrentDBDocument
if doc.IsWorkshared: OUT = True
else: OUT = False
# ----------------------------------------
bool = Output(python_script)
