# Dynamo custom node Document.ProjectParameters.dyf (Dynamo 1.3.1.1736)
# category: Clockwork.Revit.Document.Query
# Retrieves all project parameters and the categories they have been assigned to

toggle = Input(toggle : bool = true)
docOrRevitLinkInstance = Input(docOrRevitLinkInstance : var = null)  # Use only if you want to query a linked model
python_script = Python(IN[0]=toggle, IN[1]=docOrRevitLinkInstance)
# ---------- python_script.python (39 lines) ----------
import clr
clr.AddReference('RevitAPI')
from Autodesk.Revit.DB import *
import Autodesk

clr.AddReference("RevitNodes")
import Revit
clr.ImportExtensions(Revit.Elements)

clr.AddReference("RevitServices")
import RevitServices
from RevitServices.Persistence import DocumentManager

inputdoc = UnwrapElement(IN[1])
if inputdoc == None:
	doc = DocumentManager.Instance.CurrentDBDocument
elif inputdoc.GetType().ToString() == "Autodesk.Revit.DB.RevitLinkInstance":
	doc = inputdoc.GetLinkDocument()
elif inputdoc.GetType().ToString() == "Autodesk.Revit.DB.Document":
	doc = inputdoc
else: doc = None

names = []
cats = []
vag = []
iterator = doc.ParameterBindings.ForwardIterator()
while iterator.MoveNext():
	vag.append(iterator.Key.VariesAcrossGroups)
	names.append(iterator.Key.Name)
	thesecats = []
	for cat in iterator.Current.Categories:
		try:
			thesecats.append(Revit.Elements.Category.ById(cat.Id.IntegerValue))
		except:
			# Return null if category is not supported by Dynamo
			# This way the user knows there are unsupported categories assigned
			thesecats.append(None)
	cats.append(thesecats)
OUT = (names,cats,vag)
# ----------------------------------------
code_block = CodeBlock(seq=python_script) { seq[0]; seq[1]; seq[2]; }
paramName = Output(code_block.out0)
categories = Output(code_block.out1)
variesAcrossGroups = Output(code_block.out2)
