# Dynamo custom node Document.ProjectParametersByCategory.dyf (Dynamo 1.3.1.1736)
# category: Clockwork.Revit.Document.Query
# Retrieves all project parameters for a given category

category = Input()
turnIntoList = Custom[TurnIntoList](unknownItem=category)  # Turns an element (or a nested list) into a flat list
toggle = Input(toggle : bool = true)
docOrRevitLinkInstance = Input(docOrRevitLinkInstance : var = null)  # Use only if you want to query a linked model
python_script = Python(IN[0]=turnIntoList, IN[1]=toggle, IN[2]=docOrRevitLinkInstance)
# ---------- python_script.python (34 lines) ----------
import clr
clr.AddReference('RevitAPI')
from Autodesk.Revit.DB import *
import Autodesk

clr.AddReference("RevitServices")
import RevitServices
from RevitServices.Persistence import DocumentManager

search_cats = UnwrapElement(IN[0])
search_ids = []
cats = []
for search_cat in search_cats:
	search_ids.append(search_cat.Id.IntegerValue)
	cats.append(list())

inputdoc = UnwrapElement(IN[2])
if inputdoc == None:
	doc = DocumentManager.Instance.CurrentDBDocument
elif inputdoc.GetType().ToString() == "Autodesk.Revit.DB.RevitLinkInstance":
	doc = inputdoc.GetLinkDocument()
elif inputdoc.GetType().ToString() == "Autodesk.Revit.DB.Document":
	doc = inputdoc
else: doc = None

iterator = doc.ParameterBindings.ForwardIterator()
while iterator.MoveNext():
	for cat in iterator.Current.Categories:
		i = 0
		for search_id in search_ids:
			if cat.Id.IntegerValue == search_id:
				cats[i].append(iterator.Key.Name)
			i += 1
OUT = cats
# ----------------------------------------
returnListOrSingleValue = Custom[ReturnListOrSingleValue](unknownItem=category, seq=python_script)  # If the unknown item is not a list but rather a single item, only the first item of the list (input "seq") will be returned.
paramName = Output(returnListOrSingleValue)
