# Dynamo custom node Document.SaveAs.dyf (Dynamo 1.0.0.1180)
# category: Clockwork.Revit.Document.Actions
# Saves the active Revit document under the given name.

filePath = Input(filePath : string)
code_block = CodeBlock(path1=filePath)
# ---------- code_block.designscript (4 lines) ----------
// Delete filetype (if present in string)
// Filetype will automatically be added by Python script
path2 = String.Replace(path1,".rvt","");
String.Replace(path2,".rfa","");
# ----------------------------------------
compactFile = Input(compactFile : bool = false)
saveAsCentral = Input(saveAsCentral : bool = false)
isWorkshared = Custom[Document.IsWorkshared]()  # Returns true if the current project is workshared
python_script = Python(IN[0]=code_block.out1, IN[1]=compactFile, IN[2]=saveAsCentral, IN[3]=isWorkshared)
# ---------- python_script.python (32 lines) ----------
import clr
clr.AddReference('RevitAPI')
from Autodesk.Revit.DB import *

clr.AddReference("RevitServices")
import RevitServices
from RevitServices.Persistence import DocumentManager

doc = DocumentManager.Instance.CurrentDBDocument
path = IN[0]
compact = IN[1]
newcentral = IN[1]
isworkshared = IN[1]

if doc.IsFamilyDocument:
	path += '.rfa'
else:
	path += '.rvt'
opt = SaveAsOptions()
opt.OverwriteExistingFile = True
opt.Compact = compact
if isworkshared & newcentral:
	wsopt = WorksharingSaveAsOptions()
	wsopt.ClearTransmitted = True
	wsopt.SaveAsCentral = True
	opt.SetWorksharingOptions(wsopt)
try:
	OUT = doc.SaveAs(path, opt)
except:
	wsopt.ClearTransmitted = False
	opt.SetWorksharingOptions(wsopt)
	OUT = doc.SaveAs(path, opt)
# ----------------------------------------
result = Output(python_script)
