# Dynamo custom node Dynamo.Version.dyf (Dynamo 1.3.1.1736)
# category: Clockwork.Core.Application.Query
# Retrieves the version of the active Dynamo application

python_script = Python()
# ---------- python_script.python (6 lines) ----------
import clr
from System.Reflection import Assembly
dynamoCore = Assembly.Load("DynamoCore")
version_long = dynamoCore.GetName().Version.ToString()
version_short = version_long[:5]
OUT = (version_short,version_long)
# ----------------------------------------
code_block = CodeBlock(seq=python_script) { seq[0]; seq[1]; }
versionShort = Output(code_block.out0)
versionLong = Output(code_block.out1)
