# Dynamo custom node Element.ByID.dyf (Dynamo 1.0.0.1180)
# category: Clockwork.Revit.Selection.Miscellaneous
# Gets the Revit element(s) for a list of IDs (or a single ID). Optionally retrieves elements from linked documents as well.

ID_UniqueId = Input(ID/UniqueId : var[]..[])
turnIntoList = Custom[Turn Into List](unknownItem=ID_UniqueId)  # Turns an element (or a nested list) into a flat list
docOrRevitLinkInstance = Input(docOrRevitLinkInstance : var = null)  # Use only if you want to query a linked model
python_script = Python(IN[0]=turnIntoList, IN[1]=docOrRevitLinkInstance)
# ---------- python_script.python (32 lines) ----------
import clr
clr.AddReference('RevitAPI')
from Autodesk.Revit.DB import *

clr.AddReference("RevitNodes")
import Revit
clr.ImportExtensions(Revit.Elements)

clr.AddReference("RevitServices")
import RevitServices
from RevitServices.Persistence import DocumentManager

items = UnwrapElement(IN[0])
inputdoc = UnwrapElement(IN[1])
if inputdoc == None:
	doc = DocumentManager.Instance.CurrentDBDocument
elif inputdoc.GetType().ToString() == "Autodesk.Revit.DB.RevitLinkInstance":
	doc = inputdoc.GetLinkDocument()
elif inputdoc.GetType().ToString() == "Autodesk.Revit.DB.Document":
	doc = inputdoc
else: doc = None

elementlist = list()
for item in items:
	try: 
		elementlist.append(doc.GetElement(item).ToDSType(True))
	except:
		try:
			elementlist.append(doc.GetElement(ElementId(item)).ToDSType(True))
		except:
			elementlist.append(None)
OUT = elementlist
# ----------------------------------------
returnListOrSingleValue = Custom[ReturnListOrSingleValue](unknownItem=ID_UniqueId, seq=python_script)  # If the item in input #1 is not a list, only the first item of the list in input #2 will be returned.
element = Output(returnListOrSingleValue)
