# Dynamo custom node Element.Category+.dyf (Dynamo 1.0.0.1180)
# category: Clockwork.Revit.Elements.Element.Query
# Returns the category of a given element. Unlike the OOTB node Element.GetCategory, it will work for families, schedules and graphics styles as well.

element = Input()
turnIntoList = Custom[Turn Into List](unknownItem=element)  # Turns an element (or a nested list) into a flat list
python_script = Python(IN[0]=turnIntoList)
# ---------- python_script.python (25 lines) ----------
import clr
clr.AddReference('RevitAPI')
from Autodesk.Revit.DB import *

clr.AddReference("RevitNodes")
import Revit
clr.ImportExtensions(Revit.Elements)

items = UnwrapElement(IN[0])
elementlist = list()
for item in items:
	objtype = item.GetType().ToString()
	try:
		if objtype == "Autodesk.Revit.DB.ViewSchedule":
			elementlist.append(Revit.Elements.Category.ById(item.Definition.CategoryId.IntegerValue))
		elif objtype == "Autodesk.Revit.DB.Family":
			elementlist.append(Revit.Elements.Category.ById(item.FamilyCategoryId.IntegerValue))
		elif objtype == "Autodesk.Revit.DB.GraphicsStyle":
			elementlist.append(Revit.Elements.Category.ById(item.GraphicsStyleCategory.Id.IntegerValue))
		else:
			elementlist.append(Revit.Elements.Category.ById(item.Category.Id.IntegerValue))
	except:
		elementlist.append(None)

OUT = elementlist
# ----------------------------------------
returnListOrSingleValue = Custom[ReturnListOrSingleValue](unknownItem=element, seq=python_script)  # If the unknown item is not a list but rather a single item, only the first item of the list (input "seq") will be returned.
category = Output(returnListOrSingleValue)
