# Dynamo custom node Element.ExternalFileReferencePath.dyf (Dynamo 1.3.1.1736)
# category: Clockwork.Revit.Elements.Element.Query
# Returns the full path of an element's external file reference as as string

element = Input()
python_script = Python(IN[0]=element)
# ---------- python_script.python (12 lines) ----------
import clr
clr.AddReference('RevitAPI')
from Autodesk.Revit.DB import *

def GetExtFileRefPath(item):
	try: return ModelPathUtils.ConvertModelPathToUserVisiblePath(item.GetExternalFileReference().GetAbsolutePath())
	except: return None

items = UnwrapElement(IN[0])

if isinstance(IN[0], list): OUT = [GetExtFileRefPath(x) for x in items]
else: OUT = GetExtFileRefPath(items)
# ----------------------------------------
path = Output(python_script)
