# Dynamo custom node Element.FromDynamoSurface.dyf (Dynamo 1.3.0.875)
# category: Clockwork.Revit.Selection.ByFace
# Returns the underlying Revit element of a given face

DynamoSurface = Input(DynamoSurface : Surface)
turnIntoList = Custom[Turn Into List](unknownItem=DynamoSurface)  # Turns an element (or a nested list) into a flat list
python_script = Python(IN[0]=turnIntoList)
# ---------- python_script.python (19 lines) ----------
import clr
clr.AddReference('RevitAPI')
from Autodesk.Revit.DB import *

clr.AddReference("RevitServices")
import RevitServices
from RevitServices.Persistence import DocumentManager

doc = DocumentManager.Instance.CurrentDBDocument
faces = UnwrapElement(IN[0])
elementlist = list()
for face in faces:
	try:
		ref = face.Tags.LookupTag("RevitFaceReference")
		elem = doc.GetElement(ref)
		elementlist.append(elem)
	except:
		elementlist.append(list())
OUT = elementlist
# ----------------------------------------
uniqueItems = List.UniqueItems(python_script)
returnListOrSingleValue = Custom[ReturnListOrSingleValue](unknownItem=DynamoSurface, seq=uniqueItems)  # If the item in input #1 is not a list, only the first item of the list in input #2 will be returned.
element = Output(returnListOrSingleValue)
