# Dynamo custom node Element.IsOfCategory.dyf (Dynamo 1.3.4.6666)
# category: Clockwork.Revit.Elements.Element.Query
# Checks whether an element is of a specified category

category = Input(category : var[]..[])  # Works with categories, BuiltInCategories and BuiltInCategories as strings
fromInput = Custom[BuiltInCategory.FromInput](var=category)  # Returns a BuiltInCategory from a category, a Dynamo-wrapped category, a BuiltInCategory or a string representing a BuiltInCategory.
string_from_object = FromObject(fromInput)
element = Input()
category_2 = Custom[Element.Category+](element=element)  # Returns the category of a given element. Unlike the OOTB node Element.GetCategory, it will work for families, schedules and graphics styles as well.
string_from_object_2 = FromObject(category_2.builtInCategory)
containsItem = List.ContainsItem(list=string_from_object, item=string_from_object_2)
bool = Output(containsItem)
