# Dynamo custom node Element.OwnerView.dyf (Dynamo 1.3.2.2480)
# category: Clockwork.Revit.Elements.Element.Query
# Gets the owner view of a given Revit element (if possible)

element = Input()
python_script = Python(IN[0]=element)
# ---------- python_script.python (16 lines) ----------
import clr
clr.AddReference('RevitAPI')
from Autodesk.Revit.DB import *

clr.AddReference("RevitNodes")
import Revit
clr.ImportExtensions(Revit.Elements)

def GetOwnerView(item):
	if hasattr(item, "OwnerViewId"): return item.Document.GetElement(item.OwnerViewId)
	else: return None

items = UnwrapElement(IN[0])

if isinstance(IN[0], list): OUT = [GetOwnerView(x) for x in items]
else: OUT = GetOwnerView(items)
# ----------------------------------------
view = Output(python_script)
