# Dynamo custom node Element.Panels.dyf (Dynamo 1.0.0.1180)
# category: Clockwork.Revit.Elements.Element.Query
# Retrieves the panels nested in a curtain wall or curtain system. Panels of curtain systems are returned in a nested list, with one sublist for each face of the curtain system. Will not work for glazed roofs.

hostElement = Input()
turnIntoList = Custom[Turn Into List](unknownItem=hostElement)  # Turns an element (or a nested list) into a flat list
python_script = Python(IN[0]=turnIntoList)
# ---------- python_script.python (31 lines) ----------
import clr
clr.AddReference('RevitAPI')
from Autodesk.Revit.DB import *

clr.AddReference("RevitNodes")
import Revit
clr.ImportExtensions(Revit.Elements)

items = UnwrapElement(IN[0])
elementlist = list()
for item in items:
	try:
		# Curtain systems
		systemlist = list()
		for grid in item.CurtainGrids:
			panellist = list()
			for panel in grid.GetPanelIds():
				panellist.append(item.Document.GetElement(panel).ToDSType(True))
			systemlist.append(panellist)
		elementlist.append(systemlist)
	except:
		try:
			# Curtain walls
			panellist = list()
			for panel in item.CurtainGrid.GetPanelIds():
				panellist.append(item.Document.GetElement(panel).ToDSType(True))
			elementlist.append(panellist)
		except:
			# Anything else
			elementlist.append(list())
OUT = elementlist
# ----------------------------------------
returnListOrSingleValue = Custom[ReturnListOrSingleValue](unknownItem=hostElement, seq=python_script)  # If the item in input #1 is not a list, only the first item of the list in input #2 will be returned.
panels = Output(returnListOrSingleValue)
