# Dynamo custom node Element.SetMaterialParameterByCategory.dyf (Dynamo 1.0.0.1180)
# category: Clockwork.Revit.Elements.Element.Actions
# Sets a material parameter of a given element to <By Category>

element = Input()
turnIntoList = Custom[Turn Into List](unknownItem=element)  # Turns an element (or a nested list) into a flat list
materialParameterName = Input(materialParameterName : string)
python_script = Python(IN[0]=turnIntoList, IN[1]=materialParameterName)
# ---------- python_script.python (31 lines) ----------
import clr
clr.AddReference('RevitAPI')
from Autodesk.Revit.DB import *

clr.AddReference("RevitServices")
import RevitServices
from RevitServices.Persistence import DocumentManager
from RevitServices.Transactions import TransactionManager

doc = DocumentManager.Instance.CurrentDBDocument
elements = UnwrapElement(IN[0])
paramname = IN[1]
elementlist = list()
failedlist = list()

TransactionManager.Instance.EnsureInTransaction(doc)
for item in elements:
	try:
		paramset = False
		for param in item.Parameters:
			if param.Definition.Name == paramname:
				param.Set(ElementId.InvalidElementId)
				elementlist.append(item)
				paramset = True
		if paramset == False:
			failedlist.append(item)
	except:
		failedlist.append(item)
TransactionManager.Instance.TransactionTaskDone()

OUT = (elementlist,failedlist)
# ----------------------------------------
code_block = CodeBlock(seq=python_script) { seq[0]; seq[1]; }
returnListOrSingleValue = Custom[ReturnListOrSingleValue](unknownItem=element, seq=code_block.out0)  # If the item in input #1 is not a list, only the first item of the list in input #2 will be returned.
changedElements = Output(returnListOrSingleValue)
unchangedElements = Output(code_block.out1)
