# Dynamo custom node Elements.FilterByName.dyf (Dynamo 1.3.0.875)
# category: Clockwork.Revit.Selection.Filters
# Retrieves those elements from a collection whose names match the search string

elements = Input()
turnIntoList = Custom[Turn Into List](unknownItem=elements)  # Turns an element (or a nested list) into a flat list
name = Custom[Element.Name (Universal)](element=turnIntoList)  # "Element.Name+"; Gets an element's name (Dynamo's built-in Name nodes don't work for all element types, e.g. worksets...)
searchString = Input(searchString : string)
ignoreCase = Input(ignoreCase : bool = true)
contains = String.Contains(str=name, searchFor=searchString, ignoreCase=ignoreCase)
filterByBoolMask = List.FilterByBoolMask(list=turnIntoList, mask=contains)
firstItem = List.FirstItem(filterByBoolMask.in)
first = Output(firstItem)
in_ = Output(filterByBoolMask.in)  # "in"
out = Output(filterByBoolMask.out)
