# Dynamo custom node Family.IsInPlace.dyf (Dynamo 0.8.2.2392)
# category: Clockwork.Revit.Elements.Family.Query
# Determines if a family is an in-place family

family = Input(family : Family)
turnIntoList = Custom[Turn Into List](family)  # Turns an element (or a nested list) into a flat list
python_script = Python(IN[0]=turnIntoList)
# ---------- python_script.python (14 lines) ----------
import clr
import System
clr.AddReference('RevitAPI')
from Autodesk.Revit.DB import *

fams = UnwrapElement(IN[0])
elementlist = list()

for fam in fams:
	try:
		elementlist.append(fam.IsInPlace)
	except:
		elementlist.append(False)
OUT = elementlist
# ----------------------------------------
returnListOrSingleValue = Custom[ReturnListOrSingleValue](unknownItem=family, seq=python_script)  # If the item in input #1 is not a list, only the first item of the list in input #2 will be returned.
bool = Output(returnListOrSingleValue)
