# Dynamo custom node FamilyDocument.CurrentFamilyType.dyf (Dynamo 0.8.2.2392)
# category: Clockwork.Revit.FamilyDocument.Query
# Retrieves the current family type from the active family document. PLEASE NOTE: This node will only work in a family document!

toggle = Input(toggle : bool = true)
python_script = Python(IN[0]=toggle)
# ---------- python_script.python (10 lines) ----------
import clr
clr.AddReference('RevitAPI')
from Autodesk.Revit.DB import *

clr.AddReference("RevitServices")
import RevitServices
from RevitServices.Persistence import DocumentManager

doc = DocumentManager.Instance.CurrentDBDocument
OUT = doc.FamilyManager.CurrentType
# ----------------------------------------
familyType = Output(python_script)
