# Dynamo custom node FamilyInstance.FlipFacingOrientation.dyf (Dynamo 0.8.2.2392)
# category: Clockwork.Revit.Elements.FamilyInstance.Actions
# Flips the facing orientation of a given family instance

familyInstance = Input()
turnIntoList = Custom[Turn Into List](familyInstance)  # Turns an element (or a nested list) into a flat list
python_script = Python(IN[0]=turnIntoList)
# ---------- python_script.python (23 lines) ----------
import clr
clr.AddReference('RevitAPI')
from Autodesk.Revit.DB import *

clr.AddReference("RevitServices")
import RevitServices
from RevitServices.Persistence import DocumentManager
from RevitServices.Transactions import TransactionManager

doc = DocumentManager.Instance.CurrentDBDocument
faminstances = UnwrapElement(IN[0])
elementlist = list()

TransactionManager.Instance.EnsureInTransaction(doc)
for item in faminstances:
	try:
		item.flipFacing()
		elementlist.append(item)
	except:
		elementlist.append(list())
TransactionManager.Instance.TransactionTaskDone()
		
OUT = elementlist
# ----------------------------------------
returnListOrSingleValue = Custom[ReturnListOrSingleValue](unknownItem=familyInstance, seq=python_script)  # If the item in input #1 is not a list, only the first item of the list in input #2 will be returned.
familyInstance_2 = Output(returnListOrSingleValue)  # "familyInstance"
