# Dynamo custom node FamilyInstance.SuperComponent.dyf (Dynamo 1.3.3.4651)
# category: Clockwork.Revit.Elements.FamilyInstance.Query
# Retrieves the supercomponent of a given family instance

familyInstance = Input()
python_script = Python(IN[0]=familyInstance)
# ---------- python_script.python (13 lines) ----------
import clr
clr.AddReference('RevitAPI')
from Autodesk.Revit.DB import *

def GetSuperComponent(item):
	if hasattr(item, "SuperComponent"): return item.SuperComponent
	elif hasattr(item, "GetStairs"): return item.GetStairs()
	else: return None

items = UnwrapElement(IN[0])

if isinstance(IN[0], list): OUT = [GetSuperComponent(x) for x in items]
else: OUT = GetSuperComponent(items)
# ----------------------------------------
superComponent = Output(python_script)
