# Dynamo custom node FamilyParameter.MakeInstance.dyf (Dynamo 1.3.3.4651)
# category: Clockwork.Revit.Elements.FamilyParameter.Actions
# Converts a type parameter to an instance parameter. ATTENTION: Only works in a family document.

familyParameter = Input()
python_script = Python(IN[0]=familyParameter)
# ---------- python_script.python (19 lines) ----------
import clr
clr.AddReference('RevitAPI')
from Autodesk.Revit.DB import *

clr.AddReference("RevitServices")
import RevitServices
from RevitServices.Persistence import DocumentManager
from RevitServices.Transactions import TransactionManager

def MakeInstanceParam(doc, param):
	if doc.IsFamilyDocument and hasattr(param, "Formula"):
		doc.FamilyManager.MakeInstance(param)
	return param

doc = DocumentManager.Instance.CurrentDBDocument
TransactionManager.Instance.EnsureInTransaction(doc)
if isinstance(IN[0], list): OUT = [MakeInstanceParam(doc, x) for x in IN[0]]
else: OUT = MakeInstanceParam(doc, IN[0])
TransactionManager.Instance.TransactionTaskDone()
# ----------------------------------------
familyParameter_2 = Output(python_script)  # "familyParameter"
