# Dynamo custom node FamilyType.CompoundStructureHasVariableLayer.dyf (Dynamo 0.8.2.2392)
# category: Clockwork.Revit.Elements.FamilyType.Query
# Checks if the compound structure of a given floor or roof type contains a variable layer.

familyType = Input()
turn_into_list = Custom[Turn Into List](familyType)  # Turns an element (or a nested list) into a flat list
python_script = Python(IN[0]=turn_into_list)
# ---------- python_script.python (15 lines) ----------
import clr
clr.AddReference('RevitAPI')
from Autodesk.Revit.DB import *

elemtypes = UnwrapElement(IN[0])
elementlist = list()
for item in elemtypes:
	try:
		if item.GetCompoundStructure().VariableLayerIndex == -1:
			elementlist.append(False)
		else:
			elementlist.append(True)
	except:
		elementlist.append(False)
OUT = elementlist
# ----------------------------------------
returnListOrSingleValue = Custom[ReturnListOrSingleValue](unknownItem=familyType, seq=python_script)  # If the item in input #1 is not a list, only the first item of the list in input #2 will be returned.
bool = Output(returnListOrSingleValue)
