# Dynamo custom node FamilyType.FamilyName.dyf (Dynamo 1.3.2.2480)
# category: Clockwork.Revit.Elements.FamilyType.Query
# Returns the *family* name of a given family *type*

familyType = Input()
python_script = Python(IN[0]=familyType)
# ---------- python_script.python (12 lines) ----------
import clr
clr.AddReference('RevitAPI')
from Autodesk.Revit.DB import *

def GetFamilyName(item):
	if hasattr(item, "FamilyName"): return item.FamilyName
	else: return None

items = UnwrapElement(IN[0])

if isinstance(IN[0], list): OUT = [GetFamilyName(x) for x in items]
else: OUT = GetFamilyName(items)
# ----------------------------------------
str = Output(python_script)
