# Dynamo custom node FillPatternElement.IsSolidFill.dyf (Dynamo 1.3.1.1736)
# category: Clockwork.Revit.Elements.FillPatternElement.Query
# Checks if the given FillPatternElement is a solid fill

fillPatternElement = Input(fillPatternElement : FillPatternElement)
python_script = Python(IN[0]=fillPatternElement)
# ---------- python_script.python (11 lines) ----------
import clr
clr.AddReference('RevitAPI')
from Autodesk.Revit.DB import *

def IsSolidFill(fp):
	return fp.GetFillPattern().IsSolidFill

fillpatterns = UnwrapElement(IN[0])

if isinstance(IN[0], list): OUT = [IsSolidFill(x) for x in fillpatterns]
else: OUT = IsSolidFill(fillpatterns)
# ----------------------------------------
bool = Output(python_script)
