# Dynamo custom node Floor.SlabShapeByPoints.dyf (Dynamo 1.3.0.875)
# category: Clockwork.Revit.Elements.Floor.Actions
# Transform a slab shape based on a list of Points

points = Input(points : Autodesk.Point[])
floor = Input()
slabShapeByPoints = Custom[Roof.SlabShapeByPoints](points=points, roof=floor)  # Transform a slab shape based on a list of XYZs.
floor_2 = Output(slabShapeByPoints)  # "floor"
