# Dynamo custom node Grid.Plane.dyf (Dynamo 1.0.0.1180)
# category: Clockwork.Revit.Elements.Grid.Query
# Retrieves the plane of a grid

grid = Input()
curve = Grid.Curve(grid)
type = Object.Type(curve)
string = StringInput("Autodesk.DesignScript.Geometry.Line")
eq = type == string
filterByBoolMask = List.FilterByBoolMask(list=curve, mask=eq)
startPoint = Curve.StartPoint(filterByBoolMask.in)
endPoint = Curve.EndPoint(filterByBoolMask.in)
ZAxis = Vector.ZAxis()
add = Point.Add(point=endPoint, vectorToAdd=ZAxis)
byThreePoints = Plane.ByThreePoints(startPoint, endPoint, add)
plane = Output(byThreePoints)
bool = Output(eq)
