# Dynamo custom node List.DropLastItem.dyf (Dynamo 1.0.0.1180)
# category: Clockwork.Core.List.Actions
# Drops the last item from a given list.

list = Input()
code_block = CodeBlock(l1=list) { List.DropItems(l1,-1); }
list_2 = Output(code_block)  # "list"
