# Dynamo custom node List.RandomElements.dyf (Dynamo 1.3.0.875)
# category: Clockwork.Core.List.Create
# Creates a list of random elements based on a given list of elements

baseElements = Input()
turnIntoList = Custom[Turn Into List](unknownItem=baseElements)  # Turns an element (or a nested list) into a flat list
count = List.Count(turnIntoList)
code_block = CodeBlock(n=count) { n-1; }
amount = Input(amount : int)
randomIntegerList = Custom[Math.RandomIntegerList](max=code_block, amount=amount)  # Creates a list of random integers between 0 and a given maximum value
code_block_2 = CodeBlock(seq=turnIntoList, n=randomIntegerList) { seq[n]; }
seq = Output(code_block_2)
