# Dynamo custom node List.ReplaceItemAtIndex+.dyf (Dynamo 1.3.0.875)
# category: Clockwork.Core.List.Actions
# Replaces the item at a given index (or list of indices) of a list by another item

seq = Input()
replacement = Input()
turnIntoList = Custom[Turn Into List](unknownItem=replacement)  # Turns an element (or a nested list) into a flat list
indices = Input()
turnIntoList_2 = Custom[Turn Into List](unknownItem=indices)
python_script = Python(IN[0]=seq, IN[1]=turnIntoList, IN[2]=turnIntoList_2)
# ---------- python_script.python (8 lines) ----------
_list = IN[0]
rValues = IN[1]
iValues = IN[2]
if len(iValues) > 1 and len(rValues) == 1:
	rValues = [rValues[0]] * len(iValues)
for (index, value) in zip(iValues, rValues):
	_list[index] = value
OUT = _list
# ----------------------------------------
seq_2 = Output(python_script)  # "seq"
