# Dynamo custom node MassFloor.Mass.dyf (Dynamo 1.3.2.2480)
# category: Clockwork.Revit.Elements.MassFloor.Query
# Gets the mass a given mass floor belongs to

massFloor = Input()
python_script = Python(IN[0]=massFloor)
# ---------- python_script.python (16 lines) ----------
import clr
clr.AddReference('RevitAPI')
from Autodesk.Revit.DB import *

clr.AddReference("RevitNodes")
import Revit
clr.ImportExtensions(Revit.Elements)

def GetMass(item):
	if hasattr(item, "OwningMassId"): return item.Document.GetElement(item.OwningMassId).ToDSType(True)
	else: return None

items = UnwrapElement(IN[0])

if isinstance(IN[0], list): OUT = [GetMass(x) for x in items]
else: OUT = GetMass(items)
# ----------------------------------------
mass = Output(python_script)
