# Dynamo custom node PerspectiveView.OrientToEyeAndTargetPosition.dyf (Dynamo 1.3.1.1736)
# category: Clockwork.Revit.Views.PerspectiveView.Actions
# Sets the orientation of a given perspective view based on a given eye and target position. View needs to be in an unlocked state.

view = Input(view : PerspectiveView)
View = Output(view)
eyePosition = Input(eyePosition : Autodesk.Point)
targetPosition = Input(targetPosition : Autodesk.Point)
byTwoPoints = Vector.ByTwoPoints(start=eyePosition, end=targetPosition)
normalized = Vector.Normalized(byTwoPoints)
ZAxis = Vector.ZAxis()
add = Point.Add(point=targetPosition, vectorToAdd=ZAxis)
byThreePoints = Plane.ByThreePoints(eyePosition, targetPosition, add)
normal = Plane.Normal(byThreePoints)
code_block = CodeBlock { 90; }
rotate = Vector.Rotate(normalized, normal, code_block)
correctOrientation = Custom[Normal.CorrectOrientation](VectorA=rotate, VectorB=ZAxis)  # "Vector.CorrectOrientation"; Inverts normal A if its inversion is closer to normal B
python_script = Python(IN[0]=view, IN[1]=eyePosition, IN[2]=correctOrientation, IN[3]=normalized)
# ---------- python_script.python (29 lines) ----------
import clr
clr.AddReference('RevitAPI')
from Autodesk.Revit.DB import *

clr.AddReference("RevitNodes")
import Revit
clr.ImportExtensions(Revit.Elements)
clr.ImportExtensions(Revit.GeometryConversion)

clr.AddReference("RevitServices")
import RevitServices
from RevitServices.Persistence import DocumentManager
from RevitServices.Transactions import TransactionManager

doc = DocumentManager.Instance.CurrentDBDocument
view = UnwrapElement(IN[0])
eyeposition = IN[1].ToXyz()
updirection = IN[2].ToXyz()
forwarddirection = IN[3].ToXyz()

TransactionManager.Instance.EnsureInTransaction(doc)
try:
	newVO = ViewOrientation3D(eyeposition, updirection, forwarddirection)
	view.SetOrientation(newVO)
	view.SaveOrientation()
	OUT = True
except:
	OUT = False
TransactionManager.Instance.TransactionTaskDone()
# ----------------------------------------
success = Output(python_script)
