# Dynamo custom node PointSequences.ShortestPath.dyf (Dynamo 1.3.0.875)
# category: Clockwork.Geometry.PointSequence.Query
# Retrieves the shortest path from a number of point sequences

seq = Input()
accumulatedDistance = Custom[PointSequence.AccumulatedDistance](seq=seq@L2)  # Retrieves the accumulated distances of a sequence of points
minimumItem = List.MinimumItem(accumulatedDistance)
distance = Output(minimumItem)
code_block = CodeBlock(x=minimumItem, y=accumulatedDistance) { x == y; }
bool = Output(code_block)
