# Dynamo custom node RevisionCloud.FromElements.dyf (Dynamo 1.3.0.875)
# category: Clockwork.Revit.Elements.RevisionCloud.Create
# Create a revision cloud for a list of Revit elements

view = Input()
elements = Input()
byElements = Custom[BoundingBox.ByElements](elements=elements, view=view)  # Retrieves a bounding box for a list of elements
plane = Custom[View.Plane](view=view)  # Retrieves the plane of a given view
code_block = CodeBlock(pl=plane) { pl.Normal; }
perimeterCurvesByNormal = Custom[BoundingBox.PerimeterCurvesByNormal](boundingbox=byElements.DynamoBoundingBox, normal=code_block)  # Returns the perimeter curve of a bounding box on a plane determined by a given normal and the centroid of the bounding box
revision = Input()
byCurve = RevisionCloud.ByCurve(view, perimeterCurvesByNormal, revision)
revisionCloud = Output(byCurve)
