# Dynamo custom node Roof.SlabShapeByPoints.dyf (Dynamo 0.8.2.2392)
# category: Clockwork.Revit.Elements.Roof.Actions
# Transform a slab shape based on a list of XYZs. PLEASE NOTE: Will reset any previous edits on the slab shape.

points = Input(points : Autodesk.Point[])
turn_into_list = Custom[Turn Into List](points)  # Turns an element (or a nested list) into a flat list
roof = Input()
python_script = Python(IN[0]=turn_into_list, IN[1]=roof)
# ---------- python_script.python (26 lines) ----------
import clr
clr.AddReference('RevitAPI')
from Autodesk.Revit.DB import *

clr.AddReference("RevitNodes")
import Revit
clr.ImportExtensions(Revit.GeometryConversion)

clr.AddReference("RevitServices")
import RevitServices
from RevitServices.Persistence import DocumentManager
from RevitServices.Transactions import TransactionManager

doc = DocumentManager.Instance.CurrentDBDocument
xyzs = IN[0]
slabshape = UnwrapElement(IN[1])
successlist = list()
faillist = list()

TransactionManager.Instance.EnsureInTransaction(doc)
slabshape.SlabShapeEditor.ResetSlabShape()
for item in xyzs:
	slabshape.SlabShapeEditor.DrawPoint(item.ToXyz())
TransactionManager.Instance.TransactionTaskDone()

OUT = slabshape
# ----------------------------------------
roof_2 = Output(python_script)  # "roof"
