# Dynamo custom node Room.InsertsOfBoundariesByCategory.dyf (Dynamo 0.8.2.2392)
# category: Clockwork.Revit.Elements.Room.Query
# Retrieves the inserts of the bounding elements of a given room - filtered by a given category.

filterByBoolMask = List.FilterByBoolMask()
room = Input()
includeOpenings = Input(includeOpenings : bool = false)
includeShadows = Input(includeShadows : bool = false)
includeEmbeddedWalls = Input(includeEmbeddedWalls : bool = false)
includeSharedEmbeddedInserts = Input(includeSharedEmbeddedInserts : bool = false)
insertsOfBoundaries = Custom[Room.InsertsOfBoundaries](room=room, includeOpenings=includeOpenings, includeShadows=includeShadows, includeEmbeddedWalls=includeEmbeddedWalls, includeSharedEmbeddedInserts=includeSharedEmbeddedInserts)  # Retrieves the inserts of the bounding elements of a given room.
category = Input()
isOfCategory = Custom[Element.IsOfCategory](category=category)  # Checks whether an element is of a specified category
map = List.Map(list=insertsOfBoundaries, f_x=isOfCategory)
combine = List.Combine(filterByBoolMask.in, insertsOfBoundaries, map)
inserts = Output(combine)
