# Dynamo custom node StructuralFoundation.Kind.dyf (Dynamo 1.3.1.1736)
# category: Clockwork.Revit.Elements.StructuralFoundation.Query
# Retrieves the kind of a given structural foundation (isolated, wall, slab).

structuralFoundation = Input()
python_script = Python(IN[0]=structuralFoundation)
# ---------- python_script.python (15 lines) ----------
import clr
clr.AddReference('RevitAPI')
from Autodesk.Revit.DB import *

def GetFoundationKind(item):
	if not item: return None
	elif item.GetType().Name == 'FamilyInstance': return 'Isolated'
	elif item.GetType().Name == 'WallFoundation': return 'Wall Footing'
	elif item.GetType().Name == 'Floor': return 'Slab'
	else: return None

items = UnwrapElement(IN[0])

if isinstance(IN[0], list): OUT = [GetFoundationKind(x) for x in items]
else: OUT = GetFoundationKind(items)
# ----------------------------------------
kind = Output(python_script)
