# Dynamo custom node Surface.IsPlanar.dyf (Dynamo 1.3.0.875)
# category: Clockwork.Geometry.Surface.Query
# Checks whether a face is planar

surface = Input(surface : Surface)
turnIntoList = Custom[Turn Into List](unknownItem=surface)  # Turns an element (or a nested list) into a flat list
code_block = CodeBlock { 3; }
gridFromFace = Custom[Paneling.GridFromFace](surface=turnIntoList@L1, U=code_block, V=code_block)  # Returns UV coordinates, XYZ coordinates and normals for a face with UV subdivision
byBestFitThroughPoints = Plane.ByBestFitThroughPoints(gridFromFace.Points)
intersect = Geometry.Intersect(geometry=gridFromFace.Points, other=byBestFitThroughPoints)
isEmpty = List.IsEmpty(intersect@@L2)
allFalse = AllFalse(isEmpty@L2)
returnListOrSingleValue = Custom[ReturnListOrSingleValue](unknownItem=surface, seq=allFalse)  # If the item in input #1 is not a list, only the first item of the list in input #2 will be returned.
bool = Output(returnListOrSingleValue)
