# Dynamo custom node Switch.dyf (Dynamo 1.3.0.875)
# category: Clockwork.Core.Logic.Actions
# Emulates the Switch/Case statement that is  available in multiple programming languages.

Check = Input()
turnIntoList = Custom[Turn Into List](unknownItem=Check)  # Turns an element (or a nested list) into a flat list
Cases = Input()
Values = Input()
matchWithKeyValues = Custom[Match List With Key Values](seq=turnIntoList, keys=Cases, values=Values)  # "List.MatchWithKeyValues"; Matches a list with a given set of keys and returns the values corresponding to the keys
getKeys = GetKeys(matchWithKeyValues)
isEmpty = List.IsEmpty(matchWithKeyValues@L2)
filterByBoolMask = List.FilterByBoolMask(list=getKeys, mask=isEmpty)
Default = Input()
replaceItemAtIndex = Custom[List.ReplaceItemAtIndex](seq=matchWithKeyValues, indices=filterByBoolMask.in, replacement=Default)  # Replaces the item at a given index (or list of indices) of a list by another item
Result = Output(replaceItemAtIndex)
