# Dynamo custom node TextElement.SetText.dyf (Dynamo 1.3.1.1736)
# category: Clockwork.Revit.Elements.TextElement.Actions
# Sets the text of a given text element. Unlike the OOTB node TextNote.SetText, this one works on ModelText as well.

element = Input()
turnIntoList = Custom[Turn Into List](unknownItem=element)  # Turns an element (or a nested list) into a flat list
text = Input(text : string)
turnIntoList_2 = Custom[Turn Into List](unknownItem=text)
code_block = CodeBlock(turnIntoList, turnIntoList_2)
# ---------- code_block.designscript (5 lines) ----------
num = List.Count(seq1);
cond = List.Count(seq2) < 2 && num > 1;
seq3[0] = List.OfRepeatedItem(seq2[0],num);
seq3[1] = seq2;
seq3[cond ? 0 : 1];
# ----------------------------------------
python_script = Python(IN[0]=turnIntoList, IN[1]=code_block.out4)
# ---------- python_script.python (30 lines) ----------
import clr
clr.AddReference('RevitAPI')
from Autodesk.Revit.DB import *

clr.AddReference("RevitNodes")
import Revit
clr.ImportExtensions(Revit.Elements)

clr.AddReference("RevitServices")
import RevitServices
from RevitServices.Persistence import DocumentManager
from RevitServices.Transactions import TransactionManager

doc = DocumentManager.Instance.CurrentDBDocument
items = UnwrapElement(IN[0])
texts = IN[1]
booleans = list()
counter = 0

TransactionManager.Instance.EnsureInTransaction(doc)
while counter < len(items):
	try:
		items[counter].Text = texts[counter]
		booleans.append(True)
	except:
		booleans.append(False)
	counter += 1
TransactionManager.Instance.TransactionTaskDone()

OUT = (items,booleans)
# ----------------------------------------
code_block_2 = CodeBlock(seq=python_script) { seq[0]; seq[1]; }
element_2 = Output(code_block_2.out0)  # "element"
success = Output(code_block_2.out1)
