# Dynamo custom node Topography.IntersectionWithPlane.dyf (Dynamo 1.3.0.875)
# category: Clockwork.Revit.Elements.Topography.Actions
# Calculates the intersection of a toposurface and a plane

plane = Input(plane : Plane)
topo = Input(topo : Topography)
mesh = Topography.Mesh(topo)
intersectionWithPlane = Custom[Mesh.IntersectionWithPlane](plane=plane, mesh=mesh)  # Calculates the intersection of a mesh and a plane
points = Output(intersectionWithPlane.points)
polyCurve = Output(intersectionWithPlane.polyCurve)
nurbsCurveByPoints = Output(intersectionWithPlane.nurbsCurveByPoints)
nurbsCurveByControlPoints = Output(intersectionWithPlane.nurbsCurveByControlPoints)
