# Dynamo custom node View.PermanentlyIsolateCategory.dyf (Dynamo 1.3.1.1736)
# category: Clockwork.Revit.Views.View.Actions
# Permanently isolates categories in the given view

view = Input()
category = Input()
turnIntoList = Custom[Turn Into List](unknownItem=category)  # Turns an element (or a nested list) into a flat list
temporarilyIsolateCategory = Custom[View.TemporarilyIsolateCategory](view=view, category=turnIntoList)  # Temporarily isolates categories in the given view
convertTemporaryHideIsolateToPermanent = Custom[View.ConvertTemporaryHideIsolateToPermanent](view=temporarilyIsolateCategory.view)  # Convert all temporary hidden elements or categories to permanently hidden in the given view.
view_2 = Output(convertTemporaryHideIsolateToPermanent.view)  # "view"
category_2 = Output(category)  # "category"
success = Output(convertTemporaryHideIsolateToPermanent.success)
