# Dynamo custom node View.Phase.dyf (Dynamo 1.3.1.1736)
# category: Clockwork.Revit.Views.View.Query
# Returns the phase of a given view

view = Input()
python_script = Python(IN[0]=view)
# ---------- python_script.python (16 lines) ----------
import clr
clr.AddReference('RevitAPI')
from Autodesk.Revit.DB import *

clr.AddReference("RevitNodes")
import Revit
clr.ImportExtensions(Revit.Elements)

def GetViewPhase(view):
	try: return view.Document.GetElement(view.get_Parameter(BuiltInParameter.VIEW_PHASE).AsElementId())
	except: return None

views = UnwrapElement(IN[0])

if isinstance(IN[0], list): OUT = [GetViewPhase(x) for x in views]
else: OUT = GetViewPhase(views)
# ----------------------------------------
phase = Output(python_script)
