# Dynamo custom node View.TemporarilyIsolateCategory.dyf (Dynamo 1.3.1.1736)
# category: Clockwork.Revit.Views.View.Actions
# Temporarily isolates categories in the given view

category = Input()
turnIntoList = Custom[Turn Into List](unknownItem=category)  # Turns an element (or a nested list) into a flat list
view = Input()
python_script = Python(IN[0]=turnIntoList, IN[1]=view)
# ---------- python_script.python (25 lines) ----------
import clr
clr.AddReference('RevitAPI')
from Autodesk.Revit.DB import *
from System.Collections.Generic import *

clr.AddReference("RevitServices")
import RevitServices
from RevitServices.Persistence import DocumentManager
from RevitServices.Transactions import TransactionManager

doc = DocumentManager.Instance.CurrentDBDocument
cats = UnwrapElement(IN[0])
view = UnwrapElement(IN[1])
ids = list()

for cat in cats:
	ids.append(cat.Id)
icats = List[ElementId](ids)

TransactionManager.Instance.EnsureInTransaction(doc)
try:
	view.IsolateCategoriesTemporary(icats)
	OUT = (view, True)
except: OUT = (view, False)
TransactionManager.Instance.TransactionTaskDone()
# ----------------------------------------
code_block = CodeBlock(seq=python_script) { seq[0]; seq[1]; }
view_2 = Output(code_block.out0)  # "view"
category_2 = Output(category)  # "category"
success = Output(code_block.out1)
