# Dynamo custom node View.ViewTemplate.dyf (Dynamo 1.3.3.4651)
# category: Clockwork.Revit.Views.View.Query
# Returns the view template assigned to a given view (if one is assigned)

view = Input()
python_script = Python(IN[0]=view)
# ---------- python_script.python (15 lines) ----------
import clr
clr.AddReference('RevitAPI')
from Autodesk.Revit.DB import *

def GetViewTemplate(view):
	if not view: return None
	elif hasattr(view, "ViewTemplateId"):
		if view.ViewTemplateId.IntegerValue == -1: return None
		else: return view.Document.GetElement(view.ViewTemplateId)
	else: return None

views = UnwrapElement(IN[0])

if isinstance(IN[0], list): OUT = [GetViewTemplate(x) for x in views]
else: OUT = GetViewTemplate(views)
# ----------------------------------------
ViewTemplate = Output(python_script)
