# Dynamo custom node View3D.IsLocked.dyf (Dynamo 0.8.1.1823)
# category: Clockwork.Revit.Views.View3D.Query
# Checks if a given view is locked

view3d = Input(view3d : Elements.View3D)
turn_into_list = Custom[Turn Into List](view3d)  # Turns an element (or a nested list) into a flat list
python_script = Python(IN[0]=turn_into_list)
# ---------- python_script.python (16 lines) ----------
import clr
clr.AddReference('RevitAPI')
from Autodesk.Revit.DB import *

views = UnwrapElement(IN[0])
elementlist = list()
notaview = list()
for view in views:
	try:
		if view.IsLocked:
			elementlist.append(True)
		else:
			elementlist.append(False)
	except:
		elementlist.append(False)
OUT = elementlist
# ----------------------------------------
returnListOrSingleValue = Custom[ReturnListOrSingleValue](Item_1_unknown=view3d, Item_2_list=python_script)  # If the item in input #1 is not a list, only the first item of the list in input #2 will be returned.
bool = Output(returnListOrSingleValue)
