# Dynamo custom node All Elements Of Type+.dyf (Dynamo 2.0.3.8810)
# category: Clockwork.Revit.Selection.Collectors.Query
# Gets all placed elements of a given element type in the model. Unlike the OOTB node, it can also return ConnectorElements, CurveElements and Materials.

elementType = Input(elementType: var[]..[])
toggle = Input(toggle: bool = true)
docOrRevitLinkInstance = Input(docOrRevitLinkInstance: var = null)  # Use only if you want to query a linked model
python_script = Python(IN[0]=elementType, IN[1]=toggle, IN[2]=docOrRevitLinkInstance)
# ---------- python_script.python (23 lines) ----------
import System
import clr
clr.AddReference('RevitAPI')
from Autodesk.Revit.DB import *

clr.AddReference("RevitServices")
import RevitServices
from RevitServices.Persistence import DocumentManager

def ElementsByType(etype, doc):
	try:
		collector = FilteredElementCollector(doc).OfClass(etype)
		return collector.ToElements()
	except: return None

inputdoc = UnwrapElement(IN[2])
if not inputdoc: doc = DocumentManager.Instance.CurrentDBDocument
elif inputdoc.GetType().ToString() == "Autodesk.Revit.DB.RevitLinkInstance": doc = inputdoc.GetLinkDocument()
elif inputdoc.GetType().ToString() == "Autodesk.Revit.DB.Document": doc = inputdoc
else: doc = DocumentManager.Instance.CurrentDBDocument

if isinstance(IN[0], list): OUT = [ElementsByType(x, doc) for x in IN[0]]
else: OUT = ElementsByType(IN[0], doc)
# ----------------------------------------
elements = Output(python_script)
