# Dynamo custom node All Elements of Family Type+.dyf (Dynamo 2.0.1.5055)
# category: Clockwork.Revit.Selection.Collectors.Query
# Retrieves all placed instances of a given family type. Unlike the OOTB node, this node also supports family types of system families and collecting from linked models.

familyType = Input(familyType: var[]..[])
toggle = Input(toggle: bool = true)
docOrRevitLinkInstance = Input(docOrRevitLinkInstance: var = null)  # Use only if you want to query a linked model
python_script = Python(IN[0]=familyType, IN[1]=toggle, IN[2]=docOrRevitLinkInstance)
# ---------- python_script.python (24 lines) ----------
import System
import clr
clr.AddReference('RevitAPI')
from Autodesk.Revit.DB import *

clr.AddReference("RevitServices")
import RevitServices
from RevitServices.Persistence import DocumentManager

def InstancesOfFamilyType(ft, doc):
	collector = FilteredElementCollector(doc)
	bic = System.Enum.ToObject(BuiltInCategory, ft.Category.Id.IntegerValue)
	collector.OfCategory(bic)
	return [x for x in collector.ToElements() if x.GetTypeId().IntegerValue == ft.Id.IntegerValue]

famtypes = UnwrapElement(IN[0])
inputdoc = UnwrapElement(IN[2])
if not inputdoc: doc = DocumentManager.Instance.CurrentDBDocument
elif inputdoc.GetType().ToString() == "Autodesk.Revit.DB.RevitLinkInstance": doc = inputdoc.GetLinkDocument()
elif inputdoc.GetType().ToString() == "Autodesk.Revit.DB.Document": doc = inputdoc
else: doc = DocumentManager.Instance.CurrentDBDocument

if isinstance(IN[0], list): OUT = [InstancesOfFamilyType(x, doc) for x in famtypes]
else: OUT = InstancesOfFamilyType(famtypes, doc)
# ----------------------------------------
elements = Output(python_script)
