# Dynamo custom node All Families Of Category.dyf (Dynamo 2.0.4.12684)
# category: Clockwork.Revit.Selection.Collectors.Query
# Gets all famiies of a given category in the model  (does *not *work for system families)

docOrRevitLinkInstance = Input(docOrRevitLinkInstance: var = null)  # Use only if you want to query a linked model
toggle = Input(toggle: bool = true)
python_script = Python(IN[0]=docOrRevitLinkInstance, IN[1]=toggle)
# ---------- python_script.python (17 lines) ----------
import System
import clr
clr.AddReference('RevitAPI')
from Autodesk.Revit.DB import *

clr.AddReference("RevitServices")
import RevitServices
from RevitServices.Persistence import DocumentManager

inputdoc = UnwrapElement(IN[0])
if not inputdoc: doc = DocumentManager.Instance.CurrentDBDocument
elif inputdoc.GetType().ToString() == "Autodesk.Revit.DB.RevitLinkInstance": doc = inputdoc.GetLinkDocument()
elif inputdoc.GetType().ToString() == "Autodesk.Revit.DB.Document": doc = inputdoc
else: doc = DocumentManager.Instance.CurrentDBDocument

collector = FilteredElementCollector(doc).OfClass(Family)
OUT =  collector.ToElements()
# ----------------------------------------
category = Custom[Element.Category+](element=python_script)  # Returns the category of a given element. Unlike the OOTB node Element.GetCategory, it will work for subcategories, families, family documents, schedules, graphics styles and view filters as well.
groupByKey = List.GroupByKey(list=python_script, keys=category.builtInCategory)
category_2 = Input(category: var[]..[])  # Works with categories, BuiltInCategories and BuiltInCategories as strings
fromInput = Custom[BuiltInCategory.FromInput](input=category_2)  # Returns a BuiltInCategory from a category, a Dynamo-wrapped category, a BuiltInCategory or a string representing a BuiltInCategory.
indexOf = List.IndexOf(list=groupByKey.unique_keys, element=fromInput)
getItemAtIndex = List.GetItemAtIndex(list=groupByKey.groups, index=indexOf)
empty = List.Empty()
replaceNull = Custom[List.ReplaceNull](seq=getItemAtIndex, replacement=empty)  # Replaces all null values within a given list with a substitute
families = Output(replaceNull)
