# Dynamo custom node All Intersecting Elements Of Category By Vector.dyf (Dynamo 1.3.1.1736)
# category: Clockwork.Revit.Selection.Collectors.Query
# Finds all elements of a specified category that intersect with a list of vectors

startPoint = Input(startPoint : Autodesk.Point)
threeDView = Input(threeDView : Elements.View3D)
category = Input()
turnIntoList = Custom[Turn Into List](unknownItem=startPoint)  # Turns an element (or a nested list) into a flat list
endPoint = Input(endPoint : Autodesk.Point)
turnIntoList_2 = Custom[Turn Into List](unknownItem=endPoint)
toggle = Input(toggle : bool = true)
python_script = Python(IN[0]=threeDView, IN[1]=category, IN[2]=turnIntoList, IN[3]=turnIntoList_2, IN[4]=toggle)
# ---------- python_script.python (33 lines) ----------
import System
import clr
clr.AddReference('RevitAPI')
from Autodesk.Revit.DB import *

clr.AddReference("RevitNodes")
import Revit
clr.ImportExtensions(Revit.Elements)
clr.ImportExtensions(Revit.GeometryConversion)

clr.AddReference("RevitServices")
import RevitServices
from RevitServices.Persistence import DocumentManager

doc = DocumentManager.Instance.CurrentDBDocument
theview = UnwrapElement(IN[0])
cat = System.Enum.ToObject(BuiltInCategory, IN[1].Id)
vstart = [x.ToXyz() for x in IN[2]]
vend = [x.ToXyz() for x in IN[3]]

intersectorlist = list()
counter = 0
filter = ElementCategoryFilter(cat)

while counter < len(vstart):
	ThisReferenceArr = ReferenceIntersector(filter, FindReferenceTarget.All, theview)
	found = ThisReferenceArr.Find(vstart[counter], vend[counter])
	foundreferences = list()
	for item in found:
		foundreferences.append(doc.GetElement(item.GetReference()))
	intersectorlist.append(foundreferences)
	counter += 1
OUT = intersectorlist
# ----------------------------------------
uniqueItems = List.UniqueItems()  # unwired: arg0
map = List.Map(list=python_script, f_x=uniqueItems)
returnListOrSingleValue = Custom[ReturnListOrSingleValue](unknownItem=startPoint, seq=map)  # If the item in input #1 is not a list, only the first item of the list in input #2 will be returned.
elements = Output(returnListOrSingleValue)
firstItem = List.FirstItem()  # unwired: arg0
map_2 = List.Map(list=python_script, f_x=firstItem)
returnListOrSingleValue_2 = Custom[ReturnListOrSingleValue](unknownItem=startPoint, seq=map_2)
firstItem_2 = Output(returnListOrSingleValue_2)  # "firstItem"
