# Dynamo custom node All Placed Family Types of Category.dyf (Dynamo 2.0.1.5055)
# category: Clockwork.Revit.Selection.Collectors.Query
# Retrieves all family types of a given category that have *placed* instances

category = Input(category: Revit.Elements.Category)
all_elements_of_category = ElementsOfCategory(Category=category)
elementType = Custom[Element.ElementType+](element=all_elements_of_category)  # Gets the family type of a given element (if applicable). Unlike the OOTB node, it also works for elements in linked models.
uniqueItems = List.UniqueItems(list=elementType)
familyTypes = Output(uniqueItems)
