# Dynamo custom node AlphabeticalSequence.ByNumber.dyf (Dynamo 1.3.0.875)
# category: Clockwork.List.Generate.Create
# Creates a list of the first N letters of the alphabet  (where 1 = A, 2 = B, ... , 27 = AA, 28 = AB etc.).

n = Input(n : int)
code_block = CodeBlock(n=n) { 1..n; }
upperCase = Input(upperCase : bool = false)
fromNumber = Custom[Character.FromNumber](n=code_block@L2, upperCase=upperCase)  # Converts a number into a character (where 1 = A, 2 = B, ... , 27 = AA, 28 = AB etc.).
flatten = Flatten(fromNumber)
seq = Output(flatten)
