# Dynamo custom node Angle.ByLawOfCosines.dyf (Dynamo 0.8.1.1823)
# category: Clockwork.Math.Formulas.Query
# Computes an angle of a triangle using the law of cosines. A is the opposite side of the triangle while B and C are the sides forming the angle.

sideB = Input(sideB : double)
sideC = Input(sideC : double)
sideA = Input(sideA : double)
code_block = CodeBlock(b=sideB, c=sideC, a=sideA) { Math.Acos((Math.Pow(b,2)+Math.Pow(c,2)-Math.Pow(a,2))/(2*b*c)); }
alpha = Output(code_block)
