# Dynamo custom node AreaSeparator.FromCurve.dyf (Dynamo 2.12.1.8246)
# category: Clockwork.Revit.Elements.ModelCurve.Create
# Creates area separation lines from geometry curves.
# packages: Clockwork for Dynamo 2.x 2.6.0

curve = Input(curve: Autodesk.DesignScript.Geometry.Curve[]..[])
areaPlan = Input(areaPlan: Revit.Elements.Views.AreaPlanView)
plane = Custom[View.Plane](view=areaPlan)  # package Clockwork for Dynamo 2.x; Retrieves the plane of a given view
pullOntoPlane = Curve.PullOntoPlane(curve=curve, plane=plane)
byPlane = SketchPlane.ByPlane(plane=plane)
python_script = Python(IN[0]=pullOntoPlane, IN[1]=byPlane, IN[2]=areaPlan)  # IronPython2
# ---------- python_script.python (29 lines) ----------
import clr
clr.AddReference('RevitAPI')
from Autodesk.Revit.DB import *

clr.AddReference("RevitNodes")
import Revit
clr.ImportExtensions(Revit.GeometryConversion)

clr.AddReference("RevitServices")
import RevitServices
from RevitServices.Persistence import DocumentManager
from RevitServices.Transactions import TransactionManager

doc = DocumentManager.Instance.CurrentDBDocument
curves = UnwrapElement(IN[0])
sketchplane = UnwrapElement(IN[1])
view = UnwrapElement(IN[2])
elementlist = list()

if str(view.ViewType) == "AreaPlan":
	TransactionManager.Instance.EnsureInTransaction(doc)
	doccreation = doc.Create
	for curve in curves:
		separator = doccreation.NewAreaBoundaryLine(sketchplane, curve.ToRevitType(), view)
		elementlist.append(separator)
	TransactionManager.Instance.TransactionTaskDone()
else:
	elementlist = list("The active view needs to be an area plan...")
OUT = elementlist
# ----------------------------------------
areaSeparator = Output(python_script)
