# Dynamo custom node Booleans.AnyFalse.dyf (Dynamo 1.3.1.1736)
# category: Clockwork.List.Inspect.Query
# Returns true if any item in a list of booleans is false.

seq = Input(seq : bool[])
countFalse = CountFalse(seq)
code_block = CodeBlock(n=countFalse) { n > 0; }
bool = Output(code_block)
