# Dynamo custom node Booleans.AnyTrue.dyf (Dynamo 1.3.1.1736)
# category: Clockwork.List.Inspect.Query
# Returns true if any item in a list of booleans is true.

seq = Input(seq : bool[])
countTrue = CountTrue(seq)
code_block = CodeBlock(n=countTrue) { n > 0; }
bool = Output(code_block)
