# Dynamo custom node BoundingBox.PerimeterCurvesOnPlane.dyf (Dynamo 1.3.0.875)
# category: Clockwork.Geometry.BoundingBox.Query
# Returns the perimeter curve of a bounding box on a given plane (assuming that the bounding box and plane intersect)

plane = Input(plane : Plane)
boundingbox = Input(boundingbox : BoundingBox)
toCuboid = BoundingBox.ToCuboid(boundingbox)
intersect = Geometry.Intersect(geometry=plane, other=toCuboid)
flatten = Flatten(intersect)
perimeterCurves = Surface.PerimeterCurves(flatten)
curves = Output(perimeterCurves)
