# Dynamo custom node Category.FromInput.dyf (Dynamo 2.3.1.11775)
# category: Clockwork.Revit.Selection.Miscellaneous.Query
# Returns a category from a category, a Dynamo-wrapped category, a BuiltInCategory or a string representing a BuiltInCategory.

category = Input(category: var[]..[])
python_script = Python(IN[0]=category)
# ---------- python_script.python (30 lines) ----------
import System
import clr
clr.AddReference('RevitAPI')
from Autodesk.Revit.DB import *

clr.AddReference("RevitNodes")
import Revit
clr.ImportExtensions(Revit.Elements)

clr.AddReference("RevitServices")
import RevitServices
from RevitServices.Persistence import DocumentManager

doc = DocumentManager.Instance.CurrentDBDocument
bics = System.Enum.GetValues(BuiltInCategory)
cats = UnwrapElement(IN[0])

if not hasattr(cats,"__iter__"):
	cats = [cats]

output = []

for cat in cats:
	cattype = cat.GetType().ToString()
	if cattype == "Autodesk.Revit.DB.Category": output.append(cat)
	elif  cattype == "Autodesk.Revit.DB.BuiltInCategory": output.append(Category.GetCategory(doc, cat))
	elif cattype == "System.String": 
			found = [x for x in bics if x.ToString() == cat]
			if len(found) > 0: output.append( Category.GetCategory(doc, found[0]))
OUT = output
# ----------------------------------------
RevitCategory = Output(python_script)
