# Dynamo custom node Character.ToNumber.dyf (Dynamo 1.3.0.875)
# category: Clockwork.Core.String.Generate.Actions
# Converts an Excel-style character to a number (e.g. A = 1, AA = 27 etc.).

str = Input(str : string)
turnIntoList = Custom[TurnIntoList](unknownItem=str)  # Turns an element (or a nested list) into a flat list
toLower = String.ToLower(turnIntoList)
fromString = Custom[List.FromString](str=toLower)  # Chops up a string into a list of characters
count = List.Count(fromString@L2)
code_block = CodeBlock(n=count) { 0..#n..26; }
reverse = List.Reverse(code_block@L2)
code_block_2 = CodeBlock { "a".."z"; }
indexOf = IndexOf(code_block_2, fromString@@L1)
code_block_3 = CodeBlock(level=reverse, n=indexOf) { level == 0 ? n + 1 : level * (n + 1); }
sum = Math.Sum(code_block_3@L2)
returnListOrSingleValue = Custom[ReturnListOrSingleValue](unknownItem=str, seq=sum)  # If the unknown item is not a list but rather a single item, only the first item of the list (input "seq") will be returned.
int = Output(returnListOrSingleValue)
