# Dynamo custom node CustomNode.Properties.dyf (Dynamo 2.0.1.5055)
# category: Clockwork.ImportExport.Query
# Extracts information from a custom node.

path = Input(path: string)
fromPath = FileObject(path=path)  # "File.FromPath"
readText = FileSystem.ReadText(file=fromPath)
python_script = Python(IN[0]=readText)
# ---------- python_script.python (81 lines) ----------
import clr
import sys
pyt_path = r'C:\Program Files (x86)\IronPython 2.7\Lib'
sys.path.append(pyt_path)
import xml.etree.ElementTree as ET

elementlist = []

root = ET.fromstring(IN[0])
node_ver = root.get("Version")
node_name = root.get("Name")
node_id = root.get("ID")
node_desc = root.get("Description")
node_cat = root.get("Category")
isvisible = root.get("IsVisibleInDynamoLibrary")
if isvisible: node_visible = isvisible
else: node_visible = True
node_inputs = []
node_input_types = []
node_input_defaults = []
node_input_desc = []
node_outputs = []
node_output_desc = []
node_scripts = []
node_customnodes = []
node_customnodes_count = []
node_ootbnodes = []
node_ootbnodes_count = []

for child in root:
	if child.tag == "Elements":
		for element in child:
			if element.tag == "Dynamo.Nodes.Symbol" or element.tag == "Dynamo.Graph.Nodes.CustomNodes.Symbol":
				for symbol in element:
					inputdef = symbol.get("value")
					inputdef2 = inputdef.split(":")
					if inputdef2[0].startswith('//'):
						inputdef4 = inputdef2[0].splitlines()
						node_inputs.append(inputdef4[-1].strip())
						node_input_desc.append(inputdef4[0][2:].strip())
					else:
						node_inputs.append(inputdef2[0].strip())
						node_input_desc.append("")
					if len(inputdef2) > 1:
						inputdef3 = inputdef2[1].split("=")
						node_input_types.append(inputdef3[0].strip())
						if len(inputdef3) > 1:
							node_input_defaults.append(inputdef3[1].strip())
						else:
							node_input_defaults.append("")
					else:
						node_input_types.append("")
						node_input_defaults.append("")
			elif element.tag == "Dynamo.Nodes.Output" or element.tag == "Dynamo.Graph.Nodes.CustomNodes.Output":
				for symbol in element:
					outputdef = symbol.get("value")
					if outputdef != None:
						if outputdef.startswith('//'):
							outputdef2 = outputdef.splitlines()
							node_outputs.append(outputdef2[-1].strip())
							node_output_desc.append(outputdef2[0][2:].strip())
						else:
							node_outputs.append(outputdef.strip())
							node_output_desc.append("")
			elif element.tag == "DSIronPythonNode.PythonNode" or element.tag == "PythonNodeModels.PythonNode":
				for script in element:
					if script.text != None:
						node_scripts.append(script.text)
			elif element.tag == "Dynamo.Nodes.Function" or element.tag == "Dynamo.Graph.Nodes.CustomNodes.Function":
				if element.get("nickname") in node_customnodes:
					node_customnodes_count[node_customnodes.index(element.get("nickname"))] += 1
				else:
					node_customnodes.append(element.get("nickname"))
					node_customnodes_count.append(1)
			else:
				if element.get("nickname") in node_ootbnodes:
					node_ootbnodes_count[node_ootbnodes.index(element.get("nickname"))] += 1
				else:
					node_ootbnodes.append(element.get("nickname"))
					node_ootbnodes_count.append(1)
OUT = (node_ver,node_name,node_id,node_desc,node_cat,node_inputs,node_input_types,node_input_defaults,node_outputs,node_scripts,node_customnodes,node_customnodes_count,node_ootbnodes,node_ootbnodes_count,node_input_desc,node_output_desc, node_visible)
# ----------------------------------------
code_block = CodeBlock(seq=python_script)
# ---------- code_block.designscript (17 lines) ----------
seq[0];
seq[1];
seq[2];
seq[3];
seq[4];
seq[5];
seq[6];
seq[7];
seq[8];
seq[9];
seq[10];
seq[11];
seq[12];
seq[13];
seq[14];
seq[15];
seq[16];
# ----------------------------------------
Version = Output(code_block.out0)
Name = Output(code_block.out1)
ID = Output(code_block.out2)
Description = Output(code_block.out3)
Category = Output(code_block.out4)
Inputs = Output(code_block.out5)
InputDataTypes = Output(code_block.out6)
InputDefaultVals = Output(code_block.out7)
Outputs = Output(code_block.out8)
PythonScripts = Output(code_block.out9)
NestedCustomNodes = Output(code_block.out10)
CustomNodesCount = Output(code_block.out11)
NestedBuiltinNodes = Output(code_block.out12)
BuiltinNodesCount = Output(code_block.out13)
InputDescriptions = Output(code_block.out14)
OutputDescriptions = Output(code_block.out15)
IsVisibleInLibrary = Output(code_block.out16)
