# Dynamo custom node Data.ExportCSV+.dyf (Dynamo 1.3.0.875)
# category: Clockwork.ImportExport.Actions
# Writes data to a CSV file with a custom delimiter. Data inputs needs to contain strings only!

path = Input(path : string)
code_block = CodeBlock { ".csv"; ".CSV"; ""; }
replace = String.Replace(str=path, searchFor=code_block.out0, replaceWith=code_block.out2)
replace_2 = String.Replace(str=replace, searchFor=code_block.out1, replaceWith=code_block.out2)
code_block_2 = CodeBlock(path=replace_2, ext=code_block.out0) { path + ext; }
string = StringInput("\n")
delimiter = Input(delimiter : string = ",")
data = Input()
join = String.Join(delimiter, data)
flatten = Flatten(join)
join_2 = String.Join(string, flatten)
firstItem = List.FirstItem(join_2)
writeText = File.WriteText(code_block_2, firstItem)
void = Output(writeText)
