# Dynamo custom node Data.ImportCSV+.dyf (Dynamo 1.3.0.875)
# category: Clockwork.ImportExport.Actions
# Converts the content of a given CSV file to a list

ignoreLastRow = Input(ignoreLastRow : bool = false)
ignoreFirstRow = Input(ignoreFirstRow : bool = false)
CSVstring = Input(CSVstring : string)
string = StringInput("\n")
split = String.Split(CSVstring, string)
delimiter = Input(delimiter : string = ",")
split_2 = String.Split(split@L2, delimiter)
firstItem = List.FirstItem(split_2)
restOfItems = List.RestOfItems(firstItem)
scopeIf = Custom[ScopeIf+](test=ignoreFirstRow, true=restOfItems, false=firstItem)  # A (hopefully) more robust implementation of ScopeIf. Tests a single boolean and returns a value accordingly.
dropLastItem = Custom[List.DropLastItem](list=scopeIf)  # Drops the last item from a given list.
scopeIf_2 = Custom[ScopeIf+](test=ignoreLastRow, true=dropLastItem, false=scopeIf)
trimWhitespace = String.TrimWhitespace(scopeIf_2)
seq = Output(trimWhitespace)
