# Dynamo custom node Dimension.SetType.dyf (Dynamo 1.3.1.1736)
# category: Clockwork.Revit.Elements.Dimension.Actions
# Changes the dimension type of a given dimension instance to the specified type

dimensionInstance = Input()
turnIntoList = Custom[Turn Into List](unknownItem=dimensionInstance)  # Turns an element (or a nested list) into a flat list
dimensionType = Input()
python_script = Python(IN[0]=turnIntoList, IN[1]=dimensionType)
# ---------- python_script.python (23 lines) ----------
import clr
clr.AddReference('RevitAPI')
from Autodesk.Revit.DB import *

clr.AddReference("RevitServices")
import RevitServices
from RevitServices.Persistence import DocumentManager
from RevitServices.Transactions import TransactionManager

doc = DocumentManager.Instance.CurrentDBDocument
diminsts = UnwrapElement(IN[0])
dimtype = UnwrapElement(IN[1])
booleans = list()

TransactionManager.Instance.EnsureInTransaction(doc)
for item in diminsts:
	try:
		item.DimensionType = dimtype
		booleans.append(True)
	except:
		booleans.append(False)
TransactionManager.Instance.TransactionTaskDone()
OUT = (diminsts,booleans)
# ----------------------------------------
code_block = CodeBlock(seq=python_script) { seq[0]; seq[1]; }
dimensionInstance_2 = Output(code_block.out0)  # "dimensionInstance"
success = Output(code_block.out1)
