# Dynamo custom node DividedSurface.HorizontalIntersectsByEndpoints.dyf (Dynamo 1.3.1.1736)
# category: Clockwork.Revit.Elements.DividedSurface.Actions
# Creates a number of equally spaced horizontal intersects for a divided surface based on the path between between two points.

dividedSurface = Input(dividedSurface : DividedSurface)
subdivisions = Input(subdivisions : int)
n1 = Custom[+1](dbl=subdivisions)  # Increments a value by 1
normalizedSequence = Custom[Normalized Sequence](n=n1)  # "List.NormalizedSequence"; Creates a sequence of N values between 0 and 1
startPoint = Input(startPoint : Autodesk.Point)
Z = Point.Z(startPoint)
endPoint = Input(endPoint : Autodesk.Point)
Z_2 = Point.Z(endPoint)
scaleNormalized = Custom[Scale Normalized Value](dbl=normalizedSequence, min=Z, max=Z_2)  # "Math.ScaleNormalized"; Scales a normalized value according to a given minimum and maximum
restOfItems = List.RestOfItems(scaleNormalized)
dropLastItem = Custom[List.DropLastItem](list=restOfItems)  # Drops the last item from a given list.
intersectName = Input(intersectName : string = "HorizontalIntersect")
count = List.Count(dropLastItem)
code_block = CodeBlock(n=count) { 1..n; }
string_from_object = FromObject(code_block)
code_block_2 = CodeBlock(intsecname=intersectName, n=string_from_object) { intsecname + n; }
byElevationAndName = Level.ByElevationAndName(dropLastItem, code_block_2)
addIntersect = Custom[DividedSurface.AddIntersect](dividedSurface=dividedSurface, element=byElevationAndName)  # Adds an intersect to a divided surface
dividedSurface_2 = Output(addIntersect)  # "dividedSurface"
intersects = Output(byElevationAndName)
