# Dynamo custom node Document.BuiltInCategories.dyf (Dynamo 1.3.1.1736)
# category: Clockwork.Revit.Application.Query
# List all the available BuiltInCategories

python_script = Python()
# ---------- python_script.python (17 lines) ----------
import clr
import System
clr.AddReference('RevitAPI')
clr.AddReference('RevitAPIUI')
from Autodesk.Revit.DB import *
import Autodesk
clr.AddReference("RevitNodes")
import Revit

bics = System.Enum.GetValues(BuiltInCategory)
cdata = list()
for bic in bics:
	try:
		cdata.append((bic,ElementId(bic),Revit.Elements.Category.ById(ElementId(bic).IntegerValue)))
	except:
		pass
OUT = cdata
# ----------------------------------------
transpose = List.Transpose(python_script)
code_block = CodeBlock(seq=transpose) { seq[0]; seq[1]; seq[2]; }
BuiltInCategories = Output(code_block.out0)
ElementIDs = Output(code_block.out1)
Categories = Output(code_block.out2)
