# Dynamo custom node Document.ContainsElementsOfCategory.dyf (Dynamo 2.0.0.4654)
# category: Clockwork.Revit.Application.Query
# Checks if family instances of specified categories are present in the model.

category = Input(category: var[]..[])
turnIntoList = Custom[TurnIntoList](unknownItem=category)  # Turns an element (or a nested list) into a flat list
all_elements_of_category = ElementsOfCategory(Category=turnIntoList)
isNotEmpty = Custom[List.IsNotEmpty](seq=all_elements_of_category@L2)  # Just the inversion of the built-in Is Empty List node.
anyTrue = Custom[List.AnyTrue](seq=isNotEmpty)  # Returns true if any item in a list of booleans is true.
any = Output(anyTrue)  # "any?"
allTrue = List.AllTrue(list=isNotEmpty)
all = Output(allTrue)  # "all?"
returnListOrSingleValue = Custom[ReturnListOrSingleValue](unknownItem=category, seq=isNotEmpty)  # If the unknown item is not a list but rather a single item, only the first item of the list (input "seq") will be returned.
per_category = Output(returnListOrSingleValue)
returnListOrSingleValue_2 = Custom[ReturnListOrSingleValue](unknownItem=category, seq=all_elements_of_category)
instances = Output(returnListOrSingleValue_2)
