# Dynamo custom node Document.DesignOptions.dyf (Dynamo 2.6.1.8786)
# category: Clockwork.Revit.Application.Query
# Returns all design options in the model, grouped by design option set
# packages: Clockwork for Dynamo 2.x 2.3.0

string = StringInput("DesignOption")
byName = Custom[ElementType.ByName](name=string)  # package Clockwork for Dynamo 2.x; Retrieves an element type by its name - to be used with the OOTB node "All Elements of Type".
all_elements_of_type = ElementsOfType(element_type=byName)
designOptionSet = Custom[DesignOption.DesignOptionSet](designOption=all_elements_of_type)  # package Clockwork for Dynamo 2.x; Returns the design option set of a given design option
groupByKey = List.GroupByKey(list=all_elements_of_type, keys=designOptionSet)
DesignOptions = Output(groupByKey.groups)
DesignOptionSets = Output(groupByKey.unique_keys)
