# Dynamo custom node Document.ProjectParameters.dyf (Dynamo 2.0.3.8810)
# category: Clockwork.Revit.Application.Query
# Retrieves all project parameters and the categories they have been assigned to

toggle = Input(toggle: bool = true)
docOrRevitLinkInstance = Input(docOrRevitLinkInstance: var = null)  # Use only if you want to query a linked model
python_script = Python(IN[0]=toggle, IN[1]=docOrRevitLinkInstance)
# ---------- python_script.python (64 lines) ----------
import System
import clr
clr.AddReference('RevitAPI')
from Autodesk.Revit.DB import *
import Autodesk

clr.AddReference("RevitNodes")
import Revit
clr.ImportExtensions(Revit.Elements)

clr.AddReference("RevitServices")
import RevitServices
from RevitServices.Persistence import DocumentManager

inputdoc = UnwrapElement(IN[1])
if inputdoc == None:
	doc = DocumentManager.Instance.CurrentDBDocument
elif inputdoc.GetType().ToString() == "Autodesk.Revit.DB.RevitLinkInstance":
	doc = inputdoc.GetLinkDocument()
elif inputdoc.GetType().ToString() == "Autodesk.Revit.DB.Document":
	doc = inputdoc
else: doc = None

names = []
cats = []
vag = []
pgs = []
pts = []
uts = []
isvis = []
elems = []
guids = []
isinst = []
bics = []
iterator = doc.ParameterBindings.ForwardIterator()
while iterator.MoveNext():
	vag.append(iterator.Key.VariesAcrossGroups)
	names.append(iterator.Key.Name)
	pgs.append(iterator.Key.ParameterGroup)
	pts.append(iterator.Key.ParameterType)
	uts.append(iterator.Key.UnitType)
	isvis.append(iterator.Key.Visible)
	elem = doc.GetElement(iterator.Key.Id)
	elems.append(elem)
	if elem.GetType().ToString() == 'Autodesk.Revit.DB.SharedParameterElement':
		guids.append(elem.GuidValue)
	else: guids.append(None)
	if iterator.Current.GetType().ToString() == 'Autodesk.Revit.DB.InstanceBinding':
		isinst.append(True)
	else:
		isinst.append(False)
	thesecats = []
	builtincats = []
	for cat in iterator.Current.Categories:
		try:
			thesecats.append(Revit.Elements.Category.ById(cat.Id.IntegerValue))
		except:
			# Return null if category is not supported by Dynamo
			# This way the user knows there are unsupported categories assigned
			thesecats.append(None)
		builtincats.append(System.Enum.ToObject(BuiltInCategory, cat.Id.IntegerValue))
	cats.append(thesecats)
	bics.append(builtincats)
OUT = (names,cats,vag, pgs, pts, uts, isvis, elems, guids, isinst, bics)
# ----------------------------------------
code_block = CodeBlock(seq=python_script) { seq[0]; seq[1]; seq[2]; seq[3]; seq[4]; seq[5]; seq[6]; seq[7]; seq[8]; seq[9]; seq[10]; }
paramName = Output(code_block.out0)
categories = Output(code_block.out1)
variesAcrossGroups = Output(code_block.out2)
parameterGroup = Output(code_block.out3)
parameterType = Output(code_block.out4)
unitType = Output(code_block.out5)
isVisible = Output(code_block.out6)
parameterElement = Output(code_block.out7)
GUID = Output(code_block.out8)
isInstanceParameter = Output(code_block.out9)
builtInCategories = Output(code_block.out10)
