# Dynamo custom node Element.Area.dyf (Dynamo 2.0.0.4654)
# category: Clockwork.Revit.Elements.Query
# Returns the area property of a given element (if that element has such a property)

element = Input(element: var[]..[])
python_script = Python(IN[0]=element)
# ---------- python_script.python (12 lines) ----------
import clr
clr.AddReference('RevitAPI')
from Autodesk.Revit.DB import *

def GetArea(spatialElement):
	if hasattr(spatialElement, "Area"): return spatialElement.Area
	else: return None

spatialElements = UnwrapElement(IN[0])

if isinstance(IN[0], list): OUT = [GetArea(x) for x in spatialElements]
else: OUT = GetArea(spatialElements)
# ----------------------------------------
unit_types = UnitTypes(index=0)  # graph input
displayUnitType = Custom[UnitType.DisplayUnitType](unitType=unit_types)  # Retrieves the display unit type for a given unit type.
toDisplayUnit = Custom[InternalUnit.ToDisplayUnit](val=python_script, displayUnitType=displayUnitType.displayUnitType)  # Converts a value from Revit's internal unit to a given display unit
area = Output(toDisplayUnit)
