# Dynamo custom node Element.Category+.dyf (Dynamo 2.0.1.5055)
# category: Clockwork.Revit.Elements.Query
# Returns the category of a given element. Unlike the OOTB node Element.GetCategory, it will work for subcategories, families, family documents, schedules, subcategories and graphics styles as well.

element = Input(element: var[]..[])
python_script = Python(IN[0]=element)
# ---------- python_script.python (33 lines) ----------
import clr
clr.AddReference('RevitAPI')
from Autodesk.Revit.DB import *

clr.AddReference("RevitNodes")
import Revit
clr.ImportExtensions(Revit.Elements)

def GetCategory(item):
	if not item: return None
	objtype = item.GetType().ToString()
	returnID = None
	if objtype == "Autodesk.Revit.DB.ViewSchedule": returnID = item.Definition.CategoryId
	elif objtype == "Autodesk.Revit.DB.Family": returnID = item.FamilyCategoryId
	elif objtype == "Autodesk.Revit.DB.GraphicsStyle":  returnID = item.GraphicsStyleCategory.Id
	elif objtype == "Revit.Application.Document":
		if item.IsFamilyDocument: 
			clr.AddReference("RevitServices")
			import RevitServices
			from RevitServices.Persistence import DocumentManager
			returnID = DocumentManager.Instance.CurrentDBDocument.OwnerFamily.FamilyCategoryId
	elif objtype == "Autodesk.Revit.DB.Category": 
		if item.Parent: returnID = item.Parent.Id
	elif hasattr(item, "Category"): returnID = item.Category.Id
	if returnID:
		try: return Revit.Elements.Category.ById(returnID.IntegerValue)
		except: return None
	else: return None

items = UnwrapElement(IN[0])

if isinstance(IN[0], list): OUT = [GetCategory(x) for x in items]
else: OUT = GetCategory(items)
# ----------------------------------------
category = Output(python_script)
