# Dynamo custom node Element.Group.dyf (Dynamo 1.3.1.1736)
# category: Clockwork.Revit.Elements.Element.Query
# Retrieves the group an element belongs to (if any)

element = Input()
python_script = Python(IN[0]=element)
# ---------- python_script.python (12 lines) ----------
import clr
clr.AddReference('RevitAPI')
from Autodesk.Revit.DB import *

def GetGroup(item):
	if hasattr(item, "GroupId"): return item.Document.GetElement(item.GroupId)
	else: return None

items = UnwrapElement(IN[0])

if isinstance(IN[0], list): OUT = [GetGroup(x) for x in items]
else: OUT = GetGroup(items)
# ----------------------------------------
group = Output(python_script)
