# Dynamo custom node Element.IsOfCategory.dyf (Dynamo 2.0.0.4654)
# category: Clockwork.Revit.Elements.Query
# Checks whether an element is of a specified category

category = Input(category: var[]..[])
id = Category.Id(category=category)
element = Input(element: var[]..[])
category_2 = Custom[Element.Category+](element=element)  # Returns the category of a given element. Unlike the OOTB node Element.GetCategory, it will work for families, schedules and graphics styles as well.
id_2 = Category.Id(category=category_2)
contains = List.Contains(list=id, item=id_2)
bool = Output(contains)
