# Dynamo custom node Element.Materials+.dyf (Dynamo 2.12.1.8246)
# category: Clockwork.Revit.Elements.Query
# Retrieves all materials from a given element. Unlike the OOTB node Element.GetMaterials, it also retrieves QTO information.
# packages: Clockwork for Dynamo 2.x 2.6.0

element = Input(element: var[]..[])
returnPaintMaterials = Input(returnPaintMaterials: bool = false)
version = Custom[Application.Version]()  # package Clockwork for Dynamo 2.x; Retrieves the name, version and build of the current Revit application.
python_script = Python(IN[0]=element, IN[1]=returnPaintMaterials, IN[2]=version.Version)  # IronPython2
# ---------- python_script.python (40 lines) ----------
import clr
clr.AddReference('RevitAPI')
from Autodesk.Revit.DB import *

clr.AddReference("RevitServices")
import RevitServices
from RevitServices.Persistence import DocumentManager
doc = DocumentManager.Instance.CurrentDBDocument

items = UnwrapElement(IN[0])
paintedmats = IN[1]
version = IN[2]
if version > 2021: 
	unittypeA = ForgeTypeId('autodesk.spec.aec:area-2.0.0')
	unittypeV = ForgeTypeId('autodesk.spec.aec:volume-2.0.0')
else: 
	unittypeA = UnitType.UT_Area
	unittypeV = UnitType.UT_Volume

def InternalUnitToDisplayUnit(val, unittype):
	formatoptions = doc.GetUnits().GetFormatOptions(unittype)
	if version > 2021: dispunits = formatoptions.GetUnitTypeId()
	else: dispunits = formatoptions.DisplayUnits
	try: return UnitUtils.ConvertFromInternalUnits(val,dispunits)
	except: return None
	
def ElementMaterials(item, painted):
	matlist = list()
	arealist = list()
	vollist = list()
	for matid in item.GetMaterialIds(painted):
		matlist.append(item.Document.GetElement(matid))
		arealist.append(InternalUnitToDisplayUnit(item.GetMaterialArea(matid,painted), unittypeA))
		vollist.append(InternalUnitToDisplayUnit(item.GetMaterialVolume(matid), unittypeV))
	return matlist, arealist, vollist, len(matlist) > 0

if isinstance(IN[0], list): 
	results = [ElementMaterials(x, paintedmats) for x in items]
	OUT = list(zip(*results))
else: OUT = ElementMaterials(items, paintedmats)
# ----------------------------------------
code_block = CodeBlock(seq=python_script) { seq[0]; seq[1]; seq[2]; seq[3]; }
materials = Output(code_block.out0)
materialAreas = Output(code_block.out1)
materialVolumes = Output(code_block.out2)
hasMaterial = Output(code_block.out3)
