# Dynamo custom node Element.MoveToPoint.dyf (Dynamo 2.12.1.8246)
# category: Clockwork.Revit.Elements.Actions
# Moves a point-based element to the given location

element = Input(element: var[]..[])
getLocation = Element.GetLocation(element=element)
point = Input(point: Autodesk.DesignScript.Geometry.Point[]..[])
byTwoPoints = Vector.ByTwoPoints(start=getLocation, end=point)
python_script = Python(IN[0]=element, IN[1]=byTwoPoints)  # IronPython2
# ---------- python_script.python (30 lines) ----------
# Phython-Standard- und DesignScript-Bibliotheken laden
import sys
import clr
clr.AddReference('RevitNodes', 'RevitServices')
from RevitServices.Transactions import TransactionManager
from RevitServices.Persistence import DocumentManager
import Revit
clr.ImportExtensions(Revit.GeometryConversion)

doc = DocumentManager.Instance.CurrentDBDocument

elements = UnwrapElement(IN[0])
points = UnwrapElement(IN[1])

def MoveToPoint(item, point):
	try:
		res = item.Location.Move(point.ToXyz(True))
		return (item, res)
	except: return (item, False)
	
TransactionManager.Instance.EnsureInTransaction(doc)
OUT = []
if isinstance(IN[0], list):
	if isinstance(IN[1], list): results = [MoveToPoint(x, y) for x, y in zip(elements, points)]
	else: results = [MoveToPoint(x, points) for x in elements]
	OUT = list(zip(*results))
else:
	if isinstance(IN[1], list): OUT = MoveToPoint(elements, points[0])
	else: OUT = MoveToPoint(elements, points)
TransactionManager.Instance.TransactionTaskDone()
# ----------------------------------------
firstItem = List.FirstItem(list=python_script)
element_2 = Output(firstItem)  # "element"
lastItem = List.LastItem(list=python_script)
success = Output(lastItem)
