# Dynamo custom node Element.Name+.dyf (Dynamo 2.12.0.5650)
# category: Clockwork.Revit.Elements.Query
# Gets an element's name. Unlike the OOTB node, this node should work for *all* Revit elements that have names and will also return the localized names of system parameters, parameter groups, display unit types, parameter types, unit symbol types, unit types and ForgeTypeIds.

element = Input(element: var[]..[])
python_script = Python(IN[0]=element)  # IronPython2
# ---------- python_script.python (31 lines) ----------
import clr
clr.AddReference('RevitAPI')
from Autodesk.Revit.DB import *

def GetName(item):
	unwrapped = UnwrapElement(item)
	if not unwrapped: return None
	elif unwrapped.GetType().ToString() in ("Autodesk.Revit.DB.BuiltInParameter", "Autodesk.Revit.DB.BuiltInParameterGroup", "Autodesk.Revit.DB.DisplayUnitType", "Autodesk.Revit.DB.ParameterType", "Autodesk.Revit.DB.UnitSymbolType", "Autodesk.Revit.DB.UnitType"): return LabelUtils.GetLabelFor(unwrapped)
	elif unwrapped.GetType().ToString() in ("Autodesk.Revit.DB.Parameter", "Autodesk.Revit.DB.FamilyParameter"): return unwrapped.Definition.Name
	elif unwrapped.GetType().ToString() == ("Autodesk.Revit.DB.ForgeTypeId"): 
		try: return LabelUtils.GetLabelForSpec(unwrapped)
		except: 
			try: return LabelUtils.GetLabelForSymbol(unwrapped)
			except: 
				try: return LabelUtils.GetLabelForUnit(unwrapped)
				except: 
					try: return LabelUtils.GetLabelForGroup(unwrapped)
					except: 
						try: return LabelUtils.GetLabelForBuiltinParameter(unwrapped)
						except: 
							try: return LabelUtils.GetLabelForDiscipline(unwrapped)
							except: return unwrapped.TypeId			
	elif hasattr(unwrapped, "GetName"): return unwrapped.GetName()
	elif hasattr(unwrapped, "Name"): return unwrapped.Name
	elif hasattr(item, "Name"): return item.Name
	else: return None
#LabelUtils.GetLabelForSpec(iterator.Key.GetDataType())
items = IN[0]

if isinstance(IN[0], list): OUT = [GetName(x) for x in IN[0]]
else: OUT = GetName(IN[0])
# ----------------------------------------
name = Output(python_script)
