# Dynamo custom node Element.ParameterExists.dyf (Dynamo 1.3.1.1736)
# category: Clockwork.Revit.Elements.Element.Query
# Checks if an element contains a parameter of a given name

element = Input(element : Revit.Element)
param = Input(param : string)
parameterByName = Parameter.ParameterByName(element=element, name=param)
isNull = Object.IsNull(parameterByName)
not_ = Not(isNull)
bool = Output(not_)
