# Dynamo custom node ElementType.ByName.dyf (Dynamo 2.6.1.8786)
# category: Clockwork.Revit.Selection.Miscellaneous.Query
# Retrieves an element type by its name  - to be used with the OOTB node "All Elements of Type".

name = Input(name: string)
code_block = CodeBlock(str=name) { DSCore.Types.FindTypeByNameInAssembly(str, "RevitAPI"); }
elementType = Output(code_block)
