# Dynamo custom node Family.PlacementType.dyf (Dynamo 1.3.1.1736)
# category: Clockwork.Revit.Elements.Family.Query
# Returns the expected host class of a family (if any)

family = Input(family : Family)
python_script = Python(IN[0]=family)
# ---------- python_script.python (12 lines) ----------
import clr
clr.AddReference('RevitAPI')
from Autodesk.Revit.DB import *

def GetPlacementType(item):
	if hasattr(item, "FamilyPlacementType"): return item.FamilyPlacementType
	else: return None

items = UnwrapElement(IN[0])

if isinstance(IN[0], list): OUT = [GetPlacementType(x) for x in items]
else: OUT = GetPlacementType(items)
# ----------------------------------------
placementType = Output(python_script)
