# Dynamo custom node FamilyInstance.SubComponents.dyf (Dynamo 0.8.2.2392)
# category: Clockwork.Revit.Elements.FamilyInstance.Query
# Retrieves all subcomponents of a given family instance

familyInstance = Input()
turnIntoList = Custom[Turn Into List](familyInstance)  # Turns an element (or a nested list) into a flat list
python_script = Python(IN[0]=turnIntoList)
# ---------- python_script.python (20 lines) ----------
import clr
clr.AddReference('RevitAPI')
from Autodesk.Revit.DB import *

clr.AddReference("RevitNodes")
import Revit
clr.ImportExtensions(Revit.Elements)

items = UnwrapElement(IN[0])
elementlist = list()

for item in items:
	itemlist = list()
	try:
		for subcomp in item.GetSubComponentIds():
			itemlist.append(item.Document.GetElement(subcomp).ToDSType(True))
	except:
		donothing = 1
	elementlist.append(itemlist)
OUT = elementlist
# ----------------------------------------
returnListOrSingleValue = Custom[ReturnListOrSingleValue](unknownItem=familyInstance, seq=python_script)  # If the item in input #1 is not a list, only the first item of the list in input #2 will be returned.
subComponents = Output(returnListOrSingleValue)
