# Dynamo custom node FamilyParameter.Properties.dyf (Dynamo 2.0.3.8810)
# category: Clockwork.Revit.Elements.Query
# Retrieves all properties of a given family parameter. PLEASE NOTE: This node will only work in a family document!

familyParameter = Input(familyParameter: var[]..[])
turnIntoList = Custom[TurnIntoList](unknownItem=familyParameter)  # Turns an element (or a nested list) into a flat list
python_script = Python(IN[0]=turnIntoList)
# ---------- python_script.python (52 lines) ----------
import clr
clr.AddReference('RevitAPI')
from Autodesk.Revit.DB import *

clr.AddReference("RevitNodes")
import Revit
clr.ImportExtensions(Revit.Elements)

params = UnwrapElement(IN[0])
pname = list()
guid = list()
pgroup = list()
ptype = list()
utype = list()
dutype = list()
stype = list()
isinstance = list()
isreporting = list()
isshared = list()
isreadonly = list()
usermodifiable = list()
formula = list()
determinedbyformula = list()
associatedparams = list()
associatedelements = list()
canassignformula = list()
for param in params:
	pname.append(param.Definition.Name)
	try:guid.append(param.GUID.ToString())
	except: guid.append(None)
	pgroup.append(param.Definition.ParameterGroup)
	ptype.append(param.Definition.ParameterType)
	utype.append(param.Definition.UnitType)
	try: dutype.append(param.DisplayUnitType)
	except: dutype.append(None)
	stype.append(param.StorageType)
	isinstance.append(param.IsInstance)
	isreporting.append(param.IsReporting)
	isshared.append(param.IsShared)
	isreadonly.append(param.IsReadOnly)
	usermodifiable.append(param.UserModifiable)
	formula.append(param.Formula)
	determinedbyformula.append(param.IsDeterminedByFormula)
	assocparams = param.AssociatedParameters
	associatedparams.append(assocparams)
	assocelems = list()
	for assoc in assocparams:
		assocelems.append(assoc.Element)
	associatedelements.append(assocelems)
	canassignformula.append(param.CanAssignFormula)
	
OUT = (pname,guid,pgroup,ptype,utype,dutype,stype,isinstance,isreporting,isshared,isreadonly,usermodifiable,formula,determinedbyformula,associatedparams,canassignformula,associatedelements)
# ----------------------------------------
code_block = CodeBlock(seq=python_script)
# ---------- code_block.designscript (17 lines) ----------
seq[0];
seq[1];
seq[2];
seq[3];
seq[4];
seq[5];
seq[6];
seq[7];
seq[8];
seq[9];
seq[10];
seq[11];
seq[12];
seq[13];
seq[14];
seq[15];
seq[16];
# ----------------------------------------
returnListOrSingleValue = Custom[ReturnListOrSingleValue](unknownItem=familyParameter, seq=code_block.out0)  # If the unknown item is not a list but rather a single item, only the first item of the list (input "seq") will be returned.
Name = Output(returnListOrSingleValue)
returnListOrSingleValue_2 = Custom[ReturnListOrSingleValue](unknownItem=familyParameter, seq=code_block.out1)
GUID = Output(returnListOrSingleValue_2)
returnListOrSingleValue_3 = Custom[ReturnListOrSingleValue](unknownItem=familyParameter, seq=code_block.out2)
Group = Output(returnListOrSingleValue_3)
returnListOrSingleValue_4 = Custom[ReturnListOrSingleValue](unknownItem=familyParameter, seq=code_block.out3)
Type = Output(returnListOrSingleValue_4)
returnListOrSingleValue_5 = Custom[ReturnListOrSingleValue](unknownItem=familyParameter, seq=code_block.out4)
UnitType = Output(returnListOrSingleValue_5)
returnListOrSingleValue_6 = Custom[ReturnListOrSingleValue](unknownItem=familyParameter, seq=code_block.out5)
DisplayUnitType = Output(returnListOrSingleValue_6)
returnListOrSingleValue_7 = Custom[ReturnListOrSingleValue](unknownItem=familyParameter, seq=code_block.out6)
StorageType = Output(returnListOrSingleValue_7)
returnListOrSingleValue_8 = Custom[ReturnListOrSingleValue](unknownItem=familyParameter, seq=code_block.out7)
IsInstanceParameter = Output(returnListOrSingleValue_8)
returnListOrSingleValue_9 = Custom[ReturnListOrSingleValue](unknownItem=familyParameter, seq=code_block.out8)
IsReportingParameter = Output(returnListOrSingleValue_9)
returnListOrSingleValue_10 = Custom[ReturnListOrSingleValue](unknownItem=familyParameter, seq=code_block.out9)
IsSharedParameter = Output(returnListOrSingleValue_10)
returnListOrSingleValue_11 = Custom[ReturnListOrSingleValue](unknownItem=familyParameter, seq=code_block.out10)
IsReadOnly = Output(returnListOrSingleValue_11)
returnListOrSingleValue_12 = Custom[ReturnListOrSingleValue](unknownItem=familyParameter, seq=code_block.out15)
IsUserModfiable = Output(returnListOrSingleValue_12)
returnListOrSingleValue_13 = Custom[ReturnListOrSingleValue](unknownItem=familyParameter, seq=code_block.out13)
CanBeAssignedAFormula = Output(returnListOrSingleValue_13)
returnListOrSingleValue_14 = Custom[ReturnListOrSingleValue](unknownItem=familyParameter, seq=code_block.out11)
IsDeterminedByFormula = Output(returnListOrSingleValue_14)
returnListOrSingleValue_15 = Custom[ReturnListOrSingleValue](unknownItem=familyParameter, seq=code_block.out12)
Formula = Output(returnListOrSingleValue_15)
code_block_2 = CodeBlock()
# ---------- code_block_2.designscript (30 lines) ----------
"not(";
"if(";
"and(";
"or(";
"sin(";
"cos(";
"tan(";
"asin(";
"acos(";
"atan(";
"sqrt(";
"log(";
"exp(";
"abs(";
"round(";
"roundup(";
"rounddown(";
"pi()";
"(";
")";
", ";
" + ";
" - ";
" * ";
" / ";
" ^ ";
" > ";
" < ";
" = ";
"-";
# ----------------------------------------
split = String.Split(str=code_block.out12, separater0=code_block_2.out0, separater1=code_block_2.out1, separater2=code_block_2.out2, separater3=code_block_2.out3, separater4=code_block_2.out4, separater5=code_block_2.out5, separater6=code_block_2.out6, separater7=code_block_2.out7, separater8=code_block_2.out8, separater9=code_block_2.out9, separater10=code_block_2.out10, separater11=code_block_2.out11, separater12=code_block_2.out12, separater13=code_block_2.out13, separater14=code_block_2.out14, separater15=code_block_2.out15, separater16=code_block_2.out16, separater17=code_block_2.out17, separater18=code_block_2.out18, separater19=code_block_2.out19, separater20=code_block_2.out20, separater21=code_block_2.out21, separater22=code_block_2.out22, separater23=code_block_2.out23, separater24=code_block_2.out24, separater25=code_block_2.out25, separater26=code_block_2.out26, separater27=code_block_2.out27, separater28=code_block_2.out28, separater29=code_block_2.out29)
python_script_2 = Python(IN[0]=split, IN[1]=code_block.out0)
# ---------- python_script_2.python (7 lines) ----------
import clr
OUT = []
for chunks in IN[0]:
	sublist = []
	if chunks: [sublist.append(x) for x in chunks if x in IN[1]]
	OUT.append(sublist)
	
# ----------------------------------------
returnListOrSingleValue_16 = Custom[ReturnListOrSingleValue](unknownItem=familyParameter, seq=python_script_2)
ParameterNamesInFormula = Output(returnListOrSingleValue_16)
returnListOrSingleValue_17 = Custom[ReturnListOrSingleValue](unknownItem=familyParameter, seq=code_block.out16)
AssociatedElements = Output(returnListOrSingleValue_17)
returnListOrSingleValue_18 = Custom[ReturnListOrSingleValue](unknownItem=familyParameter, seq=code_block.out14)
AssociatedParameters = Output(returnListOrSingleValue_18)
