# Dynamo custom node FamilyType.CompoundStructureLayers.dyf (Dynamo 2.0.1.5055)
# category: Clockwork.Revit.Elements.Query
# Retrieves the compound layers of any layered family type (wall types, roof types, floor types etc.)

elementType = Input(elementType: var[]..[])
python_script = Python(IN[0]=elementType)
# ---------- python_script.python (43 lines) ----------
import clr
clr.AddReference('RevitAPI')
from Autodesk.Revit.DB import *

clr.AddReference("RevitNodes")
import Revit
clr.ImportExtensions(Revit.Elements)

items = UnwrapElement(IN[0])

def GetCompoundStructureLayers(item):
	layers = []
	layermat = []
	layerfunc = []
	layerwidth = []
	layercore = []
	layerwraps = []
	layervar = []
	layerdeck = []	
	try:
		if hasattr(item, "GetCompoundStructure"):
			compstruc = item.GetCompoundStructure()
			vertcomp = compstruc.IsVerticallyCompound
			varlayer = compstruc.VariableLayerIndex
			num = compstruc.LayerCount
			counter = 0
			while counter < num:
				layers.append(compstruc.GetLayers()[counter])
				layermat.append(item.Document.GetElement(compstruc.GetMaterialId(counter)))
				layerfunc.append(compstruc.GetLayerFunction(counter))
				layerwidth.append(compstruc.GetLayerWidth(counter))
				layercore.append(compstruc.IsCoreLayer(counter))
				if compstruc.IsCoreLayer(counter): layerwraps.append(False)
				else: layerwraps.append(compstruc.ParticipatesInWrapping(counter))
				if varlayer == counter: layervar.append(True)
				else: layervar.append(False)
				layerdeck.append(compstruc.IsStructuralDeck(counter))
				counter += 1
	except: pass
	return layers, layermat, layerfunc, layerwidth, layercore, layerwraps, layervar, layerdeck

if isinstance(IN[0], list): OUT = map(list, zip(*[GetCompoundStructureLayers(x) for x in items]))
else: OUT = GetCompoundStructureLayers(items)
# ----------------------------------------
code_block = CodeBlock(seq=python_script)
# ---------- code_block.designscript (16 lines) ----------
// Layers
seq[0];
// Materials
seq[1];
// Functions
seq[2];
// Widths
seq[3];
// Is core layer
seq[4];
// Wraps
seq[5];
// Is variable
seq[6];
// Is structural deck
seq[7];
# ----------------------------------------
materials = Output(code_block.out1)
functions = Output(code_block.out2)
unit_types = UnitTypes(index=2)  # graph input
displayUnitType = Custom[UnitType.DisplayUnitType](unitType=unit_types)  # Retrieves the display unit type for a given unit type.
toDisplayUnit = Custom[InternalUnit.ToDisplayUnit](val=code_block.out3, displayUnitType=displayUnitType.displayUnitType)  # Converts a value from Revit's internal unit to a given display unit
widths = Output(toDisplayUnit)
isCore = Output(code_block.out4)
wraps = Output(code_block.out5)
isVariable = Output(code_block.out6)
isStructuralDeck = Output(code_block.out7)
layers = Output(code_block.out0)
