# Dynamo custom node FamilyType.SetCompoundLayerWidth.dyf (Dynamo 2.0.4.12684)
# category: Clockwork.Revit.Elements.Actions
# Sets the width of a specified compound layer of a given family type (only applies to family types that have a compound structure, e.g. walls, floors etc.).

familyType = Input(familyType: var[]..[])
familyType_2 = Output(familyType)  # "familyType"
layerIndex = Input(layerIndex: int[]..[])
width = Input(width: double[]..[])
unit_types = UnitTypes(index=2)  # graph input
displayUnitType = Custom[UnitType.DisplayUnitType](unitType=unit_types)  # Retrieves the display unit type for a given unit type.
toInternalUnit = Custom[DisplayUnit.ToInternalUnit](val=width, displayUnitType=displayUnitType.displayUnitType)  # Converts a value from a given display unit to Revit's internal unit
python_script = Python(IN[0]=familyType, IN[1]=layerIndex, IN[2]=toInternalUnit)
# ---------- python_script.python (38 lines) ----------
import clr
clr.AddReference('RevitAPI')
from Autodesk.Revit.DB import *

clr.AddReference("RevitServices")
import RevitServices
from RevitServices.Persistence import DocumentManager
from RevitServices.Transactions import TransactionManager

def SetCompoundLayerWidth(famtype, index, width):
	try:
		cs = famtype.GetCompoundStructure()
		cs.SetLayerWidth(index,width)
		famtype.SetCompoundStructure(cs)
		return True
	except: return False

doc = DocumentManager.Instance.CurrentDBDocument
famtypes = UnwrapElement(IN[0])
indices = IN[1]
widths = IN[2]

TransactionManager.Instance.EnsureInTransaction(doc)
if isinstance(IN[0], list):
	if isinstance(IN[2], list):
		if isinstance(IN[1], list): OUT = [SetCompoundLayerWidth(x,y,z) for x,y,z in zip(famtypes, indices, widths)]
		else: OUT = [SetCompoundLayerWidth(x,indices,y) for x,y in zip(famtypes, widths)]
	else:
		if isinstance(IN[1], list): OUT = [SetCompoundLayerWidth(x,y,widths) for x,y in zip(famtypes, indices)]
		else: OUT = [SetCompoundLayerWidth(x,indices,widths) for x in famtypes]
else:
	if isinstance(IN[2], list):
		if isinstance(IN[1], list): OUT = [SetCompoundLayerWidth(famtypes,x,y) for x,y in zip(indices, widths)]
		else: OUT = [SetCompoundLayerWidth(famtypes,indices,x) for x in widths]
	else:
		if isinstance(IN[1], list): OUT = [SetCompoundLayerWidth(famtypes,x,widths) for x in indices]
		else: OUT = SetCompoundLayerWidth(famtypes,indices,widths)
TransactionManager.Instance.TransactionTaskDone()
# ----------------------------------------
success = Output(python_script)
