# Dynamo custom node Floor.ResetSlabShape.dyf (Dynamo 1.3.1.1736)
# category: Clockwork.Revit.Elements.Floor.Actions
# Resets the slabshape of a floor

floor = Input(floor : Floor[]..[])
resetSlabShape = Custom[Roof.ResetSlabShape](roof=floor)  # Resets the slabshape of a roof
floor_2 = Output(resetSlabShape.roof)  # "floor"
success = Output(resetSlabShape.success)
