# Dynamo custom node Geometry.ClosestTo.dyf (Dynamo 1.3.0.875)
# category: Clockwork.Geometry.Modifiers.Query
# Finds the closest entity in a list of geometric entities from another given entity

geometry = Input(geometry : Autodesk.Geometry[])
other = Input(other : Autodesk.Geometry)
distanceTo = Geometry.DistanceTo(geometry=geometry, other=other)
minimumItem = List.MinimumItem(distanceTo)
code_block = CodeBlock(a=distanceTo, b=minimumItem) { a == b; }
filterByBoolMask = List.FilterByBoolMask(list=geometry, mask=code_block)
flatten = Flatten(filterByBoolMask.in)
ClosestObject = Output(flatten)
closestPointTo = Geometry.ClosestPointTo(geometry=filterByBoolMask.in, other=other)
flatten_2 = Flatten(closestPointTo)
ClosestPoint = Output(flatten_2)
