# Dynamo custom node Grid.FromFace.dyf (Dynamo 2.0.1.5055)
# category: Clockwork.Geometry.Tesselation.Paneling.Create
# Returns UV coordinates, XYZ coordinates and normals for a face with UV subdivision

U = Input(U: int)
V = Input(V: int)
surface = Input(surface: Autodesk.DesignScript.Geometry.Surface)
code_block = CodeBlock(unum=U, vnum=V, surf=surface)
# ---------- code_block.designscript (4 lines) ----------
uvlist = UV.ByCoordinates((0..1..#unum+1)<1>,(0..1..#vnum+1)<2>);
UVs = Flatten(uvlist);
surf.PointAtParameter(UVs.U,UVs.V);
surf.NormalAtParameter(UVs.U,UVs.V);
# ----------------------------------------
Points = Output(code_block.out2)
Normals = Output(code_block.out3)
UVs = Output(code_block.UVs)
