# Dynamo custom node Group.Ungroup.dyf (Dynamo 2.0.0.4654)
# category: Clockwork.Revit.Elements.Actions
# Ungroups a group and returns the ungrouped elements.

group = Input(group: var[]..[])
turnIntoList = Custom[TurnIntoList](unknownItem=group)  # Turns an element (or a nested list) into a flat list
python_script = Python(IN[0]=turnIntoList)
# ---------- python_script.python (26 lines) ----------
import clr
clr.AddReference('RevitAPI')
from Autodesk.Revit.DB import *
from System.Collections.Generic import *

clr.AddReference("RevitServices")
import RevitServices
from RevitServices.Persistence import DocumentManager
from RevitServices.Transactions import TransactionManager

doc = DocumentManager.Instance.CurrentDBDocument
groups = UnwrapElement(IN[0])
elementlist = list()
TransactionManager.Instance.EnsureInTransaction(doc)
for group in groups:
	try:
		ids = group.UngroupMembers()
		ungrouped = list()
		for id in ids:
			ungrouped.append(group.Document.GetElement(id))
		elementlist.append(ungrouped)
	except:
		elementlist.append(list())
TransactionManager.Instance.TransactionTaskDone()

OUT = elementlist
# ----------------------------------------
ungroupedElements = Output(python_script)
