# Dynamo custom node InternalUnit.ToDisplayUnit.dyf (Dynamo 2.0.1.5055)
# category: Clockwork.Revit.Units.Actions
# Converts a value from Revit's internal unit to a given display unit

val = Input(val: double)
turn_into_list = Custom[Turn Into List](unknownItem=val)  # Turns an element (or a nested list) into a flat list
displayUnitType = Input(displayUnitType: var[]..[])
python_script = Python(IN[0]=turn_into_list, IN[1]=displayUnitType)
# ---------- python_script.python (10 lines) ----------
import clr
clr.AddReference('RevitAPI')
from Autodesk.Revit.DB import *

vals = IN[0]
dispunit = IN[1]
elementlist = []
for val in vals:
	elementlist.append(UnitUtils.ConvertFromInternalUnits(val,dispunit))
OUT = elementlist
# ----------------------------------------
returnListOrSingleValue = Custom[ReturnListOrSingleValue](unknownItem=val, seq=python_script)  # If the item in input #1 is not a list, only the first item of the list in input #2 will be returned.
val_2 = Output(returnListOrSingleValue)  # "val"
