# Dynamo custom node Level.Plane.dyf (Dynamo 1.3.1.1736)
# category: Clockwork.Revit.Elements.Level.Query
# Retrieves the plane of a given level

code_block = CodeBlock { 0; }
level = Input(level : Level)
elevation = Level.Elevation(level)
byCoordinates = Point.ByCoordinates(x=code_block, y=code_block, z=elevation)
ZAxis = Vector.ZAxis()
byOriginNormal = Plane.ByOriginNormal(origin=byCoordinates, normal=ZAxis)
plane = Output(byOriginNormal)
