# Dynamo custom node List.FilterBySublistLength.dyf (Dynamo 1.3.0.875)
# category: Clockwork.List.Modify.Actions
# Filters out all sublists that do not have the specified length

seq = Input()
count = List.Count(seq@L2)
length = Input(length : int)
code_block = CodeBlock(n=count, x=length) { n == x; }
filterByBoolMask = List.FilterByBoolMask(list=seq, mask=code_block)
in_ = Output(filterByBoolMask.in)  # "in"
out = Output(filterByBoolMask.out)
