# Dynamo custom node List.IsNotEmpty.dyf (Dynamo 1.3.0.875)
# category: Clockwork.List.Inspect.Query
# Just the inversion of the built-in Is Empty List node.

seq = Input()
isEmpty = List.IsEmpty(seq)
not_ = Not(isEmpty)
bool = Output(not_)
