# Dynamo custom node List.ReplaceItemAtIndex+.dyf (Dynamo 1.3.1.1736)
# category: Clockwork.List.Modify.Actions
# Replaces the item at a given index (or list of indices) of a list by another item

seq = Input(seq : var[])
replacement = Input(replacement : var[])
indices = Input(indices : int[])
python_script = Python(IN[0]=seq, IN[1]=replacement, IN[2]=indices)
# ---------- python_script.python (8 lines) ----------
_list = IN[0]
rValues = IN[1]
iValues = IN[2]
if len(iValues) > 1 and len(rValues) == 1:
	rValues = [rValues[0]] * len(iValues)
for (index, value) in zip(iValues, rValues):
	_list[index] = value
OUT = _list
# ----------------------------------------
seq_2 = Output(python_script)  # "seq"
