# Dynamo custom node List.WithLeadingZeroes.dyf (Dynamo 1.0.0.1180)
# category: Clockwork.List.Generate.Create
# Adds leading zeros to a sequence of numbers

num = Input(num : int)
string_from_object = FromObject(num)
n = Input(n : int)
code_block = CodeBlock { "0"; }
padLeft = String.PadLeft(string_from_object, n, code_block)
str = Output(padLeft)
