# Dynamo custom node ModelCurve.Type.dyf (Dynamo 1.3.1.1736)
# category: Clockwork.Revit.Elements.ModelCurve.Query
# Gets the type of a given model curve

modelCurve = Input()
python_script = Python(IN[0]=modelCurve)
# ---------- python_script.python (12 lines) ----------
import clr
clr.AddReference('RevitAPI')
from Autodesk.Revit.DB import *

def GetCurveType(item):
	if hasattr(item, "CurveElementType"): return item.CurveElementType
	else: return None

items = UnwrapElement(IN[0])

if isinstance(IN[0], list): OUT = [GetCurveType(x) for x in items]
else: OUT = GetCurveType(items)
# ----------------------------------------
type = Output(python_script)
