# Dynamo custom node Normalization.Normalize.dyf (Dynamo 0.8.1.1823)
# category: Clockwork.Math.Functions.Actions
# Converts a value into a normalized value according to a value range

dbl = Input(dbl : double)
min = Input(min : double)
max = Input(max : double)
code_block = CodeBlock(value=dbl, min=min, max=max) { (value-min)/(max-min); }
dbl_2 = Output(code_block)  # "dbl"
