# Dynamo custom node Normalization.NormalizeRange.dyf (Dynamo 1.3.0.875)
# category: Clockwork.Math.Functions.Actions
# Normalizes a range of numbers

seq = Input(seq : double[])
code_block = CodeBlock { 0; 1; }
remapRange = Math.RemapRange(numbers=seq, newMin=code_block.out0, newMax=code_block.out1)
seq_2 = Output(remapRange)  # "seq"
