# Dynamo custom node Object.MembersByName.dyf (Dynamo 2.6.2.15705)
# category: Clockwork.Input.Query
# Looks up all the members of a given element based on a given name (or part of a name) of the property or method. Search is case-insensitive.
# packages: Clockwork for Dynamo 2.x 2.4.0

element = Input(element: var[]..[])
members = Custom[Object.Members](element=element)  # package Clockwork for Dynamo 2.x; Gets a list of all members (properties and methods) of a selected element
searchFor = Input(searchFor: string)
ignoreCase = Input(ignoreCase: bool = true)
contains = String.Contains(str=members, searchFor=searchFor, ignoreCase=ignoreCase)
filterByBoolMask = List.FilterByBoolMask(list=members, mask=contains)
elements = Output(filterByBoolMask.in)
