# Dynamo custom node ParameterFilterElement.FilterRuleString.dyf (Dynamo 2.0.3.8810)
# category: Clockwork.Revit.Elements.Query
# Aggregates the filter rules of a given ParameterFilterElement into a human-readable string

parameterFilterElement = Input(parameterFilterElement: Revit.Filter.ParameterFilterElement[]..[])
version = Custom[Application.Version]()  # Retrieves the name, version and build of the current Revit application.
python_script = Python(IN[0]=parameterFilterElement, IN[1]=version.Version)
# ---------- python_script.python (74 lines) ----------
import clr
import System
clr.AddReference('RevitAPI')
from Autodesk.Revit.DB import *

clr.AddReference("RevitNodes")
import Revit
clr.ImportExtensions(Revit.Elements)

bips = {}
for bip in System.Enum.GetValues(BuiltInParameter):
	try: bips[ElementId(bip).IntegerValue] = LabelUtils.GetLabelFor(bip)
	except: pass

def GetFilterRuleStringWrapper(item):
	if version > 2018 and hasattr(item, "GetElementFilter"): 
		efilter = item.GetElementFilter()
		return GetFilterRuleString(efilter, item.Document)		
	elif version < 2019 and hasattr(item, "GetRules"): 
		#filters = item.GetRules()
		#filtertypes.append("AND")
		return None
		
def GetFilterRuleString(efilter, doc):
	rulestrings = []
	# Filters without rules will arrive as nulls:
	if not efilter: return '<<<No rules defined>>>'
	efilterstr = efilter.ToString()		
	if "And" in efilterstr: sep = " AND "
	elif "Or" in efilterstr: sep = " OR "
	else: sep = ""
	filters = efilter.GetFilters()
	for filter in filters:
		if hasattr(filter, "GetRules"):
			for rule in filter.GetRules():
				# inverted rules
				ruleInverted = ""
				if hasattr(rule, "GetInnerRule"): 
					rule = rule.GetInnerRule()
					ruleInverted = "Not"
				# rule parameters
				paramId = rule.GetRuleParameter()
				thisparam = doc.GetElement(paramId)
				if thisparam: thisparam = thisparam.Name
				else: thisparam = bips[paramId.IntegerValue]
				# rule evaluators
				if hasattr(rule, "GetEvaluator"):
					thiseval = rule.GetEvaluator().ToString().replace("Autodesk.Revit.DB.Filter","")
					thiseval = thiseval.replace("Numeric","")
					thiseval = thiseval.replace("String","")
					thiseval = thiseval + ruleInverted
					if thiseval == "Equals": thiseval = "=="
					elif thiseval == "EqualsNot": thiseval = "!="
					elif thiseval == "Greater": thiseval = ">"
					elif thiseval == "GreaterOrEqual": thiseval = ">="
					elif thiseval == "Less": thiseval = "<"
					elif thiseval == "LessOrEqual": thiseval = "<="
				elif hasattr(rule, "ParameterName"): thiseval = "Exists"
				else: thiseval = ""
				# rule values
				if hasattr(rule, "RuleString"): thisval = rule.RuleString
				elif hasattr(rule, "RuleValue"): thisval = rule.RuleValue.ToString()
				else: thisval = ""
				# rule strings
				rulestrings.append((thisparam + " " + thiseval + " " + thisval).strip())
		else: rulestrings.append("(" + GetFilterRuleString(filter, doc)+ ")")
	rulestrings.sort()
	return sep.join(rulestrings)
		
items = UnwrapElement(IN[0])
version = IN[1]

if isinstance(IN[0], list): OUT = [GetFilterRuleStringWrapper(x) for x in items]
else: OUT = GetFilterRuleStringWrapper(items)
# ----------------------------------------
str = Output(python_script)
