# Dynamo custom node ParameterFilterElement.Parameters.dyf (Dynamo 2.6.2.15705)
# category: Clockwork.Revit.Elements.Query
# Retrieves the names of all parameters used in a given ParameterFilterElement (aka view filters)
# packages: Clockwork for Dynamo 2.x 2.4.0

parameterFilterElement = Input(parameterFilterElement: Revit.Filter.ParameterFilterElement[]..[])
version = Custom[Application.Version]()  # package Clockwork for Dynamo 2.x; Retrieves the name, version and build of the current Revit application.
python_script = Python(IN[0]=parameterFilterElement, IN[1]=version.Version)
# ---------- python_script.python (40 lines) ----------
import clr
import System
clr.AddReference('RevitAPI')
from Autodesk.Revit.DB import *

clr.AddReference("RevitNodes")
import Revit
clr.ImportExtensions(Revit.Elements)

bips = {}
for bip in System.Enum.GetValues(BuiltInParameter):
	try: bips[ElementId(bip).IntegerValue] = LabelUtils.GetLabelFor(bip)
	except: pass

def GetFilterRuleParamsWrapper(item):
	if version > 2018 and hasattr(item, "GetElementFilter"): 
		efilter = item.GetElementFilter()
		return GetFilterRuleParams(efilter, item.Document)		
	elif version < 2019 and hasattr(item, "GetRules"): 
		return "Versions below Revit 2019 not supported"
		
def GetFilterRuleParams(efilter, doc):
	params = []
	if efilter:
		for filter in efilter.GetFilters():
			if hasattr(filter, "GetRules"):
				for rule in filter.GetRules():
					paramId = rule.GetRuleParameter()
					thisparam = doc.GetElement(paramId)
					if thisparam: thisparam = thisparam.Name
					else: thisparam = bips[paramId.IntegerValue]
					params.append(thisparam.strip())
			else: params.append(GetFilterRuleParams(filter, doc))
	return params
		
items = UnwrapElement(IN[0])
version = IN[1]

if isinstance(IN[0], list): OUT = [GetFilterRuleParamsWrapper(x) for x in items]
else: OUT = GetFilterRuleParamsWrapper(items)
# ----------------------------------------
str = Output(python_script)
