# Dynamo custom node Passthrough.dyf (Dynamo 0.9.0.3067)
# category: Clockwork.Script.ControlFlow.Actions
# Forces a sequential order of execution. The node wired into the output of the Passthrough node will be executed *after* the node wired into the waitFor input (e.g. important for some Revit operations). The value of the passThrough input will be passed on to the node wired into the output port of the Passthrough node.

passThrough = Input()
waitFor = Input()
code_block = CodeBlock(passthrough=passThrough, waitfor=waitFor) { {passthrough,waitfor}[0]; }
passThrough_2 = Output(code_block)  # "passThrough"
