# Dynamo custom node Plane.ByBestFitFromFace.dyf (Dynamo 1.3.1.1736)
# category: Clockwork.Geometry.Abstract.Create
# Creates a plane from face

surface = Input(surface : Surface)
vertices = Topology.Vertices(surface)
pointGeometry = Vertex.PointGeometry(vertices)
byBestFitThroughPoints = Plane.ByBestFitThroughPoints(pointGeometry)
plane = Output(byBestFitThroughPoints)
