# Dynamo custom node Point.CentralProjectionOnFace.dyf (Dynamo 1.3.0.875)
# category: Clockwork.Geometry.Points.Actions
# Projects a list of points onto a given face

surface = Input(surface : Surface)
projectionPoints = Input(projectionPoints : Autodesk.Point[])
centralProjectionPoint = Input(centralProjectionPoint : Autodesk.Point)
byTwoPoints = Vector.ByTwoPoints(start=centralProjectionPoint, end=projectionPoints)
projectInputOnto = Surface.ProjectInputOnto(surface, projectionPoints, byTwoPoints)
projectedPoints = Output(projectInputOnto)
