# Dynamo custom node Point.CentralProjectionOnPlane.dyf (Dynamo 1.3.0.875)
# category: Clockwork.Geometry.Points.Actions
# Projects a list of points onto a given plane

centralProjectionPoint = Input(centralProjectionPoint : Autodesk.Point)
projectionPoints = Input(projectionPoints : Autodesk.Point[])
byTwoPoints = Vector.ByTwoPoints(start=centralProjectionPoint, end=projectionPoints)
normalized = Vector.Normalized(byTwoPoints)
plane = Input(plane : Plane)
intersectionWithPlane = Custom[Vector.IntersectionWithPlane](vectorBasePoint=centralProjectionPoint, vector=normalized, plane=plane)  # Finds the intersection point between a plane and a vector
projectedPoints = Output(intersectionWithPlane)
