# Dynamo custom node Point.IsOutOfPlane.dyf (Dynamo 1.3.0.875)
# category: Clockwork.Geometry.Points.Query
# Checks a list for XYZs that are not located on a given plane

face_plane = Input()  # "face/plane"
point = Input(point : Autodesk.Point)
closestPointTo = Geometry.ClosestPointTo(geometry=face_plane, other=point)
isAlmostEqualTo = Geometry.IsAlmostEqualTo(closestPointTo, point)
not_ = Not(isAlmostEqualTo)
bool = Output(not_)
distanceTo = Geometry.DistanceTo(geometry=closestPointTo, other=point)
amount = Output(distanceTo)
