# Dynamo custom node PointSequence.AccumulatedDistance.dyf (Dynamo 1.3.0.875)
# category: Clockwork.Geometry.PointSequence.Query
# Retrieves the accumulated distances of a sequence of points

seq = Input(seq : Autodesk.Point[])
turnIntoList = Custom[TurnIntoList](unknownItem=seq)  # Turns an element (or a nested list) into a flat list
count = List.Count(turnIntoList)
code_block = CodeBlock(n=count) { n - 1; n < 2; 0; }
takeItems = List.TakeItems(list=turnIntoList, amount=code_block.out0)
restOfItems = List.RestOfItems(turnIntoList)
distanceTo = Geometry.DistanceTo(geometry=takeItems, other=restOfItems)
sum = Math.Sum(distanceTo)
if_ = If(test=code_block.out1, true=code_block.out2, false=sum)
distance = Output(if_)
