# Dynamo custom node PointSequence.ContainsOutOfPlanePoints.dyf (Dynamo 1.3.0.875)
# category: Clockwork.Geometry.PointSequence.Query
# Checks a list for XYZs that are not located on a given plane

face_plane = Input()  # "face/plane"
seq = Input()
turnIntoList = Custom[TurnIntoList](unknownItem=seq)  # Turns an element (or a nested list) into a flat list
isOutOfPlane = Custom[Point.IsOutOfPlane](face_plane=face_plane, point=turnIntoList)  # Checks a list for XYZs that are not located on a given plane
anyTrue = Custom[List.AnyTrue](seq=isOutOfPlane.bool)  # Returns true if any item in a list of booleans is true.
bool = Output(anyTrue)
maximumItem = List.MaximumItem(isOutOfPlane.amount)
max = Output(maximumItem)
