# Dynamo custom node PointSequence.GreatestDistanceToPoint.dyf (Dynamo 1.3.0.875)
# category: Clockwork.Geometry.PointSequence.Query
# Retrieves the furthest point in a sequence of points

point = Input(point : Autodesk.Point)
seq = Input()
turnIntoList = Custom[Turn Into List](unknownItem=seq)  # Turns an element (or a nested list) into a flat list
distanceTo = Geometry.DistanceTo(geometry=point, other=turnIntoList)
maximumItem = List.MaximumItem(distanceTo)
distance = Output(maximumItem)
code_block = CodeBlock(max=maximumItem, distlist=distanceTo) { max == distlist; }
bool = Output(code_block)
