# Dynamo custom node ReturnListOrSingleValue.dyf (Dynamo 0.8.1.1823)
# category: Clockwork.Script.ControlFlow.Actions
# If the unknown item is not a list but rather a single item, only the first item of the list (input "seq") will be returned.

unknownItem = Input()
seq = Input()
python_script = Python(IN[0]=unknownItem, IN[1]=seq)
# ---------- python_script.python (4 lines) ----------
check = IN[0]
items = IN[1]
if isinstance(check, (list)): OUT = items
else: OUT = items[0]
# ----------------------------------------
Output = Output(python_script)  # ""
