# Dynamo custom node RevisionCloud.FromElements.dyf (Dynamo 2.0.1.5055)
# category: Clockwork.Revit.Elements.Create
# Create a revision cloud for a list of Revit elements

view = Input(view: var[]..[])
elements = Input(elements: var[]..[])
byElements = Custom[BoundingBox.ByElements](elements=elements)  # Retrieves a bounding box for a list of elements
plane = Custom[View.Plane](view=view)  # Retrieves the plane of a given view
normal = Plane.Normal(plane=plane)
perimeterCurvesByNormal = Custom[BoundingBox.PerimeterCurvesByNormal](boundingbox=byElements, normal=normal)  # Returns the perimeter curve of a bounding box on a plane determined by a given normal and the centroid of the bounding box
revision = Input(revision: var[]..[])
byCurve = RevisionCloud.ByCurve(view=view, curves=perimeterCurvesByNormal, revision=revision)
revisionCloud = Output(byCurve)
