# Dynamo custom node Room.InsertsOfBoundariesByCategory.dyf (Dynamo 2.0.1.5055)
# category: Clockwork.Revit.Elements.Query
# Retrieves the inserts of the bounding elements of a given room - filtered by a given category.

filterByBoolMask = List.FilterByBoolMask()  # unwired: list, mask
room = Input(room: var[]..[])
includeOpenings = Input(includeOpenings: bool = false)
includeShadows = Input(includeShadows: bool = false)
includeEmbeddedWalls = Input(includeEmbeddedWalls: bool = false)
includeSharedEmbeddedInserts = Input(includeSharedEmbeddedInserts: bool = false)
insertsOfBoundaries = Custom[Room.InsertsOfBoundaries](room=room, includeOpenings=includeOpenings, includeShadows=includeShadows, includeEmbeddedWalls=includeEmbeddedWalls, includeSharedEmbeddedInserts=includeSharedEmbeddedInserts)  # Retrieves the inserts of the bounding elements of a given room.
category = Custom[Element.Category+](element=insertsOfBoundaries@L2)  # Returns the category of a given element. Unlike the OOTB node Element.GetCategory, it will work for families, schedules, subcategories and graphics styles as well.
ID = Custom[Element.ID+](element=category@L2)  # Gets the ID of a given Revit elements. Unlike the OOTB Element.Id node, this node also works on mixed lists of Revit elements and categories.
category_2 = Input(category: var[]..[])
ID_2 = Custom[Element.ID+](element=category_2)
eq = ID == ID_2
combine = List.Combine(comb=filterByBoolMask.in, list1=insertsOfBoundaries, list2=eq)
inserts = Output(combine)
