# Dynamo custom node RoomTag.SetType.dyf (Dynamo 2.12.0.5650)
# category: Clockwork.Revit.Elements.Actions
# Changes the family type of a given room tag to the specified type

roomTag = Input(roomTag: var[]..[])
roomTag_2 = Output(roomTag)  # "roomTag"
roomTagType = Input(roomTagType: var[]..[])
python_script = Python(IN[0]=roomTag, IN[1]=roomTagType)  # IronPython2
# ---------- python_script.python (31 lines) ----------
import clr
clr.AddReference('RevitAPI')
from Autodesk.Revit.DB import *

clr.AddReference("RevitNodes")
import Revit
clr.ImportExtensions(Revit.Elements)

clr.AddReference("RevitServices")
import RevitServices
from RevitServices.Persistence import DocumentManager
from RevitServices.Transactions import TransactionManager

def SetRoomTagType(tag,tagtype):
	if hasattr(tag, "RoomTagType"):
		tag.RoomTagType = tagtype
		return True
	else: return False

doc = DocumentManager.Instance.CurrentDBDocument
tags = UnwrapElement(IN[0])
tagtypes = UnwrapElement(IN[1])

TransactionManager.Instance.EnsureInTransaction(doc)
if isinstance(IN[0], list):
	if isinstance(IN[1], list): OUT = [SetRoomTagType(x,y) for x,y in zip(tags,tagtypes)]
	else: OUT = [SetRoomTagType(x,tagtypes) for x in tags]
else:
	if isinstance(IN[1], list): OUT = SetRoomTagType(tags,tagtypes[0])
	else: OUT = SetRoomTagType(tags,tagtypes)
TransactionManager.Instance.TransactionTaskDone()
# ----------------------------------------
success = Output(python_script)
