# Dynamo custom node Rounding.Round+.dyf (Dynamo 2.0.0.4654)
# category: Clockwork.Math.Functions.Actions
# Rounds a number to a specified precision

dbl = Input(dbl: double)
precision = Input(precision: double = 1)
code_block = CodeBlock(a=dbl, b=precision) { Math.Round(a/b)*b; }
dbl_2 = Output(code_block)  # "dbl"
