# Dynamo custom node ScopeIf+.dyf (Dynamo 2.0.1.5055)
# category: Clockwork.Script.ControlFlow.Actions
# A (hopefully) more robust implementation of ScopeIf. Tests a single boolean and returns a value accordingly.

true = Input(true: var[]..[])
false = Input(false: var[]..[])
test = Input(test: var[]..[])
code_block = CodeBlock(trueval=true, falseval=false, test=test) { result = [trueval, falseval]; result[test ? 0 : 1]; }
result = Output(code_block.out1)
