# Dynamo custom node SpaceSeparator.FromCurve.dyf (Dynamo 2.0.1.5055)
# category: Clockwork.Revit.Elements.ModelCurve.Create
# Creates space separation lines from geometry curves.

curve = Input(curve: Autodesk.DesignScript.Geometry.Curve)
turn_into_list = Custom[Turn Into List](unknownItem=curve)  # Turns an element (or a nested list) into a flat list
sketchPlane = Input(sketchPlane: Revit.Elements.SketchPlane)
view = Input(view: var[]..[])
python_script = Python(IN[0]=turn_into_list, IN[1]=sketchPlane, IN[2]=view)
# ---------- python_script.python (30 lines) ----------
import clr
clr.AddReference('RevitAPI')
from Autodesk.Revit.DB import *

clr.AddReference("RevitNodes")
import Revit
clr.ImportExtensions(Revit.GeometryConversion)

clr.AddReference("RevitServices")
import RevitServices
from RevitServices.Persistence import DocumentManager
from RevitServices.Transactions import TransactionManager

doc = DocumentManager.Instance.CurrentDBDocument
curves = UnwrapElement(IN[0])
sketchplane = UnwrapElement(IN[1])
view = UnwrapElement(IN[2])

TransactionManager.Instance.EnsureInTransaction(doc)
curvearray = CurveArray()
for curve in curves:
	curvearray.Append(curve.ToRevitType())
doccreation = doc.Create
separatorarray = doccreation.NewSpaceBoundaryLines(sketchplane, curvearray, view)
TransactionManager.Instance.TransactionTaskDone()

elementlist = list()
for item in separatorarray:
	elementlist.append(item)
OUT = elementlist
# ----------------------------------------
returnListOrSingleValue = Custom[ReturnListOrSingleValue](unknownItem=curve, seq=python_script)  # If the item in input #1 is not a list, only the first item of the list in input #2 will be returned.
spaceSeparator = Output(returnListOrSingleValue)
