# Dynamo custom node String.Replace+.dyf (Dynamo 1.0.0.1180)
# category: Clockwork.Core.String.Modify.Actions
# Replaces multiple items in a given string. Items in the string have to be denoted as {0], {1}, ..., {n} - corresponding to the respective list index of the replacement string.

str = Input()
replacements = Input()
turnIntoList = Custom[TurnIntoList](unknownItem=replacements)  # Turns an element (or a nested list) into a flat list
python_script = Python(IN[0]=str, IN[1]=turnIntoList)
# ---------- python_script.python (2 lines) ----------
import clr
OUT = IN[0].format(*IN[1])
# ----------------------------------------
str_2 = Output(python_script)  # "str"
