# Dynamo custom node Surface.IsPlanar.dyf (Dynamo 1.3.1.1736)
# category: Clockwork.Geometry.Surfaces.Query
# Checks whether a face is planar

surface = Input(surface : Surface)
turnIntoList = Custom[TurnIntoList](unknownItem=surface)  # Turns an element (or a nested list) into a flat list
code_block = CodeBlock { 3; }
gridFromFace = Custom[Paneling.GridFromFace](surface=turnIntoList@L1, U=code_block, V=code_block)  # Returns UV coordinates, XYZ coordinates and normals for a face with UV subdivision
byBestFitThroughPoints = Plane.ByBestFitThroughPoints(gridFromFace.Points)
intersect = Geometry.Intersect(geometry=gridFromFace.Points, other=byBestFitThroughPoints)
isEmpty = List.IsEmpty(intersect@@L2)
allFalse = AllFalse(isEmpty@L2)
returnListOrSingleValue = Custom[ReturnListOrSingleValue](unknownItem=surface, seq=allFalse)  # If the unknown item is not a list but rather a single item, only the first item of the list (input "seq") will be returned.
bool = Output(returnListOrSingleValue)
