# Dynamo custom node TextElement.Text.dyf (Dynamo 2.0.1.5055)
# category: Clockwork.Revit.Elements.Query
# Gets the text stored in a text element. Unlike the OOTB node TextNote.Text, this one works on ModelText as well.

element = Input(element: var[]..[])
python_script = Python(IN[0]=element)
# ---------- python_script.python (12 lines) ----------
import clr
clr.AddReference('RevitAPI')
from Autodesk.Revit.DB import *

def GetText(item):
	if hasattr(item, "Text"): return item.Text
	else: return None

textnotes = UnwrapElement(IN[0])

if isinstance(IN[0], list): OUT = [GetText(x) for x in textnotes]
else: OUT = GetText(textnotes)
# ----------------------------------------
str = Output(python_script)
