# Dynamo custom node TimeSpan.LapTime.dyf (Dynamo 1.3.1.1736)
# category: Clockwork.Input.Create
# Records a timestamp and adds it to a given list of lap times. Also passes through an arbitrary variable for integration into a graph.

lapTimes = Input(lapTimes : System.DateTime[] = List.Empty)
rerunToggle = Input(rerunToggle : bool = false)
now = DateTime.Now()
python_script = Python(IN[0]=lapTimes, IN[1]=rerunToggle, IN[2]=now)
# ---------- python_script.python (4 lines) ----------
import time
times = IN[0]
times.append(IN[2])
OUT = times
# ----------------------------------------
LapTimes = Output(python_script)
Passthrough = Input()
Passthrough_2 = Output(Passthrough)  # "Passthrough"
