# Dynamo custom node Topography.IntersectionWithPlane.dyf (Dynamo 2.0.1.5055)
# category: Clockwork.Revit.Elements.Actions
# Calculates the intersection of a toposurface and a plane

plane = Input(plane: Autodesk.DesignScript.Geometry.Plane)
topo = Input(topo: Revit.Elements.Topography)
mesh = Topography.Mesh(topography=topo)
intersectWithPlane = Custom[Mesh.IntersectWithPlane](plane=plane, mesh=mesh)  # Calculates the intersection of a mesh and a plane
points = Output(intersectWithPlane.points)
polyCurve = Output(intersectWithPlane.polyCurve)
nurbsCurveByPoints = Output(intersectWithPlane.nurbsCurveByPoints)
nurbsCurveByControlPoints = Output(intersectWithPlane.nurbsCurveByControlPoints)
