# Dynamo custom node Topography.IsSubregion.dyf (Dynamo 2.6.1.8786)
# category: Clockwork.Revit.Elements.Query
# Filters out everything that is *not* a topo subregion. Needs Revit 2014 or newer to work.

topography = Input(topography: Revit.Elements.Topography)
python_script = Python(IN[0]=topography)
# ---------- python_script.python (12 lines) ----------
import clr
clr.AddReference('RevitAPI')
from Autodesk.Revit.DB import *

def IsTopoSubregion(topo):
	if hasattr(topo, "IsSiteSubRegion"): return topo.IsSiteSubRegion
	else: return False

topos = UnwrapElement(IN[0])

if isinstance(IN[0], list): OUT = [IsTopoSubregion(x) for x in topos]
else: OUT = IsTopoSubregion(topos)
# ----------------------------------------
bool = Output(python_script)
