# Dynamo custom node UV.Average.dyf (Dynamo 0.8.1.1693)
# category: Clockwork.Geometry.Points.Query
# Determines the average of a list of UVs

UVs = Input(UVs : UV[])
code_block = CodeBlock(uvlist=UVs) { UV.ByCoordinates(Math.Average(uvlist.U),Math.Average(uvlist.V)); }
UV = Output(code_block)
