# Dynamo custom node UV.ByXY.dyf (Dynamo 0.8.1.1693)
# category: Clockwork.Geometry.Points.Create
# Creates UVs from the XY components of point coordinates

point = Input(point : Autodesk.Point)
code_block = CodeBlock(seq=point) { UV.ByCoordinates(seq.X,seq.Y); }
uv = Output(code_block)
