# Dynamo custom node UV.RoundDownToPrecision.dyf (Dynamo 1.3.0.875)
# category: Clockwork.Geometry.Points.Actions
# Rounds a UV coordinate *down* to a specified precision

uv = Input(uv : UV)
Precision = Input(Precision : double)
code_block = CodeBlock(uc=uv, pr=Precision) { a = {uc.U,uc.V}; ar = Math.Floor(a/pr)*pr; UV.ByCoordinates(ar[0],ar[1]); }
uv_2 = Output(code_block.out2)  # "uv"
