# Dynamo custom node UV.Swap.dyf (Dynamo 1.3.0.875)
# category: Clockwork.Geometry.Points.Actions
# Swaps U and V coordinates

uv = Input(uv : UV)
V = UV.V(uv)
U = UV.U(uv)
byCoordinates = UV.ByCoordinates(V, U)
uv_2 = Output(byCoordinates)  # "uv"
