# Dynamo custom node Vector.AltitudeAndAzimuth.dyf (Dynamo 1.3.0.875)
# category: Clockwork.Geometry.Abstract.Query
# Computes the altitude and azimuth of a given vector

vector = Input(vector : Vector)
normalized = Vector.Normalized(vector)
# note: Turn normalized vector into point
asPoint = Vector.AsPoint(normalized)
Z = Point.Z(asPoint)
origin = Point.Origin()
X = Point.X(asPoint)
Y = Point.Y(asPoint)
# note: Project point to XY plane
byCoordinates = Point.ByCoordinates(x=X, y=Y)
solveByPoints = Custom[Solve Triangle By XYZs](PointA=asPoint, PointB=origin, PointC=byCoordinates)  # "Triangle.SolveByPoints"; Solves a triangle based on the XYZ coordinates of its vertices.
ZAxisNegative = Custom[Z Axis (Negative)]()  # "Vector.ZAxisNegative"; Returns an XYZ of 0,0,-1
asPoint_2 = Vector.AsPoint(ZAxisNegative)
isAlmostEqualTo = Geometry.IsAlmostEqualTo(asPoint_2, asPoint)
ZAxis = Vector.ZAxis()
asPoint_3 = Vector.AsPoint(ZAxis)
isAlmostEqualTo_2 = Geometry.IsAlmostEqualTo(asPoint_3, asPoint)
YAxis = Vector.YAxis()
asPoint_4 = Vector.AsPoint(YAxis)
solveByPoints_2 = Custom[Solve Triangle By XYZs](PointA=byCoordinates, PointB=origin, PointC=asPoint_4)  # "Triangle.SolveByPoints"
code_block = CodeBlock(vecZ=Z, x=solveByPoints.Beta, cond1=isAlmostEqualTo, cond2=isAlmostEqualTo_2, vecx=X, a=solveByPoints_2.Beta) { zdir = vecZ < 0 ? -x : x; res1 = cond1 ? 90 : zdir; alt = cond2 ? 90 : res1; azi = vecx < 0 ? 360-a : a; }
altitude = Output(code_block.alt)
azimuth = Output(code_block.azi)
