# Dynamo custom node Vector.Average.dyf (Dynamo 1.3.0.875)
# category: Clockwork.Geometry.Abstract.Query
# Determines the average vector of a list of vectors

vectors = Input(vectors : Vector[])
normalized = Vector.Normalized(vectors)
X = Vector.X(normalized)
average = Math.Average(X)
Y = Vector.Y(normalized)
average_2 = Math.Average(Y)
Z = Vector.Z(normalized)
average_3 = Math.Average(Z)
boolean = BoolSelector(true)
byCoordinates = Vector.ByCoordinates(x=average, y=average_2, z=average_3, normalized=boolean)
Vector = Output(byCoordinates)
