# Dynamo custom node Vector.IsInPlane.dyf (Dynamo 1.3.0.875)
# category: Clockwork.Geometry.Abstract.Query
# Checks if a given vector is located on a given plane

vector = Input(vector : Vector)
normalized = Vector.Normalized(vector)
plane = Input(plane : Plane)
isParallelToPlane = Custom[Vector.IsParallelToPlane](vector=normalized, plane=plane)  # Checks if a given vector is parallel to a given plane
vectorBasePoint = Input(vectorBasePoint : Autodesk.Point)
isOutOfPlane = Custom[Point.IsOutOfPlane](face_plane=plane, point=vectorBasePoint)  # Checks a list for XYZs that are not located on a given plane
not_ = Not(isOutOfPlane.bool)
create = List.Create(isParallelToPlane, not_)
allTrue = AllTrue(create)
bool = Output(allTrue)
