# Dynamo custom node Vector.IsOrthogonalToVector.dyf (Dynamo 1.3.0.875)
# category: Clockwork.Geometry.Abstract.Query
# Checks if two vectors are orthogonal to each other

Vector1 = Input(Vector1 : Vector)
normalized = Vector.Normalized(Vector1)
Vector2 = Input(Vector2 : Vector)
normalized_2 = Vector.Normalized(Vector2)
dot = Vector.Dot(normalized, normalized_2)
almostZero = Custom[Almost Zero]()  # "Math.AlmostZero"; Returns a feasable computational tolerance to zero (1.0e-9 or a billionth of 1) for use in calculations. More background info: https://github.com/ikeough/Dynamo/issues/879
code_block = CodeBlock(dotprod=dot, zero=almostZero)
# ---------- code_block.designscript (3 lines) ----------
// Orthogonal vectors have a dot product of zero
// We're adding a bit of tolerance, just to be on the safe side...
isortho = !(dotprod>zero) && !(dotprod < -zero);
# ----------------------------------------
bool = Output(code_block)
