# Dynamo custom node Vector.IsParallelToPlane.dyf (Dynamo 1.3.0.875)
# category: Clockwork.Geometry.Abstract.Query
# Checks if a given vector is parallel to a given plane

vector = Input(vector : Vector)
plane = Input(plane : Plane)
normal = Plane.Normal(plane)
isOrthogonalToVector = Custom[Vector.IsOrthogonalToVector](Vector1=vector, Vector2=normal)  # Checks if two vectors are orthogonal to each other
bool = Output(isOrthogonalToVector)
