# Dynamo custom node Vector.PruneDuplicates.dyf (Dynamo 0.8.2.2392)
# category: Clockwork.Geometry.Abstract.Actions
# Prune vectors to exclude duplicates within a given tolerance

vectors = Input(vectors : Vector[])
asPoint = Vector.AsPoint(vectors)
Tolerance = Input(Tolerance : double)
# note: For some reason this does not work as a code block inside the custom node - hence nodes.
pruneDuplicates = Point.PruneDuplicates(points=asPoint, tolerance=Tolerance)
asVector = Point.AsVector(pruneDuplicates)
Vectors = Output(asVector)
