# Dynamo custom node VersionNumber.ToInteger.dyf (Dynamo 1.3.0.875)
# category: Clockwork.Core.String.Generate.Actions
# Converts a version number (e.g. a Dynamo version number) to an integer.

str = Input(str : string)
code_block = CodeBlock { "."; ""; }
replace = String.Replace(str=str, searchFor=code_block.out0, replaceWith=code_block.out1)
toNumber = String.ToNumber(replace)
int = Output(toNumber)
