# Dynamo custom node View.IsPerspective.dyf (Dynamo 2.6.1.8786)
# category: Clockwork.Revit.Views.Query
# Checks whether a given view is a perspective view.

view = Input(view: var[]..[])
python_script = Python(IN[0]=view)
# ---------- python_script.python (11 lines) ----------
import clr
clr.AddReference('RevitAPI')
from Autodesk.Revit.DB import *

def ViewIsPerspective(view):
	if hasattr(view, "IsPerspective"): return view.IsPerspective
	else: return False

views = UnwrapElement(IN[0])
if isinstance(IN[0], list): OUT = [ViewIsPerspective(x) for x in views]
else: OUT = ViewIsPerspective(views)
# ----------------------------------------
bool = Output(python_script)
