# Dynamo custom node View.PermanentlyIsolateCategory.dyf (Dynamo 2.0.0.4654)
# category: Clockwork.Revit.Views.Actions
# Permanently isolates categories in the given view

view = Input(view: var[]..[])
view_2 = Output(view)  # "view"
category = Input(category: var[]..[])
category_2 = Output(category)  # "category"
temporarilyIsolateCategory = Custom[View.TemporarilyIsolateCategory](view=view, category=category)  # Temporarily isolates categories in the given view
convertTemporaryHideIsolateToPermanent = Custom[View.ConvertTemporaryHideIsolateToPermanent](view=temporarilyIsolateCategory.view)  # Convert all temporary hidden elements or categories to permanently hidden in the given view.
success = Output(convertTemporaryHideIsolateToPermanent.success)
