# Dynamo custom node View3D.IsLocked.dyf (Dynamo 1.3.1.1736)
# category: Clockwork.Revit.Views.View3D.Query
# Checks if a given 3D view is locked. PLEASE NOTE: Due to a bug in DynamoRevit this currently only works for isometric view, not for perspective views.

view3d = Input(view3d : Elements.View3D)
python_script = Python(IN[0]=view3d)
# ---------- python_script.python (8 lines) ----------
import clr
clr.AddReference('RevitAPI')
from Autodesk.Revit.DB import *

views = UnwrapElement(IN[0])

if isinstance(IN[0], list): OUT = [x.IsLocked for x in views]
else: OUT = views.IsLocked
# ----------------------------------------
bool = Output(python_script)
