# Dynamo custom node WallType.Kind.dyf (Dynamo 2.0.1.5055)
# category: Clockwork.Revit.Elements.Query
# Retrieves the wall kind of a given wall type

wallType = Input(wallType: Revit.Elements.WallType)
python_script = Python(IN[0]=wallType)
# ---------- python_script.python (12 lines) ----------
import clr
clr.AddReference('RevitAPI')
from Autodesk.Revit.DB import *

def WallTypeKind(walltype):
	if hasattr(walltype,"Kind"): return str(walltype.Kind)
	else: return None

walltypes = UnwrapElement(IN[0])

if isinstance(IN[0], list): OUT = [WallTypeKind(x) for x in walltypes]
else: OUT = WallTypeKind(walltypes)
# ----------------------------------------
kind = Output(python_script)
