# Dynamo custom node Workset.Kind.dyf (Dynamo 1.3.1.1736)
# category: Clockwork.Revit.Elements.Workset.Query
# Retrieves the kind of a given workset

workset = Input()
python_script = Python(IN[0]=workset)
# ---------- python_script.python (15 lines) ----------
import clr
clr.AddReference('RevitAPI')
from Autodesk.Revit.DB import *

def WorksetKind(workset):
	if workset.GetType().ToString() == "Autodesk.Revit.DB.Workset":
		return str(workset.Kind)
	elif workset.GetType().ToString() == "archilab.Revit.Elements.Workset":
		return "Cannot retrieve the workset kind from a workset object generated by archi-lab nodes."
	else: return None

worksets = UnwrapElement(IN[0])

if isinstance(IN[0], list): OUT = [WorksetKind(x) for x in worksets]
else: OUT = WorksetKind(worksets)
# ----------------------------------------
kind = Output(python_script)
