# Dynamo custom node All Intersecting Elements Of Category By Vector.dyf (Dynamo 2.0.3.8810)
# category: Clockwork.Revit.Selection.Collectors.Query
# Finds all elements of a specified category that intersect with a list of vectors

origin = Input(origin: Autodesk.DesignScript.Geometry.Point)
direction = Input(direction: Autodesk.DesignScript.Geometry.Vector)
maxBounces = Input(maxBounces: int = 1)
threeDView = Input(threeDView: Revit.Elements.Views.View3D = null)
isNull = Object.IsNull(obj=threeDView)
code_block = CodeBlock { 1; }
byCoordinates = Point.ByCoordinates(x=code_block, y=code_block, z=code_block)
origin_2 = Point.Origin()
byEyePointAndTarget = AxonometricView.ByEyePointAndTarget(eyePoint=byCoordinates, target=origin_2)
if_ = If(test=isNull, true=byEyePointAndTarget, false=threeDView)
category = Input(category: var[]..[])  # Works with categories, BuiltInCategories and BuiltInCategories as strings
toggle = Input(toggle: bool = true)
passthrough = Custom[Passthrough](passThrough=category, waitFor=toggle)  # Forces a sequential order of execution. The node wired into the output of the Passthrough node will be executed *after* the node wired into the waitFor input (e.g. important for some Revit operations). The value of the passThrough input will be passed on to the node wired into the output port of the Passthrough node.
turnIntoList = Custom[TurnIntoList](unknownItem=passthrough)  # Turns an element (or a nested list) into a flat list
temporarilyIsolateCategory = Custom[View.TemporarilyIsolateCategory](view=if_, category=turnIntoList)  # Temporarily isolates categories in the given view
end = Revit.Transaction.Transaction.End(input=temporarilyIsolateCategory.view)
byOriginDirection = Revit.References.RayBounce.ByOriginDirection(origin=origin, direction=direction, maxBounces=maxBounces, view=end)
elements = Output(byOriginDirection.elements)
passthrough_2 = Custom[Passthrough](passThrough=byEyePointAndTarget, waitFor=byOriginDirection.elements)
python_script = Python(IN[0]=passthrough_2)
# ---------- python_script.python (30 lines) ----------
import clr
from System.Collections.Generic import *

clr.AddReference('RevitAPI')
from Autodesk.Revit.DB import *

clr.AddReference("RevitNodes")
import Revit
clr.ImportExtensions(Revit.GeometryConversion)

clr.AddReference("RevitServices")
import RevitServices
from RevitServices.Persistence import DocumentManager
from RevitServices.Transactions import TransactionManager

doc = DocumentManager.Instance.CurrentDBDocument
items = UnwrapElement(IN[0])

def DeleteElement(item):
	if hasattr(item, "Id"):
		try: 
			doc.Delete(item.Id)
			return True
		except: return False
	else: return False

TransactionManager.Instance.EnsureInTransaction(doc)
if isinstance(IN[0], list): OUT = [DeleteElement(x) for x in items]
else: OUT = DeleteElement(items)
TransactionManager.Instance.TransactionTaskDone()
# ----------------------------------------
passthrough_3 = Custom[Passthrough](passThrough=if_, waitFor=byOriginDirection.elements)
disableTemporaryHideIsolate = Custom[View.DisableTemporaryHideIsolate](view=passthrough_3)  # Disables the temporary hide/isolate for the given view (if set)
