# Dynamo custom node Angle.ByAngleSum.dyf (Dynamo 2.12.1.8246)
# category: Clockwork.Math.Formulas.Query
# Computes the missing interior angle of a *planar* polygon based on a given list of all other interior angles.

angles = Input(angles: double[])
count = List.Count(list=angles)
code_block = CodeBlock(n=count, angles=angles) { n > 1; (n-1)*180-Math.Sum(angles); "The list needs to consist of at least two angles."; }
if_ = RefactoredIf(test=code_block.out0, true=code_block.out1, false=code_block.out2)
angle = Output(if_)
