# Dynamo custom node Application.Version.dyf (Dynamo 2.0.1.5055)
# category: Clockwork.Revit.Application.Query
# Retrieves the name, version and build of the current Revit application.

python_script = Python()
# ---------- python_script.python (12 lines) ----------
import clr
clr.AddReference("RevitServices")
import RevitServices
from RevitServices.Persistence import DocumentManager

doc = DocumentManager.Instance.CurrentDBDocument
uiapp = DocumentManager.Instance.CurrentUIApplication
app = uiapp.Application
if int(app.VersionNumber) > 2017: fullVersion = app.SubVersionNumber
else: fullVersion = str(app.VersionNumber)

OUT = app.VersionName, int(app.VersionNumber), app.VersionBuild, app.Language.ToString(), fullVersion
# ----------------------------------------
code_block = CodeBlock(seq=python_script) { seq[0]; seq[1]; seq[2]; seq[3]; seq[4]; }
Name = Output(code_block.out0)
Version = Output(code_block.out1)
Build = Output(code_block.out2)
Language = Output(code_block.out3)
fullVersion = Output(code_block.out4)
