# Dynamo custom node CurtainPanel.HostPanel.dyf (Dynamo 2.12.1.8246)
# category: Clockwork.Revit.Elements.Query
# Retrieves the host panel of a given curtain panel. This is typcially needed when wanting to access wall elements used as curtain panels. If no host panel is found, the node will return the input panel instead.

curtainPanel = Input(curtainPanel: var[]..[])
python_script = Python(IN[0]=curtainPanel)  # CPython3
# ---------- python_script.python (19 lines) ----------
import clr
clr.AddReference('RevitAPI')
from Autodesk.Revit.DB import *

clr.AddReference("RevitNodes")
import Revit
clr.ImportExtensions(Revit.Elements)

def GetHostPanel(item):
	if hasattr(item, "FindHostPanel"):
		hpId = item.FindHostPanel()
		if hpId.IntegerValue > 0: return item.Document.GetElement(hpId).ToDSType(True)
		else: return item
	else: return item

items = UnwrapElement(IN[0])

if isinstance(IN[0], list): OUT = [GetHostPanel(x) for x in items]
else: OUT = GetHostPanel(items)
# ----------------------------------------
hostPanel = Output(python_script)
