# Dynamo custom node Data.ImportCSV+.dyf (Dynamo 2.12.1.8246)
# category: Clockwork.ImportExport.Actions
# Converts the content of a given CSV file to a list
# packages: Clockwork for Dynamo 2.x 2.12.0

ignoreLastRow = Input(ignoreLastRow: bool = false)
ignoreFirstRow = Input(ignoreFirstRow: bool = false)
CSVstring = Input(CSVstring: string)
string = StringInput("\n")  # graph input
split = String.Split(string=CSVstring, separator0=string)
delimiter = Input(delimiter: string = ",")
split_2 = String.Split(string=split@L2, separator0=delimiter)
firstItem = List.FirstItem(list=split_2)
restOfItems = List.RestOfItems(list=firstItem)
scopeIf = ScopedIf(test=ignoreFirstRow, true=restOfItems, false=firstItem)
dropLastItem = Custom[List.DropLastItem](list=scopeIf)  # package Clockwork for Dynamo 2.x; Drops the last item from a given list.
if_ = RefactoredIf(test=ignoreLastRow, true=dropLastItem, false=scopeIf)
trimWhitespace = String.TrimWhitespace(string=if_)
seq = Output(trimWhitespace)
