# Dynamo custom node DesignOption.IsPrimary.dyf (Dynamo 2.0.1.5055)
# category: Clockwork.Revit.Elements.Query
# Determines whether a given design option is the primary option in its set

designOption = Input(designOption: var[]..[])
python_script = Python(IN[0]=designOption)
# ---------- python_script.python (13 lines) ----------
import clr
import System
clr.AddReference('RevitAPI')
from Autodesk.Revit.DB import *

def DesignOptionIsPrimary(item):
	if hasattr(item, "IsPrimary"): return item.IsPrimary
	else: return False

items = UnwrapElement(IN[0])

if isinstance(IN[0], list): OUT = [DesignOptionIsPrimary(x) for x in items]
else: OUT = DesignOptionIsPrimary(items)
# ----------------------------------------
bool = Output(python_script)
