# Dynamo custom node Document.BuiltInParameters.dyf (Dynamo 2.12.1.8246)
# category: Clockwork.Revit.Application.Query
# List all the available BuiltInParameters

python_script = Python()  # CPython3; graph input
# ---------- python_script.python (15 lines) ----------
import clr
import System
clr.AddReference('RevitAPI')
clr.AddReference('RevitAPIUI')
from Autodesk.Revit.DB import *
import Autodesk

bips = System.Enum.GetValues(BuiltInParameter)
pdata = list()
for bip in bips:
	try:
		pdata.append((System.Enum.GetName(BuiltInParameter, bip),ElementId(bip),LabelUtils.GetLabelFor(bip)))
	except:
		pass
OUT = pdata
# ----------------------------------------
transpose = List.Transpose(lists=python_script)
code_block = CodeBlock(seq=transpose) { seq[0]; seq[1]; seq[2]; }
BuiltInParameters = Output(code_block.out0)
ElementIDs = Output(code_block.out1)
ParameterNames = Output(code_block.out2)
