# Dynamo custom node Document.SetComputeVolumes.dyf (Dynamo 2.0.3.8810)
# category: Clockwork.Revit.Application.Actions
# Toggle the area and volume setting to compute volumes on (true) or off (false).

computeVolumes = Input(computeVolumes: bool)
computeVolumes_2 = Custom[Document.ComputeVolumes]()  # Returns whether or not the area and volume settings are set to compute volumes.
python_script = Python(IN[0]=computeVolumes, IN[1]=computeVolumes_2)
# ---------- python_script.python (25 lines) ----------
import clr
clr.AddReference('RevitAPI')
from Autodesk.Revit.DB import *

clr.AddReference("RevitNodes")
import Revit
clr.ImportExtensions(Revit.Elements)

clr.AddReference("RevitServices")
import RevitServices
from RevitServices.Persistence import DocumentManager
from RevitServices.Transactions import TransactionManager

doc = DocumentManager.Instance.CurrentDBDocument
compvol = IN[0]
compvolstate = IN[1]

if compvol != compvolstate:
	TransactionManager.Instance.EnsureInTransaction(doc)
	try:
		AreaVolumeSettings.GetAreaVolumeSettings(doc).ComputeVolumes = compvol
		OUT = True
	except: OUT = False
	TransactionManager.Instance.TransactionTaskDone()
else: OUT = True
# ----------------------------------------
bool = Output(python_script)
