# Dynamo custom node FilledRegionType.FillPatterns.dyf (Dynamo 2.12.1.8246)
# category: Clockwork.Revit.Elements.Query
# Returns the fill pattern(s) of a given filled region type. In Revit versions prior to 2019 the background fill pattern will always return Null.

filledRegionType = Input(filledRegionType: Revit.Elements.FilledRegionType[]..[])
python_script = Python(IN[0]=filledRegionType)  # CPython3
# ---------- python_script.python (21 lines) ----------
import clr
clr.AddReference('RevitAPI')
from Autodesk.Revit.DB import *

def GetFillPatterns(frt):
	foreground = None
	background = None
	if hasattr(frt, "ForegroundPatternId"):
		if frt.ForegroundPatternId.IntegerValue > 0:
			foreground = frt.Document.GetElement(frt.ForegroundPatternId)
		if frt.BackgroundPatternId.IntegerValue > 0:
			background = frt.Document.GetElement(frt.BackgroundPatternId)
	elif hasattr(frt, "FillPatternId"):	
		if frt.FillPatternId.IntegerValue > 0:
			foreground = frt.Document.GetElement(frt.FillPatternId)
	return foreground, background

filledregiontypes = UnwrapElement(IN[0])

if isinstance(IN[0], list): OUT = list(map(list, zip(*[GetFillPatterns(x) for x in filledregiontypes])))
else: OUT = GetFillPatterns(filledregiontypes)
# ----------------------------------------
firstItem = List.FirstItem(list=python_script)
foregroundFillPattern = Output(firstItem)
lastItem = List.LastItem(list=python_script)
backgroundFillPattern = Output(lastItem)
