# Dynamo custom node ParameterFilterElement.FilterRuleString.dyf (Dynamo 2.16.4.10216)
# category: Clockwork.Revit.Elements.Query
# Aggregates the filter rules of a given ParameterFilterElement into a human-readable string

parameterFilterElement = Input(parameterFilterElement: Revit.Filter.ParameterFilterElement[]..[])
python_script = Python(IN[0]=parameterFilterElement)  # CPython3
# ---------- python_script.python (69 lines) ----------
import clr
import System
clr.AddReference('RevitAPI')
from Autodesk.Revit.DB import *

clr.AddReference("RevitNodes")
import Revit
clr.ImportExtensions(Revit.Elements)


def GetFilterRuleString(efilter, doc):
	rulestrings = []
	# Filters without rules will arrive as nulls:
	if not efilter: return '<<<No rules defined>>>'
	efilterstr = efilter.ToString()		
	if "And" in efilterstr: sep = " AND "
	elif "Or" in efilterstr: sep = " OR "
	else: sep = ""
	filters = efilter.GetFilters()
	for filter in filters:
		if hasattr(filter, "GetRules"):
			for rule in filter.GetRules():
				useRule = True
				# inverted rules
				ruleInverted = ""
				if hasattr(rule, "GetInnerRule"): 
					rule = rule.GetInnerRule()
					ruleInverted = "Not"
				# rule parameters
				paramId = rule.GetRuleParameter()
				thisparam = doc.GetElement(paramId)
				if thisparam: thisparam = thisparam.Name
				elif paramId != ElementId.InvalidElementId: thisparam = LabelUtils.GetLabelFor(int((str(paramId))))
				# discard the rule if the parameter name cannot be resolved
				else: useRule = False
				# rule evaluators
				if hasattr(rule, "GetEvaluator"):
					thiseval = rule.GetEvaluator().ToString().replace("Autodesk.Revit.DB.Filter","")
					thiseval = thiseval.replace("Numeric","")
					thiseval = thiseval.replace("String","")
					thiseval = thiseval + ruleInverted
					if thiseval == "Equals": thiseval = "=="
					elif thiseval == "EqualsNot": thiseval = "!="
					elif thiseval == "Greater": thiseval = ">"
					elif thiseval == "GreaterOrEqual": thiseval = ">="
					elif thiseval == "Less": thiseval = "<"
					elif thiseval == "LessOrEqual": thiseval = "<="
				elif hasattr(rule, "ParameterName"): thiseval = "Exists"
				else: thiseval = ""
				# rule values
				if hasattr(rule, "RuleString"): thisval = rule.RuleString
				elif hasattr(rule, "RuleValue"): thisval = str(rule.RuleValue)
				else: thisval = ""
				if useRule: rulestrings.append((thisparam + " " + thiseval + " " + thisval).strip())
		else: rulestrings.append("(" + GetFilterRuleString(filter, doc)+ ")")
	rulestrings.sort()
	return sep.join(rulestrings)
		
items = UnwrapElement(IN[0])

if not hasattr(items, "__iter__"): items = [items]
output = []
for item in items:
	try:
		rule = GetFilterRuleString(item.GetElementFilter(), item.Document)
		output.append(rule)
	except: output.append(None)

OUT = output
# ----------------------------------------
str = Output(python_script)
