# Dynamo custom node ParameterFilterElement.Parameters.dyf (Dynamo 3.3.0.6316)
# category: Clockwork.Revit.Elements.Query
# Retrieves the names of all parameters used in a given ParameterFilterElement (aka view filters)

parameterFilterElement = Input(parameterFilterElement: Revit.Filter.ParameterFilterElement[]..[])
python_script = Python(IN[0]=parameterFilterElement)  # CPython3
# ---------- python_script.python (32 lines) ----------
import clr
import System
clr.AddReference('RevitAPI')
from Autodesk.Revit.DB import *

clr.AddReference("RevitNodes")
import Revit
clr.ImportExtensions(Revit.Elements)

bips = {}
for bip in [eval("BuiltInParameter."+x) for x in dir(BuiltInParameter) if not any(y.islower() for y in x)]:
	try: bips[ElementId(bip).IntegerValue] = LabelUtils.GetLabelFor(bip)
	except: pass
		
def GetFilterRuleParams(efilter, doc):
	params = []
	if efilter:
		for filter in efilter.GetFilters():
			if hasattr(filter, "GetRules"):
				for rule in filter.GetRules():
					paramId = rule.GetRuleParameter()
					thisparam = doc.GetElement(paramId)
					if thisparam: thisparam = thisparam.Name
					else: thisparam = bips[paramId.IntegerValue]
					params.append(thisparam.strip())
			else: params.append(GetFilterRuleParams(filter, doc))
	return params
		
items = UnwrapElement(IN[0])

if isinstance(IN[0], list): OUT = [GetFilterRuleParams(x.GetElementFilter(), x.Document) for x in items]
else: OUT = GetFilterRuleParams(items.GetElementFilter(), items.Document)
# ----------------------------------------
str = Output(python_script)
