# Dynamo custom node RevitLinkType.PathType.dyf (Dynamo 2.0.3.8810)
# category: Clockwork.Revit.Elements.Query
# Returns the path type of a RevitLInkType

revitLinkType = Input(revitLinkType: var[]..[])
python_script = Python(IN[0]=revitLinkType)
# ---------- python_script.python (12 lines) ----------
import clr
clr.AddReference('RevitAPI')
from Autodesk.Revit.DB import *

links = UnwrapElement(IN[0])

def GetPathType(link):
	if hasattr(link, "PathType"): return link.PathType.ToString()
	else: return None

if isinstance(IN[0], list): OUT = [GetPathType(x) for x in links]
else: OUT = GetPathType(links)
# ----------------------------------------
str = Output(python_script)
