# Dynamo custom node RevitLinkType.Unload.dyf (Dynamo 2.0.1.5055)
# category: Clockwork.Revit.Elements.Actions
# Unloads a Revit or IFC link

revitLinkType = Input(revitLinkType: var[]..[])
turnIntoList = Custom[TurnIntoList](unknownItem=revitLinkType)  # Turns an element (or a nested list) into a flat list
forCurrentUserOnly = Input(forCurrentUserOnly: bool = false)  # Only works on workshared models
python_script = Python(IN[0]=turnIntoList, IN[1]=forCurrentUserOnly)
# ---------- python_script.python (29 lines) ----------
import clr
clr.AddReference('RevitAPI')
from Autodesk.Revit.DB import *

clr.AddReference("RevitNodes")
import Revit
clr.ImportExtensions(Revit.Elements)

clr.AddReference("RevitServices")
import RevitServices
from RevitServices.Persistence import DocumentManager
from RevitServices.Transactions import TransactionManager

doc = DocumentManager.Instance.CurrentDBDocument
linktypes = UnwrapElement(IN[0])
unload_locally = IN[1]
booleans = list()

TransactionManager.Instance.ForceCloseTransaction()
for link in linktypes:
	try:
		if unload_locally and doc.IsWorkshared:
			link.UnloadLocally(None)
		else:
			link.Unload(None)
		booleans.append(True)
	except:
		booleans.append(False)
OUT = (linktypes, booleans)
# ----------------------------------------
code_block = CodeBlock(seq=python_script) { seq[0]; seq[1]; }
returnListOrSingleValue = Custom[ReturnListOrSingleValue](unknownItem=revitLinkType, seq=code_block.out0)  # If the unknown item is not a list but rather a single item, only the first item of the list (input "seq") will be returned.
revitLinkType_2 = Output(returnListOrSingleValue)  # "revitLinkType"
returnListOrSingleValue_2 = Custom[ReturnListOrSingleValue](unknownItem=revitLinkType, seq=code_block.out1)
success = Output(returnListOrSingleValue_2)
