# Dynamo custom node Schedule.KeyScheduleParameterName.dyf (Dynamo 2.12.1.8246)
# category: Clockwork.Revit.Views.Query
# If the schedule is a key schedule, the node returns the name of the key schedule parameter.

schedule = Input(schedule: Revit.Elements.Views.ScheduleView[]..[])
python_script = Python(IN[0]=schedule)  # CPython3
# ---------- python_script.python (12 lines) ----------
import clr
clr.AddReference('RevitAPI')
from Autodesk.Revit.DB import *

def GetKeyScheduleParamName(schedule):
	try: return schedule.KeyScheduleParameterName
	except: return None

scheds = UnwrapElement(IN[0])

if isinstance(IN[0], list): OUT = [GetKeyScheduleParamName(x) for x in scheds]
else: OUT = GetKeyScheduleParamName(scheds)
# ----------------------------------------
parameterName = Output(python_script)
