# Dynamo custom node ScheduleField.Parameter.dyf (Dynamo 2.12.1.8246)
# category: Clockwork.Revit.Views.Query
# Retrieves the parameter associated with a given schedule field

scheduleField = Input(scheduleField: var[]..[])
python_script = Python(IN[0]=scheduleField)  # CPython3
# ---------- python_script.python (22 lines) ----------
import clr
import System
clr.AddReference('RevitAPI')
from Autodesk.Revit.DB import *

def GetScheduleFieldParam(schedulefield):
	if hasattr(schedulefield, "ParameterId"): 
		pId = schedulefield.ParameterId
		if pId != ElementId.InvalidElementId: 
			# BuiltInParameters
			if pId.IntegerValue < 0: 
				try: return System.Enum.GetName(BuiltInParameter, pId.IntegerValue)
				except: return None
			# Project/Family/Shared Parameters
			else: return schedulefield.Schedule.Document.GetElement(schedulefield.ParameterId)
		else: return None
	else: return None

schedulefields = UnwrapElement(IN[0])

if isinstance(IN[0], list): OUT = [GetScheduleFieldParam(x) for x in schedulefields]
else: OUT = GetScheduleFieldParam(schedulefields)
# ----------------------------------------
param = Output(python_script)
