# Dynamo custom node View.PermanentlyIsolateCategory.dyf (Dynamo 2.12.1.8246)
# category: Clockwork.Revit.Views.Actions
# Permanently isolates categories in the given view
# packages: Clockwork for Dynamo 2.x 2.12.1

view = Input(view: var[]..[])
view_2 = Output(view)  # "view"
category = Input(category: var[]..[])  # Works with categories, BuiltInCategories and BuiltInCategories as strings
category_2 = Output(category)  # "category"
isolateCategoriesTemporary = View.IsolateCategoriesTemporary(view=view, categories=category)
convertTemporaryHideIsolateToPermanent = Custom[View.ConvertTemporaryHideIsolateToPermanent](view=isolateCategoriesTemporary)  # package Clockwork for Dynamo 2.x; Convert all temporary hidden elements or categories to permanently hidden in the given view.
success = Output(convertTemporaryHideIsolateToPermanent.success)
