# Dynamo custom node View.Type.dyf (Dynamo 2.0.3.8810)
# category: Clockwork.Revit.Views.Query
# Returns the type of a given view

view = Input(view: var[]..[])
python_script = Python(IN[0]=view)
# ---------- python_script.python (12 lines) ----------
import clr
clr.AddReference('RevitAPI')
from Autodesk.Revit.DB import *

def GetViewType(view):
	if hasattr(view, "ViewType"): return str(view.ViewType)
	else: return None

views = UnwrapElement(IN[0])

if isinstance(IN[0],list): OUT = [GetViewType(x) for x in views]
else: OUT = GetViewType(views)
# ----------------------------------------
type = Output(python_script)
