# Dynamo custom node All Elements of Family Type+.dyf (Dynamo 3.6.1.9895)
# category: Clockwork.Revit.Selection.Collectors.Query
# Retrieves all placed instances of a given family type. Unlike the OOTB node, this node also supports family types of system families, group types, assembly types and collecting from linked models.
# packages: PythonNet3 Engine 1.1.1

familyType = Input(familyType: var[]..[])
toggle = Input(toggle: bool = true)
docOrRevitLinkInstance = Input(docOrRevitLinkInstance: var = null)  # Use only if you want to query a linked model
python_script = Python(IN[0]=familyType, IN[1]=toggle, IN[2]=docOrRevitLinkInstance)  # PythonNet3
# ---------- python_script.python (27 lines) ----------
import System
import clr
clr.AddReference('RevitAPI')
from Autodesk.Revit.DB import *

clr.AddReference("RevitServices")
import RevitServices
from RevitServices.Persistence import DocumentManager

def InstancesOfFamilyType(ft, doc):
    collector = FilteredElementCollector(doc)
    try:
        ftCat = ft.Category.Id.Value
        bic = System.Enum.ToObject(BuiltInCategory, ftCat)
        collector.OfCategory(bic)
        return [x for x in collector.ToElements() if x.GetTypeId().Value == ft.Id.Value]
    except: return []

famtypes = UnwrapElement(IN[0])
inputdoc = UnwrapElement(IN[2])
if not inputdoc: doc = DocumentManager.Instance.CurrentDBDocument
elif inputdoc.GetType().ToString() == "Autodesk.Revit.DB.RevitLinkInstance": doc = inputdoc.GetLinkDocument()
elif inputdoc.GetType().ToString() == "Autodesk.Revit.DB.Document": doc = inputdoc
else: doc = DocumentManager.Instance.CurrentDBDocument

if isinstance(IN[0], list): OUT = [InstancesOfFamilyType(x, doc) for x in famtypes]
else: OUT = InstancesOfFamilyType(famtypes, doc)
# ----------------------------------------
elements = Output(python_script)
