# Dynamo custom node Array.GroupType.dyf (Dynamo 2.12.1.8246)
# category: Clockwork.Revit.Elements.Query
# Returns the group type of a given array

array = Input(array: var[]..[])
python_script = Python(IN[0]=array)  # CPython3
# ---------- python_script.python (19 lines) ----------
import clr
clr.AddReference('RevitAPI')
from Autodesk.Revit.DB import *

clr.AddReference("RevitNodes")
import Revit
clr.ImportExtensions(Revit.Elements)

arrays = UnwrapElement(IN[0])

def GetArrayMembers(array):
	if hasattr(array, "GetOriginalMemberIds"):
		returnvals = []
		for id in array.GetOriginalMemberIds():
			return array.Document.GetElement(id)
	else: return None

if isinstance(IN[0], list): OUT = [GetArrayMembers(x) for x in arrays]
else: OUT = GetArrayMembers(arrays)
# ----------------------------------------
elementType = Custom[Element.ElementType+](element=python_script)  # Gets the family type of a given element (if applicable). Unlike the OOTB node, it also works for elements in linked models.
groupType = Output(elementType)
