# Dynamo custom node DateTime.CalendarWeek.dyf (Dynamo 2.12.1.8246)
# category: Clockwork.Input.Query
# Retrieves the calendar week for the given date

date = Input(date: var[]..[])
components = DateTime.Components(dateTime=date)
python_script = Python(IN[0]=components.year, IN[1]=components.month, IN[2]=components.day)  # CPython3
# ---------- python_script.python (6 lines) ----------
import clr
import datetime
year = IN[0]
month = IN[1]
day = IN[2]
OUT = datetime.date(year, month, day).isocalendar()[1]
# ----------------------------------------
calendarWeek = Output(python_script)
