# Dynamo custom node DateTime.IsLater.dyf (Dynamo 2.12.1.8246)
# category: Clockwork.Input.Actions
# Determines if a given date and time are later than another given date and time.

dateTime1 = Input(dateTime1: System.DateTime)
dateTime2 = Input(dateTime2: System.DateTime)
python_script = Python(IN[0]=dateTime1, IN[1]=dateTime2)  # CPython3
# ---------- python_script.python (13 lines) ----------
import clr

def isLater(date1, date2):
	return date1 > date2

dates1 = IN[0]
dates2 = IN[1]

if not dates1 or not dates2: OUT = None
elif isinstance(dates1, list) and isinstance(dates2, list): OUT = [isLater(x, y) for x,y in zip(dates1, dates2)]
elif isinstance(dates1, list): OUT = [isLater(x, dates2) for x in dates1]
elif isinstance(dates2, list): OUT = [isLater(dates1, x) for x in dates2]
else: OUT = isLater(dates1, dates2)
# ----------------------------------------
bool = Output(python_script)
