# Dynamo custom node DesignOption.DesignOptionSet.dyf (Dynamo 2.12.1.8246)
# category: Clockwork.Revit.Elements.Query
# Returns the design option set of a given design option

designOption = Input(designOption: var[]..[])
python_script = Python(IN[0]=designOption)  # CPython3
# ---------- python_script.python (16 lines) ----------
import clr
clr.AddReference('RevitAPI')
from Autodesk.Revit.DB import *

clr.AddReference("RevitNodes")
import Revit
clr.ImportExtensions(Revit.Elements)

def GetDesignOptionSet(item):
	try: return item.Document.GetElement(item.get_Parameter(BuiltInParameter.OPTION_SET_ID).AsElementId()).ToDSType(True)
	except: return None

items = UnwrapElement(IN[0])

if isinstance(IN[0], list): OUT = [GetDesignOptionSet(x) for x in items]
else: OUT = GetDesignOptionSet(items)
# ----------------------------------------
designOptionSet = Output(python_script)
