# Dynamo custom node Element.AllInstances.dyf (Dynamo 3.6.1.9895)
# category: Clockwork.Revit.Elements.Query
# Retrieves all instances of a given element
# packages: PythonNet3 Engine 1.1.1

element = Input(element: var[]..[])
python_script = Python(IN[0]=element)  # PythonNet3
# ---------- python_script.python (16 lines) ----------
import System
import clr
clr.AddReference('RevitAPI')
from Autodesk.Revit.DB import *

def GetAllInstances(item):
    collector = FilteredElementCollector(item.Document)
    catID = item.Category.Id.Value
    bic = System.Enum.ToObject(BuiltInCategory, catID)
    collector.OfCategory(bic)
    return [x for x in collector.ToElements() if x.GetTypeId().Value == item.GetTypeId().Value]

elements = UnwrapElement(IN[0])

if isinstance(IN[0], list): OUT = [GetAllInstances(x) for x in elements]
else: OUT = GetAllInstances(elements)
# ----------------------------------------
elements = Output(python_script)
