# Dynamo custom node Element.AllInstancesAtLevel.dyf (Dynamo 3.6.1.9895)
# category: Clockwork.Revit.Elements.Query
# Retrieves all instances of an element on a given level
# packages: PythonNet3 Engine 1.1.1

element = Input(element: var[]..[])
level = Input(level: Revit.Elements.Level)
python_script = Python(IN[0]=element, IN[1]=level)  # PythonNet3
# ---------- python_script.python (18 lines) ----------
import System
import clr
clr.AddReference('RevitAPI')
from Autodesk.Revit.DB import *

def GetAllInstancesAtLevel(item, lvl):
    collector = FilteredElementCollector(item.Document)
    catID = item.Category.Id.Value
    bic = System.Enum.ToObject(BuiltInCategory, catID)
    lvlfilter = ElementLevelFilter(lvl.Id)
    collector.OfCategory(bic).WherePasses(lvlfilter)
    return [x for x in collector.ToElements() if x.GetTypeId().Value == item.GetTypeId().Value]

elements = UnwrapElement(IN[0])
lvl = UnwrapElement(IN[1])

if isinstance(IN[0], list): OUT = [GetAllInstancesAtLevel(x, lvl) for x in elements]
else: OUT = GetAllInstancesAtLevel(elements, lvl)
# ----------------------------------------
elements = Output(python_script)
