# Dynamo custom node Element.AllViewDependentInstances.dyf (Dynamo 3.6.1.9895)
# category: Clockwork.Revit.Elements.Query
# Retrieves all instances of a view-dependent element in a given view
# packages: PythonNet3 Engine 1.1.1

element = Input(element: var[]..[])
view = Input(view: var)
python_script = Python(IN[0]=element, IN[1]=view)  # PythonNet3
# ---------- python_script.python (18 lines) ----------
import System
import clr
clr.AddReference('RevitAPI')
from Autodesk.Revit.DB import *

def GetAllInstancesInView(item, view):
    collector = FilteredElementCollector(item.Document)
    catID = item.Category.Id.Value
    bic = System.Enum.ToObject(BuiltInCategory, catID)
    viewfilter = ElementOwnerViewFilter(view.Id)
    collector.WherePasses(viewfilter).OfCategory(bic)
    return [x for x in collector.ToElements() if x.GetTypeId().Value == item.GetTypeId().Value]

elements = UnwrapElement(IN[0])
view = UnwrapElement(IN[1])

if isinstance(IN[0], list): OUT = [GetAllInstancesInView(x, view) for x in elements]
else: OUT = GetAllInstancesInView(elements, view)
# ----------------------------------------
elements = Output(python_script)
