# Dynamo custom node Element.DesignOption.dyf (Dynamo 2.12.1.8246)
# category: Clockwork.Revit.Elements.Query
# Returns the design option to which the element belongs (if any).

element = Input(element: var[]..[])
python_script = Python(IN[0]=element)  # CPython3
# ---------- python_script.python (19 lines) ----------
import clr
clr.AddReference('RevitAPI')
from Autodesk.Revit.DB import *

clr.AddReference("RevitNodes")
import Revit
clr.ImportExtensions(Revit.Elements)

def GetDesignOption(item):
	if item:
		if hasattr(item, "DesignOption"): 
			return item.DesignOption
		else: return None
	else: return None

items = UnwrapElement(IN[0])

if isinstance(IN[0], list): OUT = [GetDesignOption(x) for x in items]
else: OUT = GetDesignOption(items)
# ----------------------------------------
designOption = Output(python_script)
