# Dynamo custom node Element.ID+.dyf (Dynamo 3.6.1.9895)
# category: Clockwork.Revit.Elements.Query
# Gets the ID of a given Revit elements. Unlike the OOTB Element.Id node, this node also works on mixed lists of Revit elements and categories.
# packages: PythonNet3 Engine 1.1.1

element = Input(element: var[]..[])
python_script = Python(IN[0]=element)  # PythonNet3
# ---------- python_script.python (16 lines) ----------
import clr
clr.AddReference('RevitAPI')
from Autodesk.Revit.DB import *

clr.AddReference("RevitNodes")
import Revit
clr.ImportExtensions(Revit.Elements)

def GetId(item):
    if hasattr(item, "Id"): return item.Id.Value
    else: return None

items = UnwrapElement(IN[0])

if isinstance(IN[0], list): OUT = [GetId(x) for x in items]
else: OUT = GetId(items)
# ----------------------------------------
int = Output(python_script)
