# Dynamo custom node Family.IsInPlace.dyf (Dynamo 2.12.1.8246)
# category: Clockwork.Revit.Elements.Query
# Determines if a family is an in-place family

family = Input(family: Revit.Elements.Family)
python_script = Python(IN[0]=family)  # CPython3
# ---------- python_script.python (13 lines) ----------
import clr
import System
clr.AddReference('RevitAPI')
from Autodesk.Revit.DB import *

def IsInPlace(item):
	if hasattr(item, "IsInPlace"): return item.IsInPlace
	else: return None

items = UnwrapElement(IN[0])

if isinstance(IN[0], list): OUT = [IsInPlace(x) for x in items]
else: OUT = IsInPlace(items)
# ----------------------------------------
bool = Output(python_script)
