# Dynamo custom node Family.PlacementType.dyf (Dynamo 2.12.1.8246)
# category: Clockwork.Revit.Elements.Query
# Returns the expected host class of a family (if any)

family = Input(family: Revit.Elements.Family)
python_script = Python(IN[0]=family)  # CPython3
# ---------- python_script.python (13 lines) ----------
import clr
clr.AddReference('RevitAPI')
from Autodesk.Revit.DB import *
import System

def GetPlacementType(item):
	if hasattr(item, "FamilyPlacementType"): return System.Enum.GetName(FamilyPlacementType, item.FamilyPlacementType)
	else: return None

items = UnwrapElement(IN[0])

if isinstance(IN[0], list): OUT = [GetPlacementType(x) for x in items]
else: OUT = GetPlacementType(items)
# ----------------------------------------
placementType = Output(python_script)
