# Dynamo custom node FamilyInstance.IsMirrored.dyf (Dynamo 2.12.1.8246)
# category: Clockwork.Revit.Elements.Query
# Checks if a family instance is mirrored

familyInstance = Input(familyInstance: var[]..[])
python_script = Python(IN[0]=familyInstance)  # CPython3
# ---------- python_script.python (19 lines) ----------
import clr
clr.AddReference('RevitAPI')
from Autodesk.Revit.DB import *

clr.AddReference("RevitNodes")
import Revit
clr.ImportExtensions(Revit.Elements)
clr.ImportExtensions(Revit.GeometryConversion)

items = UnwrapElement(IN[0])

def IsMirrored(item):
	if hasattr(item, "Mirrored"):
		return item.Mirrored
	else: return False


if isinstance(IN[0], list): OUT = [IsMirrored(x) for x in items]
else: OUT = IsMirrored(items)
# ----------------------------------------
bool = Output(python_script)
