# Dynamo custom node FamilyType.Function.dyf (Dynamo 2.12.1.8246)
# category: Clockwork.Revit.Elements.Query
# Retrieves the Function property of a given family type (if it has that property)

familyType = Input(familyType: var[]..[])
python_script = Python(IN[0]=familyType)  # CPython3
# ---------- python_script.python (12 lines) ----------
import clr
clr.AddReference('RevitAPI')
from Autodesk.Revit.DB import *

def GetFunction(item):
	try: return item.get_Parameter(BuiltInParameter.FUNCTION_PARAM).AsValueString()
	except: return None

items = UnwrapElement(IN[0])

if isinstance(IN[0], list): OUT = [GetFunction(x) for x in items]
else: OUT = GetFunction(items)
# ----------------------------------------
function = Output(python_script)
