# Dynamo custom node FibonacciSequence.FromList.dyf (Dynamo 2.12.1.8246)
# category: Clockwork.List.Generate.Create
# Creates a Fibonacci row from a starting list (last two values) of a given length (starting values do *not* count toward length).

initialList = Input(initialList: int[])
length = Input(length: int)
python_script = Python(IN[0]=initialList, IN[1]=length)  # CPython3
# ---------- python_script.python (10 lines) ----------
fibseq = IN[0]
iterations = IN[1]
counter = 0
if len(fibseq) < 2:
	OUT = "Initial sequence needs to contain at least two values..."
else:
	while counter < iterations:
		fibseq.append(fibseq[len(fibseq)-2] + fibseq[len(fibseq)-1])
		counter += 1
	OUT = fibseq
# ----------------------------------------
seq = Output(python_script)
