# Dynamo custom node FileSystem.FileLastModified.dyf (Dynamo 2.12.1.8246)
# category: Clockwork.ImportExport.Query
# Returns the date and time a given file was last modified

file = Input(file: System.IO.FileInfo[]..[])
python_script = Python(IN[0]=file)  # CPython3
# ---------- python_script.python (8 lines) ----------
import clr

def FileLastModified(file):
	if hasattr(file,"LastWriteTime"): return file.LastWriteTime
	else: return None

if isinstance(IN[0], list): OUT = [FileLastModified(x) for x in IN[0]]
else: OUT = FileLastModified(IN[0])
# ----------------------------------------
dateTime = Output(python_script)
