# Dynamo custom node FileSystem.FileSize.dyf (Dynamo 2.12.1.8246)
# category: Clockwork.ImportExport.Query
# Returns the file size of a given file.

file = Input(file: var[]..[])
python_script = Python(IN[0]=file)  # CPython3
# ---------- python_script.python (13 lines) ----------
import clr
import System.IO

def GetFileSize(file):
	if str(file.GetType()) == "System.IO.FileInfo":
		size = file.Length
		return size, float(size)/1024, float(size)/1048576
	else: return None, None, None

files = IN[0]

if isinstance(IN[0], list): OUT = map(list, zip(*[GetFileSize(x) for x in files]))
else: OUT = GetFileSize(files)
# ----------------------------------------
code_block = CodeBlock(seq=python_script) { seq[0]; seq[1]; seq[2]; }
bytes = Output(code_block.out0)
kilobytes = Output(code_block.out1)
megabytes = Output(code_block.out2)
