# Dynamo custom node GlobalParameter.Formula.dyf (Dynamo 2.12.1.8246)
# category: Clockwork.Revit.Elements.Query
# Returns the formula of a global parameter (if any)

globalParam = Input(globalParam: Revit.Elements.GlobalParameter[]..[])
python_script = Python(IN[0]=globalParam)  # CPython3
# ---------- python_script.python (17 lines) ----------
import clr
import System
clr.AddReference('RevitAPI')
from Autodesk.Revit.DB import *

clr.AddReference("RevitNodes")
import Revit
clr.ImportExtensions(Revit.Elements)

def GetGPFormula(gp):
	if hasattr(gp, "GetFormula"): return gp.GetFormula()
	else: return None

items = UnwrapElement(IN[0])

if isinstance(IN[0], list): OUT = [GetGPFormula(x) for x in items]
else: OUT = GetGPFormula(items)
# ----------------------------------------
str = Output(python_script)
