# Dynamo custom node Hex.FromDecimal.dyf (Dynamo 2.12.1.8246)
# category: Clockwork.String.Generate.Create
# Converts a number to a string of its hexadecimal value

decimal = Input(decimal: int)
python_script = Python(IN[0]=decimal)  # CPython3
# ---------- python_script.python (2 lines) ----------
if isinstance(IN[0], list): OUT = [hex(x) for x in IN[0]]
else: OUT = hex(IN[0])
# ----------------------------------------
hex = Output(python_script)
