# Dynamo custom node MassFloor.Mass.dyf (Dynamo 2.12.1.8246)
# category: Clockwork.Revit.Elements.Query
# Gets the mass a given mass floor belongs to

massFloor = Input(massFloor: var[]..[])
python_script = Python(IN[0]=massFloor)  # CPython3
# ---------- python_script.python (16 lines) ----------
import clr
clr.AddReference('RevitAPI')
from Autodesk.Revit.DB import *

clr.AddReference("RevitNodes")
import Revit
clr.ImportExtensions(Revit.Elements)

def GetMass(item):
	if hasattr(item, "OwningMassId"): return item.Document.GetElement(item.OwningMassId).ToDSType(True)
	else: return None

items = UnwrapElement(IN[0])

if isinstance(IN[0], list): OUT = [GetMass(x) for x in items]
else: OUT = GetMass(items)
# ----------------------------------------
mass = Output(python_script)
