# Dynamo custom node Material.Assets.dyf (Dynamo 2.12.1.8246)
# category: Clockwork.Revit.Elements.Query
# Retreives all assets from a given material

material = Input(material: var[]..[])
python_script = Python(IN[0]=material)  # CPython3
# ---------- python_script.python (12 lines) ----------
import clr
clr.AddReference('RevitAPI')
from Autodesk.Revit.DB import *

mats = UnwrapElement(IN[0])

def GetMaterialAssets(material):
	if hasattr(material, "AppearanceAssetId"): return (material.Document.GetElement(material.AppearanceAssetId), material.Document.GetElement(material.ThermalAssetId), material.Document.GetElement(material.StructuralAssetId))
	else: return (None, None, None)

if isinstance(IN[0], list): OUT = map(list, zip(*[GetMaterialAssets(x) for x in mats]))
else: OUT = GetMaterialAssets(mats)
# ----------------------------------------
code_block = CodeBlock(seq=python_script) { seq[0]; seq[1]; seq[2]; }
AppearanceAsset = Output(code_block.out0)
ThermalAsset = Output(code_block.out1)
StructuralAsset = Output(code_block.out2)
