# Dynamo custom node Object.Members.dyf (Dynamo 2.12.1.8246)
# category: Clockwork.Input.Query
# Gets a list of all members (properties and methods) of a selected element

element = Input(element: var[]..[])
python_script = Python(IN[0]=element)  # CPython3
# ---------- python_script.python (8 lines) ----------
import clr
clr.AddReference('RevitAPI')
from Autodesk.Revit.DB import *

items = UnwrapElement(IN[0])

if isinstance(IN[0], list): OUT = [dir(x) for x in items]
else: OUT = dir(items)
# ----------------------------------------
members = Output(python_script)
