# Dynamo custom node SelectionSet.Elements.dyf (Dynamo 2.12.1.8246)
# category: Clockwork.Revit.Selection.Query
# Retrieves all elements stored in a selection set

selectionSet = Input(selectionSet: var[]..[])
python_script = Python(IN[0]=selectionSet)  # CPython3
# ---------- python_script.python (12 lines) ----------
import clr
clr.AddReference('RevitAPI')
from Autodesk.Revit.DB import *

def GetSelSetMembers(selset):
	if hasattr(selset, "GetElementIds"): return [selset.Document.GetElement(x) for x in selset.GetElementIds()]
	else: return list()

selsets = UnwrapElement(IN[0])

if isinstance(IN[0], list): OUT = [GetSelSetMembers(x) for x in selsets]
else: OUT = GetSelSetMembers(selsets)
# ----------------------------------------
elements = Output(python_script)
