# Dynamo custom node SharedParameterElement.GUID.dyf (Dynamo 2.12.1.8246)
# category: Clockwork.Revit.Elements.Query
# Returns the GUID of a shared parameter

sharedParameterElement = Input(sharedParameterElement: var[]..[])
python_script = Python(IN[0]=sharedParameterElement)  # CPython3
# ---------- python_script.python (12 lines) ----------
import clr
clr.AddReference('RevitAPI')
from Autodesk.Revit.DB import *

def GetParamGUID(param):
	if hasattr(param, "GuidValue"): return param.GuidValue.ToString()
	else: return None
	
params = UnwrapElement(IN[0])

if isinstance(IN[0], list): OUT = [GetParamGUID(x) for x in params]
else: OUT = GetParamGUID(params)
# ----------------------------------------
guid = Output(python_script)
