# Dynamo custom node StructuralFoundation.Kind.dyf (Dynamo 2.12.1.8246)
# category: Clockwork.Revit.Elements.Query
# Retrieves the kind of a given structural foundation (isolated, wall, slab).

structuralFoundation = Input(structuralFoundation: var[]..[])
python_script = Python(IN[0]=structuralFoundation)  # CPython3
# ---------- python_script.python (15 lines) ----------
import clr
clr.AddReference('RevitAPI')
from Autodesk.Revit.DB import *

def GetFoundationKind(item):
	if not item: return None
	elif item.GetType().Name == 'FamilyInstance': return 'Isolated'
	elif item.GetType().Name == 'WallFoundation': return 'Wall Footing'
	elif item.GetType().Name == 'Floor': return 'Slab'
	else: return None

items = UnwrapElement(IN[0])

if isinstance(IN[0], list): OUT = [GetFoundationKind(x) for x in items]
else: OUT = GetFoundationKind(items)
# ----------------------------------------
kind = Output(python_script)
