# Dynamo custom node TimeSpan.EvaluateLapTimes.dyf (Dynamo 2.12.1.8246)
# category: Clockwork.Input.Query
# Evaluates a list of lap times and returns the overall time

LapTimes = Input(LapTimes: System.DateTime[])
python_script = Python(IN[0]=LapTimes)  # CPython3
# ---------- python_script.python (3 lines) ----------
import clr
from System import DateTime
OUT = [x.Subtract(y) for x, y in zip(IN[0][1:], IN[0][:-1])], IN[0][-1].Subtract(IN[0][0])
# ----------------------------------------
code_block = CodeBlock(seq=python_script) { seq[0]; seq[1]; }
NetLapTimes = Output(code_block.out0)
OverallTime = Output(code_block.out1)
