# Dynamo custom node View.CategoryIsVisible.dyf (Dynamo 2.12.1.8246)
# category: Clockwork.Revit.Views.Query
# Checks if a given category is visible in a given view. ATTENTION: This node will be deprecated in 2025. As of Revit 2023, please switch to the OOTB node View.IsCategoryHidden and combine it with the Not node.

category = Input(category: var[]..[])  # Works with categories, BuiltInCategories and BuiltInCategories as strings
fromInput = Custom[Category.FromInput](category=category)  # Returns a category from a category, a Dynamo-wrapped category, a BuiltInCategory or a string representing a BuiltInCategory.
view = Input(view: var[]..[])
python_script = Python(IN[0]=fromInput, IN[1]=view)  # CPython3
# ---------- python_script.python (17 lines) ----------
import clr
clr.AddReference('RevitAPI')
from Autodesk.Revit.DB import *

def IsCategoryVisibleInView(cat, view):
	if view.GetCategoryHidden(cat.Id): return False
	else: return True

cats = IN[0]
views = UnwrapElement(IN[1])

if isinstance(IN[0], list):
	if isinstance(IN[1], list):  OUT = [[IsCategoryVisibleInView(x, y) for x in cats] for y in views]
	else: OUT = [IsCategoryVisibleInView(x, views) for x in cats]
else:
	if isinstance(IN[1], list): OUT = [IsCategoryVisibleInView(cats, x) for x in views]
	else: OUT = IsCategoryVisibleInView(cats, views)
# ----------------------------------------
bool = Output(python_script)
