# Dynamo custom node View.PrimaryView.dyf (Dynamo 2.12.1.8246)
# category: Clockwork.Revit.Views.Query
# Returns the primary view of a given view (i.e. the master view of a dependent view)

view = Input(view: var[]..[])
python_script = Python(IN[0]=view)  # CPython3
# ---------- python_script.python (18 lines) ----------
import clr
clr.AddReference('RevitAPI')
from Autodesk.Revit.DB import *

clr.AddReference("RevitNodes")
import Revit

def GetPrimaryView(view):
	if hasattr(view, "GetPrimaryViewId"):
		return view.Document.GetElement(view.GetPrimaryViewId())
	else: return None

views = UnwrapElement(IN[0])

if isinstance(IN[0], list):
	OUT = [GetPrimaryView(x) for x in views]
else:
	OUT = GetPrimaryView(views)
# ----------------------------------------
view_2 = Output(python_script)  # "view"
