# Dynamo graph Core.List.Create.Strings.dyn (Dynamo 0.7.5.3566)

string = StringInput(",")
string_2 = StringInput(";")
file_path = Filename("C:\Users\adieckmann\Documents\GitHub\ClockworkForDynamo\package_samples\0.7.x\extra\CSV_Sample.csv")
fromPath = FileObject(file_path)  # "File.FromPath"
readText = File.ReadText(fromPath)
boolean = BoolSelector(false)
boolean_2 = BoolSelector(true)
boolean_3 = BoolSelector(false)
fromCSV = Custom[List.FromCSV](delimiter=string_2, CSV_string=readText, ignore_last_column=boolean, ignore_first_row=boolean_2, ignore_last_row=boolean_3)  # Converts the content of a given CSV file to a list
watch = Watch(fromCSV)
integer_slider = IntegerSlider(79, range=0..100)
boolean_4 = BoolSelector(false)
alphabeticalSequence = Custom[List.AlphabeticalSequence](n=integer_slider, uppercase=boolean_4)  # Creates a list of the first N letters of the alphabet (where 1 = A, 2 = B, ... , 27 = AA, 28 = AB etc.).
watch_2 = Watch(alphabeticalSequence)
number = DoubleInput(1)
number_2 = DoubleInput(18)
number_3 = DoubleInput(start..end, number, number_2, lacing=Longest)
number_4 = DoubleInput(3)
withLeadingZeroes = Custom[List.WithLeadingZeroes](seq=number_3, n=number_4)  # Adds leading zeros to a sequence of numbers
watch_3 = Watch(withLeadingZeroes)
