# Dynamo graph Core.List.Create.dyn (Dynamo 0.7.5.3566)

string = StringInput("""Apples
Pears
Oranges
Peaches
Bananas
Strawberries
Pineapples
Mangos""")
string_2 = StringInput("\n")
split = String.Split(string, string_2)
code_block = CodeBlock { 16; }
randomElements = Custom[List.RandomElements](Base_elements=split, Amount=code_block)  # Creates a list of random elements based on a given list of elements
watch = Watch(randomElements)
code_block_2 = CodeBlock { 1..4; }
watch_2 = Watch(code_block_2)
reverse = List.Reverse(watch_2)
repeatItemsByLengths = Custom[List.RepeatItemsByLengths](list=watch_2, lengths=reverse)  # Repeats a list of items into sublists of given lengths
watch_3 = Watch(repeatItemsByLengths)
code_block_3 = CodeBlock { 1; }
watch_4 = Watch(code_block_3)
turn_into_list = Custom[Turn Into List](item=watch_4)  # Turns an element (or a nested list) into a flat list
watch_5 = Watch(turn_into_list)
create = List.Create(code_block_3)
create_2 = List.Create(create)
watch_6 = Watch(create_2)
turn_into_list_2 = Custom[Turn Into List](item=watch_6)
watch_7 = Watch(turn_into_list_2)
