# Dynamo graph Core.List.Query.dyn (Dynamo 0.7.5.3566)

code_block = CodeBlock { 1..3; 4..8; }
create = List.Create(code_block.out0, code_block.out1, code_block.out0)
watch = Watch(create)
isNotEmpty = Custom[List.IsNotEmpty](list=watch)  # Just the inversion of the built-in Is Empty List node.
watch_2 = Watch(isNotEmpty)
sublistLengths = Custom[List.SublistLengths](list=watch)  # Gets the lengths of all sublists in a given list of lists.
watch_3 = Watch(sublistLengths)
code_block_2 = CodeBlock { 3; }
sublistsContain = Custom[List.SublistsContain](list=watch, item=code_block_2)  # Looks for an item in each sublist of a given list and returns true/false for each sublist.
watch_4 = Watch(sublistsContain)
countOccurences = Custom[List.CountOccurences](list=watch)  # Counts the number of occurences of each unique element in a given list
watch_5 = Watch(countOccurences.Unique_elements)
watch_6 = Watch(countOccurences.Count)
