# Dynamo graph Core.Math.Actions.dyn (Dynamo 0.7.5.3566)

double_slider = DoubleSlider(50, range=0..100)
double_slider_2 = DoubleSlider(46, range=0..100)
double_slider_3 = DoubleSlider(0.1, range=0..1)
similar = Custom[Similar](A=double_slider, B=double_slider_2, Tolerance=double_slider_3)  # Computes the difference between two values and whether that difference is within a given tolerance factor
watch = Watch(similar.IsSimilar)
watch_2 = Watch(similar.Difference)
code_block = CodeBlock { 1; }
n1 = Custom[-1](code_block)  # Decrements a value by 1
watch_3 = Watch(n1)
n1_2 = Custom[+1](code_block)  # Increments a value by 1
watch_4 = Watch(n1_2)
