# Dynamo graph Core.String.Actions.dyn (Dynamo 0.7.5.3566)

string = StringInput("[a-zA-Z]*berry")
string_2 = StringInput("Strawberry123")
string_3 = StringInput("Raspberry456")
string_4 = StringInput("Banana789")
create = List.Create(string_2, string_3, string_4)
findRegularExpression = Custom[String.FindRegularExpression](regex=string, string_s=create)  # Returns all occurences of a regular expression within a string (or list of strings). The syntax for regular expressions is explained at http://ironpython-test.readthedocs.org/en/latest/howto/regex.html
watch = Watch(findRegularExpression)
string_5 = StringInput("DYNAMO")
replaceRegularExpression = Custom[String.ReplaceRegularExpression](regex=string, string_s=create, replacement=string_5)  # Replaces all occurences of a regular expression within a given string (or list of strings) with another string. The syntax for regular expressions is explained at http://ironpython-test.readthedocs.org/en/latest/howto/regex.html
watch_2 = Watch(replaceRegularExpression)
matchRegularExpression = Custom[String.MatchRegularExpression](regex=string, string_s=create)  # Determines if a regular expression matches a string (or a list of strings) and returns a boolean value (or a list, depending on the input). The syntax for regular expressions is explained at http://ironpython-test.readthedocs.org/en/latest/howto/regex.html
watch_3 = Watch(matchRegularExpression)
code_block = CodeBlock { 5; }
boolean = BoolSelector(true)
fromNumber = Custom[Character.FromNumber](n=code_block, upper=boolean)  # Converts a number into a character (where 1 = A, 2 = B, ... , 27 = AA, 28 = AB etc.).
watch_4 = Watch(fromNumber)
splitByRegularExpression = Custom[String.SplitByRegularExpression](regex=string, string_s=create)  # Splits a given string by a regular expression. The syntax for regular expressions is explained at http://ironpython-test.readthedocs.org/en/latest/howto/regex.html
watch_5 = Watch(splitByRegularExpression)
