# Dynamo graph Core.Time.dyn (Dynamo 0.7.5.3566)

empty = List.Empty()
code_block = CodeBlock { 1..10; }
lapTime = Custom[Time.LapTime](Lap_times=empty, Passthrough=code_block)  # Records a timestamp and adds it to a given list of lap times. Also passes through an arbitrary variable for integration into a graph.
code_block_2 = CodeBlock { 2; }
permutations = List.Permutations(lapTime.Passthrough, code_block_2)
lapTime_2 = Custom[Time.LapTime](Lap_times=lapTime.Lap_times, Passthrough=permutations)
string_from_object = FromObject(lapTime_2.Passthrough)
lapTime_3 = Custom[Time.LapTime](Lap_times=lapTime_2.Lap_times, Passthrough=string_from_object)
evaluateLapTimes = Custom[Time.EvaluateLapTimes](Lap_times=lapTime_3.Lap_times)  # Evaluates a list of lap times and returns the overall time
watch = Watch(evaluateLapTimes.Net_lap_times)
watch_2 = Watch(evaluateLapTimes.Overall_time)
