# Dynamo graph Geometry.Surface.dyn (Dynamo 0.7.5.3566)

origin = Point.Origin()
code_block = CodeBlock { 2; }
byCoordinates = Point.ByCoordinates(code_block)
double_slider = DoubleSlider(0, range=0..2)
byCoordinates_2 = Point.ByCoordinates(code_block, code_block, double_slider)
byCoordinates_3 = Point.ByCoordinates(arg1=code_block)
create = List.Create(origin, byCoordinates, byCoordinates_2, byCoordinates_3)
byPerimeterPoints = Surface.ByPerimeterPoints(create)
isPlanar = Custom[Surface.IsPlanar](Surface=byPerimeterPoints)  # Checks whether a face is planar
watch = Watch(isPlanar)
vertices = Custom[Surface.Vertices](Surface_s=byPerimeterPoints)  # Returns all vertices of a given surface
watch_2 = Watch(vertices)
watch_3d = Watch3D(byPerimeterPoints)
