# Dynamo graph Geometry.UV.Query.dyn (Dynamo 0.7.5.3566)

double_slider = DoubleSlider(1, range=-5..5)
byCoordinates = UV.ByCoordinates(double_slider, double_slider)
watch = Watch(byCoordinates)
code_block = CodeBlock { -2; 2; }
byCoordinates_2 = UV.ByCoordinates(code_block.out0, code_block.out1)
byCoordinates_3 = UV.ByCoordinates(code_block.out0, code_block.out0)
byCoordinates_4 = UV.ByCoordinates(code_block.out1, code_block.out0)
byCoordinates_5 = UV.ByCoordinates(code_block.out1, code_block.out1)
create = List.Create(byCoordinates_2, byCoordinates_3, byCoordinates_4, byCoordinates_5)
watch_2 = Watch(create)
isInsidePolygon = Custom[UV.IsInsidePolygon](Point_UV_s=watch, Polygon_UVs=watch_2)  # Determines if a point is inside the space enclosed by a polygon
watch_3 = Watch(isInsidePolygon)
average = Custom[UV.Average](UVs=watch_2)  # Determines the average of a list of UVs
watch_4 = Watch(average)
