# Dynamo graph Revit.Document.Query.dyn (Dynamo 0.7.5.3566)

categories = Categories("Walls")
containsElementsOfCategory = Custom[Document.ContainsElementsOfCategory](Categories=categories)  # Checks if family instances of specified categories are present in the model.
watch = Watch(containsElementsOfCategory.any)
watch_2 = Watch(containsElementsOfCategory.all)
watch_3 = Watch(containsElementsOfCategory.per_category)
watch_4 = Watch(containsElementsOfCategory.instances)
# note: You can use the Sample Architecture Project (Basic) that ships with Revit to run this graph.
activeViewFromCurrentDocument = Custom[Document.ActiveViewFromCurrentDocument]()  # Gets the active view of the current document
watch_5 = Watch(activeViewFromCurrentDocument)
dimensionTypes = Custom[Document.DimensionTypes]()  # Retrieves all dimension types from the document
watch_6 = Watch(dimensionTypes)
isWorkshared = Custom[Document.IsWorkshared]()  # Returns true if the current project is workshared
watch_7 = Watch(isWorkshared)
linksAndImports = Custom[Document.LinksAndImports]()  # Gets all linked and imported files in the document
watch_8 = Watch(linksAndImports.links)
watch_9 = Watch(linksAndImports.imports)
listBuiltInCategories = Custom[Document.ListBuiltInCategories]()  # List all the available BuiltInCategories
watch_10 = Watch(listBuiltInCategories)
listBuiltInParameters = Custom[Document.ListBuiltInParameters]()  # List all the available BuiltInParameters
watch_11 = Watch(listBuiltInParameters)
string = StringInput("Wall")
listBuiltInParametersByName = Custom[Document.ListBuiltInParametersByName](search_term=string)  # Looks up all the built-in parameters based on a given name (or part of a name) of the parameters. Search is case-insensitive.
watch_12 = Watch(listBuiltInParametersByName)
path = Custom[Document.Path]()  # Gets the path and directory of the current Revit document
watch_13 = Watch(path.path)
phases = Custom[Document.Phases]()  # Lists all phases in the active document
watch_14 = Watch(phases)
watch_15 = Watch(path.directory)
listBuiltInCategoriesByName = Custom[Document.ListBuiltInCategoriesByName](search_term=string)  # Looks up all the built-in categories based on a given name (or part of a name) of the category. Search is case-insensitive.
watch_16 = Watch(listBuiltInCategoriesByName)
projectInfo = Custom[Document.ProjectInfo]()  # Gets the project information.
watch_17 = Watch(projectInfo.Author)
watch_18 = Watch(projectInfo.Number)
watch_19 = Watch(projectInfo.Name)
watch_20 = Watch(projectInfo.Address)
watch_21 = Watch(projectInfo.OrganizationDescription)
watch_22 = Watch(projectInfo.BuildingName)
watch_23 = Watch(projectInfo.IssueDate)
watch_24 = Watch(projectInfo.ClientName)
watch_25 = Watch(projectInfo.Status)
watch_26 = Watch(projectInfo.OrganizationName)
projectPosition = Custom[Document.ProjectPosition]()  # Gets the project's position data relative to XYZ.Zero.
watch_27 = Watch(projectPosition.Angle)
watch_28 = Watch(projectPosition.Elevation)
watch_29 = Watch(projectPosition.EastWest)
watch_30 = Watch(projectPosition.NorthSouth)
watch_31 = Watch(projectPosition.Latitude)
watch_32 = Watch(projectPosition.Longitude)
