# Dynamo graph Revit.Elements.DividedSurface.Actions.dyn (Dynamo 0.7.5.3566)

select_face = DSFaceSelection()
firstItem = List.FirstItem(select_face)
integer_slider = IntegerSlider(6, range=0..20)
byFaceAndUVDivisions = DividedSurface.ByFaceAndUVDivisions(firstItem, integer_slider, integer_slider)
# note: Run this graph on the DividedSurface_Sample model in the extra folder.
boolean = BoolSelector(false)
evaluateGridNodes = Custom[DividedSurface.EvaluateGridNodes](DivSurf=byFaceAndUVDivisions, Include_overhanging_nodes=boolean)  # Returns UV and XYZ coordinates as well as surface normals for all grid nodes of a given divided surface. Also returns the underlying face.
watch = Watch(evaluateGridNodes.UVs)
watch_2 = Watch(evaluateGridNodes.XYZs)
watch_3 = Watch(evaluateGridNodes.Normals)
watch_4 = Watch(evaluateGridNodes.Face)
