# Dynamo graph Revit.Elements.FootingType.dyn (Dynamo 0.7.5.3566)

# note: You can use the Sample Architecture Project (Basic) that ships with Revit to run this graph.
categories = Categories("StructuralFoundation")
all_elements_of_category = ElementsOfCategory(categories)
watch = Watch(all_elements_of_category)
breaksAtInserts = Custom[FootingType.BreaksAtInserts](Footing_Type_s=watch)  # Determines whether a list of wall footing types break at inserts in their attached walls
watch_2 = Watch(breaksAtInserts)
