# Dynamo graph Revit.Elements.ModelCurve.dyn (Dynamo 0.7.5.3566)

code_block = CodeBlock { {0,2,2,0}; {0,0,2,2}; }
byCoordinates = Point.ByCoordinates(code_block.out0, code_block.out1)
boolean = BoolSelector(true)
byPoints = PolyCurve.ByPoints(byCoordinates, boolean)
curves = PolyCurve.Curves(byPoints)
origin = Point.Origin()
ZAxis = Vector.ZAxis()
byOriginNormal = Plane.ByOriginNormal(origin, ZAxis)
byPlane = SketchPlane.ByPlane(byOriginNormal)
views = Views("Level 1")
fromCurve = Custom[RoomSeparator.FromCurve](Curve_s=curves, Sketch_plane=byPlane, View=views)  # Creates room separation lines from geometry curves.
watch = Watch(fromCurve)
# note: You can use the Sample Architecture Project (Basic) that ships with Revit to run this graph.
element_types = ElementTypes("ViewPlan")
all_elements_of_type = ElementsOfType(element_types)
typeIsAreaPlan = Custom[View.TypeIsAreaPlan]()  # Checks whether a given view is an area plan.
filter = List.Filter(all_elements_of_type, typeIsAreaPlan)
firstItem = List.FirstItem(filter)
watch_2 = Watch(firstItem)
fromCurve_2 = Custom[AreaSeparator.FromCurve](Curve_s=curves, Sketch_plane=byPlane, AreaPlan_view=watch_2)  # Creates area separation lines from geometry curves.
watch_3 = Watch(fromCurve_2)
