# Dynamo graph Revit.Elements.RoofOrFloorType.dyn (Dynamo 0.7.5.3566)

# note: Run this graph on the RoofOrFloor_Sample file in the extra folder.
element_types = ElementTypes("FloorType")
all_elements_of_type = ElementsOfType(element_types)
element_types_2 = ElementTypes("RoofType")
all_elements_of_type_2 = ElementsOfType(element_types_2)
create = List.Create(all_elements_of_type, all_elements_of_type_2)
flatten = Flatten(create)
watch = Watch(flatten)
compoundStructureHasVariableLayer = Custom[RoofOrFloorType.CompoundStructureHasVariableLayer](Element_Type_s=watch)  # Checks if the compound structure of a given floor or roof instance contains a variable layer.
watch_2 = Watch(compoundStructureHasVariableLayer)
