# Dynamo graph Revit.Elements.Wall.Create.dyn (Dynamo 0.7.5.3566)

# note: Run this graph on the ModelByFace_sample model in the extra folder.
element_types = ElementTypes("WallType")
all_elements_of_type = ElementsOfType(element_types)
firstItem = List.FirstItem(all_elements_of_type)
coreCenterline = Custom[WallLocationLine.CoreCenterline]()  # Returns the WallLocationLine option for CoreCenterLine
select_face = DSFaceSelection()  # 1 picked in the model
firstItem_2 = List.FirstItem(select_face)
byFace = Custom[Wall.ByFace](WallType=firstItem, WallLocationLine=coreCenterline.CoreCenterline, Face_s=firstItem_2)  # Creates a wall on top of a face
watch = Watch(byFace)
