# Dynamo graph Revit.Elements.WallLocationLine.dyn (Dynamo 0.7.5.3566)

# note: Have a look at the Revit.Elements.Wall.Create sample to see how to use these nodes...
coreCenterline = Custom[WallLocationLine.CoreCenterline]()  # Returns the WallLocationLine option for CoreCenterLine
watch = Watch(coreCenterline)
coreInterior = Custom[WallLocationLine.CoreInterior]()  # Returns the WallLocationLine option for CoreInterior
watch_2 = Watch(coreInterior)
finishFaceExterior = Custom[WallLocationLine.FinishFaceExterior]()  # Returns the WallLocationLine option for FinishFaceExterior
watch_3 = Watch(finishFaceExterior)
coreExterior = Custom[WallLocationLine.CoreExterior]()  # Returns the WallLocationLine option for CoreExterior
watch_4 = Watch(coreExterior)
wallCenterline = Custom[WallLocationLine.WallCenterline]()  # Returns the WallLocationLine option for WallCenterLine
watch_5 = Watch(wallCenterline)
finishFaceInterior = Custom[WallLocationLine.FinishFaceInterior]()  # Returns the WallLocationLine option for FinishFaceInterior
watch_6 = Watch(finishFaceInterior)
