# Dynamo graph Revit.Selection.dyn (Dynamo 0.7.5.3566)

# note: You can use the Sample Architecture Project (Basic) that ships with Revit to run this graph.
categories = Categories("Furniture")
all_families_of_category = Custom[All Families Of Category](Categories=categories)  # Gets all famiies of a given category in the model (does *not *work for system families)
watch = Watch(all_families_of_category)
all_family_types_of_category = Custom[All Family Types Of Category](Categories=categories)  # Gets all family types/symbols of a given category in the model (does *not *work for system families)
watch_2 = Watch(all_family_types_of_category)
categories_2 = Categories("Dimensions")
views = Views("Level 1")
all_view_dependent_family = Custom[All View-Dependent Family Instances Of Category](Categories=categories_2, View_s=views)  # Gets all view-dependent family instances in a given view for a given list of categories - useful for finding annotation elements
watch_3 = Watch(all_view_dependent_family)
views_2 = Views("{3D}")
categories_3 = Categories("Walls")
origin = Point.Origin()
XAxis = Vector.XAxis()
all_intersecting_elements_of = Custom[All Intersecting Elements Of Category](3D_View=views_2, Category=categories_3, Vector_Basepoint_s=origin, Vector_s=XAxis)  # Finds all elements of a specified category that intersect with a list of vectors
watch_4 = Watch(all_intersecting_elements_of)
uniqueId = Element.UniqueId(watch_4)
watch_5 = Watch(uniqueId)
byID = Custom[Element.ByID](ID_s_or_UniqueId_s=watch_5)  # Gets the Revit element(s) for a list of IDs (or a single ID)
watch_6 = Watch(byID.Element_s)
select_face = DSFaceSelection()  # 1 picked in the model
watch_7 = Watch(select_face)
fromDynamoSurface = Custom[Element.FromDynamoSurface](Dynamo_surface_s=watch_7)  # Returns the underlying Revit element of a given face
watch_8 = Watch(fromDynamoSurface)
fromDynamoSurface_2 = Custom[RevitFace.FromDynamoSurface](Dynamo_surface_s=watch_7)  # Returns the underlying Revit face of a given surface
watch_9 = Watch(fromDynamoSurface_2)
fromDynamoSurface_3 = Custom[RevitFaceReference.FromDynamoSurface](Dynamo_surface_s=watch_7)  # Returns the underlying Revit face reference of a given surface
watch_10 = Watch(fromDynamoSurface_3)
string = StringInput("Dynamo Made This Selection Set")
byElements = Custom[SelectionSet.ByElements](Name=string, Element_s=watch_4)  # Creates a selections set of the given elements. Note that if a selection set of the given name already exists in the model, its contents will be replaced. Also, if the selection set is already applied as a view filter, the view filter will have to be manually updated in the visibility / graphic overrides.
watch_11 = Watch(byElements)
