# Dynamo graph Revit.Views.View.Query.dyn (Dynamo 0.7.5.3566)

# note: You can use the Sample Architecture Project (Basic) that ships with Revit to run this graph.
categories = Categories("Walls")
views = Views("{3D}")
categoryIsVisible = Custom[View.CategoryIsVisible](Category_ies=categories, View_s=views)  # Checks if a given category is visible in a given view
watch = Watch(categoryIsVisible)
plane = Custom[View.Plane](View_s=views)  # Retrieves the plane of a given view
watch_2 = Watch(plane)
isViewTemplate = Custom[View.IsViewTemplate](View_s=views)  # Checks if a given view is a view template
watch_3 = Watch(isViewTemplate)
isPerspective = Custom[View.IsPerspective](View_s=views)  # Checks whether a given view is a perspective view.
watch_4 = Watch(isPerspective)
usesViewFilters = Custom[View.UsesViewFilters](View_s=views)  # Checks if a given view has any view filters applied to it.
watch_5 = Watch(usesViewFilters)
scale = Custom[View.Scale](View_s=views)  # Returns the scale of a given view
watch_6 = Watch(scale)
viewTemplate = Custom[View.ViewTemplate](View_s=views)  # Returns the view template assigned to a given view (if one is assigned)
watch_7 = Watch(viewTemplate)
