# Dynamo graph Revit.Elements.FootingType.dyn (Dynamo 1.3.1.1736)

# note: Run this file on the FootingType_Sample model in the extra folder.
categories = Categories("StructuralFoundation")
all_elements_of_category = ElementsOfCategory(categories)
elementType = Element.ElementType(all_elements_of_category)
watch = Watch(elementType)
breaksAtInserts = Custom[FootingType.BreaksAtInserts](footingType=watch)  # Determines whether a list of wall footing types break at inserts in their attached walls
watch_2 = Watch(breaksAtInserts)
