# Dynamo graph Revit.Elements.Roof.dyn (Dynamo 1.0.0.1180)

select_face = DSFaceSelection()  # 1 picked in the model
firstItem = List.FirstItem(select_face)
# note: Run this graph on the RoofOrFloor_Sample file in the extra folder.
integer_slider = IntegerSlider(11, range=0..20 step 1)
gridFromFace = Custom[Paneling.GridFromFace](surface=firstItem, U=integer_slider, V=integer_slider)  # Returns UV coordinates, XYZ coordinates and normals for a face with UV subdivision
watch = Watch(gridFromFace.Points)
select_model_element = DSModelElementSelection()  # 1 picked in the model
watch_2 = Watch(select_model_element)
slabShapeByPoints = Custom[Roof.SlabShapeByPoints](points=watch, roof=watch_2)  # Transform a slab shape based on a list of XYZs. PLEASE NOTE: Will reset any previous edits on the slab shape.
slabShapeHasBeenModified = Custom[Roof.SlabShapeHasBeenModified](roof=slabShapeByPoints)  # Checks if the shape of a roof slab has been modified with the shape editing tools
watch_3 = Watch(slabShapeHasBeenModified)
watch_4 = Watch(slabShapeByPoints)
categories = Categories("Roofs")
all_elements_of_category = ElementsOfCategory(categories)
watch_5 = Watch(all_elements_of_category)
kind = Custom[Roof.Kind](roof=watch_5)  # Retrieves the roof kind (Basic, Glazed, Other). PLEASE NOTE: Roofs that were created by face will be identified as 'Other'
watch_6 = Watch(kind)
creationMethod = Custom[Roof.CreationMethod](roof=watch_5)  # Retrieves the creation method of a given roof
watch_7 = Watch(creationMethod)
