# Dynamo graph Core.DateTime.dyn (Dynamo 1.3.0.875)

now = DateTime.Now()
calendarWeek = Custom[Date.CalendarWeek](date=now)  # Retrieves the calendar week for the given date
watch = Watch(calendarWeek)
