# Dynamo graph Core.File.dyn (Dynamo 1.0.0.1180)

code_block = CodeBlock { "C:\Temp\TestCSV.csv"; }
string = StringInput(";")
code_block_2 = CodeBlock { 1..100; 10; }
chop = List.Chop(list=code_block_2.out0, lengths=code_block_2.out1)
string_from_object = FromObject(chop)
writeToCSV = Custom[File.WriteToCSV](path=code_block, delimiter=string, data=string_from_object)  # Writes data to a CSV file with a custom delimiter. Data inputs needs to contain strings only!
code_block_3 = CodeBlock(csvwritten=writeToCSV, path=code_block)
# ---------- code_block_3.designscript (3 lines) ----------
// Make sure the CSV has been written
// before attempting to read it
{csvwritten,path}[1];
# ----------------------------------------
fromPath = FileObject(code_block_3)  # "File.FromPath"
readText = File.ReadText(fromPath)
watch = Watch(readText)
