# Dynamo graph Core.List.Query.dyn (Dynamo 1.3.1.1736)

code_block = CodeBlock { 1..3; 4..8; }
create = List.Create(code_block.out0, code_block.out1, code_block.out0)
watch = Watch(create)
isNotEmpty = Custom[List.IsNotEmpty](seq=watch)  # Just the inversion of the built-in Is Empty List node.
watch_2 = Watch(isNotEmpty)
countOccurences = Custom[List.CountOccurences](seq=watch)  # Counts the number of occurences of each unique element in a given list
watch_3 = Watch(countOccurences.uniqueElements)
watch_4 = Watch(countOccurences.count)
code_block_2 = CodeBlock()
# ---------- code_block_2.designscript (3 lines) ----------
{{true,true},
{false,false},
{true,false}};
# ----------------------------------------
watch_5 = Watch(code_block_2)
anyTrue = Custom[List.AnyTrue](seq=watch_5@L2)  # Returns true if any item in a list of booleans is true.
watch_6 = Watch(anyTrue)
anyFalse = Custom[List.AnyFalse](seq=watch_5@L2)  # Returns true if any item in a list of booleans is false.
watch_7 = Watch(anyFalse)
