# Dynamo graph Core.System.dyn (Dynamo 1.3.0.875)

CPUs = Custom[System.CPUs]()  # Returns information on number of processors and CPU speed (GHz).
watch = Watch(CPUs.physicalProcessors)
watch_2 = Watch(CPUs.logicalProcesssors)
watch_3 = Watch(CPUs.cores)
watch_4 = Watch(CPUs.CPUspeed)
memory = Custom[System.Memory]()  # Returns information on total system memory, free memory and amount of memory used by the application.
watch_5 = Watch(memory.installedMemory)
watch_6 = Watch(memory.freeMemory)
watch_7 = Watch(memory.appMemory)
watch_8 = Watch(memory.passThrough)
version = Custom[System.Version]()  # Returns the Windows version
watch_9 = Watch(version.versionName)
watch_10 = Watch(version.servicePack)
watch_11 = Watch(version.versionNumber)
