# Dynamo graph Revit.Application.dyn (Dynamo 1.0.0.1180)

# note: You can use the Sample Architecture Project (Basic) that ships with Revit to run this graph.
version = Custom[Application.Version]()  # Retrieves the name, version and build of the current Revit application.
watch = Watch(version.Version_int)
watch_2 = Watch(version.Build)
watch_3 = Watch(version.Name)
watch_4 = Watch(version.Language)
