# Dynamo graph Revit.Document.Actions.dyn (Dynamo 1.0.0.1180)

directory_path = Directory("C:\temp")
string = StringInput("\test")
code_block = CodeBlock(dir=directory_path, path=string) { dir + path; }
saveAs = Custom[Document.SaveAs](filePath=code_block)  # Saves the active Revit document under the given name.
watch = Watch(saveAs)
file_path = Filename("..\..\..\..\..\projekte\Treppen\Revit\familien\AA%20Treppenbeschriftung%20gmp-Treppe.rfa")
loadFamily = Custom[Document.LoadFamily](path=file_path)  # A very crude implementation of family loading. Will *not* reload an already loaded family of the same name.
watch_2 = Watch(loadFamily)
boolean = BoolSelector(true)
boolean_2 = BoolSelector(false)
string_2 = StringInput("Synched with Dynamo")
# note: You'll need to run this on a workshared file...
synchronizeWithCentral = Custom[Document.SynchronizeWithCentral](relinquishProjectStandardWorksets=boolean, relinquishViewWorksets=boolean, relinquishFamilyWorksets=boolean, relinquishUserCreatedWorksets=boolean, relinquishBorrowedElements=boolean, compactCentralModel=boolean_2, saveLocalFileBeforeSync=boolean_2, saveLocalFileAfterSync=boolean, comment=string_2)  # Synchronizes a workshared model with the central model.
watch_3 = Watch(synchronizeWithCentral)
file_path_2 = Filename("c:\netz\adieckmann\Desktop\durchbr%C3%BCche_gebunden.rvt")
addLink = Custom[Document.AddLink](filePath=file_path_2)  # Adds a link to a model to the current document
watch_4 = Watch(addLink.RevitLinkInstance)
watch_5 = Watch(addLink.bool)
