# Dynamo graph Revit.Elements.Array.dyn (Dynamo 1.0.0.1180)

element_types = ElementTypes("BaseArray")
all_elements_of_type = ElementsOfType(element_types)
watch = Watch(all_elements_of_type)
associatedFamilyParameter = Custom[Array.AssociatedFamilyParameter](dimension=watch)  # Returns the associated family parameter of an array label (if any). PLEASE NOTE: This node will only work in a family document!
watch_2 = Watch(associatedFamilyParameter.familyParameter)
watch_3 = Watch(associatedFamilyParameter.familyParameterName)
