# Dynamo graph Revit.Elements.BoundingBox.dyn (Dynamo 1.3.1.1736)

categories = Categories("Walls")
# note: You can use the Sample Architecture Project (Basic) that ships with Revit to run this graph.
all_elements_of_category = ElementsOfCategory(categories)
watch = Watch(all_elements_of_category)
count = List.Count(watch)
code_block = CodeBlock(n=count) { n/3; }
chop = List.Chop(list=watch, lengths=code_block)
byElements = Custom[BoundingBox.ByElements](elements=chop)  # Retrieves a bounding box for a list of elements
watch_2 = Watch(byElements)
fromDynamoBoundingBox = Custom[RevitBoundingBox.FromDynamoBoundingBox](DynamoBoundingBox=byElements)  # Turns a Dynamo bounding box into a Revit bounding box.
watch_3 = Watch(fromDynamoBoundingBox)
toCuboid = BoundingBox.ToCuboid(byElements)
watch_3d = Watch3D(toCuboid)
