# Dynamo graph Revit.Elements.CurtainPanel.dyn (Dynamo 1.0.0.1180)

# note: Run this script with the CurtainPanel_Sample file in the extra folder.
categories = Categories("CurtainWallPanels")
all_elements_of_category = ElementsOfCategory(categories)
watch = Watch(all_elements_of_category)
hostPanel = Custom[CurtainPanel.HostPanel](curtainPanel=watch)  # Retrieves the host panel of a given curtain panel. This is typcially needed when wanting to access wall elements used as curtain panels.
watch_2 = Watch(hostPanel)
