# Dynamo graph Revit.Elements.DetailCurve.dyn (Dynamo 1.0.0.1180)

# note: Run this file on the DetailComponent_Sample model in the extra folder.
code_block = CodeBlock { 5; }
byWidthLength = Rectangle.ByWidthLength(width=code_block, length=code_block)
explode = Geometry.Explode(byWidthLength)
views = Views("Ebene 0")
fromCurve = Custom[DetailCurve.FromCurve](curve=explode, view=views)  # "DetailLine.FromCurve"; Creates a detail line based on a given curve
watch = Watch(fromCurve)
