# Dynamo graph Revit.Elements.Element.Actions.dyn (Dynamo 1.3.4.6666)

select_model_element = DSModelElementSelection()  # 1 picked in the model
watch = Watch(select_model_element)
YAxis = Vector.YAxis()
number_slider = DoubleSlider(9.2, range=0..20 step 0.1)
scale = Vector.Scale(vector=YAxis, scale_factor=number_slider)
boolean = BoolSelector(true)
copyByVector = Custom[Element.CopyByVector](element=watch, vector=scale, rehostToClosestLevel=boolean)  # Copies an element or a list of elements by a given vector.
watch_2 = Watch(copyByVector)
levels = Levels("Level 2")
copyToLevel = Custom[Element.CopyToLevel](element=copyByVector, level=levels)  # Copies an element or a list of elements to a given level. Preserves the element's transform. PLEASE NOTE: This node only works for levels that have at least one view (e.g. floor plan) associated with them.
watch_3 = Watch(copyToLevel)
# note: Run this graph on the Actons_Sample model
select_model_element_2 = DSModelElementSelection()  # 1 picked in the model
watch_4 = Watch(select_model_element_2)
select_model_element_3 = DSModelElementSelection()  # 1 picked in the model
watch_5 = Watch(select_model_element_3)
cutGeometry = Custom[Element.CutGeometry](elementToBeCut=watch_4, cuttingElement=watch_5)  # Adds a solid-solid cut for two model elements (if possible).
watch_6 = Watch(cutGeometry.success)
select_model_element_4 = DSModelElementSelection()  # 1 picked in the model
watch_7 = Watch(select_model_element_4)
joinGeometry = Custom[Element.JoinGeometry](element1=watch_4, element2=watch_7)  # Joins two model elements (if possible). Only works inside the project environment.
watch_8 = Watch(joinGeometry.success)
string = StringInput("Material")
setMaterialParameterByCategory = Custom[Element.SetMaterialParameterByCategory](element=watch_4, materialParameterName=string)  # Sets a material parameter of a given element to <By Category>
watch_9 = Watch(setMaterialParameterByCategory.elements)
watch_10 = Watch(setMaterialParameterByCategory.success)
string_2 = StringInput("RenamedByDynamo")
setName = Custom[Element.SetName](element=watch_5, name=string_2)  # Gets the name of a given Revit element
watch_11 = Watch(setName.element)
watch_12 = Watch(setName.success)
worksets = Custom[Document.Worksets]()  # Returns all Worksets in the current document
firstItem = List.FirstItem(worksets)
setWorkset = Custom[Element.SetWorkset](workset=firstItem, element=watch)  # Sets the workset of a given element
watch_13 = Watch(setWorkset.elements)
watch_14 = Watch(setWorkset.success)
name = Custom[Element.Name+](element=firstItem)  # Gets an element's name (Dynamo's built-in Name nodes don't work for all element types, e.g. worksets...)
watch_15 = Watch(name)
categories = Categories("Lines")
all_elements_of_category = ElementsOfCategory(categories)
categories_2 = Categories("CurvesThinLines")
setSubCategory = Custom[Element.SetSubCategory](elements=all_elements_of_category, subCategory=categories_2)  # Assigns the given element(s) to the specified subcategory. The node should work for all geometry and curve elements. In some cases the GraphicsStyleType (Cut or Projection) needs to be specified.
watch_16 = Watch(setSubCategory.elements)
watch_17 = Watch(setSubCategory.success)
watch_18 = Watch(cutGeometry.elementToBeCut)
watch_19 = Watch(cutGeometry.cuttingElement)
watch_20 = Watch(joinGeometry.element2)
watch_21 = Watch(joinGeometry.element1)
select_model_element_5 = DSModelElementSelection()  # 1 picked in the model
XZ = Plane.XZ()
boolean_2 = BoolSelector(false)
mirror = Custom[Element.Mirror](element=select_model_element_5, plane=XZ, copy=boolean_2)  # Mirrors an element about a given plane.
watch_22 = Watch(mirror)
