# Dynamo graph Revit.Elements.Family.dyn (Dynamo 1.0.0.1180)

element_types = ElementTypes("Family")
all_elements_of_type = ElementsOfType(element_types)
watch = Watch(all_elements_of_type)
isInPlace = Custom[Family.IsInPlace](family=all_elements_of_type)  # Determines if a family is an in-place family
filterByBoolMask = List.FilterByBoolMask(list=all_elements_of_type, mask=isInPlace)
watch_2 = Watch(filterByBoolMask.in)
