# Dynamo graph Revit.Elements.Level.dyn (Dynamo 1.0.0.1180)

# note: You can use the Sample Architecture Project (Basic) that ships with Revit to run this graph.
categories = Categories("Levels")
all_elements_of_category = ElementsOfCategory(categories)
watch = Watch(all_elements_of_category)
plane = Custom[Level.Plane](level=watch)  # Retrieves the plane of a given level
watch_2 = Watch(plane)
boolean = BoolSelector(false)
views = Custom[Level.Views](level=watch, toggleToRefresh=boolean)  # Returns all views associated with a given level
watch_3 = Watch(views.firstView)
watch_4 = Watch(views.allViews)
