# Dynamo graph Revit.Elements.TextElement.dyn (Dynamo 1.0.0.1180)

categories = Categories("TextNotes")
all_elements_of_category = ElementsOfCategory(categories)
watch = Watch(all_elements_of_category)
text = Custom[TextElement.Text](element=watch)  # Gets the text stored in a text element (i.e. text node or model text)
watch_2 = Watch(text)
code_block = CodeBlock(txt=watch_2, elems=watch)
# ---------- code_block.designscript (4 lines) ----------
// Make sure to first retrieve the old text
// before replacing it
{txt,elems}[1];
"This is the new text for all text nodes... :-)";
# ----------------------------------------
setText = Custom[TextElement.SetText](element=code_block.out0, text=code_block.out1)  # Sets the text of a given text element (i.e. text note or model text)
watch_3 = Watch(setText.fail)
watch_4 = Watch(setText.success)
text_2 = Custom[TextElement.Text](element=watch_4)
watch_5 = Watch(text_2)
