# Dynamo graph Revit.Selection.dyn (Dynamo 1.0.0.1180)

categories = Categories("Furniture")
# note: You can use the Sample Architecture Project (Basic) that ships with Revit to run this graph.
boolean = BoolSelector(false)
all_families_of_category = Custom[All Families Of Category](category=categories, toggle=boolean)  # Gets all famiies of a given category in the model (does *not *work for system families)
watch = Watch(all_families_of_category)
all_family_types_of_category = Custom[All Family Types Of Category](category=categories, toggle=boolean)  # Gets all family types/symbols of a given category in the model (does *not *work for system families)
watch_2 = Watch(all_family_types_of_category)
categories_2 = Categories("Dimensions")
views = Views("Level 1")
all_view_dependent_family = Custom[All View-Dependent Family Instances Of Category](category=categories_2, view=views)  # Gets all view-dependent family instances in a given view for a given list of categories - useful for finding annotation elements
watch_3 = Watch(all_view_dependent_family)
select_face = DSFaceSelection()  # 1 picked in the model
watch_4 = Watch(select_face)
fromDynamoSurface = Custom[Element.FromDynamoSurface](DynamoSurface=watch_4)  # Returns the underlying Revit element of a given face
watch_5 = Watch(fromDynamoSurface)
fromDynamoSurface_2 = Custom[RevitFace.FromDynamoSurface](DynamoSurface=watch_4)  # Returns the underlying Revit face of a given surface
watch_6 = Watch(fromDynamoSurface_2)
fromDynamoSurface_3 = Custom[RevitFaceReference.FromDynamoSurface](DynamoSurface=watch_4)  # Returns the underlying Revit face reference of a given surface
watch_7 = Watch(fromDynamoSurface_3)
family_types = FamilyTypes("Bar Chair:Bar Chair")
all_elements_of_family_type = Custom[All Elements of Family Type (Universal)](familyType=family_types, toggle=boolean)  # Unlike the built-in node, this node retrieves all placed instances of a given loadable *or* system family type
watch_8 = Watch(all_elements_of_family_type)
wall_types = WallTypes("Interior - Partition")
all_elements_of_family_type_2 = Custom[All Elements of Family Type (Universal)](familyType=wall_types, toggle=boolean)
watch_9 = Watch(all_elements_of_family_type_2)
categories_3 = Categories("Walls")
all_placed_family_types_of = Custom[All Placed Family Types of Category](category=categories_3)  # Retrieves all family types of a given category that have *placed* instances
watch_10 = Watch(all_placed_family_types_of)
views_2 = Views("{3D}")
categories_4 = Categories("Walls")
origin = Point.Origin()
code_block = CodeBlock { 20; }
byCoordinates = Point.ByCoordinates(x=code_block)
all_intersecting_elements_of = Custom[All Intersecting Elements Of Category](threeDView=views_2, category=categories_4, startPoint=origin, endPoint=byCoordinates, toggle=boolean)  # Finds all elements of a specified category that intersect with a list of vectors
watch_11 = Watch(all_intersecting_elements_of)
code_block_2 = CodeBlock { "Base Offset"; }
code_block_3 = CodeBlock { -0.5; }
formula = Formula("x<y", y=code_block_3)
filterByParameterValueAndCondition = Custom[Elements.FilterByParameterValueAndCondition](elements=watch_11, param=code_block_2, func=formula)
watch_12 = Watch(filterByParameterValueAndCondition.out)
watch_13 = Watch(filterByParameterValueAndCondition.in)
code_block_4 = CodeBlock { "Timber"; }
boolean_2 = BoolSelector(true)
filterByName = Custom[Elements.FilterByName](elements=watch_11, searchString=code_block_4, ignoreCase=boolean_2)  # Retrieves those elements from a collection whose names match the search string
watch_14 = Watch(filterByName.out)
watch_15 = Watch(filterByName.in)
watch_16 = Watch(filterByName.first)
uniqueId = Element.UniqueId(watch_11)
watch_17 = Watch(uniqueId)
byID = Custom[Element.ByID](ID_UniqueId=watch_17)  # Gets the Revit element(s) for a list of IDs (or a single ID)
watch_18 = Watch(byID.element)
string = StringInput("wall")
boolean_3 = BoolSelector(true)
byName = Custom[BuiltInCategory.ByName](searchFor=string, ignoreCase=boolean_3)  # Looks up all the built-in categories based on a given name (or part of a name) of the category. Search is case-insensitive.
watch_19 = Watch(byName.BuiltInCategories)
watch_20 = Watch(byName.ElementIDs)
byName_2 = Custom[BuiltInParameter.ByName](searchFor=string, ignoreCase=boolean_3)  # Looks up all the built-in parameters based on a given name (or part of a name) of the parameters. Search is case-insensitive.
watch_21 = Watch(byName_2.BuiltInParameters)
watch_22 = Watch(byName_2.ElementIDs)
watch_23 = Watch(byName_2.ParameterNames)
select_model_element = DSModelElementSelection()  # 1 picked in the model
geometry = Element.Geometry(select_model_element)
centroid = Solid.Centroid(geometry)
phases = Custom[Document.Phases]()  # Retrieves all phases in the active document in *chronological* order
string_2 = StringInput("Working Drawings")
filterByName_2 = Custom[Elements.FilterByName](elements=phases, searchString=string_2)
atPointInPhase = Custom[Room.AtPointInPhase](point=centroid, phase=filterByName_2.first)  # Tries to retrieve a room element at the given location for the given phase.
watch_24 = Watch(atPointInPhase)
