# Dynamo graph Revit.Views.PerspectiveView.dyn (Dynamo 1.0.0.1180)

# note: You can use the Sample Architecture Project (Basic) that ships with Revit to run this graph.
views = Views("Section Perspective")
number_slider = DoubleSlider(66.55577629, range=0..100 step 0.1)
number_slider_2 = DoubleSlider(84.97932586, range=0..100 step 0.1)
number_slider_3 = DoubleSlider(49.20263595, range=0..100 step 0.1)
byCoordinates = Point.ByCoordinates(x=number_slider, y=number_slider_2, z=number_slider_3)
origin = Point.Origin()
orientToEyeAndTargetPosition = Custom[PerspectiveView.SetOrientationByEyeAndTargetPosition](view=views, eyePosition=byCoordinates, targetPosition=origin)  # "PerspectiveView.OrientToEyeAndTargetPosition"; Sets the orientation of a given perspective view based on a given eye and target position
watch = Watch(orientToEyeAndTargetPosition)
