# Dynamo graph Revit.Views.Sheet.dyn (Dynamo 1.0.0.1180)

categories = Categories("Sheets")
all_elements_of_category = ElementsOfCategory(categories)
watch = Watch(all_elements_of_category)
schedules = Custom[Sheet.Schedules](sheet=watch)  # Returns all schedules placed on a specified sheet
watch_2 = Watch(schedules)
# note: You can use the Sample Architecture Project (Basic) that ships with Revit to run this graph.
code_block = CodeBlock { 1..3; }
string = StringInput("""A
B
C""")
string_2 = StringInput("\n")
split = String.Split(string, string_2)
byNumberAndName = Custom[PlaceholderSheet.ByNumberAndName](sheetNumber=code_block, sheetName=split)  # Creates placeholder sheets
watch_3 = Watch(byNumberAndName)
scale = Custom[Sheet.Scale](sheet=watch)  # Returns the scale of a given sheet
watch_4 = Watch(scale)
