# Dynamo graph Revit.Views.View.Query.dyn (Dynamo 1.0.0.1180)

categories = Categories("Walls")
views = Views("{3D}")
categoryIsVisible = Custom[View.CategoryIsVisible](category=categories, view=views)  # Checks if a given category is visible in a given view
watch = Watch(categoryIsVisible)
plane = Custom[View.Plane](view=views)  # Retrieves the plane of a given view
watch_2 = Watch(plane)
isViewTemplate = Custom[View.IsViewTemplate](view=views)  # Checks if a given view is a view template
watch_3 = Watch(isViewTemplate)
isPerspective = Custom[View.IsPerspective](view=views)  # Checks whether a given view is a perspective view.
watch_4 = Watch(isPerspective)
usesViewFilters = Custom[View.UsesViewFilters](view=views)  # Checks if a given view has any view filters applied to it.
watch_5 = Watch(usesViewFilters)
scale = Custom[View.Scale](view=views)  # Returns the scale of a given view
watch_6 = Watch(scale)
viewTemplate = Custom[View.ViewTemplate](view=views)  # Returns the view template assigned to a given view (if one is assigned)
watch_7 = Watch(viewTemplate)
views_2 = Views("Solar Analysis")
solarStudyTotalFrames = Custom[View.SolarStudyTotalFrames](view=views_2)  # Retrieves the number of frames of a solar study for a given view (if the view's sun and shadow settings are indeed set to single or multi day study)
watch_8 = Watch(solarStudyTotalFrames)
phase = Custom[View.Phase](view=views)  # Returns the phase of a given view
watch_9 = Watch(phase)
detailLevel = Custom[View.DetailLevel](view=views)  # Retrieves the detail level of a given view
watch_10 = Watch(detailLevel)
type = Custom[View.Type](view=views)  # Returns the type of a given view
watch_11 = Watch(type)
