# Dynamo graph Display.dyn "Display.Color" (Dynamo 2.0.0.4654)

aqua = Custom[Color.Aqua]()  # Returns the colour aqua.
code_block = CodeBlock { 0; }
color_range = ColorRange(colors=aqua, indices=code_block, value=code_block)
blue = Custom[Color.Blue]()  # Returns the colour blue.
color_range_2 = ColorRange(colors=blue, indices=code_block, value=code_block)
green = Custom[Color.Green]()  # Returns the colour green.
color_range_3 = ColorRange(colors=green, indices=code_block, value=code_block)
lime = Custom[Color.Lime]()  # Returns the colour lime.
color_range_4 = ColorRange(colors=lime, indices=code_block, value=code_block)
navy = Custom[Color.Navy]()  # Returns the colour navy.
color_range_5 = ColorRange(colors=navy, indices=code_block, value=code_block)
purple = Custom[Color.Purple]()  # Returns the colour purple.
color_range_6 = ColorRange(colors=purple, indices=code_block, value=code_block)
silver = Custom[Color.Silver]()  # Returns the colour silver.
color_range_7 = ColorRange(colors=silver, indices=code_block, value=code_block)
white = Custom[Color.White]()  # Returns the colour white.
color_range_8 = ColorRange(colors=white, indices=code_block, value=code_block)
string = StringInput("#FF9900")  # graph input
byWebColor = Custom[Color.ByWebColor](hex=string)  # Creates a color from a given web color (a hex triplet like #FF9900)
color_range_9 = ColorRange(colors=byWebColor, indices=code_block, value=code_block)
number_slider = DoubleSlider(0.4, range=0..1 step 0.1)  # graph input
greyscaleByNormalizedValue = Custom[Color.GreyscaleByNormalizedValue](dbl=number_slider)  # Creates a greyscale color based on a normalized value (0 = black, 1 = white)
color_range_10 = ColorRange(colors=greyscaleByNormalizedValue, indices=code_block, value=code_block)
black = Custom[Color.Black]()  # Returns the colour black.
color_range_11 = ColorRange(colors=black, indices=code_block, value=code_block)
fuchsia = Custom[Color.Fuchsia]()  # Returns the colour fuchsia a.k.a. magenta.
color_range_12 = ColorRange(colors=fuchsia, indices=code_block, value=code_block)
grey = Custom[Color.Grey]()  # Returns the colour grey.
color_range_13 = ColorRange(colors=grey, indices=code_block, value=code_block)
maroon = Custom[Color.Maroon]()  # Returns the colour maroon.
color_range_14 = ColorRange(colors=maroon, indices=code_block, value=code_block)
olive = Custom[Color.Olive]()  # Returns the colour olive.
color_range_15 = ColorRange(colors=olive, indices=code_block, value=code_block)
red = Custom[Color.Red]()  # Returns the colour red.
color_range_16 = ColorRange(colors=red, indices=code_block, value=code_block)
teal = Custom[Color.Teal]()  # Returns the colour teal.
color_range_17 = ColorRange(colors=teal, indices=code_block, value=code_block)
yellow = Custom[Color.Yellow]()  # Returns the colour yellow.
color_range_18 = ColorRange(colors=yellow, indices=code_block, value=code_block)
