# Dynamo graph Geometry.Abstract.Vector.Actions.dyn "Geometry.Abstract.Vector" (Dynamo 2.0.1.5055)

code_block = CodeBlock { 1; }
byCoordinates = Point.ByCoordinates(x=code_block)
number_slider = DoubleSlider(0.284, range=0..1 step 0.1)  # graph input
number_slider_2 = DoubleSlider(0.609, range=0..1 step 0.1)  # graph input
number_slider_3 = DoubleSlider(0, range=0..1 step 0.1)  # graph input
boolean = BoolSelector(true)  # graph input
byCoordinates_2 = Vector.ByCoordinates(x=number_slider, y=number_slider_2, z=number_slider_3, normalized=boolean)
origin = Point.Origin()
YAxis = Vector.YAxis()
byOriginNormal = Plane.ByOriginNormal(origin=origin, normal=YAxis)
intersectWithPlane = Custom[Vector.IntersectWithPlane](vectorBasePoint=byCoordinates, vector=byCoordinates_2, plane=byOriginNormal)  # Finds the intersection point between a plane and a vector
watch = Watch(intersectWithPlane)
intersectWithVector = Custom[Vector.IntersectWithVector](basePoint1=byCoordinates, vector1=byCoordinates_2, basePoint2=origin, vector2=YAxis)  # Determines if two vectors intersect and returns the closest points of intersection on both vectors.
watch_2 = Watch(intersectWithVector.VectorsIntersect)
watch_3 = Watch(intersectWithVector.AveragePoint)
watch_4 = Watch(intersectWithVector.ClosestPointOnVector2)
watch_5 = Watch(intersectWithVector.ClosestPointOnVector1)
code_block_2 = CodeBlock { 5; }
byStartPointDirectionLength = Line.ByStartPointDirectionLength(startPoint=byCoordinates, direction=byCoordinates_2, length=code_block_2)
create = List.Create(item0=byOriginNormal, item1=byStartPointDirectionLength, item2=intersectWithPlane)
watch_3d = Watch3D(create)
byStartPointDirectionLength_2 = Line.ByStartPointDirectionLength(startPoint=byCoordinates, direction=byCoordinates_2, length=code_block_2)
byStartPointDirectionLength_3 = Line.ByStartPointDirectionLength(startPoint=origin, direction=YAxis, length=code_block_2)
create_2 = List.Create(item0=byStartPointDirectionLength_2, item1=byStartPointDirectionLength_3, item2=intersectWithVector.AveragePoint)
watch_3d_2 = Watch3D(create_2)
code_block_3 = CodeBlock { 0.9..1.1..#5; }
code_block_4 = CodeBlock { 0.9..1.1..#5; }
byCoordinates_3 = Vector.ByCoordinates(x=code_block_3, y=code_block_4, lacing=CrossProduct)
flatten = List.Flatten(list=byCoordinates_3)
watch_6 = Watch(flatten)
count = List.Count(list=watch_6)
watch_7 = Watch(count)
number_slider_4 = DoubleSlider(0.06291571081, range=0..0.25 step 0.1)  # graph input
pruneDuplicates = Custom[Vector.PruneDuplicates](vectors=watch_6, Tolerance=number_slider_4)  # Prune vectors to exclude duplicates within a given tolerance
count_2 = List.Count(list=pruneDuplicates)
watch_8 = Watch(count_2)
number_slider_5 = DoubleSlider(0.4425269165, range=-1..1 step 0.1)  # graph input
number_slider_6 = DoubleSlider(0.5428332845, range=-1..1 step 0.1)  # graph input
number_slider_7 = DoubleSlider(-1, range=-1..1 step 0.1)  # graph input
boolean_2 = BoolSelector(true)  # graph input
byCoordinates_4 = Vector.ByCoordinates(x=number_slider_5, y=number_slider_6, z=number_slider_7, normalized=boolean_2)
watch_9 = Watch(byCoordinates_4)
ZAxis = Vector.ZAxis()
watch_10 = Watch(ZAxis)
correctOrientation = Custom[Vector.CorrectOrientation](VectorA=watch_9, VectorB=watch_10)  # Inverts normal A if its inversion is closer to normal B
watch_11 = Watch(correctOrientation)
origin_2 = Point.Origin()
byStartPointDirectionLength_4 = Line.ByStartPointDirectionLength(startPoint=origin_2, direction=watch_9, length=code_block_2)
byStartPointDirectionLength_5 = Line.ByStartPointDirectionLength(startPoint=origin_2, direction=watch_10, length=code_block_2)
byStartPointDirectionLength_6 = Line.ByStartPointDirectionLength(startPoint=origin_2, direction=correctOrientation, length=code_block_2)
create_3 = List.Create(item0=byStartPointDirectionLength_4, item1=byStartPointDirectionLength_5, item2=byStartPointDirectionLength_6)
watch_3d_3 = Watch3D(create_3)
