# Dynamo graph Geometry.Abstract.Vector.Create.dyn (Dynamo 2.0.1.5055)

YAxisNegative = Custom[Vector.YAxisNegative]()  # Returns an XYZ of 0,-1,0
watch = Watch(YAxisNegative)
XAxisNegative = Custom[Vector.XAxisNegative]()  # Returns an XYZ of -1,0,0
watch_2 = Watch(XAxisNegative)
ZAxisNegative = Custom[Vector.ZAxisNegative]()  # Returns an XYZ of 0,0,-1
watch_3 = Watch(ZAxisNegative)
number_slider = DoubleSlider(0.884, range=0..1 step 0.1)  # graph input
number_slider_2 = DoubleSlider(0.474, range=0..1 step 0.1)  # graph input
number_slider_3 = DoubleSlider(0.59, range=0..1 step 0.1)  # graph input
boolean = BoolSelector(false)  # graph input
byCoordinates = Vector.ByCoordinates(x=number_slider, y=number_slider_2, z=number_slider_3, normalized=boolean)
watch_4 = Watch(byCoordinates)
fromVector = Custom[XYZAxis.FromVector](vector=watch_4)  # Returns whichever main axis (X, Y or Z) is closest to a given vector
watch_5 = Watch(fromVector)
number_slider_4 = DoubleSlider(0.47, range=0..1 step 0.1)  # graph input
number_slider_5 = DoubleSlider(0.782, range=0..1 step 0.1)  # graph input
number_slider_6 = DoubleSlider(0.59, range=0..1 step 0.1)  # graph input
boolean_2 = BoolSelector(false)  # graph input
byCoordinates_2 = Vector.ByCoordinates(x=number_slider_4, y=number_slider_5, z=number_slider_6, normalized=boolean_2)
watch_6 = Watch(byCoordinates_2)
byTwoVectors = Custom[XYZAxis.ByTwoVectors](Axis1=watch_6, Axis2=watch_4)  # Given two main XYZ axes (or vectors pointing more or less in their general direction), this node will find the third axis.
watch_7 = Watch(byTwoVectors.str)
watch_8 = Watch(byTwoVectors.vector)
number_slider_7 = DoubleSlider(2.283794018, range=0..10 step 0.1)  # graph input
number_slider_8 = DoubleSlider(4.419, range=0..10 step 0.1)  # graph input
byCoordinates_3 = Point.ByCoordinates(x=number_slider_7, y=number_slider_8)
watch_9 = Watch(byCoordinates_3)
origin = Point.Origin()
number_slider_9 = DoubleSlider(-5.653393753, range=-10..0 step 0.1)  # graph input
number_slider_10 = DoubleSlider(4.419, range=0..10 step 0.1)  # graph input
byCoordinates_4 = Point.ByCoordinates(x=number_slider_9, y=number_slider_10)
watch_10 = Watch(byCoordinates_4)
byPoints = Custom[AngleBisector.ByPoints](PointA=watch_9, PointB=origin, PointC=watch_10)  # Retrieves the vector of an angle bisector at point B based on three points (A, B, C) that define the angle.
watch_11 = Watch(byPoints)
fromVector_2 = Custom[XYZAxis.FromVector](vector=watch_6)
watch_12 = Watch(fromVector_2)
code_block = CodeBlock { 5; }
byStartPointDirectionLength = Line.ByStartPointDirectionLength(startPoint=origin, direction=byPoints, length=code_block)
create = List.Create(item0=watch_9, item1=origin, item2=watch_10, item3=byStartPointDirectionLength)
watch_3d = Watch3D(create)
