# Dynamo graph Geometry.Abstract.Vector.Query.dyn (Dynamo 2.0.1.5055)

number_slider = DoubleSlider(1, range=0..1 step 0.1)  # graph input
number_slider_2 = DoubleSlider(1, range=0..1 step 0.1)  # graph input
number_slider_3 = DoubleSlider(0, range=0..1 step 0.1)  # graph input
boolean = BoolSelector(true)  # graph input
byCoordinates = Vector.ByCoordinates(x=number_slider, y=number_slider_2, z=number_slider_3, normalized=boolean)
watch = Watch(byCoordinates)
altitudeAndAzimuth = Custom[Vector.AltitudeAndAzimuth](vector=watch)  # Computes the altitude and azimuth of a given vector
watch_2 = Watch(altitudeAndAzimuth.altitude)
watch_3 = Watch(altitudeAndAzimuth.azimuth)
XAxis = Vector.XAxis()
YAxis = Vector.YAxis()
create = List.Create(item0=XAxis, item1=YAxis)
watch_4 = Watch(create)
average = Custom[Vector.Average](vectors=watch_4)  # Determines the average vector of a list of vectors
watch_5 = Watch(average)
origin = Point.Origin()
ZAxis = Vector.ZAxis()
byOriginNormal = Plane.ByOriginNormal(origin=origin, normal=ZAxis)
watch_6 = Watch(byOriginNormal)
isInPlane = Custom[Vector.IsInPlane](vectorBasePoint=origin, vector=watch, plane=watch_6)  # Checks if a given vector is located on a given plane
watch_7 = Watch(isInPlane)
isOrthogonalToVector = Custom[Vector.IsOrthogonalToVector](Vector1=watch, Vector2=YAxis)  # Checks if two vectors are orthogonal to each other
watch_8 = Watch(isOrthogonalToVector)
isParallelToPlane = Custom[Vector.IsParallelToPlane](vector=watch, plane=watch_6)  # Checks if a given vector is parallel to a given plane
watch_9 = Watch(isParallelToPlane)
