# Dynamo graph Geometry.Tesselation.Paneling.Grid.dyn (Dynamo 2.0.1.5055)

origin = Point.Origin()
code_block = CodeBlock { 2; }
byCoordinates = Point.ByCoordinates(x=code_block)
byStartPointEndPoint = Line.ByStartPointEndPoint(startPoint=origin, endPoint=byCoordinates)
byCoordinates_2 = Point.ByCoordinates(y=code_block)
code_block_2 = CodeBlock { 1; }
byCoordinates_3 = Point.ByCoordinates(x=code_block, y=code_block, z=code_block_2)
byStartPointEndPoint_2 = Line.ByStartPointEndPoint(startPoint=byCoordinates_2, endPoint=byCoordinates_3)
create = List.Create(item0=byStartPointEndPoint, item1=byStartPointEndPoint_2)
byRuledLoft = Surface.ByRuledLoft(crossSections=create)
integer_slider = IntegerSlider(13, range=0..20 step 1)  # graph input
integer_slider_2 = IntegerSlider(10, range=0..20 step 1)  # graph input
gridFromFace = Custom[Paneling.GridFromFace](surface=byRuledLoft, U=integer_slider, V=integer_slider_2)  # Returns UV coordinates, XYZ coordinates and normals for a face with UV subdivision
watch_3d = Watch3D(gridFromFace.Points)
watch = Watch(gridFromFace.Points)
watch_2 = Watch(gridFromFace.Normals)
watch_3 = Watch(gridFromFace.UVs)
file_path = Filename("..\..\2.x\extra\Image_Sample.jpg")  # graph input
fromPath = FileObject(path=file_path)  # "File.FromPath"
readFromFile = Image.ReadFromFile(file=fromPath)
watch_image = WatchImageCore(image=readFromFile)
pixels = Image.Pixels(image=watch_image, xSamples=integer_slider, ySamples=integer_slider_2)
watch_4 = Watch(pixels)
brightness = Color.Brightness(c=watch_4)
boolean = BoolSelector(true)  # graph input
boolean_2 = BoolSelector(false)  # graph input
boolean_3 = BoolSelector(false)  # graph input
invertAndMirrorNormalizedValues = Custom[Paneling.InvertAndMirrorNormalizedValues](seq=brightness, Invert=boolean, MirrorVertically=boolean_2, MirrorHorizontally=boolean_3)  # Inverts and mirrors (horizontally & vertically) a nested list of normalized values.
greyscaleByNormalizedValue = Custom[Color.GreyscaleByNormalizedValue](dbl=invertAndMirrorNormalizedValues)  # Creates a greyscale color based on a normalized value (0 = black, 1 = white)
fromPixels = Image.FromPixels(colors=greyscaleByNormalizedValue)
watch_image_2 = WatchImageCore(image=fromPixels)
