# Dynamo graph Geometry.Tesselation.Paneling.Pattern.Hexagonal.dyn (Dynamo 2.12.0.5650)
# packages: Clockwork for Dynamo 2.x 2.3.0

# group: INFO
# note: Run this graph on the Paneling_Sample model in the extra folder.

select_face = DSFaceSelection()  # 1 picked in the model; graph input
firstItem = List.FirstItem(list=select_face)
integer_slider = IntegerSlider(9, range=0..20 step 1)  # graph input
integer_slider_2 = IntegerSlider(12, range=0..20 step 1)  # graph input
fromFace = Custom[Grid.FromFace](surface=firstItem, U=integer_slider, V=integer_slider_2)  # package Clockwork for Dynamo 2.x; Returns UV coordinates, XYZ coordinates and normals for a face with UV subdivision
boolean = BoolSelector(false)  # graph input
integer_slider_3 = IntegerSlider(1, range=0..5 step 1)  # graph input
boolean_2 = BoolSelector(false)  # graph input
integer_slider_4 = IntegerSlider(2, range=0..5 step 1)  # graph input
boolean_3 = BoolSelector(false)  # graph input

# group: Pattern.Hexagonal
hexagonal = Custom[Pattern.Hexagonal](seq=fromFace.Points, V=integer_slider_2, reverseOddRows=boolean, shiftPlacementOddRows=integer_slider_3, reverseEvenRows=boolean_2, shiftPlacementEvenRows=integer_slider_4, rotateGridBy90Degrees=boolean_3)  # package Clockwork for Dynamo 2.x; Creates groups of points from a list of UVs or XYZs for the placement of hexagonal panels. The placement pattern can be reversed (boolean) and shifted (integer).
watch = Watch(hexagonal.oddRows)
watch_2 = Watch(hexagonal.evenRows)

family_types = FamilyTypes("6Point-AC_Hexagon:Type 1")  # graph input
byPoints = AdaptiveComponent.ByPoints(points=hexagonal.oddRows, familyType=family_types)
family_types_2 = FamilyTypes("6Point-AC_Hexagon:Type 2")  # graph input
byPoints_2 = AdaptiveComponent.ByPoints(points=hexagonal.evenRows, familyType=family_types_2)
