# Dynamo graph Geometry.Tesselation.Paneling.Pattern.TriangularFlatMirrored.dyn (Dynamo 2.0.1.5055)

# note: This example also requires the XYZ Grid From Face package to be installed.
select_face = DSFaceSelection()  # 1 picked in the model; graph input
firstItem = List.FirstItem(list=select_face)
integer_slider = IntegerSlider(7, range=0..20 step 1)  # graph input
integer_slider_2 = IntegerSlider(6, range=0..20 step 1)  # graph input
gridFromFace = Custom[Paneling.GridFromFace](surface=firstItem, U=integer_slider, V=integer_slider_2)  # Returns UV coordinates, XYZ coordinates and normals for a face with UV subdivision
shift_rows = BoolSelector(false)  # graph input
reverse_rows = BoolSelector(true)  # graph input
reverse_rows_2 = BoolSelector(false)  # graph input
shift_placement = IntegerSlider(0, range=0..2 step 1)  # graph input
shift_placement_2 = IntegerSlider(0, range=0..2 step 1)  # graph input
rotate_grid = BoolSelector(false)  # graph input
triangularFlatMirrored = Custom[Paneling.TriangularFlatMirrored](seq=gridFromFace.UVs, V=integer_slider_2, shiftRows=shift_rows, reverseRowsLying=reverse_rows, reverseRowsStanding=reverse_rows_2, shiftPlacementRowsLying=shift_placement, shiftPlacementRowsStanding=shift_placement_2, rotateGridBy90Degrees=rotate_grid)  # Creates groups of points from a list of UVs or XYZs for the placement of triangular (diagrid) panels. The placement pattern can be reversed (boolean) and shifted (integer).
# note: Right corners, lying
family_types = FamilyTypes(index=1)  # graph input
byParametersOnFace = AdaptiveComponent.ByParametersOnFace(uvs=triangularFlatMirrored.rightCornersLying, faceReference=firstItem, familyType=family_types, lacing=Longest)
# note: Right corners, standing
family_types_2 = FamilyTypes(index=1)  # graph input
byParametersOnFace_2 = AdaptiveComponent.ByParametersOnFace(uvs=triangularFlatMirrored.rightCornersStanding, faceReference=firstItem, familyType=family_types_2, lacing=Longest)
# note: Left corners, standing
family_types_3 = FamilyTypes(index=1)  # graph input
byParametersOnFace_3 = AdaptiveComponent.ByParametersOnFace(uvs=triangularFlatMirrored.leftCornersStanding, faceReference=firstItem, familyType=family_types_3, lacing=Longest)
# note: Left corners, lying
family_types_4 = FamilyTypes(index=1)  # graph input
byParametersOnFace_4 = AdaptiveComponent.ByParametersOnFace(uvs=triangularFlatMirrored.leftCornersLying, faceReference=firstItem, familyType=family_types_4, lacing=Longest)
# note: Rows, standing
family_types_5 = FamilyTypes(index=1)  # graph input
byParametersOnFace_5 = AdaptiveComponent.ByParametersOnFace(uvs=triangularFlatMirrored.rowsStanding, faceReference=firstItem, familyType=family_types_5, lacing=Longest)
# note: Rows, lying
family_types_6 = FamilyTypes(index=1)  # graph input
byParametersOnFace_6 = AdaptiveComponent.ByParametersOnFace(uvs=triangularFlatMirrored.rowsLying, faceReference=firstItem, familyType=family_types_6, lacing=Longest)
