# Dynamo graph ImportExport.FileSystem.dyn (Dynamo 2.0.1.5055)

file_path = Filename("C:\Program Files\Dynamo\Dynamo Core\2\DynamoSandbox.exe")
fromPath = FileObject(path=file_path)  # "File.FromPath"
fileSize = Custom[FileSystem.FileSize](file=fromPath)  # Returns the file size of a given file.
watch = Watch(fileSize.bytes)
watch_2 = Watch(fileSize.kilobytes)
watch_3 = Watch(fileSize.megabytes)
