# Dynamo graph Input.DateTime.dyn (Dynamo 2.0.1.5055)

now = DateTime.Now()
calendarWeek = Custom[DateTime.CalendarWeek](date=now)  # Retrieves the calendar week for the given date
watch = Watch(calendarWeek)
