# Dynamo graph List.Match.dyn (Dynamo 2.0.1.5055)

code_block = CodeBlock { [1..5,3..10,6..8]; }
watch = Watch(code_block)
equalSublistLengths = Custom[List.EqualSublistLengths](lists=watch)  # Trims all given lists to the length of the shortest list
watch_2 = Watch(equalSublistLengths)
