# Dynamo graph Revit.Application.Document.Actions.dyn (Dynamo 2.0.1.5055)

directory_path = Directory("C:\temp")  # graph input
string = StringInput("NewFileName")  # graph input
combinePath = FileSystem.CombinePath(path0=directory_path, path1=string)
saveAs = Custom[Document.SaveAs](filePath=combinePath)  # Saves the active Revit document under the given name.
watch = Watch(saveAs)
file_path = Filename("..\..\..\..\..\..\..\..\ProgramData\Autodesk\RVT 2017\Libraries\Germany\Möbel\Wohnen\Bücherschrank.rfa")  # graph input
loadFamily = Custom[Document.LoadFamily](path=file_path)  # A very crude implementation of family loading. Will *not* reload an already loaded family of the same name.
watch_2 = Watch(loadFamily.familyTypes)
boolean = BoolSelector(true)  # graph input
boolean_2 = BoolSelector(false)  # graph input
string_2 = StringInput("Synched with Dynamo")  # graph input
# note: You'll need to run this on a workshared file...
synchronizeWithCentral = Custom[Document.SynchronizeWithCentral](relinquishProjectStandardWorksets=boolean, relinquishViewWorksets=boolean, relinquishFamilyWorksets=boolean, relinquishUserCreatedWorksets=boolean, relinquishBorrowedElements=boolean, compactCentralModel=boolean_2, saveLocalFileBeforeSync=boolean_2, saveLocalFileAfterSync=boolean, comment=string_2, runMe=boolean)  # Synchronizes a workshared model with the central model.
watch_3 = Watch(synchronizeWithCentral)
file_path_2 = Filename("..\..\..\..\..\..\..\..\Program Files\Autodesk\Revit 2017\Samples\Technical_school-current_m.rvt")  # graph input
boolean_3 = BoolSelector(true)  # graph input
addLink = Custom[Document.AddLink](filePath=file_path_2, relativePath=boolean_3)  # Adds a link to a model to the current document
watch_4 = Watch(addLink.RevitLinkInstance)
watch_5 = Watch(addLink.success)
watch_6 = Watch(loadFamily.success)
