# Dynamo graph Revit.Application.Document.Query.dyn (Dynamo 2.12.0.5650)
# packages: Clockwork for Dynamo 2.x 2.3.0

categories = Categories("OST_ColumnAnalyticalTags")  # graph input
categories_2 = Categories("OST_DuctAccessoryTags")  # graph input
create = List.Create(item0=categories, item1=categories_2)
containsElementsOfCategory = Custom[Document.ContainsElementsOfCategory](category=create)  # package Clockwork for Dynamo 2.x; Checks if family instances of specified categories are present in the model.
watch = Watch(containsElementsOfCategory.any)
watch_2 = Watch(containsElementsOfCategory.all)
watch_3 = Watch(containsElementsOfCategory.per_category)
watch_4 = Watch(containsElementsOfCategory.instances)
# note: You can use the Sample STRUCTURAL Project (Basic) that ships with Revit to run this graph.
activeViewFromCurrentDocument = Custom[Document.ActiveViewFromCurrentDocument]()  # package Clockwork for Dynamo 2.x; Gets the active view of the current document
watch_5 = Watch(activeViewFromCurrentDocument)
toggle_to_refresh = BoolSelector(false)  # graph input
isWorkshared = Custom[Document.IsWorkshared](toggle=toggle_to_refresh)  # package Clockwork for Dynamo 2.x; Returns true if the current project is workshared
watch_6 = Watch(isWorkshared)
boolean = BoolSelector(true)
builtInCategories = Custom[Document.BuiltInCategories](dynamoSupportedCategoriesOnly=boolean)  # package Clockwork for Dynamo 2.x; List all the available BuiltInCategories
watch_7 = Watch(builtInCategories.BuiltInCategories)
builtInParameters = Custom[Document.BuiltInParameters]()  # package Clockwork for Dynamo 2.x; List all the available BuiltInParameters
watch_8 = Watch(builtInParameters.BuiltInParameters)
projectInfo = Custom[Document.ProjectInfo](toggle=toggle_to_refresh)  # package Clockwork for Dynamo 2.x; Gets the project information.
watch_9 = Watch(projectInfo.Author)
watch_10 = Watch(projectInfo.Number)
watch_11 = Watch(projectInfo.Name)
watch_12 = Watch(projectInfo.Address)
watch_13 = Watch(projectInfo.OrganizationDescription)
watch_14 = Watch(projectInfo.BuildingName)
watch_15 = Watch(projectInfo.IssueDate)
watch_16 = Watch(projectInfo.ClientName)
watch_17 = Watch(projectInfo.Status)
watch_18 = Watch(projectInfo.OrganizationName)
projectPosition = Custom[Document.ProjectPosition](toggle=toggle_to_refresh)  # package Clockwork for Dynamo 2.x; Gets the project's position data relative to the origin. Output coordinates may diverge from the project base point coordinates once the project base point has been moved in an unclipped state. Use the built-in nodes Location.Latitude & Location.Longitude to retrieve latitude and longitude.
watch_19 = Watch(projectPosition.Angle_degr)
watch_20 = Watch(projectPosition.Elevation)
watch_21 = Watch(projectPosition.EastWest)
watch_22 = Watch(projectPosition.NorthSouth)
phases = Custom[Document.Phases](toggle=toggle_to_refresh)  # package Clockwork for Dynamo 2.x; Retrieves all phases in the active document in *chronological* order
watch_23 = Watch(phases)
startingView = Custom[Document.StartingView](toggle=toggle_to_refresh)  # package Clockwork for Dynamo 2.x; Retrieves the starting view of a Project file. Returns null if no starting view is set.
watch_24 = Watch(startingView)
views = Custom[Document.Views](toggle=toggle_to_refresh)  # package Clockwork for Dynamo 2.x; Gets all views in the document - except for 3D view templates (as long as this bug is not fixed: https://github.com/DynamoDS/Dynamo/issues/2970)
watch_25 = Watch(views)
watch_26 = Watch(builtInCategories.ElementIDs)
watch_27 = Watch(builtInParameters.ElementIDs)
watch_28 = Watch(builtInParameters.ParameterNames)
worksets = Custom[Document.Worksets](toggle=toggle_to_refresh)  # package Clockwork for Dynamo 2.x; Returns all Worksets in the current document
watch_29 = Watch(worksets)
default3DView = Custom[Document.Default3DView](toggle=toggle_to_refresh)  # package Clockwork for Dynamo 2.x; Returns the default 3D view of the current model (if there is such a view)
watch_30 = Watch(default3DView)
projectParameters = Custom[Document.ProjectParameters](toggle=toggle_to_refresh)  # package Clockwork for Dynamo 2.x; Retrieves all project parameters and the categories they have been assigned to
watch_31 = Watch(projectParameters.paramName)
watch_32 = Watch(projectParameters.categories)
string = StringInput("OST_ProjectInformation")
projectParametersByCategory = Custom[Document.ProjectParametersByCategory](category=string, toggle=toggle_to_refresh)  # package Clockwork for Dynamo 2.x; Retrieves all project parameters for a given category
watch_33 = Watch(projectParametersByCategory.paramNames)
performanceAdviserRules = Custom[Document.PerformanceAdviserRules]()  # package Clockwork for Dynamo 2.x; Retrieves all Performance Adviser Rules from the current document
watch_34 = Watch(performanceAdviserRules)
watch_35 = Watch(builtInCategories.Categories)
elementTypes = Custom[Document.ElementTypes]()  # package Clockwork for Dynamo 2.x; Retrieves a list of all Revit element types
watch_36 = Watch(elementTypes.elementTypes)
watch_37 = Watch(projectParameters.variesAcrossGroups)
watch_38 = Watch(projectParameters.parameterGroup)
watch_39 = Watch(projectParameters.parameterType)
watch_40 = Watch(projectParameters.unitType)
watch_41 = Watch(projectParameters.isVisible)
watch_42 = Watch(projectParameters.parameterElement)
watch_43 = Watch(projectParameters.GUID)
watch_44 = Watch(projectParameters.isInstanceParameter)
watch_45 = Watch(projectParametersByCategory.parameterGroups)
watch_46 = Watch(projectParametersByCategory.variesAcrossGroups)
watch_47 = Watch(projectParametersByCategory.parameterTypes)
watch_48 = Watch(projectParametersByCategory.unitTypes)
watch_49 = Watch(projectParametersByCategory.isVisible)
watch_50 = Watch(projectParametersByCategory.GUIDs)
watch_51 = Watch(projectParametersByCategory.isInstanceParameter)
unitTypes = Custom[Document.UnitTypes](toggle=toggle_to_refresh)  # package Clockwork for Dynamo 2.x; Retrieves all available unit types of a given document
watch_52 = Watch(unitTypes)
watch_53 = Watch(elementTypes.elementTypeNames)
watch_54 = Watch(projectParametersByCategory.parameterElements)
enums = Custom[Document.Enums]()  # package Clockwork for Dynamo 2.x; Retrieves all Enums from the Revit API
watch_55 = Watch(enums)
computeVolumes = Custom[Document.ComputeVolumes]()  # package Clockwork for Dynamo 2.x; Returns whether or not the area and volume settings are set to compute volumes.
watch_56 = Watch(computeVolumes)
