# Dynamo graph Revit.Application.SharedParameterFile.dyn (Dynamo 2.0.4.12684)

file_path = Filename("..\..\..\..\..\..\..\..\Program Files\Autodesk\Revit 2021\IFC Shared Parameters-RevitIFCBuiltIn-Type.txt")  # graph input
parse = Custom[SharedParameterFile.Parse](path=file_path)  # Returns all parameters from a shared parameter file.
watch = Watch(parse.names)
watch_2 = Watch(parse.groups)
watch_3 = Watch(parse.data_categories)
watch_4 = Watch(parse.descriptions)
watch_5 = Watch(parse.user_modifiable)
watch_6 = Watch(parse.visible)
watch_7 = Watch(parse.data_types)
watch_8 = Watch(parse.guids)
watch_9 = Watch(parse.hide_when_no_value)
