# Dynamo graph Revit.Conversion.dyn (Dynamo 2.0.1.5055)

integer_slider = IntegerSlider(255, range=0..255 step 1)  # graph input
integer_slider_2 = IntegerSlider(0, range=0..255 step 1)  # graph input
integer_slider_3 = IntegerSlider(0, range=0..255 step 1)  # graph input
byARGB = Color.ByARGB(r=integer_slider, g=integer_slider_2, b=integer_slider_3)
watch = Watch(byARGB)
fromDynamoColor = Custom[Color.FromDynamoColor](DynamoColor=watch)  # Creates a Revit color from a Dynamo color
watch_2 = Watch(fromDynamoColor)
toDynamoColor = Custom[Color.ToDynamoColor](RevitColor=watch_2)  # Converts Revit colors into Dynamo colors
watch_3 = Watch(toDynamoColor)
code_block = CodeBlock { 0; }
color_range = ColorRange(colors=watch, indices=code_block, value=code_block)
color_range_2 = ColorRange(colors=toDynamoColor, indices=code_block, value=code_block)
byLengths = Cuboid.ByLengths()
boundingBox = Geometry.BoundingBox(geometry=byLengths)
watch_4 = Watch(boundingBox)
fromDynamoBoundingBox = Custom[BoundingBox.FromDynamoBoundingBox](DynamoBoundingBox=watch_4)  # Turns a Dynamo bounding box into a Revit bounding box.
watch_5 = Watch(fromDynamoBoundingBox)
