# Dynamo graph Revit.Elements.AngularDimension.dyn (Dynamo 2.12.0.5650)
# packages: Clockwork for Dynamo 2.x 2.3.0

# group: INFO
# note: Run this graph on the CreateStuff sample model.

string = StringInput("DimensionType")
byName = Custom[ElementType.ByName](name=string)  # package Clockwork for Dynamo 2.x; Retrieves an element type by its name - to be used with the OOTB node "All Elements of Type".
all_elements_of_type = ElementsOfType(element_type=byName)
styleType = DimensionType.StyleType(dimensionType=all_elements_of_type)
code_block = CodeBlock(style=styleType) { style == "Angular"; }
filterByBoolMask = List.FilterByBoolMask(list=all_elements_of_type, mask=code_block)

# group: AngularDimension.ByElements
select_model_element = DSModelElementSelection()  # 1 picked in the model; graph input
select_model_element_2 = DSModelElementSelection()  # 1 picked in the model; graph input
code_block_2 = CodeBlock { 5; }
views = Views("Ebene 0")  # graph input
firstItem = List.FirstItem(list=filterByBoolMask.in)
byElements = Custom[AngularDimension.ByElements](element1=select_model_element, element2=select_model_element_2, radius=code_block_2, view=views, dimensionType=firstItem)  # package Clockwork for Dynamo 2.x; Creates angular dimensions between elements. Only works in project environment. ATTENTION: Do NOT use in automatic mode.
watch = Watch(byElements)
