# Dynamo graph Revit.Elements.Array.dyn (Dynamo 2.0.1.5055)

element_types = ElementTypes(index=25)  # graph input
all_elements_of_type = ElementsOfType(element_type=element_types)
watch = Watch(all_elements_of_type)
associatedFamilyParameter = Custom[Array.AssociatedFamilyParameter](baseArray=watch)  # Returns the associated family parameter of an array label (if any). PLEASE NOTE: This node will only work in a family document!
watch_2 = Watch(associatedFamilyParameter.familyParameter)
watch_3 = Watch(associatedFamilyParameter.familyParameterName)
groupType = Custom[Array.GroupType](array=watch)  # Returns the group type of a given array
watch_4 = Watch(groupType)
