# Dynamo graph Revit.Elements.DesignOption.dyn (Dynamo 2.3.1.11775)
# packages: Clockwork for Dynamo 2.x 2.3.0

# group: INFO
# note: Run this script on the DesignOption_Sample model in the extra folder.

# group: Document.DesignOptions
designOptions = Custom[Document.DesignOptions]()  # package Clockwork for Dynamo 2.x; Returns all design options in the model, grouped by design option set
watch = Watch(designOptions.DesignOptions)

# group: DesignOption.DesignOptionSet
designOptionSet = Custom[DesignOption.DesignOptionSet](designOption=watch@L2)  # package Clockwork for Dynamo 2.x; Returns the design option set of a given design option
watch_2 = Watch(designOptionSet)

# group: DesignOption.IsPrimary
isPrimary = Custom[DesignOption.IsPrimary](designOption=watch@L2)  # package Clockwork for Dynamo 2.x; Determines whether a given design option is the primary option in its set
watch_3 = Watch(isPrimary)
