# Dynamo graph Revit.Elements.DetailComponent.dyn (Dynamo 2.0.1.5055)

# note: Run this file on the CreateStuff_Sample model in the extra folder.
code_block = CodeBlock { 7; }
byWidthLength = Rectangle.ByWidthLength(width=code_block, length=code_block)
explode = Geometry.Explode(geometry=byWidthLength)
family_types = FamilyTypes(index=17)  # graph input
views = Views(index=2)  # graph input
byCurve = Custom[DetailComponent.ByCurve](curve=explode, familyType=family_types, view=views)  # Places a line-based detail component in a given view
watch = Watch(byCurve)
