# Dynamo graph Revit.Elements.DetailCurve.dyn (Dynamo 2.0.1.5055)

# note: Run this file on the CreateStuff_Sample model in the extra folder.
code_block = CodeBlock { 5; }
byWidthLength = Rectangle.ByWidthLength(width=code_block, length=code_block)
explode = Geometry.Explode(geometry=byWidthLength)
views = Views(index=2)  # graph input
byCurve = Custom[DetailCurve.ByCurve+](curve=explode, view=views)  # Creates a detail line based on a given curve. Unlike the OOTB node it can also draw circles.
watch = Watch(byCurve)
