# Dynamo graph Revit.Elements.DirectShape.dyn (Dynamo 2.0.3.8810)

select_model_elements = DSModelElementsSelection()  # 13 picked in the model; graph input
watch = Watch(select_model_elements)
detail_level = DetailLevel(index=1)  # graph input
geometry = Custom[Element.Geometry+](element=watch, detailLevel=detail_level)  # Returns Dynamo AND native Revit geometry of a given element
watch_2 = Watch(geometry.revitGeometry)
string = StringInput("OST_GenericModel")
byName = Category.ByName(name=string)
element_name_universal = Custom[Element.Name (Universal)](element=watch)  # Gets an element's name. Unlike the OOTB node, this node should work for all Revit elements that have names and will also return the localized names of system parameters, parameter groups, display unit types, parameter types, unit symbol types and unit types.
count = List.Count(list=element_name_universal)
code_block = CodeBlock(name=element_name_universal, n=count) { name + "_" + (1..n); }
fromRevitGeometry = Custom[DirectShape.FromRevitGeometry](revitGeometry=watch_2, category=byName, name=code_block)  # Creates a DirectShape from native Revit geometry objects
watch_3 = Watch(fromRevitGeometry)
