# Dynamo graph Revit.Elements.DividedSurface.Query.dyn (Dynamo 1.0.0.1180)

# note: Run this graph on the DividedSurface_Sample model in the extra folder.
select_face = DSFaceSelection()  # 1 picked in the model
firstItem = List.FirstItem(select_face)
integer_slider = IntegerSlider(6, range=0..20 step 1)
byFaceAndUVDivisions = DividedSurface.ByFaceAndUVDivisions(firstItem, integer_slider, integer_slider)
end = Revit.Transaction.Transaction.End(byFaceAndUVDivisions)
boolean = BoolSelector(false)
evaluateGridNodes = Custom[DividedSurface.EvaluateGridNodes](dividedSurface=end, includeOverhangingNodes=boolean)  # Returns UV and XYZ coordinates as well as surface normals for all grid nodes of a given divided surface. Also returns the underlying face.
watch = Watch(evaluateGridNodes.UVs)
watch_2 = Watch(evaluateGridNodes.points)
watch_3 = Watch(evaluateGridNodes.normals)
watch_4 = Watch(evaluateGridNodes.surface)
