# Dynamo graph Revit.Elements.Element.Actions.dyn (Dynamo 1.3.1.1736)

select_model_element = DSModelElementSelection()  # 1 picked in the model
watch = Watch(select_model_element)
YAxis = Vector.YAxis()
number_slider = DoubleSlider(9.2, range=0..20 step 0.1)
scale = Vector.Scale(vector=YAxis, scale_factor=number_slider)
boolean = BoolSelector(true)
copyByVector = Custom[Element.CopyByVector](element=watch, vector=scale, rehostToClosestLevel=boolean)  # Copies an element or a list of elements by a given vector.
watch_2 = Watch(copyByVector)
levels = Levels("Level 2")
copyToLevel = Custom[Element.CopyToLevel](element=copyByVector, level=levels)  # Copies an element or a list of elements to a given level. Preserves the element's transform. PLEASE NOTE: This node only works for levels that have at least one view (e.g. floor plan) associated with them.
watch_3 = Watch(copyToLevel)
select_model_element_2 = DSModelElementSelection()  # 1 picked in the model
watch_4 = Watch(select_model_element_2)
select_model_element_3 = DSModelElementSelection()  # 1 picked in the model
watch_5 = Watch(select_model_element_3)
cutGeometry = Custom[Element.CutGeometry](elementToBeCut=watch_4, cuttingElement=watch_5)  # Adds a solid-solid cut for two model elements (if possible).
watch_6 = Watch(cutGeometry)
select_model_element_4 = DSModelElementSelection()  # 1 picked in the model
watch_7 = Watch(select_model_element_4)
joinGeometry = Custom[Element.JoinGeometry](element1=watch_4, element2=watch_7)  # Joins two model elements (if possible). Only works inside the project environment.
watch_8 = Watch(joinGeometry)
categories = Categories("Doors")
# note: Run this graph on the Actons_Sample model
all_elements_of_category = ElementsOfCategory(categories)
groupByHost = Custom[Elements.GroupByHost](elements=all_elements_of_category)  # Groups a list of Revit elements by their respective hosts (if they have any)
watch_9 = Watch(groupByHost.elementsGroupedByHost)
watch_10 = Watch(groupByHost.unhostedElements)
watch_11 = Watch(groupByHost.hosts)
string = StringInput("Material")
setMaterialParameterByCategory = Custom[Element.SetMaterialParameterByCategory](element=watch_4, materialParameterName=string)  # Sets a material parameter of a given element to <By Category>
watch_12 = Watch(setMaterialParameterByCategory.elements)
watch_13 = Watch(setMaterialParameterByCategory.success)
string_2 = StringInput("RenamedByDynamo")
setName = Custom[Element.SetName](element=watch_5, name=string_2)  # Gets the name of a given Revit element
watch_14 = Watch(setName.element)
watch_15 = Watch(setName.success)
worksets = Custom[Document.Worksets]()  # Returns all Worksets in the current document
firstItem = List.FirstItem(worksets)
setWorkset = Custom[Element.SetWorkset](workset=firstItem, element=watch)  # Sets the workset of a given element
watch_16 = Watch(setWorkset.elements)
watch_17 = Watch(setWorkset.success)
name = Custom[Element.Name+](element=firstItem)  # Gets an element's name (Dynamo's built-in Name nodes don't work for all element types, e.g. worksets...)
watch_18 = Watch(name)
categories_2 = Categories("Lines")
all_elements_of_category_2 = ElementsOfCategory(categories_2)
categories_3 = Categories("CurvesThinLines")
setSubCategory = Custom[Element.SetSubCategory](elements=all_elements_of_category_2, subCategory=categories_3)  # Assigns the given element(s) to the specified subcategory. The node should work for all geometry and curve elements. In some cases the GraphicsStyleType (Cut or Projection) needs to be specified.
watch_19 = Watch(setSubCategory.elements)
watch_20 = Watch(setSubCategory.success)
