# Dynamo graph Revit.Elements.Element.Query.dyn (Dynamo 2.12.0.5650)
# packages: Clockwork for Dynamo 2.x 2.3.0

string = StringInput("OST_Windows")
string_2 = StringInput("OST_Walls")
list_create = List.Create(item0=string, item1=string_2)
all_elements_of_category = Custom[All Elements Of Category+](category=list_create)  # package Clockwork for Dynamo 2.x; Gets all placed elements of a given category in the model.
watch = Watch(all_elements_of_category)

# group: Element.AllInstances
allInstances = Custom[Element.AllInstances](element=watch@L2)  # package Clockwork for Dynamo 2.x; Retrieves all instances of a given element
watch_2 = Watch(allInstances)

# group: INPUTS
pick_level_for_selection = Levels("Level 1")  # graph input
min_transparency_percentage = DoubleSlider(30, range=0..100 step 0.1)  # graph input
element_geometry_detail_level = DetailLevel("Coarse")  # graph input
element_geometry_include = BoolSelector(false)  # "Element Geometry: Include Invisible Objects"; graph input
element_geometry_return_geometry = BoolSelector(false)  # "Element Geometry: Return Geometry Without Inserts"; graph input

# group: Element.AllInstancesAtLevel
allInstancesAtLevel = Custom[Element.AllInstancesAtLevel](element=watch@L2, level=pick_level_for_selection)  # package Clockwork for Dynamo 2.x; Retrieves all instances of an element on a given level
watch_3 = Watch(allInstancesAtLevel)

string_3 = StringInput("Dimension")
byName = Custom[ElementType.ByName](name=string_3)  # package Clockwork for Dynamo 2.x; Retrieves an element type by its name - to be used with the OOTB node "All Elements of Type".
all_elements_of_type = ElementsOfType(element_type=byName)
watch_4 = Watch(all_elements_of_type)
views = Views()  # nothing selected; graph input
# note: Only works for annotation elements
allViewDependentInstances = Custom[Element.AllViewDependentInstances](element=watch_4@L2, view=views)  # package Clockwork for Dynamo 2.x; Retrieves all instances of a view-dependent element in a given view
watch_5 = Watch(allViewDependentInstances)
string_4 = StringInput("OST_Rooms")
all_elements_of_category_2 = Custom[All Elements Of Category+](category=string_4)
watch_6 = Watch(all_elements_of_category_2)
# note: Only works for rooms, areas and zones
area = Custom[Element.Area](element=watch_6@L2)  # package Clockwork for Dynamo 2.x; Returns the area property of a given element (if that element has such a property)
watch_7 = Watch(area)
string_5 = StringInput("""Extrusion
Blend
Sweep
Revolution
SweptBlend""")
string_6 = StringInput("\n")
split = String.Split(string=string_5, separator0=string_6)
byName_2 = Custom[ElementType.ByName](name=split)
all_elements_of_type_2 = ElementsOfType(element_type=byName_2)
flatten = List.Flatten(list=all_elements_of_type_2)
# note: Will only return results when run inside a parametric family
associatedFamilyParameters = Custom[Element.AssociatedFamilyParameters](element=flatten)  # package Clockwork for Dynamo 2.x; Returns the associated family parameters of an element in a family (and the respective element parameters). PLEASE NOTE: This node will only work in a family document!
watch_8 = Watch(associatedFamilyParameters.elementParameters)
watch_9 = Watch(associatedFamilyParameters.associatedFamilyParameters)
watch_10 = Watch(associatedFamilyParameters.elementParameterNames)
watch_11 = Watch(associatedFamilyParameters.associatedFamilyParameterNames)

# group: Element.ContainsTransparentMaterials
containsTransparentMaterials = Custom[Element.ContainsTransparentMaterials](element=watch@L2, minTransparencyPercentage=min_transparency_percentage)  # package Clockwork for Dynamo 2.x; Checks if a given element contains transparent materials.
watch_12 = Watch(containsTransparentMaterials)

# group: Element.ElevationOfHostLevel
elevationOfHostLevel = Custom[Element.ElevationOfHostLevel](element=watch@L2)  # package Clockwork for Dynamo 2.x; Returns the elevation of the level a given element is associated with
watch_13 = Watch(elevationOfHostLevel)

string_7 = StringInput("AssemblyCodeTable")
byName_3 = Custom[ElementType.ByName](name=string_7)
all_elements_of_type_3 = ElementsOfType(element_type=byName_3)
externalFileReferencePath = Custom[Element.ExternalFileReferencePath](element=all_elements_of_type_3)  # package Clockwork for Dynamo 2.x; Returns the full path of an element's external file reference as as string
watch_14 = Watch(externalFileReferencePath)
host = Custom[Element.Host+](element=watch@L2)  # package Clockwork for Dynamo 2.x; Gets an element's host. Unlike the OOTB node FamilyInstance.GetHost it not only works for family instances but also for elements like wall sweeps, foundations, railings, builing pads and topo subregions.
watch_15 = Watch(host)
ID = Custom[Element.ID+](element=watch@L2)  # package Clockwork for Dynamo 2.x; Gets the ID of a given Revit elements. Unlike the OOTB Element.Id node, this node also works on mixed lists of Revit elements and categories.
watch_16 = Watch(ID)
boolean = BoolSelector(true)  # graph input
inserts = Custom[Element.Inserts](element=watch@L2, includeOpenings=boolean, includeShadows=boolean, includeEmbeddedWalls=boolean, includeSharedEmbeddedInserts=boolean)  # package Clockwork for Dynamo 2.x; Gets all the objects inserted into a given element.
watch_17 = Watch(inserts)
isRelatedToMass = Custom[Element.IsRelatedToMass](element=watch@L2)  # package Clockwork for Dynamo 2.x; Returns true if an object (wall, roof, floor or curtain system) has been modelled by face and the underlying mass still exists in the project.
watch_18 = Watch(isRelatedToMass)
level = Custom[Element.Level](element=watch@L2)  # package Clockwork for Dynamo 2.x; Gets an element's level
watch_19 = Watch(level)
location = Custom[Element.Location](element=watch@L2)  # package Clockwork for Dynamo 2.x; Returns the location of an element as point, curve or curve loop, along with some booleans to help filtering the results. Unlike the OOTB Element.GetLocation node, it also retunrs sketch lines of sketch-based elements like floor slabs as well as the element's rotation property.
watch_20 = Watch(location.points)
watch_21 = Watch(location.isPoint)
watch_22 = Watch(location.curves)
watch_23 = Watch(location.isCurve)
watch_24 = Watch(location.hasLocation)
watch_25 = Watch(location.curveEndpoints)
boolean_2 = BoolSelector(false)  # graph input
materials = Custom[Element.Materials](element=watch@L2, returnPaintMaterials=boolean_2)  # package Clockwork for Dynamo 2.x; Retrieves all materials from a given element. Unlike the OOTB node Element.GetMaterials, it also retrieves QTO information.
watch_26 = Watch(materials.materials)
watch_27 = Watch(materials.hasMaterial)
watch_28 = Watch(materials.materialVolumes)
watch_29 = Watch(materials.materialAreas)
name = Custom[Element.Name+](element=watch@L2)  # package Clockwork for Dynamo 2.x; Gets an element's name. Unlike the OOTB node, this node should work for all Revit elements that have names and will also return the localized names of system parameters, parameter groups, display unit types, parameter types, unit symbol types and unit types.
watch_30 = Watch(name)
# note: Only works with annotation elements
ownerView = Custom[Element.OwnerView](element=watch_4@L2)  # package Clockwork for Dynamo 2.x; Gets the owner view of a given Revit element (if possible)
watch_31 = Watch(ownerView)
boolean_3 = BoolSelector(true)
panels = Custom[Element.Panels](hostElement=watch@L2, organizeInRows=boolean_3)  # package Clockwork for Dynamo 2.x; Retrieves the panels nested in a curtain wall, curtain system or glazed roof. Differences to OOTB node CurtainPanel.ByElement: - Returns embedded walls - Panels of curtain systems and glazed roofs are returned in a nested list, with one sublist for each face of the curtain system. PLEASE NOTE: Will not work for glazed roofs created by RoofByFace method.
watch_32 = Watch(panels)
string_8 = StringInput("Width")  # graph input
parameterExists = Custom[Element.ParameterExists](param=string_8, element=watch@L2)  # package Clockwork for Dynamo 2.x; Checks if an element contains a parameter of a given name
watch_33 = Watch(parameterExists)
phases = Custom[Element.Phases](element=watch@L2)  # package Clockwork for Dynamo 2.x; Gets the created and demolished phases of an element
watch_34 = Watch(phases.Created)
watch_35 = Watch(phases.Demolished)

# group: Element.ElementType+
elementType = Custom[Element.ElementType+](element=watch@L2)  # package Clockwork for Dynamo 2.x; Gets the family type of a given element (if applicable). Unlike the OOTB node, it also works for elements in linked models.
watch_36 = Watch(elementType)

workset = Custom[Element.Workset](element=watch@L2)  # package Clockwork for Dynamo 2.x; Retrieves the workset of a given element
watch_37 = Watch(workset)
watch_38 = Watch(location.hasRotation)
watch_39 = Watch(location.angle)

# group: Element.Geometry+
geometry = Custom[Element.Geometry+](element=watch@L2, detailLevel=element_geometry_detail_level, includeInvisibleObjects=element_geometry_include, returnGeometryWithoutInserts=element_geometry_return_geometry)  # package Clockwork for Dynamo 2.x; Returns Dynamo AND native Revit geometry of a given element
watch_40 = Watch(geometry.dynamoGeometry)
watch_41 = Watch(geometry.revitGeometry)
watch_42 = Watch(geometry.subCategory)

# group: Element.Category+
category = Custom[Element.Category+](element=watch@L2)  # package Clockwork for Dynamo 2.x; Returns the category of a given element. Unlike the OOTB node Element.GetCategory, it will work for subcategories, families, family documents, schedules, graphics styles and view filters as well.
watch_43 = Watch(category.category)
watch_44 = Watch(category.builtInCategory)

watch_45 = Watch(location.hasMulipleCurves)
watch_46 = Watch(location.mulipleCurves)
string_9 = StringInput("OST_Stairs")
all_elements_of_category_3 = Custom[All Elements Of Category+](category=string_9)
watch_47 = Watch(all_elements_of_category_3)
subComponents = Custom[Element.SubComponents](element=watch_47@L2)  # package Clockwork for Dynamo 2.x; Retrieves all subcomponents of a given family instance
watch_48 = Watch(subComponents)
superComponent = Custom[Element.SuperComponent](element=watch_48@@L2)  # package Clockwork for Dynamo 2.x; Retrieves the supercomponent of a given family instance, hand rail, top rail, stair component or beam in a beam system.
watch_49 = Watch(superComponent)
curtainGridLines = Custom[Element.CurtainGridLines](hostElement=watch@L2)  # package Clockwork for Dynamo 2.x; Retrieves the grid lines of curtain walls, curtain systems or glazed roofs.
watch_50 = Watch(curtainGridLines.uGridLines)
watch_51 = Watch(curtainGridLines.vGridLines)
byName_4 = Category.ByName(name=string_2)
isOfCategory = Custom[Element.IsOfCategory](element=watch@L2, category=byName_4)  # package Clockwork for Dynamo 2.x; Checks whether an element is of a specified category
watch_52 = Watch(isOfCategory)

# group: Element.DependentElements
dependentElements = Custom[Element.DependentElements](element=watch@L2)  # package Clockwork for Dynamo 2.x; Returns all elements that, from a logical point of view, are the children of this element.
watch_53 = Watch(dependentElements)
