# Dynamo graph Revit.Elements.ElevationMarker.dyn (Dynamo 2.0.3.8810)

string = StringInput("ElevationMarker")
byName = Custom[ElementType.ByName](name=string)  # Retrieves an element type by its name - to be used with the OOTB node "All Elements of Type".
all_elements_of_type = ElementsOfType(element_type=byName)
views = Custom[ElevationMarker.Views](elevationMarker=all_elements_of_type)  # Retrieves all views referenced by a given elevation marker
watch = Watch(views)
