# Dynamo graph Revit.Elements.FamilyInstance.Actions.dyn (Dynamo 2.0.1.5055)

select_model_elements = DSModelElementsSelection()  # 2 picked in the model; graph input
flipFacingOrientation = Custom[FamilyInstance.FlipFacingOrientation](familyInstance=select_model_elements)  # Flips the facing orientation of a given family instance
watch = Watch(flipFacingOrientation.familyInstance)
select_model_elements_2 = DSModelElementsSelection()  # 3 picked in the model; graph input
flipHandOrientation = Custom[FamilyInstance.FlipHandOrientation](familyInstance=select_model_elements_2)  # Flips the hand orientation of a given family instance
watch_2 = Watch(flipHandOrientation.familyInstance)
family_types = FamilyTypes(index=1)  # graph input
setType = Custom[FamilyInstance.SetType](familyInstance=select_model_elements, familyType=family_types)  # Changes the family type of a given family instance to the specified type
watch_3 = Watch(setType.familyInstance)
select_model_elements_3 = DSModelElementsSelection()  # 2 picked in the model; graph input
levels = Levels(index=1)  # graph input
setLevel = Custom[FamilyInstance.SetLevel](familyInstance=select_model_elements_3, level=levels)  # Sets the level property of a family instance. Family instance will move accordingly.
watch_4 = Watch(setLevel.familyInstance)
watch_5 = Watch(setLevel.success)
views = Views(index=0)  # graph input
phase = Custom[View.Phase](view=views)  # Returns the phase of a given view
rooms = Custom[Door.Rooms](door=select_model_elements_2, phase=phase)  # Gets the rooms that are connected by a given door
watch_6 = Watch(rooms.fromRoom)
watch_7 = Watch(rooms.toRoom)
passthrough = Custom[Passthrough](passThrough=select_model_elements_2, waitFor=rooms.toRoom)  # Forces a sequential order of execution. The node wired into the output of the Passthrough node will be executed *after* the node wired into the waitFor input (e.g. important for some Revit operations). The value of the passThrough input will be passed on to the node wired into the output port of the Passthrough node.
flipFromToRoom = Custom[FamilyInstance.FlipFromToRoom](familyInstance=passthrough)  # Flips the settings of "From Room" and "To Room" for any given door or window instance.
rooms_2 = Custom[Door.Rooms](door=flipFromToRoom.familyInstance, phase=phase)
watch_8 = Watch(rooms_2.fromRoom)
watch_9 = Watch(rooms_2.toRoom)
select_model_element = DSModelElementSelection()  # 1 picked in the model; graph input
select_model_element_2 = DSModelElementSelection()  # 1 picked in the model; graph input
# note: Run this graph on the Actions_Sample model
addCoping = Custom[FamilyInstance.AddCoping](familyInstance=select_model_element, cuttingElement=select_model_element_2)  # Adds a coping (cut) to a steel beam
watch_10 = Watch(addCoping.familyInstance)
select_model_element_3 = DSModelElementSelection()  # 1 picked in the model; graph input
removeCoping = Custom[FamilyInstance.RemoveCoping](familyInstance=select_model_element_3, cuttingElementToBeRemoved=select_model_element_2)  # Removes a coping (cut) from a steel beam
watch_11 = Watch(removeCoping.familyInstance)
watch_12 = Watch(setType.success)
watch_13 = Watch(flipFacingOrientation.success)
watch_14 = Watch(flipHandOrientation.success)
watch_15 = Watch(addCoping.success)
watch_16 = Watch(removeCoping.success)
watch_17 = Watch(flipFromToRoom.success)
