# Dynamo graph Revit.Elements.FamilyInstance.Create.dyn (Dynamo 2.0.1.5055)

code_block = CodeBlock { 2; }
byWidthLength = Rectangle.ByWidthLength(width=code_block, length=code_block)
# note: Run this graph on the CreateStuff_Sample model
explode = Geometry.Explode(geometry=byWidthLength)
family_types = FamilyTypes(index=16)  # graph input
levels = Levels(index=0)  # graph input
byCurve = Custom[FamilyInstance.ByCurve](curve=explode, familyType=family_types, level=levels)  # Places a line-based family instance on a given level
watch = Watch(byCurve)
origin = Point.Origin()
family_types_2 = FamilyTypes(index=20)  # graph input
views = Views(index=2)  # graph input
byPointInView = Custom[FamilyInstance.ByPointInView](point=origin, familyType=family_types_2, view=views)  # Places a family instance at a given point in a given view (e.g. a detail component).
watch_2 = Watch(byPointInView)
