# Dynamo graph Revit.Elements.FamilyInstance.Query.dyn (Dynamo 2.0.1.5055)

element_types = ElementTypes(index=120)  # graph input
all_elements_of_type = ElementsOfType(element_type=element_types)
watch = Watch(all_elements_of_type)
subComponents = Custom[FamilyInstance.SubComponents](familyInstance=watch)  # Retrieves all subcomponents of a given family instance
watch_2 = Watch(subComponents)
watch_3 = Watch(watch_2)
superComponent = Custom[FamilyInstance.SuperComponent](familyInstance=watch_3@L2)  # Retrieves the supercomponent of a given family instance
watch_4 = Watch(superComponent)
handOrientation = Custom[FamilyInstance.HandOrientation](familyInstance=watch)  # Gets the hand orientation of a hosted object (e.g. a window or a door)
watch_5 = Watch(handOrientation)
copingElements = Custom[FamilyInstance.CopingElements](familyInstance=watch)  # Returns all elements used as coping cutters for a given element.
watch_6 = Watch(copingElements)
