# Dynamo graph Revit.Elements.FamilyParameter.dyn (Dynamo 2.0.4.12684)

boolean = BoolSelector(false)
familyParameters = Custom[FamilyDocument.FamilyParameters](toggle=boolean)  # Retrieves all family parameters from the active family document. PLEASE NOTE: This node will only work in a family document!
properties = Custom[FamilyParameter.Properties](familyParameter=familyParameters)  # Retrieves all properties of a given family parameter. PLEASE NOTE: This node will only work in a family document!
watch = Watch(properties.Name)
watch_2 = Watch(properties.CanBeAssignedAFormula)
watch_3 = Watch(properties.IsUserModfiable)
watch_4 = Watch(properties.AssociatedParameters)
watch_5 = Watch(properties.AssociatedElements)
watch_6 = Watch(properties.ParameterNamesInFormula)
watch_7 = Watch(properties.IsInstanceParameter)
watch_8 = Watch(properties.IsSharedParameter)
watch_9 = Watch(properties.IsReportingParameter)
watch_10 = Watch(properties.IsDeterminedByFormula)
watch_11 = Watch(properties.IsReadOnly)
watch_12 = Watch(properties.Formula)
watch_13 = Watch(properties.Type)
watch_14 = Watch(properties.StorageType)
watch_15 = Watch(properties.DisplayUnitType)
watch_16 = Watch(properties.UnitType)
watch_17 = Watch(properties.Group)
watch_18 = Watch(properties.GUID)
filterByBoolMask = List.FilterByBoolMask(list=familyParameters, mask=properties.IsInstanceParameter)
watch_19 = Watch(filterByBoolMask.in)
makeType = Custom[FamilyParameter.MakeType](familyParameter=watch_19)  # Converts an instance parameter to a type parameter. ATTENTION: Only works in a family document.
watch_20 = Watch(makeType.success)
watch_21 = Watch(filterByBoolMask.out)
makeInstance = Custom[FamilyParameter.MakeInstance](familyParameter=watch_21)  # Converts a type parameter to an instance parameter. ATTENTION: Only works in a family document.
watch_22 = Watch(makeInstance.success)
string_from_object = FromObject(obj=properties.StorageType)
code_block = CodeBlock(storagetype=string_from_object) { storagetype == "String"; }
filterByBoolMask_2 = List.FilterByBoolMask(list=familyParameters, mask=code_block)
firstItem = List.FirstItem(list=filterByBoolMask_2.in)
string = StringInput("\"Formula set by Dynamo\"")  # graph input
setFormula = Custom[FamilyParameter.SetFormula](familyParameter=firstItem, formula=string)  # Sets the formula for a given family parameter. ATTENTION: Will only work if family contains at least one family type.
watch_23 = Watch(setFormula.familyParameter)
watch_24 = Watch(setFormula.success)
familyTypes = Custom[FamilyDocument.FamilyTypes](toggle=boolean)  # Retrieves all family types from the active family document. PLEASE NOTE: This node will only work in a family document!
getValueByFamilyType = Custom[FamilyParameter.GetValueByFamilyType](familyParameter=familyParameters@L1, familyType=familyTypes)  # Returns the value of a family parameter for a given family type
watch_25 = Watch(getValueByFamilyType)
