# Dynamo graph Revit.Elements.FamilyType.dyn (Dynamo 2.0.3.8810)

string = StringInput("WallType")
byName = Custom[ElementType.ByName](name=string)  # Retrieves an element type by its name - to be used with the OOTB node "All Elements of Type".
# note: You can use the Sample Architecture Project (Basic) that ships with Revit to run this graph.
all_elements_of_type = ElementsOfType(element_type=byName)
watch = Watch(all_elements_of_type)
firstItem = List.FirstItem(list=watch)
compoundStructureLayers = Custom[FamilyType.CompoundStructureLayers](elementType=firstItem)  # Retrieves the compound layers of any layered family type (wall types, roof types, floor types etc.)
watch_2 = Watch(compoundStructureLayers.materials)
watch_3 = Watch(compoundStructureLayers.wraps)
watch_4 = Watch(compoundStructureLayers.layers)
watch_5 = Watch(compoundStructureLayers.isStructuralDeck)
watch_6 = Watch(compoundStructureLayers.isVariable)
watch_7 = Watch(compoundStructureLayers.isCore)
watch_8 = Watch(compoundStructureLayers.widths)
watch_9 = Watch(compoundStructureLayers.functions)
code_block = CodeBlock { "Duplicated by Dynamo"; }
duplicate = Custom[FamilyType.Duplicate](elementType=firstItem, name=code_block)  # Duplicates a family type
code_block_2 = CodeBlock { 1; }
string_2 = StringInput("OST_Materials")
all_elements_of_category = Custom[All Elements Of Category+](category=string_2)  # Gets all placed elements of a given category in the model.
code_block_3 = CodeBlock { "Aluminium"; }
boolean = BoolSelector(true)  # graph input
filterByName = Custom[Elements.FilterByName](elements=all_elements_of_category, searchString=code_block_3, ignoreCase=boolean)  # Retrieves those elements from a collection whose names match the search string
setCompoundLayerMaterial = Custom[FamilyType.SetCompoundLayerMaterial](familyType=duplicate, layerIndex=code_block_2, material=filterByName.first)  # Sets the material of a specified compound layer of a given family type (only applies to family types that have a compound structure, e.g. walls, floors etc.).
watch_10 = Watch(setCompoundLayerMaterial.success)
watch_11 = Watch(setCompoundLayerMaterial.familyType)
compoundStructureHasVariableLayer = Custom[FamilyType.CompoundStructureHasVariableLayer](familyType=firstItem)  # Checks if the compound structure of a given floor or roof type contains a variable layer.
watch_12 = Watch(compoundStructureHasVariableLayer)
watch_13 = Watch(duplicate)
code_block_4 = CodeBlock { 10; }
setCompoundLayerWidth = Custom[FamilyType.SetCompoundLayerWidth](familyType=duplicate, layerIndex=code_block_2, width=code_block_4)  # Sets the width of a specified compound layer of a given family type (only applies to family types that have a compound structure, e.g. walls, floors etc.).
watch_14 = Watch(setCompoundLayerWidth.familyType)
watch_15 = Watch(setCompoundLayerWidth.success)
familyName = Custom[FamilyType.FamilyName](familyType=all_elements_of_type)  # Returns the *family* name of a given family *type*
watch_16 = Watch(familyName)
function = Custom[FamilyType.Function](familyType=all_elements_of_type)  # Retrieves the Function property of a given family type (if it has that property)
watch_17 = Watch(function)
