# Dynamo graph Revit.Elements.FillPatternElement.dyn (Dynamo 2.0.3.8810)

element_types = ElementTypes(index=126)  # graph input
all_elements_of_type = ElementsOfType(element_type=element_types)
isSolidFill = Custom[FillPatternElement.IsSolidFill](fillPatternElement=all_elements_of_type)  # Checks if the given FillPatternElement is a solid fill
watch = Watch(isSolidFill)
watch_2 = Watch(all_elements_of_type)
filterByBoolMask = List.FilterByBoolMask(list=all_elements_of_type, mask=isSolidFill)
name = Custom[Element.Name+](element=filterByBoolMask.in)  # Gets an element's name. Unlike the OOTB node, this node should work for all Revit elements that have names and will also return the localized names of system parameters, parameter groups, display unit types, parameter types, unit symbol types and unit types.
watch_3 = Watch(name)
