# Dynamo graph Revit.Elements.FilledRegionType.dyn (Dynamo 2.0.3.8810)

string = StringInput("FilledRegionType")
byName = Custom[ElementType.ByName](name=string)  # Retrieves an element type by its name - to be used with the OOTB node "All Elements of Type".
all_elements_of_type = ElementsOfType(element_type=byName)
watch = Watch(all_elements_of_type)
fillPatterns = Custom[FilledRegionType.FillPatterns](filledRegionType=watch)  # Returns the fill pattern(s) of a given filled region type. In Revit versions prior to 2019 the background fill pattern will always return Null.
watch_2 = Watch(fillPatterns.foregroundFillPattern)
watch_3 = Watch(fillPatterns.backgroundFillPattern)
