# Dynamo graph Revit.Elements.Floor.dyn (Dynamo 2.12.0.5650)
# packages: Clockwork for Dynamo 2.x 2.3.0

# group: INFO
# note: Run this graph on the Floor_Sample file in the extra folder.

# group: INPUTS
select_face_for_subdivisions = DSFaceSelection()  # 1 picked in the model; graph input
subdivisions = IntegerSlider(11, range=0..20 step 1)  # graph input
select_floor_to_modify = DSModelElementSelection()  # 1 picked in the model; graph input
select_floor_to_reset = DSModelElementSelection()  # 1 picked in the model; graph input

firstItem = List.FirstItem(list=select_face_for_subdivisions)
fromFace = Custom[Grid.FromFace](surface=firstItem, U=subdivisions, V=subdivisions)  # package Clockwork for Dynamo 2.x; Returns UV coordinates, XYZ coordinates and normals for a face with UV subdivision

# group: Floor.SlabShapeByPoints
watch = Watch(fromFace.Points)
slabShapeByPoints = Custom[Floor.SlabShapeByPoints](points=watch, floor=select_floor_to_modify)  # package Clockwork for Dynamo 2.x; Transform a slab shape based on a list of Points
watch_2 = Watch(slabShapeByPoints.floor)
watch_3 = Watch(slabShapeByPoints.success)

# group: Floor.ResetSlabShape
resetSlabShape = Custom[Floor.ResetSlabShape](floor=select_floor_to_reset)  # package Clockwork for Dynamo 2.x; Resets the slabshape of a floor
watch_4 = Watch(resetSlabShape.floor)
watch_5 = Watch(resetSlabShape.success)

join = List.Join(list0=watch_2, list1=watch_4)

# group: Floor.SlabShapeHasBeenModified
watch_6 = Watch(join)
slabShapeHasBeenModified = Custom[Floor.SlabShapeHasBeenModified](floor=watch_6)  # package Clockwork for Dynamo 2.x; Checks if the shape of a floor slab has been modified with the shape editing tools
watch_7 = Watch(slabShapeHasBeenModified)
