# Dynamo graph Revit.Elements.FootingType.dyn (Dynamo 2.0.1.5055)

# note: Run this file on the FootingType_Sample model in the extra folder.
categories = Categories(index=172)  # graph input
all_elements_of_category = ElementsOfCategory(Category=categories)
elementType = Element.ElementType(element=all_elements_of_category)
watch = Watch(elementType)
breaksAtInserts = Custom[FootingType.BreaksAtInserts](footingType=watch)  # Determines whether a list of wall footing types break at inserts in their attached walls
watch_2 = Watch(breaksAtInserts)
