# Dynamo graph Revit.Elements.Grid.dyn (Dynamo 2.0.3.8810)

string = StringInput("OST_Grids")
# note: You can use the Sample Architecture Project (Basic) that ships with Revit to run this graph.
all_elements_of_category = Custom[All Elements Of Category+](category=string)  # Gets all placed elements of a given category in the model.
watch = Watch(all_elements_of_category)
plane = Custom[Grid.Plane](grid=watch)  # Retrieves the plane of a grid. Returns null for curved grid lines.
watch_2 = Watch(plane)
