# Dynamo graph Revit.Elements.Group.dyn (Dynamo 2.12.0.5650)
# packages: Clockwork for Dynamo 2.x 2.3.0

string = StringInput("Group")
byName = Custom[ElementType.ByName](name=string)  # package Clockwork for Dynamo 2.x; Retrieves an element type by its name - to be used with the OOTB node "All Elements of Type".
all_elements_of_type = ElementsOfType(element_type=byName)

# group: Group.Members
watch = Watch(all_elements_of_type)
members = Custom[Group.Members](group=watch)  # package Clockwork for Dynamo 2.x; Retrieves the members of a group
watch_2 = Watch(members)

# group: INPUTS
select_model_elements = DSModelElementsSelection()  # 5 picked in the model; graph input
group_name = StringInput("Trees")

# group: Group.FromElements
fromElements = Custom[Group.FromElements](elements=select_model_elements, groupName=group_name)  # package Clockwork for Dynamo 2.x; Creates a group from a list of Revit elements
watch_3 = Watch(fromElements.ungroupableElements)
watch_4 = Watch(fromElements.group)

boolean = BoolSelector(true)

# group: Group.Ungroup
ungroup = Custom[Group.Ungroup](group=watch_4, showUngroupedElements=boolean)  # package Clockwork for Dynamo 2.x; Ungroups a group and returns a boolean and the ungrouped elements. Returning the ungrouped elements can be turned off for two reasons: 1.) better performance when dealing with large numbers of groups. 2.) Circumventing a bug where DynamoRevit will fail to instantiate TextNote elements contained in detail groups when run on top of non-English Revit.
watch_5 = Watch(ungroup.ungroupedElements)
watch_6 = Watch(ungroup.success)

string_2 = StringInput("GroupType")
byName_2 = Custom[ElementType.ByName](name=string_2)
all_elements_of_type_2 = ElementsOfType(element_type=byName_2)

# group: GroupType.Groups
watch_7 = Watch(all_elements_of_type_2)
groups = Custom[GroupType.Groups](groupType=watch_7)  # package Clockwork for Dynamo 2.x; Returns all group instances of a given group type
watch_8 = Watch(groups)

deconstruct = List.Deconstruct(list=watch_8@L2)

# group: Group.IsMirrored
watch_9 = Watch(deconstruct.first)
watch_10 = Watch(deconstruct.rest)
isMirrored = Custom[Group.IsMirrored](referenceGroup=watch_9@L1, groupsToCheck=watch_10@L2)  # package Clockwork for Dynamo 2.x; Checks if a list of group instances have been mirrored. The reference group should usually be the first placed instance of the group (since that one has likely not been mirrored). The node will return null for group instances of other group types than the reference group as well as for group instances with excluded members. Furthermore, it will return null for *all* groups if the reference group itself has excluded members or if it doesn't contain any loadable families (since they are the only way of determining if the group instance has been mirrored). The node will likely report null for group instances where members have been excluded but subsequently been restored.
watch_11 = Watch(isMirrored)
