# Dynamo graph Revit.Elements.GroupType.dyn (Dynamo 2.0.1.5055)

element_types = ElementTypes(index=145)  # graph input
all_elements_of_type = ElementsOfType(element_type=element_types)
watch = Watch(all_elements_of_type)
groups = Custom[GroupType.Groups](groupType=watch)  # Returns all group instances of a given group type
watch_2 = Watch(groups)
