# Dynamo graph Revit.Elements.ImportInstance.dyn (Dynamo 2.0.3.8810)

string = StringInput("ImportInstance")
byName = Custom[ElementType.ByName](name=string)  # Retrieves an element type by its name - to be used with the OOTB node "All Elements of Type".
# note: Run this graph on the RevitLinkType_Sample model
all_elements_of_type = ElementsOfType(element_type=byName)
watch = Watch(all_elements_of_type)
isLinked = Custom[ImportInstance.IsLinked](importInstance=watch)  # Determines whether an ImportInstance is linked or not
watch_2 = Watch(isLinked)
