# Dynamo graph Revit.Elements.MassFloor.dyn (Dynamo 2.0.3.8810)

string = StringInput("OST_MassFloor")
all_elements_of_category = Custom[All Elements Of Category+](category=string)  # Gets all placed elements of a given category in the model.
# note: You can run this graph on the ModelByFace_Sample file in the extra folder.
watch = Watch(all_elements_of_category)
mass = Custom[MassFloor.Mass](massFloor=watch)  # Gets the mass a given mass floor belongs to
watch_2 = Watch(mass)
