# Dynamo graph Revit.Elements.Material.dyn (Dynamo 2.0.3.8810)

# note: You can use the Sample Architecture Project (Basic) that ships with Revit to run this graph.
string = StringInput("OST_Materials")
all_elements_of_category = Custom[All Elements Of Category+](category=string)  # Gets all placed elements of a given category in the model.
watch = Watch(all_elements_of_category)
firstItem = List.FirstItem(list=watch)
string_2 = StringInput("MyNewMaterial")  # graph input
duplicate = Custom[Material.Duplicate](material=firstItem, name=string_2)  # Duplicates a material
watch_2 = Watch(duplicate)
assets = Custom[Material.Assets](Material_var=watch)  # Retreives all assets from a given material
watch_3 = Watch(assets.AppearanceAsset)
watch_4 = Watch(assets.ThermalAsset)
watch_5 = Watch(assets.StructuralAsset)
