# Dynamo graph Revit.Elements.Part.dyn (Dynamo 2.0.3.8810)

# note: Run this graph on the Parts_Sample file in the extra folder.
string = StringInput("OST_Parts")
all_elements_of_category = Custom[All Elements Of Category+](category=string)  # Gets all placed elements of a given category in the model.
watch = Watch(all_elements_of_category)
sourceElement = Custom[Part.SourceElement](part=watch)  # Retrieves the element a given part was made from
watch_2 = Watch(sourceElement)
