# Dynamo graph Revit.Elements.Railing.dyn (Dynamo 2.0.4.12684)

select_model_elements = DSModelElementsSelection()  # 2 picked in the model
# note: Run this group with the CreateStuff sample model
getLocation = Element.GetLocation(element=select_model_elements)
string = StringInput("RailingType")
byName = Custom[ElementType.ByName](name=string)  # Retrieves an element type by its name - to be used with the OOTB node "All Elements of Type".
all_elements_of_type = ElementsOfType(element_type=byName)
firstItem = List.FirstItem(list=all_elements_of_type)
levels = Levels(index=0)
byPathTypeAndLevel = Custom[Railing.ByPathTypeAndLevel](curves=getLocation, railingType=firstItem, level=levels)  # Creates a railing based on a given path, railing type and level.
