# Dynamo graph Revit.Elements.RevisionCloud.dyn (Dynamo 2.0.3.8810)

string = StringInput("OST_StructuralColumns")
byName = Category.ByName(name=string)
all_elements_of_category = ElementsOfCategory(Category=byName)
create = List.Create(item0=all_elements_of_category)
watch = Watch(create)
string_2 = StringInput("Revision")
byName_2 = Custom[ElementType.ByName](name=string_2)  # Retrieves an element type by its name - to be used with the OOTB node "All Elements of Type".
all_elements_of_type = ElementsOfType(element_type=byName_2)
lastItem = List.LastItem(list=all_elements_of_type)
watch_2 = Watch(lastItem)
views = Views(index=20)  # graph input
# note: You can use the Sample Architecture Project (Basic) that ships with Revit to run this graph.
fromElements = Custom[RevisionCloud.FromElements](elements=watch, revision=watch_2, view=views)  # Create a revision cloud for a list of Revit elements
watch_3 = Watch(fromElements)
