# Dynamo graph Revit.Elements.RevitLinkType.dyn (Dynamo 2.0.1.5055)

# note: True = Unload
# False = Reload
unload_reload = BoolSelector(true)  # graph input
# note: Run this graph on the RevitLinkType_Sample model.
element_types = ElementTypes(index=261)  # graph input
all_elements_of_type = ElementsOfType(element_type=element_types)
watch = Watch(all_elements_of_type)
empty = List.Empty()
scopeIf = Custom[ScopeIf+](test=unload_reload, true_var=watch, false_var=empty)  # A (hopefully) more robust implementation of ScopeIf. Tests a single boolean and returns a value accordingly.
unload = Custom[RevitLinkType.Unload](revitLinkType=scopeIf)  # Unloads a Revit or IFC link
scopeIf_2 = Custom[ScopeIf+](test=unload_reload, true_var=empty, false_var=watch)
reload = Custom[RevitLinkType.Reload](revitLinkType=scopeIf_2)  # Reloads a Revit or IFC link.
# note: Alternatively, to reload from a different source connect this to the relaodFrom input of the RevitLinkType.Reload node.
file_path = Filename("No file selected.")  # graph input
