# Dynamo graph Revit.Elements.RoomSequence.dyn (Dynamo 2.0.1.5055)

# note: You can use the Sample Architecture Project (Basic) that ships with Revit to run this graph.
categories = Categories(index=393)  # graph input
all_elements_of_category = ElementsOfCategory(Category=categories)
builtInParameters = Custom[Document.BuiltInParameters]()  # List all the available BuiltInParameters
string = StringInput("ROOM_NUMBER")  # graph input
string_from_object = FromObject(obj=builtInParameters.BuiltInParameters)
eq = string == string_from_object
filterByBoolMask = List.FilterByBoolMask(list=builtInParameters.ParameterNames, mask=eq)
firstItem = List.FirstItem(list=filterByBoolMask.in)
code_block = CodeBlock()
# ---------- code_block.designscript (3 lines) ----------
// A sequence of room numbers
// of connected rooms
["201","202","203"];
# ----------------------------------------
contains = List.Contains(list=code_block)  # unwired: item
filterByParameterValueAndCondition = Custom[Elements.FilterByParameterValueAndCondition](elements=all_elements_of_category, param=firstItem, func=contains)
phases = Custom[Document.Phases]()  # Retrieves all phases in the active document in *chronological* order
string_2 = StringInput("Working Drawings")  # graph input
filterByName = Custom[Elements.FilterByName](elements=phases, searchString=string_2)  # Retrieves those elements from a collection whose names match the search string
toDoorSequence = Custom[RoomSequence.ToDoorSequence](rooms=filterByParameterValueAndCondition.in, phase=filterByName.first)  # Retrieves a sequence of doors connecting a given sequence of rooms (if possible)
watch = Watch(toDoorSequence)
