# Dynamo graph Revit.Elements.RoomTag.dyn (Dynamo 2.0.3.8810)

string = StringInput("OST_RoomTags")
byName = Category.ByName(name=string)
all_elements_of_category = ElementsOfCategory(Category=byName)
watch = Watch(all_elements_of_category)
room = Custom[RoomTag.Room](roomTag=watch)  # Returns the room of a given room tag
watch_2 = Watch(room)
string_2 = StringInput("FamilySymbol")
byName_2 = Custom[ElementType.ByName](name=string_2)  # Retrieves an element type by its name - to be used with the OOTB node "All Elements of Type".
all_elements_of_type = ElementsOfType(element_type=byName_2)
category = Custom[Element.Category+](element=all_elements_of_type)  # Returns the category of a given element. Unlike the OOTB node Element.GetCategory, it will work for subcategories, families, family documents, schedules, subcategories and graphics styles as well.
equals = List.Equals(objectA=category.category@L1, objectB=byName)
filterByBoolMask = List.FilterByBoolMask(list=all_elements_of_type, mask=equals)
watch_3 = Watch(filterByBoolMask.in)
firstItem = List.FirstItem(list=watch_3)
count = List.Count(list=watch)
ofRepeatedItem = List.OfRepeatedItem(item=firstItem, amount=count)
setType = Custom[RoomTag.SetType](roomTag=watch, roomTagType=ofRepeatedItem)  # Changes the family type of a given room tag to the specified type
watch_4 = Watch(setType.roomTag)
watch_5 = Watch(setType.success)
