# Dynamo graph Revit.Elements.Schema.dyn (Dynamo 2.0.4.12684)

schemas = Custom[Document.Schemas]()  # Retrieves all ExtensibleStorage Schemas from the current document
properties = Custom[Schema.Properties](schema=schemas)  # Retrieves all properties of a given ExtensibleStorage Schema
watch = Watch(properties.name)
watch_2 = Watch(properties.vendorID)
watch_3 = Watch(properties.writeAccessLevel)
watch_4 = Watch(properties.documentation)
watch_5 = Watch(properties.applicationGUID)
watch_6 = Watch(properties.readAccessLevel)
watch_7 = Watch(properties.GUID)
fields = Custom[Schema.Fields](schema=schemas@L1)  # Returns the fields of a given ExtensibleStorage Schema
watch_8 = Watch(fields)
properties_2 = Custom[SchemaField.Properties](schemaField=watch_8@L2)  # Retrieves the properties of a given ExtensibleStorage schema field
watch_9 = Watch(properties_2.name)
watch_10 = Watch(properties_2.documentation)
watch_11 = Watch(properties_2.containerType)
watch_12 = Watch(properties_2.subSchema)
watch_13 = Watch(properties_2.subSchemaGUID)
watch_14 = Watch(properties_2.valueType)
watch_15 = Watch(properties_2.unitType)
element_types = ElementTypes(index=244)
lastItem = List.LastItem(list=properties.GUID)
all_elements_of_type = Custom[All Elements of Type+](elementType=element_types, schemaGUID=lastItem)  # Gets all placed elements of a given element type in the model. Unlike the OOTB node, it works for virtually all element types.
lastItem_2 = List.LastItem(list=schemas)
extensibleStorageData = Custom[Element.ExtensibleStorageData](element=all_elements_of_type, schema=lastItem_2)  # Reads the extensible storage data of a given schema from an element
watch_16 = Watch(extensibleStorageData.data)
watch_17 = Watch(extensibleStorageData.fields)
