# Dynamo graph Revit.Elements.SharedParameterElement.dyn (Dynamo 2.0.3.8810)

string = StringInput("SharedParameterElement")
byName = Custom[ElementType.ByName](name=string)  # Retrieves an element type by its name - to be used with the OOTB node "All Elements of Type".
all_elements_of_type = ElementsOfType(element_type=byName)
GUID = Custom[SharedParameterElement.GUID](sharedParameterElement=all_elements_of_type)  # Returns the GUID of a shared parameter
watch = Watch(GUID)
