# Dynamo graph Revit.Elements.SpotElevation.dyn (Dynamo 2.0.1.5055)

origin = Point.Origin()
views = Views(index=2)  # graph input
XAxis = Vector.XAxis()
# note: Run this graph on the CreateStuff_Sample.rvt file
byPoint = Custom[SpotElevation.ByPoint](point=origin, view=views, bend=XAxis, end=XAxis)  # Places a spot elevation at a given point in a given view. May not work in all view types.
watch = Watch(byPoint)
