# Dynamo graph Revit.Elements.StructuralFoundation.dyn (Dynamo 2.0.3.8810)

# note: Run this graph on the StructuralFoundation_Sample file in the extra folder.
string = StringInput("OST_StructuralFoundation")
all_elements_of_category = Custom[All Elements Of Category+](category=string)  # Gets all placed elements of a given category in the model.
watch = Watch(all_elements_of_category)
kind = Custom[StructuralFoundation.Kind](structuralFoundation=watch)  # Retrieves the kind of a given structural foundation (isolated, wall, slab).
watch_2 = Watch(kind)
