# Dynamo graph Revit.Elements.Subcategory.dyn (Dynamo 2.0.1.5055)

categories = Categories(index=248)  # graph input
string = StringInput("SubcategoryCreatedByDynamo")  # graph input
# note: Run this graph in a family or project file and pick the correct category
byName = Custom[Subcategory.ByName](category=categories, name=string)  # Creates a new subcategory for a given element category in a *family document* (unless a subcategory of that name already exists - in that case it returns the existing subcategory)
watch = Watch(byName)
