# Dynamo graph Revit.Elements.TextElement.dyn (Dynamo 2.0.3.8810)

string = StringInput("ModelText")
# note: Run this graph on the TextElement_Sample model.
byName = Custom[ElementType.ByName](name=string)  # Retrieves an element type by its name - to be used with the OOTB node "All Elements of Type".
all_elements_of_type = ElementsOfType(element_type=byName)
watch = Watch(all_elements_of_type)
text = Custom[TextElement.Text](element=watch)  # Gets the text stored in a text element. Unlike the OOTB node TextNote.Text, this one works on ModelText as well.
watch_2 = Watch(text)
passthrough = Custom[Passthrough](passThrough=watch, waitFor=watch_2)  # Forces a sequential order of execution. The node wired into the output of the Passthrough node will be executed *after* the node wired into the waitFor input (e.g. important for some Revit operations). The value of the passThrough input will be passed on to the node wired into the output port of the Passthrough node.
code_block = CodeBlock { "This is the new text for all text nodes... :-)"; }
setText = Custom[TextElement.SetText](element=passthrough, text=code_block)  # Sets the text of a given text element. Unlike the OOTB node TextNote.SetText, this one works on ModelText as well.
watch_3 = Watch(setText.element)
text_2 = Custom[TextElement.Text](element=watch_3)
watch_4 = Watch(text_2)
