# Dynamo graph Revit.Elements.Topography.dyn (Dynamo 2.0.3.8810)

# note: You can use the Sample Architecture Project (Basic) that ships with Revit to run this graph.
string = StringInput("OST_Topography")
all_elements_of_category = Custom[All Elements Of Category+](category=string)  # Gets all placed elements of a given category in the model.
watch = Watch(all_elements_of_category)
isSubregion = Custom[Topography.IsSubregion](topography=watch)  # Filters out everything that is *not* a topo subregion. Needs Revit 2014 or newer to work.
watch_2 = Watch(isSubregion)
origin = Point.Origin()
XAxis = Vector.XAxis()
byOriginNormal = Plane.ByOriginNormal(origin=origin, normal=XAxis)
firstItem = List.FirstItem(list=watch)
intersectionWithPlane = Custom[Topography.IntersectionWithPlane](plane=byOriginNormal, topo=firstItem)  # Calculates the intersection of a toposurface and a plane
watch_3 = Watch(intersectionWithPlane.points)
watch_4 = Watch(intersectionWithPlane.nurbsCurveByPoints)
byCurve = ModelCurve.ByCurve(curve=watch_4)
watch_5 = Watch(intersectionWithPlane.nurbsCurveByControlPoints)
byCurve_2 = ModelCurve.ByCurve(curve=watch_5)
watch_6 = Watch(intersectionWithPlane.polyCurve)
