# Dynamo graph Revit.Elements.Wall.Actions.dyn (Dynamo 2.0.3.8810)

# note: You can use the Sample Architecture Project (Basic) that ships with Revit to run this graph.
string = StringInput("OST_Walls")
all_elements_of_category = Custom[All Elements Of Category+](category=string)  # Gets all placed elements of a given category in the model.
watch = Watch(all_elements_of_category)
flip = Custom[Wall.Flip](wall=watch)  # Flips the orientation of a given wall - DO ***NOT*** USE IN AUTOMATIC MODE
watch_2 = Watch(flip.wall)
watch_3 = Watch(flip.success)
