# Dynamo graph Revit.Elements.WallType.dyn (Dynamo 2.0.3.8810)

string = StringInput("WallType")
byName = Custom[ElementType.ByName](name=string)  # Retrieves an element type by its name - to be used with the OOTB node "All Elements of Type".
all_elements_of_type = ElementsOfType(element_type=byName)
# note: You can use the Sample Architecture Project (Basic) that ships with Revit to run this graph.
watch = Watch(all_elements_of_type)
kind = Custom[WallType.Kind](wallType=watch)  # Retrieves the wall kind of a given wall type
watch_2 = Watch(kind)
