# Dynamo graph Revit.Elements.Window.dyn (Dynamo 2.0.3.8810)

# note: You can use the Sample Architecture Project (Basic) that ships with Revit to run this graph.
string = StringInput("OST_Windows")
all_elements_of_category = Custom[All Elements Of Category+](category=string)  # Gets all placed elements of a given category in the model.
watch = Watch(all_elements_of_category)
phases = Custom[Document.Phases]()  # Retrieves all phases in the active document in *chronological* order
code_block = CodeBlock { "Working Drawings"; }
boolean = BoolSelector(true)  # graph input
filterByName = Custom[Elements.FilterByName](elements=phases, searchString=code_block, ignoreCase=boolean)  # Retrieves those elements from a collection whose names match the search string
watch_2 = Watch(filterByName.first)
rooms = Custom[Window.Rooms](window=watch, phase=watch_2)  # Gets the rooms that are connected by a given window
watch_3 = Watch(rooms.roomCount)
watch_4 = Watch(rooms.fromRoom)
watch_5 = Watch(rooms.toRoom)
