# Dynamo graph Revit.Selection.dyn (Dynamo 2.0.3.8810)

categories = Categories(index=377)  # graph input
# note: You can use the Sample Architecture Project (Basic) that ships with Revit to run this graph.
boolean = BoolSelector(false)  # graph input
all_families_of_category = Custom[All Families Of Category](category=categories, toggle=boolean)  # Gets all famiies of a given category in the model (does *not *work for system families)
watch = Watch(all_families_of_category)
all_family_types_of_category = Custom[All Family Types Of Category](category=categories, toggle=boolean)  # Gets all family types/symbols of a given category in the model.
watch_2 = Watch(all_family_types_of_category)
categories_2 = Categories(index=153)  # graph input
views = Views(index=20)  # graph input
all_view_dependent_family = Custom[All View-Dependent Family Instances Of Category](category=categories_2, view=views)  # Gets all view-dependent family instances in a given view for a given list of categories - useful for finding annotation elements
watch_3 = Watch(all_view_dependent_family)
select_face = DSFaceSelection()  # 1 picked in the model; graph input
watch_4 = Watch(select_face)
fromDynamoSurface = Custom[Element.FromDynamoSurface](DynamoSurface=watch_4)  # Returns the underlying Revit element of a given face
watch_5 = Watch(fromDynamoSurface)
fromDynamoSurface_2 = Custom[RevitFace.FromDynamoSurface](DynamoSurface=watch_4)  # Returns the underlying Revit face of a given surface
watch_6 = Watch(fromDynamoSurface_2)
fromDynamoSurface_3 = Custom[RevitFaceReference.FromDynamoSurface](DynamoSurface=watch_4)  # Returns the underlying Revit face reference of a given surface
watch_7 = Watch(fromDynamoSurface_3)
family_types = FamilyTypes(index=4)  # graph input
all_elements_of_family_type = Custom[All Elements of Family Type+](familyType=family_types, toggle=boolean)  # Unlike the built-in node, this node retrieves all placed instances of a given loadable *or* system family type
watch_8 = Watch(all_elements_of_family_type)
categories_3 = Categories(index=590)  # graph input
all_placed_family_types_of = Custom[All Placed Family Types of Category](category=categories_3)  # Retrieves all family types of a given category that have *placed* instances
watch_9 = Watch(all_placed_family_types_of)
code_block = CodeBlock { 1; }
byCoordinates = Point.ByCoordinates(z=code_block)
XAxis = Vector.XAxis()
all_intersecting_elements_of = Custom[All Intersecting Elements Of Category By Vector](category=categories_3, origin=byCoordinates, direction=XAxis, toggle=boolean)  # Finds all elements of a specified category that intersect with a list of vectors
watch_10 = Watch(all_intersecting_elements_of)
string = StringInput("Base Offset")  # graph input
code_block_2 = CodeBlock { -500; }
formula = Formula("x<y", y=code_block_2)  # unwired: x
filterByParameterValueAndCondition = Custom[Elements.FilterByParameterValueAndCondition](elements=watch_10, param=string, func=formula)  # Retrieves those elements from a collection whose parameter value matches the defined condition
watch_11 = Watch(filterByParameterValueAndCondition.out)
watch_12 = Watch(filterByParameterValueAndCondition.in)
code_block_3 = CodeBlock { "Timber"; }
boolean_2 = BoolSelector(true)  # graph input
filterByName = Custom[Elements.FilterByName](elements=watch_10, searchString=code_block_3, ignoreCase=boolean_2)  # Retrieves those elements from a collection whose names match the search string
watch_13 = Watch(filterByName.out)
watch_14 = Watch(filterByName.in)
watch_15 = Watch(filterByName.first)
uniqueId = Element.UniqueId(element=watch_10)
watch_16 = Watch(uniqueId)
byID = Custom[Element.ByID](ID_UniqueId_var_var=watch_16)  # Gets the Revit element(s) for a list of IDs (or a single ID). Optionally retrieves elements from linked documents as well.
watch_17 = Watch(byID)
string_2 = StringInput("wall")  # graph input
boolean_3 = BoolSelector(true)  # graph input
byName = Custom[BuiltInCategory.ByName](searchFor=string_2, ignoreCase=boolean_3)  # Looks up all the built-in categories based on a given name (or part of a name) of the category. Search is case-insensitive.
watch_18 = Watch(byName.BuiltInCategories)
watch_19 = Watch(byName.ElementIDs)
byName_2 = Custom[BuiltInParameter.ByName](searchFor=string_2, ignoreCase=boolean_3)  # Looks up all the built-in parameters based on a given name (or part of a name) of the parameters. Search is case-insensitive.
watch_20 = Watch(byName_2.BuiltInParameters)
watch_21 = Watch(byName_2.ElementIDs)
watch_22 = Watch(byName_2.ParameterNames)
select_model_element = DSModelElementSelection()  # 1 picked in the model; graph input
geometry = Element.Geometry(element=select_model_element)
centroid = Solid.Centroid(solid=geometry)
phases = Custom[Document.Phases]()  # Retrieves all phases in the active document in *chronological* order
string_3 = StringInput("Working Drawings")  # graph input
filterByName_2 = Custom[Elements.FilterByName](elements=phases, searchString=string_3)
atPointInPhase = Custom[Room.AtPointInPhase](point=centroid, phase=filterByName_2.first)  # Tries to retrieve a room element at the given location for the given phase.
watch_23 = Watch(atPointInPhase)
all_elements_of_category = ElementsOfCategory(Category=categories_3)
firstItem = List.FirstItem(list=all_elements_of_category)
all_intersecting_elements_of_2 = Custom[All Intersecting Elements of Category By BoundingBox](element=firstItem, category=categories_3)  # Finds all elements that intersect the bounding box of a given element
watch_24 = Watch(all_intersecting_elements_of_2)
watch_25 = Watch(byName.Categories)
code_block_4 = CodeBlock { "My awesome SelectionSet generated by Dynamo"; }
select_model_elements = DSModelElementsSelection()  # 127 picked in the model; graph input
byElements = Custom[SelectionSet.ByElements](Name=code_block_4, elements=select_model_elements)  # Creates a selection set of the given elements. Note that if a selection set of the given name already exists in the model, its contents will be replaced. Also, if the selection set is already applied as a view filter, the view filter will have to be manually updated in the visibility / graphic overrides. DO ***NOT*** USE IN AUTOMATIC MODE!
watch_26 = Watch(byElements)
elements = Custom[SelectionSet.Elements](selectionSet=watch_26)  # Retrieves all elements stored in a selection set
watch_27 = Watch(elements)
string_4 = StringInput("WallType")
byName_3 = Custom[ElementType.ByName](name=string_4)  # Retrieves an element type by its name - to be used with the OOTB node "All Elements of Type".
watch_28 = Watch(byName_3)
all_elements_of_category_2 = Custom[All Elements Of Category+](category=categories, toggle=boolean)  # Gets all placed elements of a given category in the model.
watch_29 = Watch(all_elements_of_category_2)
