# Dynamo graph Revit.Units.dyn (Dynamo 2.12.0.5650)
# packages: Clockwork for Dynamo 2.x 2.3.0

# group: INPUTS
value = DoubleSlider(35.9, range=0..100 step 0.1)  # graph input
select_unit_type = UnitTypes("Length")  # graph input

# group: UnitType.DisplayUnitType
displayUnitType = Custom[UnitType.DisplayUnitType](unitType=select_unit_type)  # package Clockwork for Dynamo 2.x; Retrieves the display unit type for a given unit type.
watch = Watch(displayUnitType.displayUnitType)
watch_2 = Watch(displayUnitType.unitSymbol)

# group: DisplayUnit.ToInternalUnit
toInternalUnit = Custom[DisplayUnit.ToInternalUnit](val=value, displayUnitType=watch)  # package Clockwork for Dynamo 2.x; Converts a value from a given display unit to Revit's internal unit
watch_3 = Watch(toInternalUnit)

# group: InternalUnit.ToDisplayUnit
toDisplayUnit = Custom[InternalUnit.ToDisplayUnit](val=value, displayUnitType=watch)  # package Clockwork for Dynamo 2.x; Converts a value from Revit's internal unit to a given display unit
watch_4 = Watch(toDisplayUnit)
