# Dynamo graph Revit.Views.Schedule.dyn (Dynamo 2.0.4.12684)

string = StringInput("ViewSchedule")
byName = Custom[ElementType.ByName](name=string)  # Retrieves an element type by its name - to be used with the OOTB node "All Elements of Type".
all_elements_of_type = ElementsOfType(element_type=byName)
keyScheduleParameterName = Custom[Schedule.KeyScheduleParameterName](schedule=all_elements_of_type)  # If the schedule is a key schedule, the node returns the name of the key schedule parameter.
watch = Watch(keyScheduleParameterName)
fields = Custom[Schedule.Fields](schedule=all_elements_of_type)  # Returns all fields of a schedule in the order in which they appear in the schedule. Unlike the OOTB node, it returns actual ScheduleField objects that can be further queried.
watch_2 = Watch(fields)
type = Custom[ScheduleField.Type](scheduleField=watch_2@L2)  # Returns the FieldType of a given ScheduleField
watch_3 = Watch(type)
