# Dynamo graph Revit.Views.Sheet.dyn (Dynamo 2.0.3.8810)

string = StringInput("OST_Sheets")
all_elements_of_category = Custom[All Elements Of Category+](category=string)  # Gets all placed elements of a given category in the model.
watch = Watch(all_elements_of_category)
schedules = Custom[Sheet.Schedules](sheet=watch)  # Returns all schedules placed on a specified sheet
watch_2 = Watch(schedules)
code_block = CodeBlock { 1..3; }
# note: You can use the Sample Architecture Project (Basic) that ships with Revit to run this graph.
string_from_object = FromObject(obj=code_block)
string_2 = StringInput("""A
B
C""")  # graph input
string_3 = StringInput("\n")  # graph input
split = String.Split(str=string_2, separater0=string_3)
placeholderByNumberAndName = Custom[Sheet.PlaceholderByNumberAndName](sheetNumber=string_from_object, sheetName=split)  # Creates placeholder sheets
watch_3 = Watch(placeholderByNumberAndName)
scale = Custom[Sheet.Scale](sheet=watch)  # Returns the scale of a given sheet
watch_4 = Watch(scale)
