# Dynamo graph Revit.Views.View3D.dyn (Dynamo 2.0.1.5055)

# note: You can use the Sample Architecture Project (Basic) that ships with Revit to run this graph.
views = Views(index=2)  # graph input
isLocked = Custom[View3D.IsLocked](view3d=views)  # Checks if a given view is locked
watch = Watch(isLocked)
