# Dynamo graph Revit.Views.ViewSheetSet.dyn (Dynamo 2.0.3.8810)

string = StringInput("ViewSheetSet")
byName = Custom[ElementType.ByName](name=string)  # Retrieves an element type by its name - to be used with the OOTB node "All Elements of Type".
all_elements_of_type = ElementsOfType(element_type=byName)
watch = Watch(all_elements_of_type)
views = Custom[ViewSheetSet.Views](viewsSheetSet=watch)  # Retrieves all the views/sheets in a given view/sheet set.
watch_2 = Watch(views)
