# Dynamo graph String.Generate.dyn (Dynamo 2.0.1.5055)

number = DoubleInput(78)
fromDecimal = Custom[Binary.FromDecimal](decimal=number)  # Converts a number to a string of its binary value
watch = Watch(fromDecimal)
toDecimal = Custom[Binary.ToDecimal](binary=watch)  # Converts a string of a binary number into a decimal value
watch_2 = Watch(toDecimal)
number_2 = DoubleInput(16750848)
fromDecimal_2 = Custom[Hex.FromDecimal](decimal=number_2)  # Converts a number to a string of its hexadecimal value
watch_3 = Watch(fromDecimal_2)
toDecimal_2 = Custom[Hex.ToDecimal](hex=watch_3)  # Converts a string of a hexadecimal value to a number
watch_4 = Watch(toDecimal_2)
string = StringInput("DYNAMO")
fromAlphanumeric = Custom[Morse.FromAlphanumeric](str=string)  # Converts an alphanumeric string to Morse code
watch_5 = Watch(fromAlphanumeric)
toAlphanumeric = Custom[Morse.ToAlphanumeric](str=watch_5)  # Converts a string in Morse code to alphanumeric
watch_6 = Watch(toAlphanumeric)
boolean = BoolSelector(false)  # graph input
fromNumber = Custom[Character.FromNumber](n=number, upperCase=boolean)  # Converts a number into a character (where 1 = A, 2 = B, ... , 27 = AA, 28 = AB etc.).
watch_7 = Watch(fromNumber)
toNumber = Custom[Character.ToNumber](str=watch_7)  # Converts an Excel-style character to a number (e.g. A = 1, AA = 27 etc.).
watch_8 = Watch(toNumber)
boolean_2 = BoolSelector(true)  # graph input
create = List.Create(item0=boolean_2, item1=boolean, item2=boolean, item3=boolean_2)
fromBooleans = Custom[Binary.FromBooleans](booleans=create)  # Creates a binary string from a list of booleans
watch_9 = Watch(fromBooleans)
toBooleans = Custom[Binary.ToBooleans](str=watch_9)  # Converst a binary string to a list of booleans
watch_10 = Watch(toBooleans)
string_2 = StringInput("1.32.4.342")
toInteger = Custom[VersionNumber.ToInteger](str=string_2)  # Converts a version number (e.g. a Dynamo version number) to an integer.
watch_11 = Watch(toInteger)
