# Dynamo graph String.Inspect.dyn (Dynamo 2.0.1.5055)

string = StringInput("[a-zA-Z]*berry")  # graph input
string_2 = StringInput("""Strawberry123
Raspberry456
Banana789
123Raspberry456""")  # graph input
string_3 = StringInput("\n")  # graph input
split = String.Split(str=string_2, separater0=string_3)
watch = Watch(split)
findRegularExpression = Custom[String.FindRegularExpression](RegEx=string, str=watch)  # Returns all occurences of a regular expression within a string (or list of strings). The syntax for regular expressions is explained at http://ironpython-test.readthedocs.org/en/latest/howto/regex.html
watch_2 = Watch(findRegularExpression)
containsRegularExpression = Custom[String.ContainsRegularExpression](RegEx=string, str=watch)  # Determines if a regular expression matches a string (or a list of strings) and returns a boolean value (or a list, depending on the input). The syntax for regular expressions is explained at http://ironpython-test.readthedocs.org/en/latest/howto/regex.html
watch_3 = Watch(containsRegularExpression)
startsWithRegularExpression = Custom[String.StartsWithRegularExpression](RegEx=string, str=watch)  # Determines if a string starts with the regular expression and returns a boolean value (or a list, depending on the input). The syntax for regular expressions is explained at http://ironpython-test.readthedocs.org/en/latest/howto/regex.html
watch_4 = Watch(startsWithRegularExpression)
