# Dynamo graph Revit.Elements.DesignOption.dyn (Dynamo 3.3.0.6316)
# author: Andreas Dieckmann
# Revit DesignOption nodes sample graph
# packages: Clockwork for Dynamo 2.x 2.12.2

# group: INFO
# note: Run this script on the DesignOption_Sample model in the extra folder.

# group: Document.DesignOptions
designOptions = Custom[Document.DesignOptions]()  # package Clockwork for Dynamo 2.x; Returns all design options in the model, grouped by design option set
watch = Watch(designOptions.DesignOptions)

# group: DesignOption.DesignOptionSet
designOptionSet = Custom[DesignOption.DesignOptionSet](designOption=watch@L2)  # package Clockwork for Dynamo 2.x; Returns the design option set of a given design option
watch_2 = Watch(designOptionSet)

# group: DesignOption.IsPrimary
isPrimary = Custom[DesignOption.IsPrimary](designOption=watch@L2)  # package Clockwork for Dynamo 2.x; Determines whether a given design option is the primary option in its set
watch_3 = Watch(isPrimary)

string = StringInput("OST_Walls")
byName = Category.ByName(name=string)
all_elements_of_category = ElementsOfCategory(Category=byName)

# group: Element.DesignOption
designOption = Custom[Element.DesignOption](element=all_elements_of_category)  # package Clockwork for Dynamo 2.x; Returns the design option to which the element belongs (if any).
watch_4 = Watch(designOption)
