# Dynamo graph Revit.Elements.Dimension.dyn (Dynamo 3.3.0.6316)
# author: Andreas Dieckmann
# Revit Dimension nodes sample graph
# packages: Clockwork for Dynamo 2.x 2.12.2

# group: INFO
# note: Run this file on the Dimension_Sample model in the extra folder.

string = StringInput("OST_Dimensions")
byName = Category.ByName(name=string)
all_elements_of_category = ElementsOfCategory(Category=byName)
watch = Watch(all_elements_of_category)

# group: Dimension.AssociatedFamilyParameter
associatedFamilyParameter = Custom[Dimension.AssociatedFamilyParameter](dimension=watch)  # package Clockwork for Dynamo 2.x; Returns the associated family parameter of a dimension label (if any). PLEASE NOTE: This node will only work in a family document!
watch_2 = Watch(associatedFamilyParameter.familyParameter)
watch_3 = Watch(associatedFamilyParameter.familyParameterName)

# group: Dimension.ReferencedElements
referencedElements = Custom[Dimension.ReferencedElements](dimension=watch)  # package Clockwork for Dynamo 2.x; Returns all elements that are referenced by a given dimension
watch_4 = Watch(referencedElements.elements)
watch_5 = Watch(referencedElements.linkInstances)
watch_6 = Watch(referencedElements.stableReferences)
