# Dynamo graph Revit.Elements.Enum.dyn (Dynamo 3.0.3.7597)
# author: Andreas Dieckmann
# Revit Enum nodes sample graph
# packages: Clockwork for Dynamo 2.x 2.6.0

# group: Document.Enums
enums = Custom[Document.Enums]()  # package Clockwork for Dynamo 2.x; Retrieves all Enums from the Revit API
watch = Watch(enums)

# group: Enum.Values
values = Custom[Enum.Values](enumName=watch)  # package Clockwork for Dynamo 2.x; Returns the keys and values of a given Revit Enum
watch_2 = Watch(values.values)
watch_3 = Watch(values.keys)
