# Dynamo graph Revit.Elements.GlobalParameter.dyn (Dynamo 2.12.1.8246)
# author: Andreas Dieckmann
# Revit GlobalParameter nodes sample graph
# packages: Clockwork for Dynamo 2.x 2.12.2

# group: INPUTS
global_parameter_name = StringInput("GP_Text")
formula_value = StringInput("\"Formula set by Dynamo\"")
select_model_elements = DSModelElementsSelection()  # 4 picked in the model
instance_parameter_name = StringInput("PP_Text")

findByName = GlobalParameter.FindByName(name=global_parameter_name)

# group: GlobalParameter.SetFormula
setFormula = Custom[GlobalParameter.SetFormula](globalParam=findByName, formula=formula_value)  # package Clockwork for Dynamo 2.x; Sets the formula of a global parameter
watch = Watch(setFormula.globalParam)
watch_2 = Watch(setFormula.success)

passthrough = Custom[Passthrough](passThrough=findByName, waitFor=watch)  # package Clockwork for Dynamo 2.x; Forces a sequential order of execution. The node wired into the output of the Passthrough node will be executed *after* the node wired into the waitFor input (e.g. important for some Revit operations). The value of the passThrough input will be passed on to the node wired into the output port of the Passthrough node.

# group: GlobalParameter.Formula
formula = Custom[GlobalParameter.Formula](globalParam=passthrough)  # package Clockwork for Dynamo 2.x; Returns the formula of a global parameter (if any)
watch_3 = Watch(formula)

string = StringInput("GlobalParameter")
byName = Custom[ElementClass.ByName](name=string)  # package Clockwork for Dynamo 2.x; Retrieves an element class by its name - to be used with the OOTB node "All Elements of Class".
all_elements_of_type = ElementsOfType(element_type=byName)
watch_4 = Watch(all_elements_of_type)

# group: GlobalParameter.AffectedElements
affectedElements = Custom[GlobalParameter.AffectedElements](globalParam=watch_4)  # package Clockwork for Dynamo 2.x; Returns the elements that have a parameter driven by the given global parameter
watch_5 = Watch(affectedElements)

# group: Element.AssociatedGlobalParameterByParameter
associatedGlobalParameterByParameter = Custom[Element.AssociatedGlobalParameterByParameter](element=select_model_elements, param=instance_parameter_name)  # package Clockwork for Dynamo 2.x; Returns the global parameter that drives a given parameter of an element
watch_6 = Watch(associatedGlobalParameterByParameter)

isNull = Object.IsNull(object=watch_6)
filterByBoolMask = List.FilterByBoolMask(list=select_model_elements, mask=isNull)

# group: Element.AssociateParameterWithGlobalParameter
associateParameterWithGlobalParameter = Custom[Element.AssociateParameterWithGlobalParameter](element=filterByBoolMask.in, elementParam=instance_parameter_name, globalParam=findByName)  # package Clockwork for Dynamo 2.x; Sets an element parameter to be driven by a global parameter
watch_7 = Watch(associateParameterWithGlobalParameter.success)
watch_8 = Watch(associateParameterWithGlobalParameter.element)

# group: Element.DissociateParameterFromGlobalParameter
dissociateParameterFromGlobalParameter = Custom[Element.DissociateParameterFromGlobalParameter](element=filterByBoolMask.out, elementParam=instance_parameter_name)  # package Clockwork for Dynamo 2.x; Dissociates an element parameter from the global parameter that is driving it
watch_9 = Watch(dissociateParameterFromGlobalParameter.element)
watch_10 = Watch(dissociateParameterFromGlobalParameter.success)
