# Dynamo graph Revit.Elements.RevitLinkType.dyn (Dynamo 3.3.0.6316)
# author: Andreas Dieckmann
# RevitLinkType nodes sample graph
# packages: Clockwork for Dynamo 2.x 2.12.0

# group: INFO
# note: Run this graph on the RevitLinkType_Sample model.

string = StringInput("RevitLinkType")
byName = Custom[ElementType.ByName](name=string)  # package Clockwork for Dynamo 2.x; Retrieves an element class by its name - to be used with the OOTB node "All Elements of Class".
all_elements_of_type = ElementsOfType(element_type=byName)

# group: RevitLinkType.AttachmentType
attachmentType = Custom[RevitLinkType.AttachmentType](revitLinkType=all_elements_of_type)  # package Clockwork for Dynamo 2.x; Returns the attachment type of a RevitLInkType
watch = Watch(attachmentType)

# group: RevitLinkType.PathType
pathType = Custom[RevitLinkType.PathType](revitLinkType=all_elements_of_type)  # package Clockwork for Dynamo 2.x; Returns the path type of a RevitLInkType
watch_2 = Watch(pathType)

# group: INPUTS
# note: True = Unload
# False = Reload
unload_reload = BoolSelector(false)  # graph input

empty = List.Empty()
if_ = RefactoredIf(test=unload_reload, true=all_elements_of_type, false=empty)

# group: RevitLinkType.Unload
unload = Custom[RevitLinkType.Unload](revitLinkType=if_)  # package Clockwork for Dynamo 2.x; Unloads a Revit or IFC link
watch_3 = Watch(unload.revitLinkType)
watch_4 = Watch(unload.success)

if_2 = RefactoredIf(test=unload_reload, true=empty, false=all_elements_of_type)

# group: RevitLinkType.Reload
reload = Custom[RevitLinkType.Reload](revitLinkType=if_2)  # package Clockwork for Dynamo 2.x; Reloads a Revit or IFC link.
watch_5 = Watch(reload.revitLinkType)
watch_6 = Watch(reload.success)

# group: RevitLinkType.IsNested
isNested = Custom[RevitLinkType.IsNested](revitLinkType=all_elements_of_type)  # package Clockwork for Dynamo 2.x; Returns whether a RevitLinkType is nested or not
watch_7 = Watch(isNested)
