# Dynamo graph Revit.Elements.Room.dyn (Dynamo 3.2.1.5366)
# author: Andreas Dieckmann
# Room nodes sample graph
# packages: Clockwork for Dynamo 2.x 2.6.0

# group: INFO
# note: You can use the Sample Architecture Project (Basic) that ships with Revit to run this graph.

string = StringInput("OST_Rooms")
all_elements_of_category = Custom[All Elements Of Category+](category=string)  # package Clockwork for Dynamo 2.x; Gets all placed elements of a given category in the model. Unlike the OOTB node it also supports linked models and a few more special categories (e.g. Legend Components).

# group: Room.Boundaries
boundaries = Custom[Room.Boundaries](room=all_elements_of_category)  # package Clockwork for Dynamo 2.x; Gets a list of all boundaries of a given room or area and a corresponding list of the elements that are generating those boundaries.
watch = Watch(boundaries.curves)
watch_2 = Watch(boundaries.elements)

# group: Room.State
state = Custom[Room.State](room=all_elements_of_category)  # package Clockwork for Dynamo 2.x; Returns the state of a room, i.e. is it placed, unplaced, redundant or not enclosed.
watch_3 = Watch(state)

# group: INPUTS
include_openings = BoolSelector(true)  # graph input
include_shadows = BoolSelector(true)  # graph input
include_embedded_walls = BoolSelector(true)  # graph input
include_shared_embedded_inserts = BoolSelector(true)  # graph input
phase_name = StringInput("Working Drawings")

# group: Room.InsertsOfBoundaries
insertsOfBoundaries = Custom[Room.InsertsOfBoundaries](room=all_elements_of_category, includeOpenings=include_openings, includeShadows=include_shadows, includeEmbeddedWalls=include_embedded_walls, includeSharedEmbeddedInserts=include_shared_embedded_inserts)  # package Clockwork for Dynamo 2.x; Retrieves the inserts of the bounding elements of a given room.
watch_4 = Watch(insertsOfBoundaries)

string_2 = StringInput("OST_Doors")

# group: Room.InsertsOfBoundariesByCategory
insertsOfBoundariesByCategory = Custom[Room.InsertsOfBoundariesByCategory](room=all_elements_of_category, category=string_2, includeOpenings=include_openings, includeShadows=include_shadows, includeEmbeddedWalls=include_embedded_walls, includeSharedEmbeddedInserts=include_shared_embedded_inserts)  # package Clockwork for Dynamo 2.x; Retrieves the inserts of the bounding elements of a given room - filtered by a given category.
watch_5 = Watch(insertsOfBoundariesByCategory)

code_block = CodeBlock { ["DummyRoom1","DummyRoom2","DummyRoom3"]; 1001..1003; }
string_from_object = FromObject(obj=code_block.out1)

# group: Room.UnplacedByNameAndNumber
unplacedByNameAndNumber = Custom[Room.UnplacedByNameAndNumber](names=code_block.out0, numbers=string_from_object)  # package Clockwork for Dynamo 2.x; Creates an unplaced room
watch_6 = Watch(unplacedByNameAndNumber)

# group: Room.Finishes
finishes = Custom[Room.Finishes](room=all_elements_of_category)  # package Clockwork for Dynamo 2.x; Returns all room bounding faces and their materials
watch_7 = Watch(finishes.finishMaterials)
watch_8 = Watch(finishes.areas)
watch_9 = Watch(finishes.faceTypes)
watch_10 = Watch(finishes.revitFaces)
watch_11 = Watch(finishes.elements)

# group: Element.Area
area = Custom[Element.Area](element=all_elements_of_category)  # package Clockwork for Dynamo 2.x; Returns the area property of a given spatial element (room, area or space)
watch_12 = Watch(area)

phases = Custom[Document.Phases]()  # package Clockwork for Dynamo 2.x; Retrieves all phases in the active document in *chronological* order
filterByName = Custom[Elements.FilterByName](elements=phases, searchString=phase_name)  # package Clockwork for Dynamo 2.x; Retrieves those elements from a collection whose names match the search string

# group: Room.Doors
doors = Custom[Room.Doors](room=all_elements_of_category, phase=filterByName.first)  # package Clockwork for Dynamo 2.x; Retrieves all doors that are associated with a room (hosted in walls and roofs).
watch_13 = Watch(doors)

flatten = List.Flatten(list=watch_13)
watch_14 = Watch(flatten)

# group: Door.Rooms
rooms = Custom[Door.Rooms](door=watch_14, phase=filterByName.first)  # package Clockwork for Dynamo 2.x; Gets the rooms that are connected by a given door
watch_15 = Watch(rooms.roomCount)
watch_16 = Watch(rooms.fromRoom)
watch_17 = Watch(rooms.toRoom)

# group: Room.Windows
windows = Custom[Room.Windows](room=all_elements_of_category, phase=filterByName.first)  # package Clockwork for Dynamo 2.x; Retrieves all windows that are associated with a room (hosted in walls and roofs).
watch_18 = Watch(windows)

flatten_2 = List.Flatten(list=watch_18)
watch_19 = Watch(flatten_2)

# group: Window.Rooms
rooms_2 = Custom[Window.Rooms](window=watch_19, phase=filterByName.first)  # package Clockwork for Dynamo 2.x; Gets the rooms that are connected by a given window
watch_20 = Watch(rooms_2.fromRoom)
watch_21 = Watch(rooms_2.toRoom)
watch_22 = Watch(rooms_2.roomCount)
