# Dynamo graph Revit.Elements.SpotCoordinate.dyn (Dynamo 3.3.0.6316)
# author: Andreas Dieckmann
# SpotCoordinate nodes sample graph
# packages: Clockwork for Dynamo 2.x 2.12.2

# group: INFO
# note: Run this graph on the CreateStuff_Sample.rvt file

origin = Point.Origin()
views = Views("Ebene 0")
XAxis = Vector.XAxis()

# group: SpotCoordinate.ByPoint
byPoint = Custom[SpotCoordinate.ByPoint](point=origin, view=views, bend=XAxis, end=XAxis)  # package Clockwork for Dynamo 2.x; Places a spot coordinate at a given point in a given view. May not work in all view types.
watch = Watch(byPoint)
