# Dynamo graph Revit.Elements.StructuralFoundation.dyn (Dynamo 2.12.1.8246)
# author: Andreas Dieckmann
# StructuralFoundation nodes sample graph
# packages: Clockwork for Dynamo 2.x 2.12.0

# group: INFO
# note: Run this graph on the StructuralFoundation_Sample file in the extra folder.

string = StringInput("OST_StructuralFoundation")
all_elements_of_category = Custom[All Elements Of Category+](category=string)  # package Clockwork for Dynamo 2.x; Gets all placed elements of a given category in the model. Unlike the OOTB node it also supports linked models and a few more special categories (e.g. Legend Components).

# group: StructuralFoundation.Kind
watch = Watch(all_elements_of_category)
kind = Custom[StructuralFoundation.Kind](structuralFoundation=watch)  # package Clockwork for Dynamo 2.x; Retrieves the kind of a given structural foundation (isolated, wall, slab).
watch_2 = Watch(kind)
