# Dynamo graph Revit.Elements.Subcategory.dyn (Dynamo 3.2.1.5366)
# author: Andreas Dieckmann
# Subcategory nodes sample graph
# packages: Clockwork for Dynamo 2.x 2.6.0

# group: INPUTS
pick_category = Categories("OST_DetailComponents")
subcategory_name = StringInput("SubcategoryCreatedByDynamo")  # graph input

# group: Subcategory.ByName
byName = Custom[Subcategory.ByName](category=pick_category, name=subcategory_name)  # package Clockwork for Dynamo 2.x; Creates a new subcategory for a given element category (unless a subcategory of that name already exists - in that case it returns the existing subcategory).
watch = Watch(byName)
