# Dynamo graph Revit.Units.dyn (Dynamo 3.2.1.5366)
# author: Andreas Dieckmann
# Units nodes sample graph
# packages: Clockwork for Dynamo 2.x 2.6.0

# group: INPUTS
value = DoubleSlider(35.9, range=0..100 step 0.1)  # graph input
select_unit_type = UnitTypes("Length")

# group: UnitType.DisplayUnitType
displayUnitType = Custom[UnitType.DisplayUnitType](unitType=select_unit_type)  # package Clockwork for Dynamo 2.x; Retrieves the display unit type for a given unit type.
watch = Watch(displayUnitType.displayUnitType)
watch_2 = Watch(displayUnitType.unitSymbol)

# group: DisplayUnit.ToInternalUnit
toInternalUnit = Custom[DisplayUnit.ToInternalUnit](val=value, displayUnitType=watch)  # package Clockwork for Dynamo 2.x; Converts a value from a given display unit to Revit's internal unit
watch_3 = Watch(toInternalUnit)

# group: InternalUnit.ToDisplayUnit
toDisplayUnit = Custom[InternalUnit.ToDisplayUnit](val=value, displayUnitType=watch)  # package Clockwork for Dynamo 2.x; Converts a value from Revit's internal unit to a given display unit
watch_4 = Watch(toDisplayUnit)

# group: Document.UnitTypes
unitTypes = Custom[Document.UnitTypes]()  # package Clockwork for Dynamo 2.x; Retrieves all available unit types of a given document (as of Revit 2022: ForgeTypeIds)
watch_5 = Watch(unitTypes)
name = Custom[Element.Name+](element=watch_5)  # package Clockwork for Dynamo 2.x; Gets an element's name. Unlike the OOTB node, this node should work for *all* Revit elements that have names and will also return the localized names of system parameters, parameter groups, display unit types, parameter types, unit symbol types, unit types and ForgeTypeIds.
watch_6 = Watch(name)
