# Dynamo graph Revit.Views.PlanView.dyn (Dynamo 3.2.1.5366)
# author: Andreas Dieckmann
# PlanView nodes sample graph
# packages: Clockwork for Dynamo 2.x 2.6.0

# group: INPUTS
pick_plan_view = Views("Level 1")

# group: PlanView.Underlay
underlay = Custom[PlanView.Underlay](planView=pick_plan_view)  # package Clockwork for Dynamo 2.x; Returns the underlay(s) of a given plan view
watch = Watch(underlay.baseUnderlay)
watch_2 = Watch(underlay.topUnderlay)
watch_3 = Watch(underlay.underlayOrientation)
