# Dynamo graph Revit.Views.Sheet.dyn (Dynamo 2.12.1.8246)
# author: Andreas Dieckmann
# Sheet nodes sample graph
# packages: Clockwork for Dynamo 2.x 2.12.2

code_block = CodeBlock { 1..3; }
string_from_object = FromObject(obj=code_block)
string = StringInput("""A
B
C""")  # graph input
string_2 = StringInput("\n")  # graph input
split = String.Split(string=string, separator0=string_2)

# group: Sheet.PlaceholderByNumberAndName
placeholderByNumberAndName = Custom[Sheet.PlaceholderByNumberAndName](sheetNumber=string_from_object, sheetName=split)  # package Clockwork for Dynamo 2.x; Creates placeholder sheets
watch = Watch(placeholderByNumberAndName)

string_3 = StringInput("OST_Sheets")
all_elements_of_category = Custom[All Elements Of Category+](category=string_3)  # package Clockwork for Dynamo 2.x; Gets all placed elements of a given category in the model. Unlike the OOTB node it also supports linked models and a few more special categories (e.g. Legend Components).
watch_2 = Watch(all_elements_of_category)

# group: Sheet.Scale
scale = Custom[Sheet.Scale](sheet=watch_2)  # package Clockwork for Dynamo 2.x; Returns the scale of a given sheet
watch_3 = Watch(scale)
