# Dynamo graph Revit.Views.ViewSheetSet.dyn (Dynamo 3.3.0.6316)
# author: Andreas Dieckmann
# ViewSheetSet nodes sample graph
# packages: Clockwork for Dynamo 2.x 2.12.2

string = StringInput("ViewSheetSet")
byName = Custom[ElementType.ByName](name=string)  # package Clockwork for Dynamo 2.x; Retrieves an element class by its name - to be used with the OOTB node "All Elements of Class".
all_elements_of_type = ElementsOfType(element_type=byName)

# group: ViewSheetSet.Views
watch = Watch(all_elements_of_type)
views = Custom[ViewSheetSet.Views](viewsSheetSet=watch)  # package Clockwork for Dynamo 2.x; Retrieves all the views/sheets in a given view/sheet set.
watch_2 = Watch(views)
