# Dynamo graph Script.ControlFlow.dyn (Dynamo 2.12.1.8246)
# author: Andreas Dieckmann
# ControlFlow nodes sample graph
# packages: Clockwork for Dynamo 2.x 2.12.0

code_block = CodeBlock { 1; 4; }
list_create = List.Create(item0=code_block.out1)
list_create_2 = List.Create(item0=code_block.out0)

# group: ReturnListOrSingleValue
watch = Watch(code_block.out0)
watch_2 = Watch(list_create)
returnListOrSingleValue = Custom[ReturnListOrSingleValue](unknownItem=watch, seq=watch_2)  # package Clockwork for Dynamo 2.x; If the unknown item is not a list but rather a single item, only the first item of the list (input "seq") will be returned.
watch_3 = Watch(returnListOrSingleValue)
watch_4 = Watch(list_create_2)
returnListOrSingleValue_2 = Custom[ReturnListOrSingleValue](unknownItem=watch_4, seq=watch_2)
watch_5 = Watch(returnListOrSingleValue_2)

boolean = BoolSelector(false)  # graph input
code_block_2 = CodeBlock { "This is a test."; }
sendTo = Custom[Clipboard.SendTo](str=code_block_2)  # package Clockwork for Dynamo 2.x; Copies a string to the clipboard.

# group: Passthrough
passthrough = Custom[Passthrough](passThrough=boolean, waitFor=sendTo)  # package Clockwork for Dynamo 2.x; Forces a sequential order of execution. The node wired into the output of the Passthrough node will be executed *after* the node wired into the waitFor input (e.g. important for some Revit operations). The value of the passThrough input will be passed on to the node wired into the output port of the Passthrough node.

getFrom = Custom[Clipboard.GetFrom](toggle=passthrough)  # package Clockwork for Dynamo 2.x; Gets the content of the clipboard. ATTENTION: Will only work with strings.
watch_6 = Watch(getFrom)
code_block_3 = CodeBlock { 2..6; 1..4; "A".."D"; "E"; }

# group: Switch
switch = Custom[Switch](Check=code_block_3.out0, Cases=code_block_3.out1, Values=code_block_3.out2, Default=code_block_3.out3)  # package Clockwork for Dynamo 2.x; Emulates the Switch/Case statement that is available in multiple programming languages.
watch_7 = Watch(switch)
