# Dynamo graph AlmostZero.dyn (Dynamo 0.6.3.5260)

xyz_distance = XyzDistance(lacing=Longest)
# note: This example needs the Select By Category, Hoste Object Stuff and Wall Stuff packages to be installed.
builtincategory_windows = Custom[BuiltInCategory Windows]()  # Returns the BuiltInCategory Windows
get_family_instances_by_category = Custom[Get Family Instances By Category](BuiltInCategories=builtincategory_windows)  # Gets all family instances in the model for a given list of categories
get_hosted_object_orientation = Custom[Get Hosted Object Orientation](element_s=get_family_instances_by_category)  # Gets the orientation of a hosted object (e.g. a window or a door - orientation always facing towards exterior)
get_host = Custom[Get Host](element_s=get_family_instances_by_category)  # Gets an element's host
get_wall_orientation = Custom[Get Wall Orientation](Wall_Instance_s=get_host)  # Gets the orientation of a given wall instance (normal of the exterior face of the wall). Will *not* work for walls hosted on mass faces or in-place walls.
combine = Combine(xyz_distance, get_hosted_object_orientation, get_wall_orientation)
watch = Watch(combine)
watch_2 = Watch(get_wall_orientation)
watch_3 = Watch(get_hosted_object_orientation)
almost_zero = Custom[Almost Zero]()  # Returns a feasable computational tolerance (1.0e-9 or a billionth of 1) for calculations that need to check if two values are equal.
formula = Formula("x<t AND x>-t", x=combine, t=almost_zero, lacing=Longest)
watch_4 = Watch(formula)
