# Dynamo graph AlphabeticalSequence.dyn (Dynamo 0.6.3.31051)

integer_slider = IntegerSliderInput(15, range=1..26)
boolean = BoolSelector(false)
alphabetical_sequence = Custom[Alphabetical Sequence](n=integer_slider, uppercase=boolean)  # Creates a list of the first N letters of the alphabet.
watch = Watch(alphabetical_sequence)
