# Dynamo graph AngleBisector.dyn (Dynamo 0.7.1.29946)

number = DoubleInput(2)
number_2 = DoubleInput(-1)
code_block = CodeBlock(a=number, b=number_2) { Point.ByCoordinates(a,0,0); Point.ByCoordinates(0,0,0); Point.ByCoordinates(0,b,0); }
angle_bisector = Custom[Angle Bisector](XYZ_A=code_block.out0, XYZ_B=code_block.out1, XYZ_C=code_block.out2)  # Retrieves the vector of an angle bisector at point B based on three points (A, B, C) that define the angle.
watch = Watch(angle_bisector)
select_model_element = DSModelElementSelection()  # 1 picked in the model
point = ReferencePoint.Point(select_model_element, lacing=Longest)
select_model_element_2 = DSModelElementSelection()  # 1 picked in the model
point_2 = ReferencePoint.Point(select_model_element_2, lacing=Longest)
select_model_element_3 = DSModelElementSelection()  # 1 picked in the model
point_3 = ReferencePoint.Point(select_model_element_3, lacing=Longest)
angle_bisector_2 = Custom[Angle Bisector](XYZ_A=point, XYZ_B=point_2, XYZ_C=point_3)
watch_2 = Watch(angle_bisector_2)
