# Dynamo graph BinaryToDecimal.dyn (Dynamo 0.7.1.29946)

boolean = BoolSelector(false)
boolean_2 = BoolSelector(true)
create_list = List.Create(boolean, boolean, boolean_2, boolean_2, boolean, boolean_2)
watch = Watch(create_list)
binary_to_decimal = Custom[Binary To Decimal](list=watch)  # Converts a list of binary (boolean) values into a decimal value
watch_2 = Watch(binary_to_decimal)
