# Dynamo graph ConvexHull2D.dyn (Dynamo 0.6.3.7375)

# note: This sample also needs the package Lines Through Points (Closed Loop) to be installed.
select_elements = MultipleCurvesBySelection()  # 19 picked in the model
xyz_from_reference_point = XyzFromReferencePoint(select_elements, lacing=Longest)
xyz_components = XyzComponents(xyz_from_reference_point, lacing=Longest)
UV = Uv(xyz_components.out0, xyz_components.out1, lacing=Longest)
convex_hull_2d = Custom[Convex Hull 2D](UVs=UV)  # Computes the convex hull of a given set of UV coordinates based on the monotone chain algorithm
uv_components = Custom[UV Components](UV_s=convex_hull_2d)  # Get the components of a UV
XYZ = Xyz(uv_components.U, uv_components.V, lacing=Longest)
lines_through_points_closed_loop = Custom[Lines Through Points (Closed Loop)](list=XYZ)  # Works just like the built-in node Lines Through Points (creates a series of lines through a list of points) - except that it creates a *closed* loop of lines.
model_curve = ModelCurve(lines_through_points_closed_loop, lacing=Longest)
watch = Watch(UV)
watch_2 = Watch(convex_hull_2d)
