# Dynamo graph GetAndSetName.dyn (Dynamo 0.6.3.5262)

select_elements = MultipleCurvesBySelection()  # 1 picked in the model
string = StringInput("hhassh")
set_name = Custom[Set Name](element_s=select_elements, name=string)  # Gets the name of a given Revit element
watch = Watch(set_name.Fail)
watch_2 = Watch(set_name.Success)
get_name = Custom[Get Name](element_s=watch_2)  # Gets the name of a given Revit element
watch_3 = Watch(get_name)
