# Dynamo graph HostedObjectStuff.dyn (Dynamo 0.6.3.5262)

builtincategory_doors = Custom[BuiltInCategory Doors]()  # Returns the BuiltInCategory Doors
builtincategory_windows = Custom[BuiltInCategory Windows]()  # Returns the BuiltInCategory Windows
# note: This example also requires the Select By Category package to be installed.
list = NewList(index0=builtincategory_doors, index1=builtincategory_windows)
get_family_instances_by_category = Custom[Get Family Instances By Category](BuiltInCategories=list)  # Gets all family instances in the model for a given list of categories
get_hosted_object_orientation = Custom[Get Hosted Object Orientation](element_s=get_family_instances_by_category)  # Gets the orientation of a hosted object (e.g. a window or a door - orientation always facing towards exterior)
watch = Watch(get_hosted_object_orientation)
get_host = Custom[Get Host](element_s=get_family_instances_by_category)  # Gets an element's host
watch_2 = Watch(get_host)
