# Dynamo graph InvertAndMirrorNormalizedValues.dyn (Dynamo 0.6.3.7375)

file_path = StringFilename("C:\Users\adieckmann\Documents\GitHub\DynamoSamples\package_samples\Invert And Mirror Normalized Values\sample_image.jpg")
X = IntegerSliderInput(5, range=0..5)
Y = IntegerSliderInput(5, range=0..5)
read_image_file = ImageFileReader(file_path, X, Y)
color_brightness = ColorBrightness(read_image_file, lacing=Longest)
watch = Watch(color_brightness)
invert = BoolSelector(false)
mirror_vertically = BoolSelector(false)
mirror_horizontally = BoolSelector(true)
invert_and_mirror_normalized = Custom[Invert And Mirror Normalized Values](list=color_brightness, Invert=invert, Mirror_Vertically=mirror_vertically, Mirror_Horizontally=mirror_horizontally, X=X)  # Inverts and mirrors (horizontally & vertically) a list of normalized values.
watch_2 = Watch(invert_and_mirror_normalized)
