# Dynamo graph Normalization.dyn (Dynamo 0.7.1.29946)

integer_slider = IntegerSlider(10, range=0..20)
normalized_sequence = Custom[Normalized Sequence](N=integer_slider)  # Creates a sequence of N values between 0 and 1
watch = Watch(normalized_sequence)
formula = Formula("Sin(x*Pi/2)", lacing=Longest)
normalized_sequence_by_function = Custom[Normalized Sequence by Function](f_x=formula, N=integer_slider)  # Creates a sequence of N values between 0 and 1 driven by a function
watch_2 = Watch(normalized_sequence_by_function)
invert_normalized_value = Custom[Invert Normalized Value](normalized_sequence)  # Inverts a value between 0 and 1 or a boolean to its opposite (1-x)
watch_3 = Watch(invert_normalized_value)
double_slider = DoubleSlider(26.579, range=0..100)
double_slider_2 = DoubleSlider(56.749, range=0..100)
scale_normalized_value = Custom[Scale Normalized Value](val=normalized_sequence, Min=double_slider, Max=double_slider_2)  # Scales a normalized value according to a given minimum and maximum
watch_4 = Watch(scale_normalized_value)
normalize_value = Custom[Normalize Value](val=scale_normalized_value, Min=double_slider, Max=double_slider_2)  # Converts a value into a normalized value according to a value range
watch_5 = Watch(normalize_value)
