# Dynamo graph PhasingStuff.dyn (Dynamo 0.6.3.7375)

list_phases = Custom[List Phases]()  # Lists all phases in the active document
watch = Watch(list_phases)
string = StringInput("Existing")
get_phase_by_name = Custom[Get Phase by Name](str=string)  # Returns the phase of a given name (if it exists)
watch_2 = Watch(get_phase_by_name)
select_elements = MultipleCurvesBySelection()  # 5 picked in the model
watch_3 = Watch(select_elements)
get_phases = Custom[Get Phases](Element_s=watch_3)  # Gets the created and demolished phases of an element
watch_4 = Watch(get_phases.Created)
watch_5 = Watch(get_phases.Demolished)
