# Dynamo graph PythagoreanTheorem.dyn (Dynamo 0.6.3.5256)

A = DoubleSliderInput(4.172661871, range=0..10)
B = DoubleSliderInput(8.345323741, range=0..10)
hypotenuse_by_pythagoras = Custom[Hypotenuse By Pythagoras](A=A, B=B)  # Computes the length of the hypotenuse of a right triangle using the Pythagorean Theorem. A and B are the legs / catheti of the triangle.
watch = Watch(hypotenuse_by_pythagoras)
cathetus_by_pythagoras = Custom[Cathetus By Pythagoras](C=hypotenuse_by_pythagoras, B=B)  # Computes the length of one of the catheti / legs of a right triangle using the Pythagorean Theorem. B is the other leg / cathetus of the triangle while C is the hypotenuse.
watch_2 = Watch(cathetus_by_pythagoras)
