# Dynamo graph RemoveDuplicatesFromList.dyn (Dynamo 0.6.3.5291)

number = DoubleInput(1..10)
number_2 = DoubleInput(2)
repeat = Repeat(number, number_2, lacing=Longest)
flatten_completely = FlattenList(repeat)
watch = Watch(flatten_completely)
remove_duplicates_from_list = Custom[Remove Duplicates From List](list=watch)  # Removes duplicate items from a given list. Will *not* work for Revit elements!
watch_2 = Watch(remove_duplicates_from_list)
select_elements = MultipleCurvesBySelection()  # 3 picked in the model
repeat_2 = Repeat(select_elements, number_2, lacing=Longest)
list = NewList(index0=repeat_2, index1=repeat)
flatten_completely_2 = FlattenList(list)
watch_3 = Watch(flatten_completely_2)
remove_duplicate_revit_elements = Custom[Remove Duplicate Revit Elements From List](list=watch_3)  # Removes all duplicates of Revit elements from a given list. (Will also remove any other duplicates from a list...)
watch_4 = Watch(remove_duplicate_revit_elements.elements)
watch_5 = Watch(remove_duplicate_revit_elements.other)
