# Dynamo graph ReturnListOrSingleValue.dyn (Dynamo 0.7.1.29946)

number = DoubleInput(1)
create_list = List.Create(number)
number_2 = DoubleInput(4)
number_3 = DoubleInput(2)
create_list_2 = List.Create(number_2, number_3)
return_list_or_single_value = Custom[Return List Or Single Value](list_1=create_list, list_2=create_list_2)  # If the list in input #1 only contains one item, only the first item of the list in input #2 will be returned.
watch = Watch(return_list_or_single_value)
number_4 = DoubleInput(1)
number_5 = DoubleInput(3)
create_list_3 = List.Create(number_4, number_5)
return_list_or_single_value_2 = Custom[Return List Or Single Value](list_1=create_list_3, list_2=create_list_2)
watch_2 = Watch(return_list_or_single_value_2)
