# Dynamo graph RevitAPIHelpers.dyn (Dynamo 0.6.3.5259)

string = StringInput("*WALL*")
search_in_builtinparameters = Custom[Search In BuiltInParameters](search_term=string)  # Lets you search in Revit's built-in parameters. Search is case-sensitive. Use * as a wildcard.
watch = Watch(search_in_builtinparameters)
string_2 = StringInput("*Wall*")
search_in_builtincategories = Custom[Search In BuiltInCategories](search_term=string_2)  # Lets you search in Revit's built-in categories. Search is case-sensitive. Use * as a wildcard.
watch_2 = Watch(search_in_builtincategories)
list_builtinparameters = Custom[List BuiltInParameters]()  # List all the BuiltInCategories available
watch_3 = Watch(list_builtinparameters)
list_builtincategories = Custom[List BuiltInCategories]()  # List all the BuiltInCategories available
watch_4 = Watch(list_builtincategories)
select_elements = MultipleCurvesBySelection()  # 1 picked in the model
watch_5 = Watch(select_elements)
get_members = Custom[Get Members](element_s=watch_5)  # Gets a list of all members (properties and methods) of a selected element
watch_6 = Watch(get_members)
