# Dynamo graph RoomStuff.dyn (Dynamo 0.6.3.5291)

# note: This sample also requires the Select By Category and Phasing Stuff packages to be installed.
builtincategory_windows = Custom[BuiltInCategory Windows]()  # Returns the BuiltInCategory Windows
builtincategory_doors = Custom[BuiltInCategory Doors]()  # Returns the BuiltInCategory Doors
list = NewList(index0=builtincategory_windows, index1=builtincategory_doors)
get_family_instances_by_category = Custom[Get Family Instances By Category](BuiltInCategories=list)  # Gets all family instances in the model for a given list of categories
watch = Watch(get_family_instances_by_category)
string = StringInput("New Construction")
get_phase_by_name = Custom[Get Phase by Name](str=string)  # Returns the phase of a given name (if it exists)
watch_2 = Watch(get_phase_by_name)
rooms_from_doors_and_windows = Custom[Rooms From Doors And Windows](Door_s_Window_s=watch, Phase=watch_2)  # Gets the rooms that are connected by a given door or a window
watch_3 = Watch(rooms_from_doors_and_windows.From_Room_s)
watch_4 = Watch(rooms_from_doors_and_windows.To_Room_s)
builtincategory_rooms = Custom[BuiltInCategory Rooms]()  # Returns the BuiltInCategory Rooms
get_family_instances_by_category_2 = Custom[Get Family Instances By Category](BuiltInCategories=builtincategory_rooms)
get_room_boundaries = Custom[Get Room Boundaries](Room_s=get_family_instances_by_category_2)  # Gets a list of all boundary elements of a given room
watch_5 = Watch(get_room_boundaries)
get_area = Custom[Get Area](element_s=get_family_instances_by_category_2)  # Returns the area property of a given element (if that element has such a property)
watch_6 = Watch(get_area)
