# Dynamo graph SelectByCategory.dyn (Dynamo 0.6.3.7375)

category = Categories(index=877)
category_2 = Categories(index=313)
category_3 = Categories(index=892)
category_4 = Categories(index=206)
list = NewList(index0=category, index1=category_2, index2=category_3, index3=category_4)
get_family_symbols_by_category = Custom[Get Family Symbols By Category](BuiltInCategories=list)  # Gets all family symbols of a given category in the model (does *not *work for system families)
watch = Watch(get_family_symbols_by_category)
get_family_instances_by_category = Custom[Get Family Instances By Category](BuiltInCategories=list)  # Gets all family instances in the model for a given list of categories
watch_2 = Watch(get_family_instances_by_category)
filter_list_by_category = Custom[Filter List By Category](element_s=watch_2, BuiltInCategory=category)  # Filters out all elements that are not of a specified category
watch_3 = Watch(filter_list_by_category.in)
has_instances_of_categories = Custom[Has Instances of Categories](BuiltInCategories=list)  # Checks if family instances of specified categories are present in the model.
watch_4 = Watch(has_instances_of_categories.any)
watch_5 = Watch(has_instances_of_categories.all)
watch_6 = Watch(has_instances_of_categories.per_category)
watch_7 = Watch(has_instances_of_categories.instances)
is_of_category = Custom[Is Of Category](element_s=get_family_instances_by_category, BuiltInCategory=category)  # Checks whether an element is of a specified category
watch_8 = Watch(is_of_category)
get_active_view = ActiveRevitView(lacing=Longest)
boolean = BoolSelector(false)
select_curve = CurvesBySelection()  # 1 picked in the model
evaluate_curve = XyzOnCurveOrEdge(boolean, select_curve, lacing=Longest)
boolean_2 = BoolSelector(true)
evaluate_curve_2 = XyzOnCurveOrEdge(boolean_2, select_curve, lacing=Longest)
direction_to_xyz = XyzStartEndVector(evaluate_curve, evaluate_curve_2, lacing=Longest)
reference_intersector_by = Custom[Reference Intersector By Category](View=get_active_view, BuiltInCategory=category, VectorStart=evaluate_curve, VectorEnd=direction_to_xyz)  # Finds all elements of a specified category that intersect with a list of vectors
watch_9 = Watch(reference_intersector_by)
category_5 = Categories(index=188)
category_6 = Categories(index=846)
list_2 = NewList(index0=category_5, index1=category_6)
get_active_view_2 = ActiveRevitView(lacing=Longest)
get_view_dependent_family = Custom[Get View-Dependent Family Instances By Category](BuiltInCategories=list_2, View_s=get_active_view_2)  # Gets all view-dependent family instances in a given view for a given list of categories - useful for finding annotation elements
watch_10 = Watch(get_view_dependent_family)
string = StringInput("*Generic*")
get_family_instances_by_category_2 = Custom[Get Family Instances By Category And Name](BuiltInCategories=list, Name=string)  # Gets all family instances in the model for a given list of categories and a specified name. Use '*' as a wildcard.
watch_11 = Watch(get_family_instances_by_category_2)
watch_12 = Watch(filter_list_by_category.out)
get_families_by_category = Custom[Get Families By Category](BuiltInCategories=list)  # Gets all famiies of a given category in the model (does *not *work for system families)
watch_13 = Watch(get_families_by_category)
