# Dynamo graph Similar.dyn (Dynamo 0.6.3.5256)

A = DoubleSliderInput(50, range=0..100)
B = DoubleSliderInput(45.283, range=0..100)
tolerance_percentage = DoubleSliderInput(0.045, range=0..1)
similar = Custom[Similar](A=A, B=B, Tolerance=tolerance_percentage)  # Computes the difference between two values and whether that difference is within a given tolerance percentage
watch = Watch(similar.IsSimilar)
watch_2 = Watch(similar.Difference)
