# Dynamo graph TopoStuff.dyn (Dynamo 0.6.3.5244)

# note: Ths example also requires the package Select By Category to be installed.
select_elements = MultipleCurvesBySelection()  # 1 picked in the model
category = Categories(index=852)
get_family_instances_by_category = Custom[Get Family Instances By Category](BuiltInCategories=category)  # Gets all family instances in the model for a given list of categories
watch = Watch(get_family_instances_by_category)
filter_for_topo_subregions = Custom[Filter For Topo Subregions](Toposurface_s=watch)  # Filters out everything that is *not* a topo subregion. Needs Revit 2014 or newer to work.
watch_2 = Watch(filter_for_topo_subregions.Subregions)
watch_3 = Watch(filter_for_topo_subregions.No_Subregions)
watch_4 = Watch(filter_for_topo_subregions.bool)
