# Dynamo graph ViewStuff.dyn (Dynamo 0.6.3.5260)

# note: This example also needs the Select By Category package to be installed.
builtincategory_sheets = Custom[BuiltInCategory Sheets]()  # Returns the BuiltInCategory Sheets
get_family_instances_by_category = Custom[Get Family Instances By Category](BuiltInCategories=builtincategory_sheets)  # Gets all family instances in the model for a given list of categories
get_views_on_sheet = Custom[Get Views On Sheet](Sheet_s=get_family_instances_by_category)  # Returns all views placed on a specified sheet
watch = Watch(get_views_on_sheet)
filter_views_by_type = Custom[Filter Views By Type](View_s=watch)  # Filters a list of views by their respective types.
watch_2 = Watch(filter_views_by_type.Floor_Plans)
watch_3 = Watch(filter_views_by_type.Elevations)
builtincategory_doors = Custom[BuiltInCategory Doors]()  # Returns the BuiltInCategory Doors
builtincategory_windows = Custom[BuiltInCategory Windows]()  # Returns the BuiltInCategory Windows
list = NewList(index0=builtincategory_doors, index1=builtincategory_windows)
category_is_visible_in_view = Custom[Category Is Visible In View](BuiltInCategories=list, View_s=watch)  # Checks if a given category is visible in a given view
watch_4 = Watch(category_is_visible_in_view)
get_view_template_from_view = Custom[Get View Template From View](View_s=watch)  # Returns the view template assigned to a given view (if one is assigned)
watch_5 = Watch(get_view_template_from_view)
view_uses_view_filters = Custom[View Uses View Filters](View_s=watch)  # Checks if a given view has any view filters applied to it.
watch_6 = Watch(view_uses_view_filters)
