# Dynamo graph WallStuff.dyn (Dynamo 0.6.3.5256)

builtincategory_stacked_walls = Custom[BuiltInCategory Stacked Walls]()  # Returns the BuiltInCategory Stacked Walls
builtincategory_walls = Custom[BuiltInCategory Walls]()  # Returns the BuiltInCategory Walls
# note: This example also requires the package Select By Category to be installed.
list = NewList(index0=builtincategory_stacked_walls, index1=builtincategory_walls)
get_family_instances_by_category = Custom[Get Family Instances By Category](BuiltInCategories=list)  # Gets all family instances in the model for a given list of categories
get_wall_type = Custom[Get Wall Type](Wall_Instance_s=get_family_instances_by_category)  # Gets the wall type of a given wall instance. Please note that in-place walls do *not* have a wall type and will be returned in the 'No Wall(s)' output port.
watch = Watch(get_wall_type.Unknown)
filter_walls_by_creation_method = Custom[Filter Walls By Creation Method](Wall_Instance_s=get_family_instances_by_category)  # Filters a list of walls by their method of creation.
watch_2 = Watch(filter_walls_by_creation_method.No_Wall_s)
watch_3 = Watch(get_wall_type.No_Wall_s)
watch_4 = Watch(filter_walls_by_creation_method.Standard)
watch_5 = Watch(filter_walls_by_creation_method.By_Face)
watch_6 = Watch(filter_walls_by_creation_method.In_Place)
list_2 = NewList(index0=watch_4, index1=watch_5, index2=watch_6)
get_wall_orientation = Custom[Get Wall Orientation](Wall_Instance_s=list_2)  # Gets the orientation of a given wall instance (normal of the exterior face of the wall). Will *not* work for walls hosted on mass faces or in-place walls.
watch_7 = Watch(get_wall_orientation)
watch_8 = Watch(get_wall_type.Basic_Walls)
watch_9 = Watch(get_wall_type.Curtain_Walls)
watch_10 = Watch(get_wall_type.Stacked_Walls)
list_3 = NewList(index0=watch_8, index1=watch_9, index2=watch_10)
filter_wall_types_by_function = Custom[Filter Wall Types By Function](Wall_Type_s=list_3)  # Separates a list of wall types into several lists according to wall function
watch_11 = Watch(filter_wall_types_by_function.Exterior)
watch_12 = Watch(filter_wall_types_by_function.Foundation)
watch_13 = Watch(filter_wall_types_by_function.Retaining)
watch_14 = Watch(filter_wall_types_by_function.Interior)
watch_15 = Watch(filter_wall_types_by_function.No_Wall_s)
watch_16 = Watch(filter_wall_types_by_function.Core_Shaft)
watch_17 = Watch(filter_wall_types_by_function.Soffit)
builtincategory_curtain_systems = Custom[BuiltInCategory Curtain Systems]()  # Returns the BuiltInCategory Curtain Systems
get_family_instances_by_category_2 = Custom[Get Family Instances By Category](BuiltInCategories=builtincategory_curtain_systems)
get_curtain_system_type = Custom[Get Curtain System Type](Curtain_System_Instance_s=get_family_instances_by_category_2)  # Retrieves the family type for a given curtain system instance.
watch_18 = Watch(get_curtain_system_type)
