# Dynamo graph ImageToCNC.dyn (Dynamo 0.7.0.28161)

# note: Subcategory naming
builtincategory_masses = Custom[BuiltInCategory Masses]()  # Returns the BuiltInCategory Masses
subcategory_name_for_boundary = StringInput("CNC_Boundary")
create_new_subcategory = Custom[Create New Subcategory](BuiltInCategory=builtincategory_masses, Name=subcategory_name_for_boundary)  # Creates a new subcategory for a given element category (unless a subcategory of that name already exists - in that case it returns the existing subcategory)
boolean = BoolSelector(false)
number = DoubleInput(0)
x_overall_width = DoubleSliderInput(1.2, range=0..2)
meters_to_feet = Custom[Meters To Feet](meters=x_overall_width)  # Converts meters into feet
list = NewList(index0=number, index1=meters_to_feet, index2=meters_to_feet, index3=number)
y_overall_width = DoubleSliderInput(0.8, range=0..2)
meters_to_feet_2 = Custom[Meters To Feet](meters=y_overall_width)
list_2 = NewList(index0=number, index1=number, index2=meters_to_feet_2, index3=meters_to_feet_2)
XYZ = Xyz(list, list_2, number, lacing=Longest)
# note: Create boundary
lines_through_points_closed_loop = Custom[Lines Through Points (Closed Loop)](list=XYZ)  # Works just like the built-in node Lines Through Points (creates a series of lines through a list of points) - except that it creates a *closed* loop of lines.
model_curve = ModelCurve(lines_through_points_closed_loop, lacing=Longest)
transaction = Transaction(model_curve)
set_element_subcategory = Custom[Set Element Subcategory](Subcategory=create_new_subcategory, Cut_Projection=boolean, Element_s=transaction)  # Assigns the given element(s) to the specified subcategory (0 for Cut, 1 for Projection).
subcategory_name_for_vertical = StringInput("CNC_Vertical")  # "Subcategory name for vertical lines"
create_new_subcategory_2 = Custom[Create New Subcategory](BuiltInCategory=builtincategory_masses, Name=subcategory_name_for_vertical)
boolean_2 = BoolSelector(false)
# note: This definition allows the creation of CNC paths (for milling reliefs) in a mass family file out of image data. There are two methods available:
# a) Create parallel lines with varying depths
# b) Create a grid of points with varying depths
# (You could of course adapt method #1 to loft a surface out of the image data...)
# For questions email me at dieckmann@caad.arch.rwth-aachen.de
# This was created as learning material for the BIM to Production class at the chair of CAAD, RWTH Aachen University in the winter semester of 2013/14.
# note: Layout-related Settings
# note: REQUIRED PACKAGES:
# - Invert And Mirror Normalized Values
# - Lines Through Points (Closed Loop)
# - Select By Category
# - Subcategory Stuff
# - Unit Conversion
x_count = IntegerSliderInput(20, range=0..50)
y_slider = IntegerSliderInput(20, range=0..50)
formula = Formula("1", lacing=Longest)
x_margin = DoubleSliderInput(0.05, range=0..0.1)
meters_to_feet_3 = Custom[Meters To Feet](meters=x_margin)
y_margin = DoubleSliderInput(0.05, range=0..0.1)
meters_to_feet_4 = Custom[Meters To Feet](meters=y_margin)
formula_2 = Formula("(width-2*margin)/(elements-1)", width=meters_to_feet, margin=meters_to_feet_3, elements=x_count, lacing=Longest)
formula_3 = Formula("(width-2*margin)/(elements-1)", width=meters_to_feet_2, margin=meters_to_feet_4, elements=y_slider, lacing=Longest)
# note: Create a point grid based on the settings
xyz_grid = ReferencePtGrid(x_count, y_slider, formula, meters_to_feet_3, meters_to_feet_4, number, formula_2, formula_3, number, lacing=Longest)
# note: Image-related Settings
path_to_image_file = StringFilename("C:\Users\adieckmann\Documents\GitHub\DynamoSamples\workflow_samples\ImageToCNC\sample_image.jpg")
read_image_file = ImageFileReader(path_to_image_file, x_count, y_slider)
# note: Replace this with a Color Saturation or Color Hue node for different effects.
color_brightness = ColorBrightness(read_image_file, lacing=Longest)
invert_image_data = BoolSelector(true)
mirror_image_vertically = BoolSelector(false)
mirror_image_horizontally = BoolSelector(true)
# note: Translate normalized values to min and max values from sliders and turn that into a height value
invert_and_mirror_normalized = Custom[Invert And Mirror Normalized Values](list=color_brightness, Invert=invert_image_data, Mirror_Vertically=mirror_image_vertically, Mirror_Horizontally=mirror_image_horizontally, X=x_count)  # Inverts and mirrors (horizontally & vertically) a list of normalized values.
minimum_depth = DoubleSliderInput(0.001, range=0..0.01)
meters_to_feet_5 = Custom[Meters To Feet](meters=minimum_depth)
maximum_depth = DoubleSliderInput(0.025, range=0..0.1)
meters_to_feet_6 = Custom[Meters To Feet](meters=maximum_depth)
scale_normalized_value = Custom[Scale Normalized Value](value=invert_and_mirror_normalized, Min=meters_to_feet_5, Max=meters_to_feet_6)  # Scales a normalized value according to a given minimum and maximum
XYZ_2 = Xyz(number, number, scale_normalized_value, lacing=Longest)
subtract_xyz = XyzSubtract(xyz_grid, XYZ_2, lacing=Longest)
line = LineBound(xyz_grid, subtract_xyz, lacing=Longest)
# note: Create vertical lines
model_curve_2 = ModelCurve(line, lacing=Longest)
transaction_2 = Transaction(model_curve_2)
set_element_subcategory_2 = Custom[Set Element Subcategory](Subcategory=create_new_subcategory_2, Cut_Projection=boolean_2, Element_s=transaction_2)
subcategory_name_for_horizontal = StringInput("CNC_Horizontal")  # "Subcategory name for horizontal lines"
create_new_subcategory_3 = Custom[Create New Subcategory](BuiltInCategory=builtincategory_masses, Name=subcategory_name_for_horizontal)
boolean_3 = BoolSelector(false)
reference_point = ReferencePointByXyz(lacing=Longest)
# note: Change (sp)line direction?
swap_path_direction = BoolSelector(true)
partition_list = Slice(subtract_xyz, x_count)
transpose_lists = Transpose(partition_list)
if_ = Conditional(swap_path_direction, transpose_lists, partition_list)
map = Map(reference_point, if_)
boolean_4 = BoolSelector(false)
# note: Create (more or less) horizontal (sp)lines
curve_by_points = CurveByPoints(map, boolean_4, lacing=Longest)
transaction_3 = Transaction(curve_by_points)
set_element_subcategory_3 = Custom[Set Element Subcategory](Subcategory=create_new_subcategory_3, Cut_Projection=boolean_3, Element_s=transaction_3)
