# Dynamo graph 03_Management_07_Grouping-Custom.dyn (Dynamo 0.7.5.3566)

categories = Categories("Walls")
all_elements_of_category = ElementsOfCategory(categories)
watch = Watch(all_elements_of_category)
name = Element.Name(all_elements_of_category)
create = List.Create(all_elements_of_category, name)
code_block = CodeBlock { 1; }
groupListOfListsByKey = Custom[List.GroupListOfListsByKey](list=create, key_index=code_block)  # Groups a list of lists by one of its keys
watch_2 = Watch(groupListOfListsByKey)
watch_3 = Watch(name)
